# Grasshopper definition Facade(1).gh (Grasshopper 1.0.8)
# plug-ins: Pufferfish, Chromodoris, Weaverbird, Telepathy

mullion_colour = RemoteSender(ColourSwatch(SwatchColor=RGB(212, 212, 212)))
glass_colour = RemoteSender(ColourSwatch(SwatchColor=RGBA(255, 255, 255, 50)))

panel = Panel("""4100
3645
1950
5475""")
panel_2 = Panel("""3550
3600
3535
3900""")
negative = Negative(Value="450")
division = Division(A="7300", B=2)
typical_floor_height_x2 = RemoteSender("7300")
no_of_typical_floors = RemoteSender(Slider(10, range=0..10))
raise_from_slab_top = RemoteSender("133.5")
typical_floor_height = RemoteSender(division)
add_floor_heights = RemoteSender(panel)
gap_b_w_mullion = RemoteSender("20")
glass_thickness = RemoteSender("30")
mullion_depth = RemoteSender("195")
move_floor_up = RemoteSender("200")
mullion_width = RemoteSender(Slider(65, range=0..100))
facade_offset = RemoteSender(Slider(300, range=0..1000))
floor_height = RemoteSender(negative)
g_f_heights = RemoteSender(panel_2)

floor_crv = Curve(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)
panel_3 = Panel("""1590
1585
1300
1300
1400
1300
1300
1400
1300
1300
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""")
explode = Explode(Curve=floor_crv, Recursive=True)  # -> Segments, Vertices
gap_b_w_mullion_2 = RemoteReceiver(gap_b_w_mullion)
series = Series(Start=Slider(4, range=0..10), Step=1, Count=Slider(3, range=0..10))
addition = Addition(A=panel_3, B=gap_b_w_mullion_2)
list_item = ListItem(List=explode.Segments, Index=series, Wrap=True)
join_curves = JoinCurves(Curves=list_item, Preserve=False)
mass_addition = MassAddition(Input=addition)  # -> Result, PartialResults
facade_offset_2 = RemoteReceiver(facade_offset)
offset_curve = OffsetCurve(Curve=join_curves, Distance=facade_offset_2, Corners=1)
evaluate_length = EvaluateLength(Curve=offset_curve, Length=mass_addition.PartialResults, Normalized=False)  # -> Point, Tangent, Parameter
end_points = EndPoints(Curve=offset_curve)  # -> Start, End
merge = Merge(Data1=end_points.Start, Data2=evaluate_length.Point)
point = Point(merge)
polyline = PolyLine(Vertices=point, Closed=False)
raise_from_slab_top_2 = RemoteReceiver(raise_from_slab_top)
unit_z = UnitZ(Factor=raise_from_slab_top_2)
move = Move(Geometry=polyline, Motion=unit_z)  # -> Geometry, Transform
no_of_typical_floors_2 = RemoteReceiver(no_of_typical_floors)
integer = Integer(no_of_typical_floors_2)
typical_floor_height_2 = RemoteReceiver(typical_floor_height)
subtraction = Subtraction(A=integer, B=1)
multiplication = Multiplication(A=typical_floor_height_2, B=subtraction)
unit_z_2 = UnitZ(Factor=typical_floor_height_2)
linear_array = LinearArray(Geometry=move.Geometry, Direction=unit_z_2, Count=integer)  # -> Geometry, Transform
mesh_loft = MeshLoft(Polylines=linear_array.Geometry, Cap=False)
mullion_width_2 = RemoteReceiver(mullion_width)
weaverbird_s_picture_frame = WeaverbirdsPictureFrame(MeshPolylines=mesh_loft, Distance=expr("x/2", mullion_width_2), InsetType=1)
weaverbird_s_mesh_window = WeaverbirdsMeshWindow(MeshPolylines=mesh_loft, Distance=expr("x/2", mullion_width_2), InsetType=1)
mullion_depth_2 = RemoteReceiver(mullion_depth)
offset_mesh = OffsetMesh(Mesh=weaverbird_s_mesh_window, Distance=expr("-x", mullion_depth_2), BothSides=0, CreateSolid=False)
glass_thickness_2 = RemoteReceiver(glass_thickness)
offset_mesh_2 = OffsetMesh(Mesh=weaverbird_s_picture_frame, Distance=expr("-x", mullion_depth_2), BothSides=0, CreateSolid=True)
offset_mesh_3 = OffsetMesh(Mesh=weaverbird_s_mesh_window, Distance=expr("-x", glass_thickness_2), BothSides=0, CreateSolid=True)
offset_mesh_4 = OffsetMesh(Mesh=offset_mesh, Distance=glass_thickness_2, BothSides=0, CreateSolid=True)
merge_2 = Merge(Data1=flatten(offset_mesh_3), Data2=flatten(offset_mesh_4))
mullion_colour_2 = RemoteReceiver(mullion_colour)
glass_colour_2 = RemoteReceiver(glass_colour)
custom_preview = CustomPreview(Geometry=merge_2, Material=glass_colour_2)
custom_preview_2 = CustomPreview(Geometry=offset_mesh_2, Material=mullion_colour_2)

g_f_heights_2 = RemoteReceiver(g_f_heights)
mass_addition_2 = MassAddition(Input=g_f_heights_2)  # -> Result, PartialResults
negative_2 = Negative(Value=mass_addition_2.PartialResults)
unit_z_3 = UnitZ(Factor=negative_2)

floor_thickness = Panel("700")
negative_3 = Negative(Value=floor_thickness)
floor_thickness_2 = RemoteSender(negative_3)
floor_colour = RemoteSender(ColourSwatch(SwatchColor=RGB(255, 255, 255)))
explode_2 = Explode(Recursive=True)  # -> Segments, Vertices
glass_thickness_3 = RemoteReceiver(glass_thickness)
floor_thickness_3 = RemoteReceiver(floor_thickness_2)
unit_z_4 = UnitZ(Factor=floor_thickness_3)
floor_colour_2 = RemoteReceiver(floor_colour)

no_of_typical_floors_3 = RemoteReceiver(no_of_typical_floors)
typical_floor_height_3 = RemoteReceiver(typical_floor_height)
curve = Curve(floor_crv)
unit_z_5 = UnitZ(Factor=typical_floor_height_3)
linear_array_2 = LinearArray(Geometry=curve, Direction=unit_z_5, Count=no_of_typical_floors_3)  # -> Geometry, Transform
move_floor_up_2 = RemoteReceiver(move_floor_up)
floor_height_2 = RemoteReceiver(floor_height)
surface = Surface(linear_array_2.Geometry)
unit_z_6 = UnitZ(Factor=move_floor_up_2)
unit_z_7 = UnitZ(Factor=floor_height_2)
move_2 = Move(Geometry=surface, Motion=unit_z_6)  # -> Geometry, Transform
extrude = Extrude(Base=move_2.Geometry, Direction=unit_z_7)
custom_preview_3 = CustomPreview(
    Geometry=extrude,
    Material={diffuse=RGB(211, 211, 211), emission=RGB(0, 0, 0), shine=0, specular=RGB(255, 255, 255), transparency=0})

# ----
# Create Glass: Meeting, Banquet till Ground Floor
curve_2 = Curve(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)
panel_4 = Panel("""1590
1585
1300
1300
1400
1300
1300
1400
1300
1300
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""")
gap_b_w_mullion_3 = RemoteReceiver(gap_b_w_mullion)
explode_3 = Explode(Curve=curve_2, Recursive=True)  # -> Segments, Vertices
series_2 = Series(Start=Slider(6, range=0..10), Step=1, Count=Slider(4, range=0..10))
addition_2 = Addition(A=panel_4, B=gap_b_w_mullion_3)
list_item_2 = ListItem(List=explode_3.Segments, Index=series_2, Wrap=True)
mass_addition_3 = MassAddition(Input=addition_2)  # -> Result, PartialResults
join_curves_2 = JoinCurves(Curves=list_item_2, Preserve=False)
flip_curve = FlipCurve(Curve=join_curves_2)  # -> Curve, Flag
facade_offset_3 = RemoteReceiver(facade_offset)
offset_curve_2 = OffsetCurve(Curve=flip_curve.Curve, Distance=facade_offset_3, Corners=1)
evaluate_length_2 = EvaluateLength(Curve=offset_curve_2, Length=mass_addition_3.PartialResults, Normalized=False)  # -> Point, Tangent, Parameter
end_points_2 = EndPoints(Curve=offset_curve_2)  # -> Start, End
merge_3 = Merge(Data1=end_points_2.Start, Data2=evaluate_length_2.Point)
mullion_width_3 = RemoteReceiver(mullion_width)
mullion_depth_3 = RemoteReceiver(mullion_depth)
mullion_colour_3 = RemoteReceiver(mullion_colour)
glass_colour_3 = RemoteReceiver(glass_colour)

point_2 = Point(merge_3)
polyline_2 = PolyLine(Vertices=point_2, Closed=False)
raise_from_slab_top_3 = RemoteReceiver(raise_from_slab_top)
unit_z_8 = UnitZ(Factor=raise_from_slab_top_3)
move_3 = Move(Geometry=polyline_2, Motion=unit_z_8)  # -> Geometry, Transform

curve_3 = Curve(curve_2)
g_f_heights_3 = RemoteReceiver(g_f_heights)
mass_addition_4 = MassAddition(Input=g_f_heights_3)  # -> Result, PartialResults
negative_4 = Negative(Value=mass_addition_4.PartialResults)
unit_z_9 = UnitZ(Factor=negative_4)
move_4 = Move(Geometry=curve_3, Motion=unit_z_9)  # -> Geometry, Transform
move_floor_up_3 = RemoteReceiver(move_floor_up)
floor_height_3 = RemoteReceiver(floor_height)
unit_z_10 = UnitZ(Factor=move_floor_up_3)
unit_z_11 = UnitZ(Factor=floor_height_3)
surface_2 = Surface(move_4.Geometry)
move_5 = Move(Geometry=surface_2, Motion=unit_z_10)  # -> Geometry, Transform
extrude_2 = Extrude(Base=move_5.Geometry, Direction=unit_z_11)
custom_preview_4 = CustomPreview(
    Geometry=extrude_2,
    Material={diffuse=RGB(211, 211, 211), emission=RGB(0, 0, 0), shine=0, specular=RGB(255, 255, 255), transparency=0})

# ----
# Create Glass: ADD Floor
number_slider = Slider(9, range=0..10)
curve_4 = Curve(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)
panel_5 = Panel("""1590
1585
1300
1300
1400
1300
1300
1400
1300
1300
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""")
gap_b_w_mullion_4 = RemoteReceiver(gap_b_w_mullion)
explode_4 = Explode(Curve=curve_4, Recursive=True)  # -> Segments, Vertices
series_3 = Series(Start=number_slider, Step=1, Count=Slider(4, range=0..10))
addition_3 = Addition(A=panel_5, B=gap_b_w_mullion_4)
list_item_3 = ListItem(List=explode_4.Segments, Index=series_3, Wrap=True)
mass_addition_5 = MassAddition(Input=addition_3)  # -> Result, PartialResults
join_curves_3 = JoinCurves(Curves=list_item_3, Preserve=False)
facade_offset_4 = RemoteReceiver(facade_offset)
offset_curve_3 = OffsetCurve(Curve=join_curves_3, Distance=facade_offset_4, Corners=1)
evaluate_length_3 = EvaluateLength(Curve=offset_curve_3, Length=mass_addition_5.PartialResults, Normalized=False)  # -> Point, Tangent, Parameter
end_points_3 = EndPoints(Curve=offset_curve_3)  # -> Start, End
merge_4 = Merge(Data1=end_points_3.Start, Data2=evaluate_length_3.Point, Data3=end_points_3.End)
add_floor_heights_2 = RemoteReceiver(add_floor_heights)
mass_addition_6 = MassAddition(Input=add_floor_heights_2)  # -> Result, PartialResults
list_item_4 = ListItem(List=add_floor_heights_2, Index=0, Wrap=True)  # -> Item, Item1
addition_4 = Addition(A=list_item_4.Item, B=list_item_4.Item1)
unit_z_12 = UnitZ(Factor=mass_addition_6.PartialResults)
mullion_width_4 = RemoteReceiver(mullion_width)
mullion_depth_4 = RemoteReceiver(mullion_depth)
glass_thickness_4 = RemoteReceiver(glass_thickness)
mullion_colour_4 = RemoteReceiver(mullion_colour)
glass_colour_4 = RemoteReceiver(glass_colour)

point_3 = Point(merge_4)
polyline_3 = PolyLine(Vertices=point_3, Closed=False)
raise_from_slab_top_4 = RemoteReceiver(raise_from_slab_top)
unit_z_13 = UnitZ(Factor=raise_from_slab_top_4)
move_6 = Move(Geometry=polyline_3, Motion=unit_z_13)  # -> Geometry, Transform

move_7 = Move(Geometry=move_6.Geometry, Motion=unit_z_12)  # -> Geometry, Transform
merge_5 = Merge(Data1=move_6.Geometry, Data2=move_7.Geometry)
curve_5 = Curve(merge_5)
mesh_loft_2 = MeshLoft(Polylines=curve_5, Cap=False)
weaverbird_s_picture_frame_2 = WeaverbirdsPictureFrame(MeshPolylines=mesh_loft_2, Distance=expr("x/2", mullion_width_4), InsetType=1)
weaverbird_s_mesh_window_2 = WeaverbirdsMeshWindow(MeshPolylines=mesh_loft_2, Distance=expr("x/2", mullion_width_4), InsetType=1)
offset_mesh_5 = OffsetMesh(Mesh=weaverbird_s_picture_frame_2, Distance=expr("-x", mullion_depth_4), BothSides=0, CreateSolid=True)
offset_mesh_6 = OffsetMesh(Mesh=weaverbird_s_mesh_window_2, Distance=expr("-x", mullion_depth_4), BothSides=0, CreateSolid=False)
offset_mesh_7 = OffsetMesh(Mesh=weaverbird_s_mesh_window_2, Distance=expr("-x", glass_thickness_4), BothSides=0, CreateSolid=True)
offset_mesh_8 = OffsetMesh(Mesh=offset_mesh_6, Distance=glass_thickness_4, BothSides=0, CreateSolid=True)
merge_6 = Merge(Data1=flatten(offset_mesh_7), Data2=flatten(offset_mesh_8))
custom_preview_5 = CustomPreview(Geometry=offset_mesh_5, Material=mullion_colour_4)
custom_preview_6 = CustomPreview(Geometry=merge_6, Material=glass_colour_4)

curve_6 = Curve(curve_4)
add_floor_heights_3 = RemoteReceiver(add_floor_heights)
mass_addition_7 = MassAddition(Input=add_floor_heights_3)  # -> Result, PartialResults
unit_z_14 = UnitZ(Factor=mass_addition_7.PartialResults)
move_8 = Move(Geometry=curve_6, Motion=unit_z_14)  # -> Geometry, Transform
move_floor_up_4 = RemoteReceiver(move_floor_up)
floor_height_4 = RemoteReceiver(floor_height)
unit_z_15 = UnitZ(Factor=move_floor_up_4)
unit_z_16 = UnitZ(Factor=floor_height_4)
surface_3 = Surface(move_8.Geometry)
move_9 = Move(Geometry=surface_3, Motion=unit_z_15)  # -> Geometry, Transform
extrude_3 = Extrude(Base=move_9.Geometry, Direction=unit_z_16)
custom_preview_7 = CustomPreview(
    Geometry=extrude_3,
    Material={diffuse=RGB(211, 211, 211), emission=RGB(0, 0, 0), shine=0, specular=RGB(255, 255, 255), transparency=0})

panel_6 = Panel("""0
1200
5100
8500
12100
15700
18300
22950
26600
30250
33900
37550
41200
44850
48800
52900
56550
58550
62775
63975""")
construct_point = ConstructPoint(XCoordinate=0, YCoordinate=0, ZCoordinate=panel_6)
point_list = PointList(Points=construct_point)
floor_lvl_s = RemoteSender(construct_point)

floor_lvl_s_2 = RemoteReceiver(floor_lvl_s)
list_item_5 = ListItem(List=floor_lvl_s_2, Index="19", Wrap=True)

swimming_floor_crv = Curve(<curve referenced from the Rhino model>)
floor_lvl_s_3 = RemoteReceiver(floor_lvl_s)
subtraction_2 = Subtraction(A="19", B="16")
list_item_6 = ListItem(List=floor_lvl_s_3, Index="16", Wrap=True)
series_4 = Series(Start=expr("x+1", "16"), Step=1, Count=expr("x-1", subtraction_2))
orient = Orient(Geometry=swimming_floor_crv, Source=PlaneXY(0, 0, 0), Target=list_item_6)  # -> Geometry, Transform
swimming_floor_crv_at_lvl = RemoteSender(orient.Geometry)

add_floor_crv = Curve(<curve referenced from the Rhino model>)
floor_lvl_s_4 = RemoteReceiver(floor_lvl_s)
list_item_7 = ListItem(List=floor_lvl_s_4, Index="14", Wrap=True)
subtraction_3 = Subtraction(A="16", B="14")
orient_2 = Orient(Geometry=add_floor_crv, Source=PlaneXY(0, 0, 0), Target=list_item_7)  # -> Geometry, Transform
series_5 = Series(Start=expr("x+1", "14"), Step=1, Count=subtraction_3)
add_floor_crv_at_lvl = RemoteSender(orient_2.Geometry)

typical_floor_crv = Curve(<curve referenced from the Rhino model>)
floor_lvl_s_5 = RemoteReceiver(floor_lvl_s)
list_item_8 = ListItem(List=floor_lvl_s_5, Index="4", Wrap=True)
subtraction_4 = Subtraction(A="14", B="4")
series_6 = Series(Start="4", Step=1, Count=expr("x+1", subtraction_4))
orient_3 = Orient(Geometry=typical_floor_crv, Source=PlaneXY(0, 0, 0), Target=list_item_8)  # -> Geometry, Transform
typical_floor_crv_at_lvl = RemoteSender(orient_3.Geometry)

ground_banquet_floor_crv = Curve(<curve referenced from the Rhino model>)
floor_lvl_s_6 = RemoteReceiver(floor_lvl_s)
list_item_9 = ListItem(List=floor_lvl_s_6, Index="1", Wrap=True)
subtraction_5 = Subtraction(A="4", B="1")
orient_4 = Orient(Geometry=ground_banquet_floor_crv, Source=PlaneXY(0, 0, 0), Target=list_item_9)  # -> Geometry, Transform
series_7 = Series(Start="1", Step=1, Count=subtraction_5)
ground_banquet_crv_at_lvl = RemoteSender(orient_4.Geometry)

xy_plane = XYPlane(Origin=construct_point)

floor_planes_at_lvl = RemoteSender(xy_plane)

swimming_floor_crv_at_lvl_2 = RemoteReceiver(swimming_floor_crv_at_lvl)
subtraction_6 = Subtraction(A=list_item_5, B=list_item_6)
unit_z_17 = UnitZ(Factor=subtraction_6)
extrude_4 = Extrude(Base=swimming_floor_crv_at_lvl_2, Direction=unit_z_17)
cap_holes = CapHoles(Brep=extrude_4)

add_floor_crv_at_lvl_2 = RemoteReceiver(add_floor_crv_at_lvl)
subtraction_7 = Subtraction(A=list_item_6, B=list_item_7)
unit_z_18 = UnitZ(Factor=subtraction_7)
extrude_5 = Extrude(Base=add_floor_crv_at_lvl_2, Direction=unit_z_18)
cap_holes_2 = CapHoles(Brep=extrude_5)

typical_floor_crv_at_lvl_2 = RemoteReceiver(typical_floor_crv_at_lvl)
subtraction_8 = Subtraction(A=list_item_7, B=list_item_8)
unit_z_19 = UnitZ(Factor=subtraction_8)
extrude_6 = Extrude(Base=typical_floor_crv_at_lvl_2, Direction=unit_z_19)
cap_holes_3 = CapHoles(Brep=extrude_6)

ground_banquet_crv_at_lvl_2 = RemoteReceiver(ground_banquet_crv_at_lvl)
subtraction_9 = Subtraction(A=list_item_8, B=list_item_9)
unit_z_20 = UnitZ(Factor=subtraction_9)
extrude_7 = Extrude(Base=ground_banquet_crv_at_lvl_2, Direction=unit_z_20)
cap_holes_4 = CapHoles(Brep=extrude_7)

add_floor_crv_at_lvl_3 = RemoteReceiver(add_floor_crv_at_lvl)
subtraction_10 = Subtraction(A=list_item_5, B=list_item_7)
unit_z_21 = UnitZ(Factor=subtraction_10)
extrude_8 = Extrude(Base=add_floor_crv_at_lvl_3, Direction=unit_z_21)
cap_holes_5 = CapHoles(Brep=extrude_8)

floor_planes_at_lvl_2 = RemoteReceiver(floor_planes_at_lvl)
brep = Brep(cap_holes_3)
list_item_10 = ListItem(List=floor_planes_at_lvl_2, Index=series_6, Wrap=True)
brep_plane = BrepPlane(Brep=brep, Plane=list_item_10)  # -> Curves, Points
surface_4 = Surface(brep_plane.Curves)

floor_planes_at_lvl_3 = RemoteReceiver(floor_planes_at_lvl)
brep_2 = Brep(cap_holes_4)
list_item_11 = ListItem(List=floor_planes_at_lvl_3, Index=series_7, Wrap=True)
brep_plane_2 = BrepPlane(Brep=brep_2, Plane=list_item_11)  # -> Curves, Points
surface_5 = Surface(brep_plane_2.Curves)

floor_planes_at_lvl_4 = RemoteReceiver(floor_planes_at_lvl)
brep_3 = Brep(cap_holes)
list_item_12 = ListItem(List=floor_planes_at_lvl_4, Index=series_4, Wrap=True)
brep_plane_3 = BrepPlane(Brep=brep_3, Plane=list_item_12)  # -> Curves, Points
surface_6 = Surface(brep_plane_3.Curves)

floor_planes_at_lvl_5 = RemoteReceiver(floor_planes_at_lvl)
list_item_13 = ListItem(List=floor_planes_at_lvl_5, Index=series_5, Wrap=True)
brep_4 = Brep(cap_holes_2)
brep_plane_4 = BrepPlane(Brep=brep_4, Plane=list_item_13)  # -> Curves, Points
surface_7 = Surface(brep_plane_4.Curves)

merge_7 = Merge(Data1=surface_6, Data2=surface_7, Data3=surface_4, Data4=surface_5)
extrude_9 = Extrude(Base=merge_7, Direction=unit_z_4)
custom_preview_8 = CustomPreview(Geometry=extrude_9, Material=floor_colour_2)

move_10 = Move(Geometry=move_3.Geometry, Motion=unit_z_3)  # -> Geometry, Transform
merge_8 = Merge(Data1=move_3.Geometry, Data2=move_10.Geometry)
curve_7 = Curve(merge_8)
mesh_loft_3 = MeshLoft(Polylines=curve_7, Cap=False)
weaverbird_s_picture_frame_3 = WeaverbirdsPictureFrame(MeshPolylines=mesh_loft_3, Distance=expr("x/2", mullion_width_3), InsetType=1)
weaverbird_s_mesh_window_3 = WeaverbirdsMeshWindow(MeshPolylines=mesh_loft_3, Distance=expr("x/2", mullion_width_3), InsetType=1)
offset_mesh_9 = OffsetMesh(Mesh=weaverbird_s_picture_frame_3, Distance=expr("-x", mullion_depth_3), BothSides=0, CreateSolid=True)
custom_preview_9 = CustomPreview(Geometry=offset_mesh_9, Material=mullion_colour_3)

offset_mesh_10 = OffsetMesh(Mesh=weaverbird_s_mesh_window_3, Distance=expr("-x", mullion_depth_3), BothSides=0, CreateSolid=False)
offset_mesh_11 = OffsetMesh(Mesh=weaverbird_s_mesh_window_3, Distance=expr("-x", glass_thickness_3), BothSides=0, CreateSolid=True)
offset_mesh_12 = OffsetMesh(Mesh=offset_mesh_10, Distance=glass_thickness_3, BothSides=0, CreateSolid=True)
merge_9 = Merge(Data1=flatten(offset_mesh_11), Data2=flatten(offset_mesh_12))

custom_preview_10 = CustomPreview(Geometry=merge_9, Material=glass_colour_3)

merge_10 = Merge(Data1=flatten(curve_7), Data2=flatten(curve_5), Data3=flatten(linear_array.Geometry))
curve_middle = CurveMiddle(Curve=merge_10)
deconstruct = Deconstruct(Point=curve_middle)  # -> XComponent, YComponent, ZComponent
sort_list = SortList(Keys=deconstruct.ZComponent, ValuesValuesA=merge_10)  # -> Keys, ValuesValuesA
