# Grasshopper definition Facade001.gh (Grasshopper 1.0.8)
# plug-ins: MeshEdit Components, Pufferfish, Chromodoris, Human, OpenNest, ghgl, LunchBox, Weaverbird, Wombat, Telepathy

number_slider = Slider(0.06, range=0.02..0.49)
number_slider_2 = Slider(20, range=0..50)
number_slider_3 = Slider(12, range=0..50)
number_slider_4 = Slider(0.06, range=0.02..0.49)  # disabled
number_slider_5 = Slider(20, range=0..50)  # disabled
number_slider_6 = Slider(12, range=0..50)  # disabled

mullion_colour = RemoteSender(ColourSwatch(SwatchColor=RGB(117, 117, 117)))
glass_colour = RemoteSender(ColourSwatch(SwatchColor=RGBA(255, 255, 255, 50)))

panel = Panel("""4100
3645
1950
5475""")
panel_2 = Panel("""3550
3600
3535
3900""")
negative = Negative(Value="450")
division = Division(A="7300", B=2)
typical_floor_height_x2 = RemoteSender("7300")
no_of_typical_floors = RemoteSender(Slider(10, range=0..10))
raise_from_slab_top = RemoteSender("133.5")
typical_floor_height = RemoteSender(division)
add_floor_heights = RemoteSender(panel)
gap_b_w_mullion = RemoteSender("0")
glass_thickness = RemoteSender("30")
mullion_depth = RemoteSender("195")
move_floor_up = RemoteSender("200")
mullion_width = RemoteSender(Slider(85, range=0..100))
facade_offset = RemoteSender(Slider(300, range=0..1000))
floor_height = RemoteSender(negative)
g_f_heights = RemoteSender(panel_2)

srf_extension_left_right = RemoteSender(Slider(576, range=0..1000))
srf_extension_up_down = RemoteSender(Slider(10000, range=0..10000))

number_slider_7 = Slider(0.13, range=0.02..0.49)
number_slider_8 = Slider(16, range=0..50)
number_slider_9 = Slider(0.13, range=0.02..0.49)  # disabled
number_slider_10 = Slider(16, range=0..50)  # disabled

typical_right_upper_crv = Curve()
typical_right_lower_crv = Curve(<curve referenced from the Rhino model>)

typical_left_upper_crv = Curve(<curve referenced from the Rhino model>)
typical_left_lower_crv = Curve(<curve referenced from the Rhino model>)

typical_right_lower_crv_2 = Curve(<curve referenced from the Rhino model>)
typical_right_upper_crv_2 = Curve(<curve referenced from the Rhino model>)

typical_left_upper_crv_2 = Curve(<curve referenced from the Rhino model>)
typical_left_lower_crv_2 = Curve(<curve referenced from the Rhino model>)

typical_right_upper_crv_3 = Curve(<curve referenced from the Rhino model>)
typical_right_lower_crv_3 = Curve(<curve referenced from the Rhino model>)

typical_left_upper_crv_3 = Curve(<curve referenced from the Rhino model>)
typical_left_lower_crv_3 = Curve(<curve referenced from the Rhino model>)

typical_right_upper_crv_4 = Curve(<curve referenced from the Rhino model>)
typical_right_lower_crv_4 = Curve(<curve referenced from the Rhino model>)

typical_left_upper_crv_4 = Curve(<curve referenced from the Rhino model>)
typical_left_lower_crv_4 = Curve(<curve referenced from the Rhino model>)

typical_right_lower_crv_5 = Curve(<curve referenced from the Rhino model>)
typical_right_upper_crv_5 = Curve(<curve referenced from the Rhino model>)

typical_left_upper_crv_5 = Curve(<curve referenced from the Rhino model>)
typical_left_lower_crv_5 = Curve(<curve referenced from the Rhino model>)

typical_right_upper_crv_6 = Curve(<curve referenced from the Rhino model>)
typical_right_lower_crv_6 = Curve(<curve referenced from the Rhino model>)

typical_right_lower_crv_7 = Curve(<curve referenced from the Rhino model>)
typical_right_upper_crv_7 = Curve(<curve referenced from the Rhino model>)

typical_left_upper_crv_6 = Curve(<curve referenced from the Rhino model>)
typical_left_lower_crv_6 = Curve(<curve referenced from the Rhino model>)

typical_left_upper_crv_7 = Curve(<curve referenced from the Rhino model>)
typical_left_lower_crv_7 = Curve(<curve referenced from the Rhino model>)

text = Text(" to ")
construct_domain = ConstructDomain(DomainStart="0.01", DomainEnd="0.49")
concatenate = Concatenate(Fragment_A="0.01", Fragment_B=text, A="0.49")
remap_numbers = RemapNumbers(Value=Slider(0.12, range=0.02..0.49), Source=concatenate, Target=construct_domain)  # -> Mapped, Clipped

floor_thickness = Panel("700")
negative_2 = Negative(Value=floor_thickness)
floor_thickness_2 = RemoteSender(negative_2)
floor_colour = RemoteSender(ColourSwatch(SwatchColor=RGB(0, 0, 0)))

typical_right_lower_crv_8 = Curve(<curve referenced from the Rhino model>)
typical_right_upper_crv_8 = Curve(<curve referenced from the Rhino model>)

typical_right_upper_crv_9 = Curve(<curve referenced from the Rhino model>)
typical_right_lower_crv_9 = Curve(<curve referenced from the Rhino model>)

typical_right_upper_crv_10 = Curve(<curve referenced from the Rhino model>)
typical_right_lower_crv_10 = Curve(<curve referenced from the Rhino model>)

typical_left_upper_crv_8 = Curve(<curve referenced from the Rhino model>)
typical_left_lower_crv_8 = Curve(<curve referenced from the Rhino model>)

typical_left_upper_crv_9 = Curve(<curve referenced from the Rhino model>)
typical_left_lower_crv_9 = Curve(<curve referenced from the Rhino model>)

typical_left_upper_crv_10 = Curve(<curve referenced from the Rhino model>)
typical_left_lower_crv_10 = Curve(<curve referenced from the Rhino model>)

text_2 = Text(" to ")
construct_domain_2 = ConstructDomain(DomainStart="0.01", DomainEnd="0.49")
concatenate_2 = Concatenate(Fragment_A="0.01", Fragment_B=text_2, A="0.49")
remap_numbers_2 = RemapNumbers(Value=number_slider_7, Source=concatenate_2, Target=construct_domain_2)  # -> Mapped, Clipped

honeycomb_sheet_colour = RemoteSender(ColourSwatch(SwatchColor=RGB(0, 59, 56)))

typical_right_upper_crv_11 = Curve(<curve referenced from the Rhino model>)
typical_right_lower_crv_11 = Curve(<curve referenced from the Rhino model>)

typical_right_lower_crv_12 = Curve(<curve referenced from the Rhino model>)
typical_right_upper_crv_12 = Curve(<curve referenced from the Rhino model>)

silicone_width_in_honeycomg_sheet = RemoteSender(Slider(20, range=0..20))
honeycomb_sheet_depth = RemoteSender(Slider(10, range=0..10))

typical_left_upper_crv_11 = Curve(<curve referenced from the Rhino model>)
typical_left_lower_crv_11 = Curve(<curve referenced from the Rhino model>)

typical_right_upper_crv_13 = Curve(<curve referenced from the Rhino model>)
typical_right_lower_crv_13 = Curve(<curve referenced from the Rhino model>)

typical_left_upper_crv_12 = Curve(<curve referenced from the Rhino model>)
typical_left_lower_crv_12 = Curve(<curve referenced from the Rhino model>)

text_3 = Text(" to ")
construct_domain_3 = ConstructDomain(DomainStart="0.01", DomainEnd="0.49")
concatenate_3 = Concatenate(Fragment_A="0.01", Fragment_B=text_3, A="0.49")
remap_numbers_3 = RemapNumbers(Value=Slider(0.24, range=0.02..0.49), Source=concatenate_3, Target=construct_domain_3)  # -> Mapped, Clipped

typical_left_upper_crv_13 = Curve(<curve referenced from the Rhino model>)
typical_left_lower_crv_13 = Curve(<curve referenced from the Rhino model>)

text_4 = Text(" to ")
construct_domain_4 = ConstructDomain(DomainStart="0.01", DomainEnd="0.49")
concatenate_4 = Concatenate(Fragment_A="0.01", Fragment_B=text_4, A="0.49")
remap_numbers_4 = RemapNumbers(Value=number_slider_7, Source=concatenate_4, Target=construct_domain_4)  # -> Mapped, Clipped

typical_right_upper_crv_14 = Curve(<curve referenced from the Rhino model>)
typical_right_lower_crv_14 = Curve(<curve referenced from the Rhino model>)

typical_right_upper_crv_15 = Curve()  # disabled
typical_right_lower_crv_15 = Curve(<curve referenced from the Rhino model>)  # disabled

typical_left_upper_crv_14 = Curve(<curve referenced from the Rhino model>)
typical_left_lower_crv_14 = Curve(<curve referenced from the Rhino model>)

text_5 = Text(" to ")
construct_domain_5 = ConstructDomain(DomainStart="0.01", DomainEnd="0.49")
concatenate_5 = Concatenate(Fragment_A="0.01", Fragment_B=text_5, A="0.49")
remap_numbers_5 = RemapNumbers(Value=Slider(0.24, range=0.02..0.49), Source=concatenate_5, Target=construct_domain_5)  # -> Mapped, Clipped

typical_left_upper_crv_15 = Curve(<curve referenced from the Rhino model>)  # disabled
typical_left_lower_crv_15 = Curve(<curve referenced from the Rhino model>)  # disabled

typical_right_upper_crv_16 = Curve(<curve referenced from the Rhino model>)
typical_right_lower_crv_16 = Curve(<curve referenced from the Rhino model>)

typical_right_lower_crv_17 = Curve(<curve referenced from the Rhino model>)  # disabled
typical_right_upper_crv_17 = Curve(<curve referenced from the Rhino model>)  # disabled

typical_left_upper_crv_16 = Curve(<curve referenced from the Rhino model>)
typical_left_lower_crv_16 = Curve(<curve referenced from the Rhino model>)

text_6 = Text(" to ")
construct_domain_6 = ConstructDomain(DomainStart="0.01", DomainEnd="0.49")
concatenate_6 = Concatenate(Fragment_A="0.01", Fragment_B=text_6, A="0.49")
remap_numbers_6 = RemapNumbers(Value=Slider(0.24, range=0.02..0.49), Source=concatenate_6, Target=construct_domain_6)  # -> Mapped, Clipped

text_7 = Text(" to ")
construct_domain_7 = ConstructDomain(DomainStart="0.01", DomainEnd="0.49")
concatenate_7 = Concatenate(Fragment_A="0.01", Fragment_B=text_7, A="0.49")
remap_numbers_7 = RemapNumbers(Value=Slider(0.24, range=0.02..0.49), Source=concatenate_7, Target=construct_domain_7)  # -> Mapped, Clipped

typical_left_upper_crv_17 = Curve(<curve referenced from the Rhino model>)  # disabled
typical_left_lower_crv_17 = Curve(<curve referenced from the Rhino model>)  # disabled

silicone_colour = RemoteSender(ColourSwatch(SwatchColor=RGB(0, 0, 0)))
right_side_straight_bands = RemoteSender(Slider(17, range=0..50))

text_8 = Text(" to ")
construct_domain_8 = ConstructDomain(DomainStart="0.01", DomainEnd="0.49")
concatenate_8 = Concatenate(Fragment_A="0.01", Fragment_B=text_8, A="0.49")
remap_numbers_8 = RemapNumbers(Value=Slider(0.24, range=0.02..0.49), Source=concatenate_8, Target=construct_domain_8)  # -> Mapped, Clipped

typical_right_upper_crv_18 = Curve(<curve referenced from the Rhino model>)  # disabled
typical_right_lower_crv_18 = Curve(<curve referenced from the Rhino model>)  # disabled

text_9 = Text(" to ")
construct_domain_9 = ConstructDomain(DomainStart="0.01", DomainEnd="0.49")
concatenate_9 = Concatenate(Fragment_A="0.01", Fragment_B=text_9, A="0.49")
remap_numbers_9 = RemapNumbers(Value=Slider(0.24, range=0.02..0.49), Source=concatenate_9, Target=construct_domain_9)  # -> Mapped, Clipped

text_10 = Text(" to ")
construct_domain_10 = ConstructDomain(DomainStart="0.01", DomainEnd="0.49")
concatenate_10 = Concatenate(Fragment_A="0.01", Fragment_B=text_10, A="0.49")
remap_numbers_10 = RemapNumbers(Value=Slider(0.24, range=0.02..0.49), Source=concatenate_10, Target=construct_domain_10)  # -> Mapped, Clipped

typical_left_upper_crv_18 = Curve(<curve referenced from the Rhino model>)  # disabled
typical_left_lower_crv_18 = Curve(<curve referenced from the Rhino model>)  # disabled

typical_right_upper_crv_19 = Curve(<curve referenced from the Rhino model>)  # disabled
typical_right_lower_crv_19 = Curve(<curve referenced from the Rhino model>)  # disabled

left_side_straight_bands = RemoteSender(Slider(20, range=0..50))

typical_left_upper_crv_19 = Curve(<curve referenced from the Rhino model>)  # disabled
typical_left_lower_crv_19 = Curve(<curve referenced from the Rhino model>)  # disabled

text_11 = Text(" to ")
construct_domain_11 = ConstructDomain(DomainStart="0.01", DomainEnd="0.49")
concatenate_11 = Concatenate(Fragment_A="0.01", Fragment_B=text_11, A="0.49")
remap_numbers_11 = RemapNumbers(Value=Slider(0.24, range=0.02..0.49), Source=concatenate_11, Target=construct_domain_11)  # -> Mapped, Clipped

typical_right_lower_crv_20 = Curve(<curve referenced from the Rhino model>)  # disabled
typical_right_upper_crv_20 = Curve(<curve referenced from the Rhino model>)  # disabled

text_12 = Text(" to ")
construct_domain_12 = ConstructDomain(DomainStart="0.01", DomainEnd="0.49")
concatenate_12 = Concatenate(Fragment_A="0.01", Fragment_B=text_12, A="0.49")
remap_numbers_12 = RemapNumbers(Value=Slider(0.24, range=0.02..0.49), Source=concatenate_12, Target=construct_domain_12)  # -> Mapped, Clipped

typical_left_upper_crv_20 = Curve(<curve referenced from the Rhino model>)  # disabled
typical_left_lower_crv_20 = Curve(<curve referenced from the Rhino model>)  # disabled

typical_right_upper_crv_21 = Curve(<curve referenced from the Rhino model>)  # disabled
typical_right_lower_crv_21 = Curve(<curve referenced from the Rhino model>)  # disabled

typical_right_lower_crv_22 = Curve(<curve referenced from the Rhino model>)  # disabled
typical_right_upper_crv_22 = Curve(<curve referenced from the Rhino model>)  # disabled

text_13 = Text(" to ")
construct_domain_13 = ConstructDomain(DomainStart="0.01", DomainEnd="0.49")
concatenate_13 = Concatenate(Fragment_A="0.01", Fragment_B=text_13, A="0.49")
remap_numbers_13 = RemapNumbers(Value=number_slider, Source=concatenate_13, Target=construct_domain_13)  # -> Mapped, Clipped

typical_left_upper_crv_21 = Curve(<curve referenced from the Rhino model>)  # disabled
typical_left_lower_crv_21 = Curve(<curve referenced from the Rhino model>)  # disabled

typical_left_upper_crv_22 = Curve(<curve referenced from the Rhino model>)  # disabled
typical_left_lower_crv_22 = Curve(<curve referenced from the Rhino model>)  # disabled

text_14 = Text(" to ")
construct_domain_14 = ConstructDomain(DomainStart="0.01", DomainEnd="0.49")
concatenate_14 = Concatenate(Fragment_A="0.01", Fragment_B=text_14, A="0.49")
remap_numbers_14 = RemapNumbers(Value=Slider(0.24, range=0.02..0.49), Source=concatenate_14, Target=construct_domain_14)  # -> Mapped, Clipped

number_slider_11 = Slider(0.12, range=0.02..0.49)  # disabled
text_15 = Text(" to ")  # disabled
panel_3 = Panel("0.01")  # disabled
panel_4 = Panel("0.49")  # disabled
construct_domain_15 = ConstructDomain(DomainStart=panel_3, DomainEnd=panel_4)  # disabled
concatenate_15 = Concatenate(Fragment_A=panel_3, Fragment_B=text_15, A=panel_4)  # disabled
remap_numbers_15 = RemapNumbers(Value=number_slider_11, Source=concatenate_15, Target=construct_domain_15)  # -> Mapped, Clipped; disabled

typical_right_lower_crv_23 = Curve(<curve referenced from the Rhino model>)  # disabled
typical_right_upper_crv_23 = Curve(<curve referenced from the Rhino model>)  # disabled

text_16 = Text(" to ")
construct_domain_16 = ConstructDomain(DomainStart="0.01", DomainEnd="0.49")
concatenate_16 = Concatenate(Fragment_A="0.01", Fragment_B=text_16, A="0.49")
remap_numbers_16 = RemapNumbers(Value=number_slider, Source=concatenate_16, Target=construct_domain_16)  # -> Mapped, Clipped

typical_right_upper_crv_24 = Curve(<curve referenced from the Rhino model>)  # disabled
typical_right_lower_crv_24 = Curve(<curve referenced from the Rhino model>)  # disabled

typical_right_upper_crv_25 = Curve(<curve referenced from the Rhino model>)  # disabled
typical_right_lower_crv_25 = Curve(<curve referenced from the Rhino model>)  # disabled

typical_left_upper_crv_23 = Curve(<curve referenced from the Rhino model>)  # disabled
typical_left_lower_crv_23 = Curve(<curve referenced from the Rhino model>)  # disabled

typical_left_upper_crv_24 = Curve(<curve referenced from the Rhino model>)  # disabled
typical_left_lower_crv_24 = Curve(<curve referenced from the Rhino model>)  # disabled

typical_left_upper_crv_25 = Curve(<curve referenced from the Rhino model>)  # disabled
typical_left_lower_crv_25 = Curve(<curve referenced from the Rhino model>)  # disabled

text_17 = Text(" to ")  # disabled
panel_5 = Panel("0.01")  # disabled
panel_6 = Panel("0.49")  # disabled
construct_domain_17 = ConstructDomain(DomainStart=panel_5, DomainEnd=panel_6)  # disabled
concatenate_17 = Concatenate(Fragment_A=panel_5, Fragment_B=text_17, A=panel_6)  # disabled
remap_numbers_17 = RemapNumbers(Value=number_slider_9, Source=concatenate_17, Target=construct_domain_17)  # -> Mapped, Clipped; disabled

typical_right_upper_crv_26 = Curve(<curve referenced from the Rhino model>)  # disabled
typical_right_lower_crv_26 = Curve(<curve referenced from the Rhino model>)  # disabled

typical_right_lower_crv_27 = Curve(<curve referenced from the Rhino model>)  # disabled
typical_right_upper_crv_27 = Curve(<curve referenced from the Rhino model>)  # disabled

typical_left_upper_crv_26 = Curve(<curve referenced from the Rhino model>)  # disabled
typical_left_lower_crv_26 = Curve(<curve referenced from the Rhino model>)  # disabled

typical_right_upper_crv_28 = Curve(<curve referenced from the Rhino model>)  # disabled
typical_right_lower_crv_28 = Curve(<curve referenced from the Rhino model>)  # disabled

typical_left_upper_crv_27 = Curve(<curve referenced from the Rhino model>)  # disabled
typical_left_lower_crv_27 = Curve(<curve referenced from the Rhino model>)  # disabled

number_slider_12 = Slider(0.24, range=0.02..0.49)  # disabled
text_18 = Text(" to ")  # disabled
panel_7 = Panel("0.01")  # disabled
panel_8 = Panel("0.49")  # disabled
construct_domain_18 = ConstructDomain(DomainStart=panel_7, DomainEnd=panel_8)  # disabled
concatenate_18 = Concatenate(Fragment_A=panel_7, Fragment_B=text_18, A=panel_8)  # disabled
remap_numbers_18 = RemapNumbers(Value=number_slider_12, Source=concatenate_18, Target=construct_domain_18)  # -> Mapped, Clipped; disabled

typical_left_upper_crv_28 = Curve(<curve referenced from the Rhino model>)  # disabled
typical_left_lower_crv_28 = Curve(<curve referenced from the Rhino model>)  # disabled

text_19 = Text(" to ")  # disabled
panel_9 = Panel("0.01")  # disabled
panel_10 = Panel("0.49")  # disabled
construct_domain_19 = ConstructDomain(DomainStart=panel_9, DomainEnd=panel_10)  # disabled
concatenate_19 = Concatenate(Fragment_A=panel_9, Fragment_B=text_19, A=panel_10)  # disabled
remap_numbers_19 = RemapNumbers(Value=number_slider_9, Source=concatenate_19, Target=construct_domain_19)  # -> Mapped, Clipped; disabled

typical_right_upper_crv_29 = Curve(<curve referenced from the Rhino model>)  # disabled
typical_right_lower_crv_29 = Curve(<curve referenced from the Rhino model>)  # disabled

typical_left_upper_crv_29 = Curve(<curve referenced from the Rhino model>)  # disabled
typical_left_lower_crv_29 = Curve(<curve referenced from the Rhino model>)  # disabled

number_slider_13 = Slider(0.24, range=0.02..0.49)  # disabled
text_20 = Text(" to ")  # disabled
panel_11 = Panel("0.01")  # disabled
panel_12 = Panel("0.49")  # disabled
construct_domain_20 = ConstructDomain(DomainStart=panel_11, DomainEnd=panel_12)  # disabled
concatenate_20 = Concatenate(Fragment_A=panel_11, Fragment_B=text_20, A=panel_12)  # disabled
remap_numbers_20 = RemapNumbers(Value=number_slider_13, Source=concatenate_20, Target=construct_domain_20)  # -> Mapped, Clipped; disabled

typical_right_upper_crv_30 = Curve(<curve referenced from the Rhino model>)  # disabled
typical_right_lower_crv_30 = Curve(<curve referenced from the Rhino model>)  # disabled

typical_left_upper_crv_30 = Curve(<curve referenced from the Rhino model>)  # disabled
typical_left_lower_crv_30 = Curve(<curve referenced from the Rhino model>)  # disabled

number_slider_14 = Slider(0.24, range=0.02..0.49)  # disabled
text_21 = Text(" to ")  # disabled
panel_13 = Panel("0.01")  # disabled
panel_14 = Panel("0.49")  # disabled
construct_domain_21 = ConstructDomain(DomainStart=panel_13, DomainEnd=panel_14)  # disabled
concatenate_21 = Concatenate(Fragment_A=panel_13, Fragment_B=text_21, A=panel_14)  # disabled
remap_numbers_21 = RemapNumbers(Value=number_slider_14, Source=concatenate_21, Target=construct_domain_21)  # -> Mapped, Clipped; disabled

number_slider_15 = Slider(0.24, range=0.02..0.49)  # disabled
text_22 = Text(" to ")  # disabled
panel_15 = Panel("0.01")  # disabled
panel_16 = Panel("0.49")  # disabled
construct_domain_22 = ConstructDomain(DomainStart=panel_15, DomainEnd=panel_16)  # disabled
concatenate_22 = Concatenate(Fragment_A=panel_15, Fragment_B=text_22, A=panel_16)  # disabled
remap_numbers_22 = RemapNumbers(Value=number_slider_15, Source=concatenate_22, Target=construct_domain_22)  # -> Mapped, Clipped; disabled

merge = Merge(Data1=typical_right_upper_crv, Data2=typical_right_lower_crv)
merge_2 = Merge(Data1=typical_left_upper_crv, Data2=typical_left_lower_crv)

number_slider_16 = Slider(0.24, range=0.02..0.49)  # disabled
text_23 = Text(" to ")  # disabled
panel_17 = Panel("0.01")  # disabled
panel_18 = Panel("0.49")  # disabled
construct_domain_23 = ConstructDomain(DomainStart=panel_17, DomainEnd=panel_18)  # disabled
concatenate_23 = Concatenate(Fragment_A=panel_17, Fragment_B=text_23, A=panel_18)  # disabled
remap_numbers_23 = RemapNumbers(Value=number_slider_16, Source=concatenate_23, Target=construct_domain_23)  # -> Mapped, Clipped; disabled

number_slider_17 = Slider(0.24, range=0.02..0.49)  # disabled
text_24 = Text(" to ")  # disabled
panel_19 = Panel("0.01")  # disabled
panel_20 = Panel("0.49")  # disabled
construct_domain_24 = ConstructDomain(DomainStart=panel_19, DomainEnd=panel_20)  # disabled
concatenate_24 = Concatenate(Fragment_A=panel_19, Fragment_B=text_24, A=panel_20)  # disabled
remap_numbers_24 = RemapNumbers(Value=number_slider_17, Source=concatenate_24, Target=construct_domain_24)  # -> Mapped, Clipped; disabled

number_slider_18 = Slider(0.24, range=0.02..0.49)  # disabled
text_25 = Text(" to ")  # disabled
panel_21 = Panel("0.01")  # disabled
panel_22 = Panel("0.49")  # disabled
construct_domain_25 = ConstructDomain(DomainStart=panel_21, DomainEnd=panel_22)  # disabled
concatenate_25 = Concatenate(Fragment_A=panel_21, Fragment_B=text_25, A=panel_22)  # disabled
remap_numbers_25 = RemapNumbers(Value=number_slider_18, Source=concatenate_25, Target=construct_domain_25)  # -> Mapped, Clipped; disabled

merge_3 = Merge(Data1=typical_right_upper_crv_2, Data2=typical_right_lower_crv_2)

number_slider_19 = Slider(0.24, range=0.02..0.49)  # disabled
text_26 = Text(" to ")  # disabled
panel_23 = Panel("0.01")  # disabled
panel_24 = Panel("0.49")  # disabled
construct_domain_26 = ConstructDomain(DomainStart=panel_23, DomainEnd=panel_24)  # disabled
concatenate_26 = Concatenate(Fragment_A=panel_23, Fragment_B=text_26, A=panel_24)  # disabled
remap_numbers_26 = RemapNumbers(Value=number_slider_19, Source=concatenate_26, Target=construct_domain_26)  # -> Mapped, Clipped; disabled

merge_4 = Merge(Data1=typical_left_upper_crv_2, Data2=typical_left_lower_crv_2)

number_slider_20 = Slider(0.24, range=0.02..0.49)  # disabled
panel_25 = Panel("0.01")  # disabled
panel_26 = Panel("0.49")  # disabled
text_27 = Text(" to ")  # disabled
construct_domain_27 = ConstructDomain(DomainStart=panel_25, DomainEnd=panel_26)  # disabled
concatenate_27 = Concatenate(Fragment_A=panel_25, Fragment_B=text_27, A=panel_26)  # disabled
remap_numbers_27 = RemapNumbers(Value=number_slider_20, Source=concatenate_27, Target=construct_domain_27)  # -> Mapped, Clipped; disabled

text_28 = Text(" to ")  # disabled
panel_27 = Panel("0.01")  # disabled
panel_28 = Panel("0.49")  # disabled
construct_domain_28 = ConstructDomain(DomainStart=panel_27, DomainEnd=panel_28)  # disabled
concatenate_28 = Concatenate(Fragment_A=panel_27, Fragment_B=text_28, A=panel_28)  # disabled
remap_numbers_28 = RemapNumbers(Value=number_slider_4, Source=concatenate_28, Target=construct_domain_28)  # -> Mapped, Clipped; disabled

merge_5 = Merge(Data1=typical_left_upper_crv_3, Data2=typical_left_lower_crv_3)
merge_6 = Merge(Data1=typical_right_upper_crv_3, Data2=typical_right_lower_crv_3)
merge_7 = Merge(Data1=typical_left_upper_crv_4, Data2=typical_left_lower_crv_4)

number_slider_21 = Slider(0.24, range=0.02..0.49)  # disabled
text_29 = Text(" to ")  # disabled
panel_29 = Panel("0.01")  # disabled
panel_30 = Panel("0.49")  # disabled
construct_domain_29 = ConstructDomain(DomainStart=panel_29, DomainEnd=panel_30)  # disabled
concatenate_29 = Concatenate(Fragment_A=panel_29, Fragment_B=text_29, A=panel_30)  # disabled
remap_numbers_29 = RemapNumbers(Value=number_slider_21, Source=concatenate_29, Target=construct_domain_29)  # -> Mapped, Clipped; disabled

text_30 = Text(" to ")  # disabled
panel_31 = Panel("0.01")  # disabled
panel_32 = Panel("0.49")  # disabled
construct_domain_30 = ConstructDomain(DomainStart=panel_31, DomainEnd=panel_32)  # disabled
concatenate_30 = Concatenate(Fragment_A=panel_31, Fragment_B=text_30, A=panel_32)  # disabled
remap_numbers_30 = RemapNumbers(Value=number_slider_4, Source=concatenate_30, Target=construct_domain_30)  # -> Mapped, Clipped; disabled

merge_8 = Merge(Data1=typical_right_upper_crv_4, Data2=typical_right_lower_crv_4)
merge_9 = Merge(Data1=typical_right_upper_crv_5, Data2=typical_right_lower_crv_5)
merge_10 = Merge(Data1=typical_left_upper_crv_5, Data2=typical_left_lower_crv_5)
merge_11 = Merge(Data1=typical_right_upper_crv_6, Data2=typical_right_lower_crv_6)
merge_12 = Merge(Data1=typical_right_upper_crv_7, Data2=typical_right_lower_crv_7)
merge_13 = Merge(Data1=typical_left_upper_crv_6, Data2=typical_left_lower_crv_6)
merge_14 = Merge(Data1=typical_left_upper_crv_7, Data2=typical_left_lower_crv_7)
merge_15 = Merge(Data1=typical_right_upper_crv_8, Data2=typical_right_lower_crv_8)
merge_16 = Merge(Data1=typical_right_upper_crv_9, Data2=typical_right_lower_crv_9)
merge_17 = Merge(Data1=typical_right_upper_crv_10, Data2=typical_right_lower_crv_10)
merge_18 = Merge(Data1=typical_left_upper_crv_8, Data2=typical_left_lower_crv_8)
merge_19 = Merge(Data1=typical_left_upper_crv_9, Data2=typical_left_lower_crv_9)
merge_20 = Merge(Data1=typical_left_upper_crv_10, Data2=typical_left_lower_crv_10)

# ----
# Typical Floor: Right Side_Cross-Section
merge_21 = Merge(Data1=typical_right_upper_crv_11, Data2=typical_right_lower_crv_11)
group = Group(Geometry=merge_21)
group_2 = Group(group)
typical_right_side_cross_section_crv = RemoteSender(group_2)

# ----
# Typical Floor: Right Side_Cross-Section
merge_22 = Merge(Data1=typical_right_upper_crv_12, Data2=typical_right_lower_crv_12)
group_3 = Group(Geometry=merge_22)
group_4 = Group(group_3)
typical_right_side_cross_section_crv_2 = RemoteSender(group_4)

# ----
# Typical Floor: Left Side_Cross-Section
merge_23 = Merge(Data1=typical_left_upper_crv_11, Data2=typical_left_lower_crv_11)
group_5 = Group(Geometry=merge_23)
group_6 = Group(group_5)
typical_left_side_cross_section_crv = RemoteSender(group_6)

# ----
# Typical Floor: Right Side_Cross-Section
merge_24 = Merge(Data1=typical_right_upper_crv_15, Data2=typical_right_lower_crv_15)  # disabled
group_7 = Group(Geometry=typical_right_lower_crv_15)  # disabled
group_8 = Group(group_7)  # disabled
typical_right_side_cross_section_crv_3 = RemoteSender(group_8)  # disabled

# ----
# Typical Floor: Right Side_Cross-Section
merge_25 = Merge(Data1=typical_right_upper_crv_13, Data2=typical_right_lower_crv_13)
group_9 = Group(Geometry=merge_25)
group_10 = Group(group_9)
typical_right_side_cross_section_crv_4 = RemoteSender(group_10)

# ----
# Typical Floor: Left Side_Cross-Section
merge_26 = Merge(Data1=typical_left_upper_crv_12, Data2=typical_left_lower_crv_12)
group_11 = Group(Geometry=merge_26)
group_12 = Group(group_11)
typical_left_side_cross_section_crv_2 = RemoteSender(group_12)

# ----
# Typical Floor: Left Side_Cross-Section
merge_27 = Merge(Data1=typical_left_upper_crv_13, Data2=typical_left_lower_crv_13)
group_13 = Group(Geometry=merge_27)
group_14 = Group(group_13)
typical_left_side_cross_section_crv_3 = RemoteSender(group_14)

# ----
# Typical Floor: Left Side_Cross-Section
merge_28 = Merge(Data1=typical_left_upper_crv_15, Data2=typical_left_lower_crv_15)  # disabled
group_15 = Group(Geometry=merge_28)  # disabled
group_16 = Group(group_15)  # disabled
typical_left_side_cross_section_crv_4 = RemoteSender(group_16)  # disabled

# ----
# Typical Floor: Right Side_Cross-Section
merge_29 = Merge(Data1=typical_right_upper_crv_14, Data2=typical_right_lower_crv_14)
group_17 = Group(Geometry=merge_29)
group_18 = Group(group_17)
typical_right_side_cross_section_crv_5 = RemoteSender(group_18)

cross_section_curvature = Integer(Slider(1, range=0..2))
cross_section_fillet_1 = Number(Slider(0.49, range=0..1))
cross_section_fillet_2 = Number(Slider(0.53, range=0..1))

# ----
# Typical Floor: Left Side_Cross-Section
merge_30 = Merge(Data1=typical_left_upper_crv_14, Data2=typical_left_lower_crv_14)
group_19 = Group(Geometry=merge_30)
group_20 = Group(group_19)
typical_left_side_cross_section_crv_5 = RemoteSender(group_20)

merge_31 = Merge(Data1=typical_right_upper_crv_16, Data2=typical_right_lower_crv_16)

# ----
# Typical Floor: Right Side_Cross-Section
merge_32 = Merge(Data1=typical_right_upper_crv_17, Data2=typical_right_lower_crv_17)  # disabled
group_21 = Group(Geometry=merge_32)  # disabled
group_22 = Group(group_21)  # disabled
typical_right_side_cross_section_crv_6 = RemoteSender(group_22)  # disabled

merge_33 = Merge(Data1=typical_left_upper_crv_16, Data2=typical_left_lower_crv_16)
right_side_straight_bands_2 = RemoteReceiver(right_side_straight_bands)

cross_section_curvature_2 = Integer(Slider(1, range=0..2))
cross_section_fillet_1_2 = Number(Slider(0.67, range=0..1))
cross_section_fillet_2_2 = Number(Slider(0.47, range=0..1))

# ----
# Typical Floor: Left Side_Cross-Section
merge_34 = Merge(Data1=typical_left_upper_crv_17, Data2=typical_left_lower_crv_17)  # disabled
group_23 = Group(Geometry=merge_34)  # disabled
group_24 = Group(group_23)  # disabled
typical_left_side_cross_section_crv_6 = RemoteSender(group_24)  # disabled

scissor_upper_crv_curvature_1 = Number(Slider(0.63, range=0..1))
scissor_upper_crv_curvature_2 = Number(Slider(0.49, range=0..1))
scissor_upper_crv_curvature = Integer(Slider(2, range=0..2))

scissor_lower_crv_curvature_2 = Number(Slider(0.53, range=0..1))
scissor_lower_crv_curvature_1 = Number(Slider(0.47, range=0..1))
scissor_lower_crv_curvature = Integer(Slider(2, range=0..2))

left_side_straight_bands_2 = RemoteReceiver(left_side_straight_bands)

# ----
# Typical Floor: Left Side_Cross-Section
merge_35 = Merge(Data1=typical_left_upper_crv_18, Data2=typical_left_lower_crv_18)  # disabled
group_25 = Group(Geometry=typical_left_lower_crv_18)  # disabled
group_26 = Group(group_25)  # disabled
typical_left_side_cross_section_crv_7 = RemoteSender(group_26)  # disabled

# ----
# Typical Floor: Right Side_Cross-Section
merge_36 = Merge(Data1=typical_right_upper_crv_18, Data2=typical_right_lower_crv_18)  # disabled
group_27 = Group(Geometry=merge_36)  # disabled
group_28 = Group(group_27)  # disabled
typical_right_side_cross_section_crv_7 = RemoteSender(group_28)  # disabled

right_side_straight_bands_3 = RemoteReceiver(right_side_straight_bands)

scissor_upper_crv_curvature_1_2 = Number(Slider(0.75, range=0..1))
scissor_upper_crv_curvature_2_2 = Number(Slider(0.99, range=0..1))
scissor_upper_crv_curvature_3 = Integer(Slider(2, range=0..2))

scissor_lower_crv_curvature_2_2 = Number(Slider(0.83, range=0..1))
scissor_lower_crv_curvature_1_2 = Number(Slider(0.92, range=0..1))
scissor_lower_crv_curvature_3 = Integer(Slider(2, range=0..2))

right_side_straight_bands_4 = RemoteReceiver(right_side_straight_bands)

# ----
# Typical Floor: Left Side_Cross-Section
merge_37 = Merge(Data1=typical_left_upper_crv_19, Data2=typical_left_lower_crv_19)  # disabled
group_29 = Group(Geometry=merge_37)  # disabled
group_30 = Group(group_29)  # disabled
typical_left_side_cross_section_crv_8 = RemoteSender(group_30)  # disabled

cross_section_curvature_3 = Integer(Slider(1, range=0..2))
cross_section_fillet_1_3 = Number(Slider(0.28, range=0..1))
cross_section_fillet_2_3 = Number(Slider(0.26, range=0..1))

right_side_straight_bands_5 = RemoteReceiver(right_side_straight_bands)

cross_section_curvature_4 = Integer(Slider(1, range=0..2))
cross_section_fillet_1_4 = Number(Slider(0.28, range=0..1))
cross_section_fillet_2_4 = Number(Slider(0.26, range=0..1))

left_side_straight_bands_3 = RemoteReceiver(left_side_straight_bands)
left_side_straight_bands_4 = RemoteReceiver(left_side_straight_bands)

# ----
# Typical Floor: Right Side_Cross-Section
merge_38 = Merge(Data1=typical_right_upper_crv_19, Data2=typical_right_lower_crv_19)  # disabled
group_31 = Group(Geometry=merge_38)  # disabled
group_32 = Group(group_31)  # disabled
typical_right_side_cross_section_crv_8 = RemoteSender(group_32)  # disabled

# ----
# Typical Floor: Right Side_Cross-Section
merge_39 = Merge(Data1=typical_right_upper_crv_20, Data2=typical_right_lower_crv_20)  # disabled
group_33 = Group(Geometry=merge_39)  # disabled
group_34 = Group(group_33)  # disabled
typical_right_side_cross_section_crv_9 = RemoteSender(group_34)  # disabled

scissor_upper_crv_curvature_1_3 = Number(Slider(0.67, range=0..1))
scissor_upper_crv_curvature_2_3 = Number(Slider(0.3, range=0..1))
scissor_upper_crv_curvature_4 = Integer(Slider(2, range=0..2))

left_side_straight_bands_5 = RemoteReceiver(left_side_straight_bands)

scissor_lower_crv_curvature_2_3 = Number(Slider(0.53, range=0..1))
scissor_lower_crv_curvature_1_3 = Number(Slider(0.47, range=0..1))
scissor_lower_crv_curvature_4 = Integer(Slider(2, range=0..2))

cross_section_curvature_5 = Integer(Slider(1, range=0..2))
cross_section_fillet_1_5 = Number(Slider(0.56, range=0..1))
cross_section_fillet_2_5 = Number(Slider(0.24, range=0..1))

group_35 = Group(Geometry=typical_right_lower_crv)

# ----
# Typical Floor: Left Side_Cross-Section
merge_40 = Merge(Data1=typical_left_upper_crv_20, Data2=typical_left_lower_crv_20)  # disabled
group_36 = Group(Geometry=merge_40)  # disabled
group_37 = Group(group_36)  # disabled
typical_left_side_cross_section_crv_9 = RemoteSender(group_37)  # disabled

# ----
# Typical Floor: Right Side_Cross-Section
merge_41 = Merge(Data1=typical_right_upper_crv_21, Data2=typical_right_lower_crv_21)  # disabled
group_38 = Group(Geometry=merge_41)  # disabled
group_39 = Group(group_38)  # disabled
typical_right_side_cross_section_crv_10 = RemoteSender(group_39)  # disabled

# ----
# Typical Floor: Right Side_Cross-Section
merge_42 = Merge(Data1=typical_right_upper_crv_22, Data2=typical_right_lower_crv_22)  # disabled
group_40 = Group(Geometry=merge_42)  # disabled
group_41 = Group(group_40)  # disabled
typical_right_side_cross_section_crv_11 = RemoteSender(group_41)  # disabled

right_side_straight_bands_6 = RemoteReceiver(right_side_straight_bands)

scissor_upper_crv_curvature_1_4 = Number(Slider(0.6, range=0..1))
scissor_upper_crv_curvature_2_4 = Number(Slider(0.62, range=0..1))
scissor_upper_crv_curvature_5 = Integer(Slider(2, range=0..2))

right_side_straight_bands_7 = RemoteReceiver(right_side_straight_bands)

scissor_lower_crv_curvature_2_4 = Number(Slider(0.82, range=0..1))
scissor_lower_crv_curvature_1_4 = Number(Slider(0.49, range=0..1))
scissor_lower_crv_curvature_5 = Integer(Slider(2, range=0..2))

right_side_straight_bands_8 = RemoteReceiver(right_side_straight_bands)
group_42 = Group(Geometry=merge_2)

cross_section_curvature_6 = Integer(Slider(1, range=0..2))
cross_section_fillet_1_6 = Number(Slider(0.28, range=0..1))
cross_section_fillet_2_6 = Number(Slider(0.26, range=0..1))

cross_section_curvature_7 = Integer(Slider(1, range=0..2))
cross_section_fillet_1_7 = Number(Slider(0.28, range=0..1))
cross_section_fillet_2_7 = Number(Slider(0.26, range=0..1))

# ----
# Typical Floor: Left Side_Cross-Section
merge_43 = Merge(Data1=typical_left_upper_crv_21, Data2=typical_left_lower_crv_21)  # disabled
group_43 = Group(Geometry=merge_43)  # disabled
group_44 = Group(group_43)  # disabled
typical_left_side_cross_section_crv_10 = RemoteSender(group_44)  # disabled

# ----
# Typical Floor: Left Side_Cross-Section
merge_44 = Merge(Data1=typical_left_upper_crv_22, Data2=typical_left_lower_crv_22)  # disabled
group_45 = Group(Geometry=merge_44)  # disabled
group_46 = Group(group_45)  # disabled
typical_left_side_cross_section_crv_11 = RemoteSender(group_46)  # disabled

right_side_straight_bands_9 = RemoteReceiver(right_side_straight_bands)
left_side_straight_bands_6 = RemoteReceiver(left_side_straight_bands)
group_47 = Group(Geometry=merge_3)

scissor_upper_crv_curvature_1_5 = Number(Slider(0.46, range=0..1))
scissor_upper_crv_curvature_2_5 = Number(Slider(0.65, range=0..1))
scissor_upper_crv_curvature_6 = Integer(Slider(2, range=0..2))

scissor_lower_crv_curvature_2_5 = Number(Slider(0.45, range=0..1))
scissor_lower_crv_curvature_1_5 = Number(Slider(0.69, range=0..1))
scissor_lower_crv_curvature_6 = Integer(Slider(2, range=0..2))

left_side_straight_bands_7 = RemoteReceiver(left_side_straight_bands)
left_side_straight_bands_8 = RemoteReceiver(left_side_straight_bands)
group_48 = Group(Geometry=merge_4)

# ----
# Typical Floor: Right Side_Cross-Section
merge_45 = Merge(Data1=typical_right_upper_crv_23, Data2=typical_right_lower_crv_23)  # disabled
group_49 = Group(Geometry=merge_45)  # disabled
group_50 = Group(group_49)  # disabled
typical_right_side_cross_section_crv_12 = RemoteSender(group_50)  # disabled

# ----
# Typical Floor: Right Side_Cross-Section
merge_46 = Merge(Data1=typical_right_upper_crv_24, Data2=typical_right_lower_crv_24)  # disabled
group_51 = Group(Geometry=merge_46)  # disabled
group_52 = Group(group_51)  # disabled
typical_right_side_cross_section_crv_13 = RemoteSender(group_52)  # disabled

# ----
# Typical Floor: Right Side_Cross-Section
merge_47 = Merge(Data1=typical_right_upper_crv_25, Data2=typical_right_lower_crv_25)  # disabled
group_53 = Group(Geometry=merge_47)  # disabled
group_54 = Group(group_53)  # disabled
typical_right_side_cross_section_crv_14 = RemoteSender(group_54)  # disabled

scissor_upper_crv_curvature_1_6 = Number(Slider(0.67, range=0..1))
scissor_upper_crv_curvature_2_6 = Number(Slider(0.3, range=0..1))
scissor_upper_crv_curvature_7 = Integer(Slider(2, range=0..2))

scissor_lower_crv_curvature_2_6 = Number(Slider(0.53, range=0..1))
scissor_lower_crv_curvature_1_6 = Number(Slider(0.47, range=0..1))
scissor_lower_crv_curvature_7 = Integer(Slider(2, range=0..2))

scissor_upper_crv_curvature_1_7 = Number(Slider(0.67, range=0..1))
scissor_upper_crv_curvature_2_7 = Number(Slider(0.3, range=0..1))
scissor_upper_crv_curvature_8 = Integer(Slider(2, range=0..2))

cross_section_curvature_8 = Integer(Slider(1, range=0..2))
cross_section_fillet_1_8 = Number(Slider(0.28, range=0..1))
cross_section_fillet_2_8 = Number(Slider(0.26, range=0..1))

cross_section_curvature_9 = Integer(Slider(1, range=0..2))
cross_section_fillet_1_9 = Number(Slider(0.56, range=0..1))
cross_section_fillet_2_9 = Number(Slider(0.24, range=0..1))

scissor_lower_crv_curvature_2_7 = Number(Slider(0.53, range=0..1))
scissor_lower_crv_curvature_1_7 = Number(Slider(0.47, range=0..1))
scissor_lower_crv_curvature_8 = Integer(Slider(2, range=0..2))

left_side_straight_bands_9 = RemoteReceiver(left_side_straight_bands)

cross_section_curvature_10 = Integer(Slider(1, range=0..2))
cross_section_fillet_1_10 = Number(Slider(0.56, range=0..1))
cross_section_fillet_2_10 = Number(Slider(0.24, range=0..1))

# ----
# Typical Floor: Left Side_Cross-Section
merge_48 = Merge(Data1=typical_left_upper_crv_23, Data2=typical_left_lower_crv_23)  # disabled
group_55 = Group(Geometry=merge_48)  # disabled
group_56 = Group(group_55)  # disabled
typical_left_side_cross_section_crv_12 = RemoteSender(group_56)  # disabled

# ----
# Typical Floor: Left Side_Cross-Section
merge_49 = Merge(Data1=typical_left_upper_crv_24, Data2=typical_left_lower_crv_24)  # disabled
group_57 = Group(Geometry=merge_49)  # disabled
group_58 = Group(group_57)  # disabled
typical_left_side_cross_section_crv_13 = RemoteSender(group_58)  # disabled

# ----
# Typical Floor: Left Side_Cross-Section
merge_50 = Merge(Data1=typical_left_upper_crv_25, Data2=typical_left_lower_crv_25)  # disabled
group_59 = Group(Geometry=merge_50)  # disabled
group_60 = Group(group_59)  # disabled
typical_left_side_cross_section_crv_14 = RemoteSender(group_60)  # disabled

group_61 = Group(Geometry=merge_6)
group_62 = Group(Geometry=merge_8)
group_63 = Group(Geometry=typical_left_lower_crv_3)

# ----
# Typical Floor: Right Side_Cross-Section
merge_51 = Merge(Data1=typical_right_upper_crv_26, Data2=typical_right_lower_crv_26)  # disabled
group_64 = Group(Geometry=merge_51)  # disabled
group_65 = Group(group_64)  # disabled
typical_right_side_cross_section_crv_15 = RemoteSender(group_65)  # disabled

# ----
# Typical Floor: Right Side_Cross-Section
merge_52 = Merge(Data1=typical_right_upper_crv_27, Data2=typical_right_lower_crv_27)  # disabled
group_66 = Group(Geometry=merge_52)  # disabled
group_67 = Group(group_66)  # disabled
typical_right_side_cross_section_crv_16 = RemoteSender(group_67)  # disabled

scissor_upper_crv_curvature_1_8 = Number(Slider(0.67, range=0..1))
scissor_upper_crv_curvature_2_8 = Number(Slider(0.3, range=0..1))
scissor_upper_crv_curvature_9 = Integer(Slider(2, range=0..2))

right_side_straight_bands_10 = RemoteReceiver(right_side_straight_bands)

scissor_upper_crv_curvature_1_9 = Number(Slider(0.46, range=0..1))
scissor_upper_crv_curvature_2_9 = Number(Slider(0.65, range=0..1))
scissor_upper_crv_curvature_10 = Integer(Slider(2, range=0..2))

scissor_upper_crv_curvature_1_10 = Number(Slider(0.46, range=0..1))
scissor_upper_crv_curvature_2_10 = Number(Slider(0.65, range=0..1))
scissor_upper_crv_curvature_11 = Integer(Slider(2, range=0..2))

cross_section_curvature_11 = Integer(Slider(1, range=0..2))
cross_section_fillet_1_11 = Number(Slider(0.28, range=0..1))
cross_section_fillet_2_11 = Number(Slider(0.26, range=0..1))

scissor_lower_crv_curvature_2_8 = Number(Slider(0.53, range=0..1))
scissor_lower_crv_curvature_1_8 = Number(Slider(0.47, range=0..1))
scissor_lower_crv_curvature_9 = Integer(Slider(2, range=0..2))

scissor_lower_crv_curvature_2_9 = Number(Slider(0.45, range=0..1))
scissor_lower_crv_curvature_1_9 = Number(Slider(0.69, range=0..1))
scissor_lower_crv_curvature_10 = Integer(Slider(2, range=0..2))

scissor_lower_crv_curvature_2_10 = Number(Slider(0.45, range=0..1))
scissor_lower_crv_curvature_1_10 = Number(Slider(0.69, range=0..1))
scissor_lower_crv_curvature_11 = Integer(Slider(2, range=0..2))

group_68 = Group(Geometry=merge_7)

cross_section_curvature_12 = Integer(Slider(1, range=0..2))
cross_section_fillet_1_12 = Number(Slider(0.56, range=0..1))
cross_section_fillet_2_12 = Number(Slider(0.24, range=0..1))

# ----
# Typical Floor: Left Side_Cross-Section
merge_53 = Merge(Data1=typical_left_upper_crv_26, Data2=typical_left_lower_crv_26)  # disabled
group_69 = Group(Geometry=merge_53)  # disabled
group_70 = Group(group_69)  # disabled
typical_left_side_cross_section_crv_15 = RemoteSender(group_70)  # disabled

# ----
# Typical Floor: Right Side_Cross-Section
merge_54 = Merge(Data1=typical_right_upper_crv_28, Data2=typical_right_lower_crv_28)  # disabled
group_71 = Group(Geometry=merge_54)  # disabled
group_72 = Group(group_71)  # disabled
typical_right_side_cross_section_crv_17 = RemoteSender(group_72)  # disabled

# ----
# Typical Floor: Left Side_Cross-Section
merge_55 = Merge(Data1=typical_left_upper_crv_27, Data2=typical_left_lower_crv_27)  # disabled
group_73 = Group(Geometry=merge_55)  # disabled
group_74 = Group(group_73)  # disabled
typical_left_side_cross_section_crv_16 = RemoteSender(group_74)  # disabled

cross_section_curvature_13 = Integer(Slider(1, range=0..2))
cross_section_fillet_1_13 = Number(Slider(0.12, range=0..1))
cross_section_fillet_2_13 = Number(Slider(0.16, range=0..1))

group_75 = Group(Geometry=merge_9)

# ----
# Typical Floor: Left Side_Cross-Section
merge_56 = Merge(Data1=typical_left_upper_crv_28, Data2=typical_left_lower_crv_28)  # disabled
group_76 = Group(Geometry=merge_56)  # disabled
group_77 = Group(group_76)  # disabled
typical_left_side_cross_section_crv_17 = RemoteSender(group_77)  # disabled

left_side_straight_bands_10 = RemoteReceiver(left_side_straight_bands)

scissor_upper_crv_curvature_1_11 = Number(Slider(0.67, range=0..1))
scissor_upper_crv_curvature_2_11 = Number(Slider(0.3, range=0..1))
scissor_upper_crv_curvature_12 = Integer(Slider(2, range=0..2))

group_78 = Group(Geometry=merge_10)

# ----
# Typical Floor: Right Side_Cross-Section
merge_57 = Merge(Data1=typical_right_upper_crv_29, Data2=typical_right_lower_crv_29)  # disabled
group_79 = Group(Geometry=merge_57)  # disabled
group_80 = Group(group_79)  # disabled
typical_right_side_cross_section_crv_18 = RemoteSender(group_80)  # disabled

scissor_lower_crv_curvature_2_11 = Number(Slider(0.53, range=0..1))
scissor_lower_crv_curvature_1_11 = Number(Slider(0.47, range=0..1))
scissor_lower_crv_curvature_12 = Integer(Slider(2, range=0..2))

scissor_upper_crv_curvature_1_12 = Number(Slider(0.46, range=0..1))
scissor_upper_crv_curvature_2_12 = Number(Slider(0.65, range=0..1))
scissor_upper_crv_curvature_13 = Integer(Slider(2, range=0..2))

group_81 = Group(Geometry=merge_11)
group_82 = Group(Geometry=merge_12)

cross_section_curvature_14 = Integer(Slider(1, range=0..2))
cross_section_fillet_1_14 = Number(Slider(0.56, range=0..1))
cross_section_fillet_2_14 = Number(Slider(0.24, range=0..1))

scissor_lower_crv_curvature_2_12 = Number(Slider(0.45, range=0..1))
scissor_lower_crv_curvature_1_12 = Number(Slider(0.69, range=0..1))
scissor_lower_crv_curvature_13 = Integer(Slider(2, range=0..2))

number_slider_22 = Slider(0.49, range=0..1)  # disabled
number_slider_23 = Slider(0.53, range=0..1)  # disabled
number_slider_24 = Slider(1, range=0..2)  # disabled
cross_section_curvature_15 = Integer(number_slider_24)  # disabled
cross_section_fillet_1_15 = Number(number_slider_22)  # disabled
cross_section_fillet_2_15 = Number(number_slider_23)  # disabled

# ----
# Typical Floor: Left Side_Cross-Section
merge_58 = Merge(Data1=typical_left_upper_crv_29, Data2=typical_left_lower_crv_29)  # disabled
group_83 = Group(Geometry=merge_58)  # disabled
group_84 = Group(group_83)  # disabled
typical_left_side_cross_section_crv_18 = RemoteSender(group_84)  # disabled

group_85 = Group(Geometry=merge_13)
group_86 = Group(Geometry=merge_14)

# ----
# Typical Floor: Right Side_Cross-Section
merge_59 = Merge(Data1=typical_right_upper_crv_30, Data2=typical_right_lower_crv_30)  # disabled
group_87 = Group(Geometry=merge_59)  # disabled
group_88 = Group(group_87)  # disabled
typical_right_side_cross_section_crv_19 = RemoteSender(group_88)  # disabled

scissor_upper_crv_curvature_1_13 = Number(Slider(0.62, range=0..1))
scissor_upper_crv_curvature_2_13 = Number(Slider(0.76, range=0..1))
scissor_upper_crv_curvature_14 = Integer(Slider(2, range=0..2))

scissor_lower_crv_curvature_2_13 = Number(Slider(1, range=0..1))
scissor_lower_crv_curvature_1_13 = Number(Slider(0.52, range=0..1))
scissor_lower_crv_curvature_14 = Integer(Slider(2, range=0..2))

cross_section_curvature_16 = Integer(Slider(1, range=0..2))
cross_section_fillet_1_16 = Number(Slider(0.29, range=0..1))
cross_section_fillet_2_16 = Number(Slider(0.15, range=0..1))

# ----
# Typical Floor: Left Side_Cross-Section
merge_60 = Merge(Data1=typical_left_upper_crv_30, Data2=typical_left_lower_crv_30)  # disabled
group_89 = Group(Geometry=merge_60)  # disabled
group_90 = Group(group_89)  # disabled
typical_left_side_cross_section_crv_19 = RemoteSender(group_90)  # disabled

right_side_straight_bands_11 = RemoteReceiver(right_side_straight_bands)  # disabled

number_slider_25 = Slider(0.67, range=0..1)  # disabled
number_slider_26 = Slider(0.47, range=0..1)  # disabled
number_slider_27 = Slider(1, range=0..2)  # disabled
cross_section_curvature_17 = Integer(number_slider_27)  # disabled
cross_section_fillet_1_17 = Number(number_slider_25)  # disabled
cross_section_fillet_2_17 = Number(number_slider_26)  # disabled

scissor_upper_crv_curvature_1_14 = Number(Slider(0.46, range=0..1))
scissor_upper_crv_curvature_2_14 = Number(Slider(0.65, range=0..1))
scissor_upper_crv_curvature_15 = Integer(Slider(2, range=0..2))

scissor_lower_crv_curvature_2_14 = Number(Slider(0.45, range=0..1))
scissor_lower_crv_curvature_1_14 = Number(Slider(0.69, range=0..1))
scissor_lower_crv_curvature_15 = Integer(Slider(2, range=0..2))

group_91 = Group(Geometry=merge_15)
group_92 = Group(Geometry=merge_16)
group_93 = Group(Geometry=merge_17)

number_slider_28 = Slider(0.63, range=0..1)  # disabled
number_slider_29 = Slider(0.49, range=0..1)  # disabled
number_slider_30 = Slider(2, range=0..2)  # disabled
scissor_upper_crv_curvature_1_15 = Number(number_slider_28)  # disabled
scissor_upper_crv_curvature_2_15 = Number(number_slider_29)  # disabled
scissor_upper_crv_curvature_16 = Integer(number_slider_30)  # disabled

number_slider_31 = Slider(0.53, range=0..1)  # disabled
number_slider_32 = Slider(2, range=0..2)  # disabled
number_slider_33 = Slider(0.47, range=0..1)  # disabled
scissor_lower_crv_curvature_2_15 = Number(number_slider_31)  # disabled
scissor_lower_crv_curvature_1_15 = Number(number_slider_33)  # disabled
scissor_lower_crv_curvature_16 = Integer(number_slider_32)  # disabled

left_side_straight_bands_11 = RemoteReceiver(left_side_straight_bands)  # disabled

scissor_upper_crv_curvature_1_16 = Number(Slider(0.52, range=0..1))
scissor_upper_crv_curvature_2_16 = Number(Slider(1, range=0..1))
scissor_upper_crv_curvature_17 = Integer(Slider(2, range=0..2))

group_94 = Group(Geometry=merge_18)
group_95 = Group(Geometry=merge_19)
group_96 = Group(Geometry=merge_20)

scissor_lower_crv_curvature_2_16 = Number(Slider(0.96, range=0..1))
scissor_lower_crv_curvature_1_16 = Number(Slider(0.57, range=0..1))
scissor_lower_crv_curvature_17 = Integer(Slider(2, range=0..2))

right_side_straight_bands_12 = RemoteReceiver(right_side_straight_bands)  # disabled

number_slider_34 = Slider(0.75, range=0..1)  # disabled
number_slider_35 = Slider(0.99, range=0..1)  # disabled
number_slider_36 = Slider(2, range=0..2)  # disabled
scissor_upper_crv_curvature_1_17 = Number(number_slider_34)  # disabled
scissor_upper_crv_curvature_2_17 = Number(number_slider_35)  # disabled
scissor_upper_crv_curvature_18 = Integer(number_slider_36)  # disabled

number_slider_37 = Slider(0.83, range=0..1)  # disabled
number_slider_38 = Slider(2, range=0..2)  # disabled
number_slider_39 = Slider(0.92, range=0..1)  # disabled
scissor_lower_crv_curvature_2_17 = Number(number_slider_37)  # disabled
scissor_lower_crv_curvature_1_17 = Number(number_slider_39)  # disabled
scissor_lower_crv_curvature_18 = Integer(number_slider_38)  # disabled

right_side_straight_bands_13 = RemoteReceiver(right_side_straight_bands)  # disabled

number_slider_40 = Slider(0.26, range=0..1)  # disabled
number_slider_41 = Slider(0.28, range=0..1)  # disabled
number_slider_42 = Slider(1, range=0..2)  # disabled
cross_section_curvature_18 = Integer(number_slider_42)  # disabled
cross_section_fillet_1_18 = Number(number_slider_41)  # disabled
cross_section_fillet_2_18 = Number(number_slider_40)  # disabled

right_side_straight_bands_14 = RemoteReceiver(right_side_straight_bands)  # disabled
right_side_straight_bands_15 = RemoteReceiver(right_side_straight_bands)

number_slider_43 = Slider(0.28, range=0..1)  # disabled
number_slider_44 = Slider(0.26, range=0..1)  # disabled
number_slider_45 = Slider(1, range=0..2)  # disabled
cross_section_curvature_19 = Integer(number_slider_45)  # disabled
cross_section_fillet_1_19 = Number(number_slider_43)  # disabled
cross_section_fillet_2_19 = Number(number_slider_44)  # disabled

left_side_straight_bands_12 = RemoteReceiver(left_side_straight_bands)  # disabled
left_side_straight_bands_13 = RemoteReceiver(left_side_straight_bands)  # disabled

number_slider_46 = Slider(0.3, range=0..1)  # disabled
number_slider_47 = Slider(2, range=0..2)  # disabled
number_slider_48 = Slider(0.67, range=0..1)  # disabled
scissor_upper_crv_curvature_1_18 = Number(number_slider_48)  # disabled
scissor_upper_crv_curvature_2_18 = Number(number_slider_46)  # disabled
scissor_upper_crv_curvature_19 = Integer(number_slider_47)  # disabled

left_side_straight_bands_14 = RemoteReceiver(left_side_straight_bands)  # disabled
left_side_straight_bands_15 = RemoteReceiver(left_side_straight_bands)

number_slider_49 = Slider(0.47, range=0..1)  # disabled
number_slider_50 = Slider(0.53, range=0..1)  # disabled
number_slider_51 = Slider(2, range=0..2)  # disabled
scissor_lower_crv_curvature_2_18 = Number(number_slider_50)  # disabled
scissor_lower_crv_curvature_1_18 = Number(number_slider_49)  # disabled
scissor_lower_crv_curvature_19 = Integer(number_slider_51)  # disabled

number_slider_52 = Slider(0.56, range=0..1)  # disabled
number_slider_53 = Slider(0.24, range=0..1)  # disabled
number_slider_54 = Slider(1, range=0..2)  # disabled
cross_section_curvature_20 = Integer(number_slider_54)  # disabled
cross_section_fillet_1_20 = Number(number_slider_52)  # disabled
cross_section_fillet_2_20 = Number(number_slider_53)  # disabled

right_side_straight_bands_16 = RemoteReceiver(right_side_straight_bands)  # disabled

number_slider_55 = Slider(0.62, range=0..1)  # disabled
number_slider_56 = Slider(2, range=0..2)  # disabled
number_slider_57 = Slider(0.6, range=0..1)  # disabled
scissor_upper_crv_curvature_1_19 = Number(number_slider_57)  # disabled
scissor_upper_crv_curvature_2_19 = Number(number_slider_55)  # disabled
scissor_upper_crv_curvature_20 = Integer(number_slider_56)  # disabled

right_side_straight_bands_17 = RemoteReceiver(right_side_straight_bands)  # disabled

number_slider_58 = Slider(0.82, range=0..1)  # disabled
number_slider_59 = Slider(2, range=0..2)  # disabled
number_slider_60 = Slider(0.49, range=0..1)  # disabled
scissor_lower_crv_curvature_2_19 = Number(number_slider_58)  # disabled
scissor_lower_crv_curvature_1_19 = Number(number_slider_60)  # disabled
scissor_lower_crv_curvature_20 = Integer(number_slider_59)  # disabled

right_side_straight_bands_18 = RemoteReceiver(right_side_straight_bands)  # disabled

number_slider_61 = Slider(0.28, range=0..1)  # disabled
number_slider_62 = Slider(0.26, range=0..1)  # disabled
number_slider_63 = Slider(1, range=0..2)  # disabled
cross_section_curvature_21 = Integer(number_slider_63)  # disabled
cross_section_fillet_1_21 = Number(number_slider_61)  # disabled
cross_section_fillet_2_21 = Number(number_slider_62)  # disabled

number_slider_64 = Slider(0.26, range=0..1)  # disabled
number_slider_65 = Slider(0.28, range=0..1)  # disabled
number_slider_66 = Slider(1, range=0..2)  # disabled
cross_section_curvature_22 = Integer(number_slider_66)  # disabled
cross_section_fillet_1_22 = Number(number_slider_65)  # disabled
cross_section_fillet_2_22 = Number(number_slider_64)  # disabled

group_97 = Group(Geometry=merge_31)
right_side_straight_bands_19 = RemoteReceiver(right_side_straight_bands)  # disabled
right_side_straight_bands_20 = RemoteReceiver(right_side_straight_bands)
left_side_straight_bands_16 = RemoteReceiver(left_side_straight_bands)  # disabled

number_slider_67 = Slider(0.46, range=0..1)  # disabled
number_slider_68 = Slider(0.65, range=0..1)  # disabled
number_slider_69 = Slider(2, range=0..2)  # disabled
scissor_upper_crv_curvature_1_20 = Number(number_slider_67)  # disabled
scissor_upper_crv_curvature_2_20 = Number(number_slider_68)  # disabled
scissor_upper_crv_curvature_21 = Integer(number_slider_69)  # disabled

number_slider_70 = Slider(0.45, range=0..1)  # disabled
number_slider_71 = Slider(2, range=0..2)  # disabled
number_slider_72 = Slider(0.69, range=0..1)  # disabled
scissor_lower_crv_curvature_2_20 = Number(number_slider_70)  # disabled
scissor_lower_crv_curvature_1_20 = Number(number_slider_72)  # disabled
scissor_lower_crv_curvature_21 = Integer(number_slider_71)  # disabled

group_98 = Group(Geometry=merge_33)
left_side_straight_bands_17 = RemoteReceiver(left_side_straight_bands)  # disabled
left_side_straight_bands_18 = RemoteReceiver(left_side_straight_bands)  # disabled
left_side_straight_bands_19 = RemoteReceiver(left_side_straight_bands)

number_slider_73 = Slider(0.67, range=0..1)  # disabled
number_slider_74 = Slider(0.3, range=0..1)  # disabled
number_slider_75 = Slider(2, range=0..2)  # disabled
scissor_upper_crv_curvature_1_21 = Number(number_slider_73)  # disabled
scissor_upper_crv_curvature_2_21 = Number(number_slider_74)  # disabled
scissor_upper_crv_curvature_22 = Integer(number_slider_75)  # disabled

number_slider_76 = Slider(0.53, range=0..1)  # disabled
number_slider_77 = Slider(2, range=0..2)  # disabled
number_slider_78 = Slider(0.47, range=0..1)  # disabled
scissor_lower_crv_curvature_2_21 = Number(number_slider_76)  # disabled
scissor_lower_crv_curvature_1_21 = Number(number_slider_78)  # disabled
scissor_lower_crv_curvature_22 = Integer(number_slider_77)  # disabled

number_slider_79 = Slider(0.67, range=0..1)  # disabled
number_slider_80 = Slider(0.3, range=0..1)  # disabled
number_slider_81 = Slider(2, range=0..2)  # disabled
scissor_upper_crv_curvature_1_22 = Number(number_slider_79)  # disabled
scissor_upper_crv_curvature_2_22 = Number(number_slider_80)  # disabled
scissor_upper_crv_curvature_23 = Integer(number_slider_81)  # disabled

number_slider_82 = Slider(0.26, range=0..1)  # disabled
number_slider_83 = Slider(0.28, range=0..1)  # disabled
number_slider_84 = Slider(1, range=0..2)  # disabled
cross_section_curvature_23 = Integer(number_slider_84)  # disabled
cross_section_fillet_1_23 = Number(number_slider_83)  # disabled
cross_section_fillet_2_23 = Number(number_slider_82)  # disabled

number_slider_85 = Slider(0.24, range=0..1)  # disabled
number_slider_86 = Slider(0.56, range=0..1)  # disabled
number_slider_87 = Slider(1, range=0..2)  # disabled
cross_section_curvature_24 = Integer(number_slider_87)  # disabled
cross_section_fillet_1_24 = Number(number_slider_86)  # disabled
cross_section_fillet_2_24 = Number(number_slider_85)  # disabled

number_slider_88 = Slider(0.47, range=0..1)  # disabled
number_slider_89 = Slider(0.53, range=0..1)  # disabled
number_slider_90 = Slider(2, range=0..2)  # disabled
scissor_lower_crv_curvature_2_22 = Number(number_slider_89)  # disabled
scissor_lower_crv_curvature_1_22 = Number(number_slider_88)  # disabled
scissor_lower_crv_curvature_23 = Integer(number_slider_90)  # disabled

left_side_straight_bands_20 = RemoteReceiver(left_side_straight_bands)  # disabled
left_side_straight_bands_21 = RemoteReceiver(left_side_straight_bands)

number_slider_91 = Slider(0.56, range=0..1)  # disabled
number_slider_92 = Slider(0.24, range=0..1)  # disabled
number_slider_93 = Slider(1, range=0..2)  # disabled
cross_section_curvature_25 = Integer(number_slider_93)  # disabled
cross_section_fillet_1_25 = Number(number_slider_91)  # disabled
cross_section_fillet_2_25 = Number(number_slider_92)  # disabled

number_slider_94 = Slider(0.67, range=0..1)  # disabled
number_slider_95 = Slider(0.3, range=0..1)  # disabled
number_slider_96 = Slider(2, range=0..2)  # disabled
scissor_upper_crv_curvature_1_23 = Number(number_slider_94)  # disabled
scissor_upper_crv_curvature_2_23 = Number(number_slider_95)  # disabled
scissor_upper_crv_curvature_24 = Integer(number_slider_96)  # disabled

right_side_straight_bands_21 = RemoteReceiver(right_side_straight_bands)  # disabled

number_slider_97 = Slider(0.65, range=0..1)  # disabled
number_slider_98 = Slider(2, range=0..2)  # disabled
number_slider_99 = Slider(0.46, range=0..1)  # disabled
scissor_upper_crv_curvature_1_24 = Number(number_slider_99)  # disabled
scissor_upper_crv_curvature_2_24 = Number(number_slider_97)  # disabled
scissor_upper_crv_curvature_25 = Integer(number_slider_98)  # disabled

number_slider_100 = Slider(0.65, range=0..1)  # disabled
number_slider_101 = Slider(2, range=0..2)  # disabled
number_slider_102 = Slider(0.46, range=0..1)  # disabled
scissor_upper_crv_curvature_1_25 = Number(number_slider_102)  # disabled
scissor_upper_crv_curvature_2_25 = Number(number_slider_100)  # disabled
scissor_upper_crv_curvature_26 = Integer(number_slider_101)  # disabled

number_slider_103 = Slider(0.28, range=0..1)  # disabled
number_slider_104 = Slider(0.26, range=0..1)  # disabled
number_slider_105 = Slider(1, range=0..2)  # disabled
cross_section_curvature_26 = Integer(number_slider_105)  # disabled
cross_section_fillet_1_26 = Number(number_slider_103)  # disabled
cross_section_fillet_2_26 = Number(number_slider_104)  # disabled

number_slider_106 = Slider(0.47, range=0..1)  # disabled
number_slider_107 = Slider(0.53, range=0..1)  # disabled
number_slider_108 = Slider(2, range=0..2)  # disabled
scissor_lower_crv_curvature_2_23 = Number(number_slider_107)  # disabled
scissor_lower_crv_curvature_1_23 = Number(number_slider_106)  # disabled
scissor_lower_crv_curvature_24 = Integer(number_slider_108)  # disabled

number_slider_109 = Slider(0.45, range=0..1)  # disabled
number_slider_110 = Slider(2, range=0..2)  # disabled
number_slider_111 = Slider(0.69, range=0..1)  # disabled
scissor_lower_crv_curvature_2_24 = Number(number_slider_109)  # disabled
scissor_lower_crv_curvature_1_24 = Number(number_slider_111)  # disabled
scissor_lower_crv_curvature_25 = Integer(number_slider_110)  # disabled

number_slider_112 = Slider(0.45, range=0..1)  # disabled
number_slider_113 = Slider(2, range=0..2)  # disabled
number_slider_114 = Slider(0.69, range=0..1)  # disabled
scissor_lower_crv_curvature_2_25 = Number(number_slider_112)  # disabled
scissor_lower_crv_curvature_1_25 = Number(number_slider_114)  # disabled
scissor_lower_crv_curvature_26 = Integer(number_slider_113)  # disabled

number_slider_115 = Slider(0.56, range=0..1)  # disabled
number_slider_116 = Slider(0.24, range=0..1)  # disabled
number_slider_117 = Slider(1, range=0..2)  # disabled
cross_section_curvature_27 = Integer(number_slider_117)  # disabled
cross_section_fillet_1_27 = Number(number_slider_115)  # disabled
cross_section_fillet_2_27 = Number(number_slider_116)  # disabled

number_slider_118 = Slider(0.12, range=0..1)  # disabled
number_slider_119 = Slider(0.16, range=0..1)  # disabled
number_slider_120 = Slider(1, range=0..2)  # disabled
cross_section_curvature_28 = Integer(number_slider_120)  # disabled
cross_section_fillet_1_28 = Number(number_slider_118)  # disabled
cross_section_fillet_2_28 = Number(number_slider_119)  # disabled

left_side_straight_bands_22 = RemoteReceiver(left_side_straight_bands)  # disabled

number_slider_121 = Slider(0.3, range=0..1)  # disabled
number_slider_122 = Slider(2, range=0..2)  # disabled
number_slider_123 = Slider(0.67, range=0..1)  # disabled
scissor_upper_crv_curvature_1_26 = Number(number_slider_123)  # disabled
scissor_upper_crv_curvature_2_26 = Number(number_slider_121)  # disabled
scissor_upper_crv_curvature_27 = Integer(number_slider_122)  # disabled

number_slider_124 = Slider(0.53, range=0..1)  # disabled
number_slider_125 = Slider(2, range=0..2)  # disabled
number_slider_126 = Slider(0.47, range=0..1)  # disabled
scissor_lower_crv_curvature_2_26 = Number(number_slider_124)  # disabled
scissor_lower_crv_curvature_1_26 = Number(number_slider_126)  # disabled
scissor_lower_crv_curvature_27 = Integer(number_slider_125)  # disabled

number_slider_127 = Slider(0.65, range=0..1)  # disabled
number_slider_128 = Slider(2, range=0..2)  # disabled
number_slider_129 = Slider(0.46, range=0..1)  # disabled
scissor_upper_crv_curvature_1_27 = Number(number_slider_129)  # disabled
scissor_upper_crv_curvature_2_27 = Number(number_slider_127)  # disabled
scissor_upper_crv_curvature_28 = Integer(number_slider_128)  # disabled

number_slider_130 = Slider(0.24, range=0..1)  # disabled
number_slider_131 = Slider(0.56, range=0..1)  # disabled
number_slider_132 = Slider(1, range=0..2)  # disabled
cross_section_curvature_29 = Integer(number_slider_132)  # disabled
cross_section_fillet_1_29 = Number(number_slider_131)  # disabled
cross_section_fillet_2_29 = Number(number_slider_130)  # disabled

number_slider_133 = Slider(0.45, range=0..1)  # disabled
number_slider_134 = Slider(2, range=0..2)  # disabled
number_slider_135 = Slider(0.69, range=0..1)  # disabled
scissor_lower_crv_curvature_2_27 = Number(number_slider_133)  # disabled
scissor_lower_crv_curvature_1_27 = Number(number_slider_135)  # disabled
scissor_lower_crv_curvature_28 = Integer(number_slider_134)  # disabled

number_slider_136 = Slider(0.62, range=0..1)  # disabled
number_slider_137 = Slider(0.76, range=0..1)  # disabled
number_slider_138 = Slider(2, range=0..2)  # disabled
scissor_upper_crv_curvature_1_28 = Number(number_slider_136)  # disabled
scissor_upper_crv_curvature_2_28 = Number(number_slider_137)  # disabled
scissor_upper_crv_curvature_29 = Integer(number_slider_138)  # disabled

number_slider_139 = Slider(1, range=0..1)  # disabled
number_slider_140 = Slider(2, range=0..2)  # disabled
number_slider_141 = Slider(0.52, range=0..1)  # disabled
scissor_lower_crv_curvature_2_28 = Number(number_slider_139)  # disabled
scissor_lower_crv_curvature_1_28 = Number(number_slider_141)  # disabled
scissor_lower_crv_curvature_29 = Integer(number_slider_140)  # disabled

number_slider_142 = Slider(0.15, range=0..1)  # disabled
number_slider_143 = Slider(0.29, range=0..1)  # disabled
number_slider_144 = Slider(1, range=0..2)  # disabled
cross_section_curvature_30 = Integer(number_slider_144)  # disabled
cross_section_fillet_1_30 = Number(number_slider_143)  # disabled
cross_section_fillet_2_30 = Number(number_slider_142)  # disabled

left_side_straight_bands_23 = RemoteReceiver(left_side_straight_bands)

number_slider_145 = Slider(0.65, range=0..1)  # disabled
number_slider_146 = Slider(2, range=0..2)  # disabled
number_slider_147 = Slider(0.46, range=0..1)  # disabled
scissor_upper_crv_curvature_1_29 = Number(number_slider_147)  # disabled
scissor_upper_crv_curvature_2_29 = Number(number_slider_145)  # disabled
scissor_upper_crv_curvature_30 = Integer(number_slider_146)  # disabled

number_slider_148 = Slider(0.69, range=0..1)  # disabled
number_slider_149 = Slider(0.45, range=0..1)  # disabled
number_slider_150 = Slider(2, range=0..2)  # disabled
scissor_lower_crv_curvature_2_29 = Number(number_slider_149)  # disabled
scissor_lower_crv_curvature_1_29 = Number(number_slider_148)  # disabled
scissor_lower_crv_curvature_30 = Integer(number_slider_150)  # disabled

number_slider_151 = Slider(1, range=0..1)  # disabled
number_slider_152 = Slider(2, range=0..2)  # disabled
number_slider_153 = Slider(0.52, range=0..1)  # disabled
scissor_upper_crv_curvature_1_30 = Number(number_slider_153)  # disabled
scissor_upper_crv_curvature_2_30 = Number(number_slider_151)  # disabled
scissor_upper_crv_curvature_31 = Integer(number_slider_152)  # disabled

number_slider_154 = Slider(0.96, range=0..1)  # disabled
number_slider_155 = Slider(2, range=0..2)  # disabled
number_slider_156 = Slider(0.57, range=0..1)  # disabled
scissor_lower_crv_curvature_2_30 = Number(number_slider_154)  # disabled
scissor_lower_crv_curvature_1_30 = Number(number_slider_156)  # disabled
scissor_lower_crv_curvature_31 = Integer(number_slider_155)  # disabled

right_side_straight_bands_22 = RemoteReceiver(right_side_straight_bands)  # disabled
left_side_straight_bands_24 = RemoteReceiver(left_side_straight_bands)  # disabled
group_99 = Group(group_35)
right_side_straight_bands_23 = RemoteReceiver(right_side_straight_bands)  # disabled
group_100 = Group(group_42)
left_side_straight_bands_25 = RemoteReceiver(left_side_straight_bands)  # disabled
group_101 = Group(group_47)
left_side_straight_bands_26 = RemoteReceiver(left_side_straight_bands)  # disabled
group_102 = Group(group_48)
group_103 = Group(group_61)
group_104 = Group(group_63)
group_105 = Group(group_62)
group_106 = Group(group_68)
group_107 = Group(group_75)
group_108 = Group(group_78)
group_109 = Group(group_81)
group_110 = Group(group_82)
left_side_straight_bands_27 = RemoteReceiver(left_side_straight_bands)  # disabled
group_111 = Group(group_85)
group_112 = Group(group_86)
group_113 = Group(group_91)
group_114 = Group(group_92)
group_115 = Group(group_93)
group_116 = Group(group_94)
group_117 = Group(group_95)
group_118 = Group(group_96)
balcony_side_additional_cross_setional_c = Curve(<curve referenced from the Rhino model>)  # "Balcony_Side_Additional_Cross-Setional_Crv"
typical_right_side_cross_section_crv_20 = RemoteSender(group_99)
group_119 = Group(group_97)
typical_left_side_cross_section_crv_20 = RemoteSender(group_100)
typical_right_side_cross_section_crv_21 = RemoteSender(group_101)
group_120 = Group(group_98)
balcony_side_additional_cross_setional_c_2 = Curve(<curve referenced from the Rhino model>)  # "Balcony_Side_Additional_Cross-Setional_Crv"
typical_left_side_cross_section_crv_21 = RemoteSender(group_102)
balcony_side_additional_cross_setional_c_3 = Curve(<curve referenced from the Rhino model>)  # "Balcony_Side_Additional_Cross-Setional_Crv"
typical_right_side_cross_section_crv_22 = RemoteSender(group_103)
typical_right_side_cross_section_crv_23 = RemoteSender(group_105)
balcony_side_additional_cross_setional_c_4 = Curve(<curve referenced from the Rhino model>)  # "Balcony_Side_Additional_Cross-Setional_Crv"
typical_left_side_cross_section_crv_22 = RemoteSender(group_104)
typical_right_side_cross_section_crv_24 = RemoteSender(group_107)
typical_left_side_cross_section_crv_23 = RemoteSender(group_106)
balcony_side_additional_cross_setional_c_5 = Curve(<curve referenced from the Rhino model>)  # "Balcony_Side_Additional_Cross-Setional_Crv"
balcony_side_additional_cross_setional_c_6 = Curve(<curve referenced from the Rhino model>)  # "Balcony_Side_Additional_Cross-Setional_Crv"
typical_right_side_cross_section_crv_25 = RemoteSender(group_109)
typical_right_side_cross_section_crv_26 = RemoteSender(group_110)
typical_left_side_cross_section_crv_24 = RemoteSender(group_108)
typical_left_side_cross_section_crv_25 = RemoteSender(group_111)
typical_left_side_cross_section_crv_26 = RemoteSender(group_112)
balcony_side_additional_cross_setional_c_7 = Curve(<curve referenced from the Rhino model>)  # "Balcony_Side_Additional_Cross-Setional_Crv"
typical_right_side_cross_section_crv_27 = RemoteSender(group_113)
typical_right_side_cross_section_crv_28 = RemoteSender(group_114)
typical_right_side_cross_section_crv_29 = RemoteSender(group_115)
balcony_side_additional_cross_setional_c_8 = Curve(<curve referenced from the Rhino model>)  # "Balcony_Side_Additional_Cross-Setional_Crv"
typical_left_side_cross_section_crv_27 = RemoteSender(group_116)
typical_left_side_cross_section_crv_28 = RemoteSender(group_117)
typical_left_side_cross_section_crv_29 = RemoteSender(group_118)
balcony_side_additional_cross_setional_c_9 = Curve(<curve referenced from the Rhino model>)  # "Balcony_Side_Additional_Cross-Setional_Crv"; disabled
typical_right_side_cross_section_crv_30 = RemoteSender(group_119)
typical_left_side_cross_section_crv_30 = RemoteSender(group_120)
balcony_side_additional_cross_setional_c_10 = Curve(<curve referenced from the Rhino model>)  # "Balcony_Side_Additional_Cross-Setional_Crv"; disabled
balcony_side_additional_cross_setional_c_11 = Curve(<curve referenced from the Rhino model>)  # "Balcony_Side_Additional_Cross-Setional_Crv"; disabled
balcony_side_additional_cross_setional_c_12 = Curve(<curve referenced from the Rhino model>)  # "Balcony_Side_Additional_Cross-Setional_Crv"; disabled
balcony_side_additional_cross_setional_c_13 = Curve(<curve referenced from the Rhino model>)  # "Balcony_Side_Additional_Cross-Setional_Crv"; disabled
balcony_side_additional_cross_setional_c_14 = Curve(<curve referenced from the Rhino model>)  # "Balcony_Side_Additional_Cross-Setional_Crv"; disabled
balcony_side_additional_cross_setional_c_15 = Curve(<curve referenced from the Rhino model>)  # "Balcony_Side_Additional_Cross-Setional_Crv"; disabled
balcony_side_additional_cross_setional_c_16 = Curve(<curve referenced from the Rhino model>)  # "Balcony_Side_Additional_Cross-Setional_Crv"; disabled

# ----
# Ground Floor Glass Division
panel_33 = Panel("""1590
1585
1300
1300
1400
1300
1300
1400
1300
1300
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""")
gap_b_w_mullion_2 = RemoteReceiver(gap_b_w_mullion)
addition = Addition(A=panel_33, B=gap_b_w_mullion_2)
mass_addition = MassAddition(Input=addition)  # -> Result, PartialResults
g_f_glass_division_parameters = RemoteSender(mass_addition.PartialResults)

panel_34 = Panel("0")  # disabled
panel_35 = Panel("1800")  # disabled

construct_point = ConstructPoint(XCoordinate=0, YCoordinate=0, ZCoordinate=0)
xy_plane = XYPlane(Origin=construct_point)

construct_point_2 = ConstructPoint(XCoordinate=0, YCoordinate=0, ZCoordinate=0)
xy_plane_2 = XYPlane(Origin=construct_point_2)

construct_point_3 = ConstructPoint(XCoordinate=0, YCoordinate=0, ZCoordinate=0)
xy_plane_3 = XYPlane(Origin=construct_point_3)

construct_point_4 = ConstructPoint(XCoordinate=0, YCoordinate=0, ZCoordinate=0)  # disabled
xy_plane_4 = XYPlane(Origin=construct_point_4)  # disabled

construct_point_5 = ConstructPoint(XCoordinate=0, YCoordinate=0, ZCoordinate=0)  # disabled
xy_plane_5 = XYPlane(Origin=construct_point_5)  # disabled

construct_point_6 = ConstructPoint(XCoordinate=0, YCoordinate=0, ZCoordinate=0)  # disabled
xy_plane_6 = XYPlane(Origin=construct_point_6)  # disabled

opennest = OpenNest(Spacing=1, Placement=1, Tolerance=0.1, Rotations=4, Iterations=1, Seed=1, Reset=True, Run=False)  # -> Sheets, Geo, ID, Transform, IDS; disabled

# ----
# Typical Floor Glass Division
panel_36 = Panel("""1590
1585
1300
1300
1400
1300
1300
1400
1300
1300
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""")
gap_b_w_mullion_3 = RemoteReceiver(gap_b_w_mullion)
addition_2 = Addition(A=panel_36, B=gap_b_w_mullion_3)
mass_addition_2 = MassAddition(Input=addition_2)  # -> Result, PartialResults
typical_floor_glass_division_parameters = RemoteSender(mass_addition_2.PartialResults)

# ----
# ADD Floor Glass Division
panel_37 = Panel("""1590
1585
1300
1300
1400
1300
1300
1400
1300
1300
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""")
gap_b_w_mullion_4 = RemoteReceiver(gap_b_w_mullion)
addition_3 = Addition(A=panel_37, B=gap_b_w_mullion_4)
mass_addition_3 = MassAddition(Input=addition_3)  # -> Result, PartialResults
add_floor_glass_division_pareametrs = RemoteSender(mass_addition_3.PartialResults)

# ----
# Rear Elevation Glass Division
panel_38 = Panel("""406
1300
1400
1300
1300
1400
1300
1300
1400
1300
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""")
gap_b_w_mullion_5 = RemoteReceiver(gap_b_w_mullion)
addition_4 = Addition(A=panel_38, B=gap_b_w_mullion_5)
mass_addition_4 = MassAddition(Input=addition_4)  # -> Result, PartialResults
rear_elevation_glass_division_pareametrs = RemoteSender(mass_addition_4.PartialResults)

panel_39 = Panel("""0
4""")

material = MaterialShiny(
    Colour=ColourSwatch(SwatchColor=RGB(187, 189, 255)),
    Reflection=Slider(0.3, range=0..1),
    Smoothness=Slider(0.1, range=0..1))  # -> out, Mat; inputs Colour: Color, Reflection: Double, Smoothness: Double
# ---------- material: C# usings ----------
using System.Drawing;
# ---------- material: C# ----------
    Reflection = Math.Min(Math.Max(Reflection, 0), 1);
    Smoothness = Math.Min(Math.Max(Smoothness, 0), 1);
    Rhino.DocObjects.Material material = new  Rhino.DocObjects.Material();
    //material.SetBitmapTexture(fileName);
    material.ReflectionColor = Colour;
    material.DiffuseColor = Colour;
    material.AmbientColor = System.Drawing.Color.Black;
    material.EmissionColor = System.Drawing.Color.Black;
    material.Reflectivity = Reflection;
    material.ReflectionGlossiness = Smoothness;

    var renderMaterial = Rhino.Render.RenderMaterial.CreateBasicMaterial(material);
    Mat = new GH_Material(renderMaterial);
# ---------- end material ----------
preview = CustomPreview(Material=material.Mat)

honeycomb_sheet_depth_2 = RemoteReceiver(honeycomb_sheet_depth)
honeycomb_sheet_colour_2 = RemoteReceiver(honeycomb_sheet_colour)
silicone_colour_2 = RemoteReceiver(silicone_colour)

panel_40 = Panel("""0
1200
5100
8500
12100
15700
19300
22950
26600
30250
33900
37550
41200
44850
48800
52900
56550
58550
62775
63975""")
construct_point_7 = ConstructPoint(XCoordinate=0, YCoordinate=0, ZCoordinate=panel_40)
point_list = PointList(Points=construct_point_7)
floor_lvl_s = RemoteSender(construct_point_7)

floor_lvl_s_2 = RemoteReceiver(floor_lvl_s)
list_item = ListItem(List=floor_lvl_s_2, Index="19", Wrap=True)

swimming_floor_crv = Curve(<curve referenced from the Rhino model>)
floor_lvl_s_3 = RemoteReceiver(floor_lvl_s)
subtraction = Subtraction(A="19", B="17")
list_item_2 = ListItem(List=floor_lvl_s_3, Index="17", Wrap=True)
series = Series(Start=expr("x+1", "17"), Step=1, Count=expr("x-1", subtraction))
orient = Orient(Geometry=swimming_floor_crv, Source=PlaneXY(0, 0, 0), Target=list_item_2)  # -> Geometry, Transform
swimming_floor_crv_at_lvl = RemoteSender(orient.Geometry)

add_floor_crv = Curve(<curve referenced from the Rhino model>)
floor_lvl_s_4 = RemoteReceiver(floor_lvl_s)
list_item_3 = ListItem(List=floor_lvl_s_4, Index="14", Wrap=True)
subtraction_2 = Subtraction(A="17", B="14")
series_2 = Series(Start=expr("x+1", "14"), Step=1, Count=subtraction_2)
orient_2 = Orient(Geometry=add_floor_crv, Source=PlaneXY(0, 0, 0), Target=list_item_3)  # -> Geometry, Transform
add_floor_crv_at_lvl = RemoteSender(orient_2.Geometry)

floor_lvl_s_5 = RemoteReceiver(floor_lvl_s)
typical_floor_crv = Curve(<curve referenced from the Rhino model>)
subtraction_3 = Subtraction(A="14", B="5")
list_item_4 = ListItem(List=floor_lvl_s_5, Index="5", Wrap=True)
series_3 = Series(Start="5", Step=1, Count=expr("x+1", subtraction_3))
orient_3 = Orient(Geometry=typical_floor_crv, Source=PlaneXY(0, 0, 0), Target=list_item_4)  # -> Geometry, Transform
list_length = ListLength(List=series_3)
typical_floor_crv_at_lvl = RemoteSender(orient_3.Geometry)

floor_lvl_s_6 = RemoteReceiver(floor_lvl_s)
ground_banquet_floor_crv = Curve(<curve referenced from the Rhino model>)
list_item_5 = ListItem(List=floor_lvl_s_6, Index="1", Wrap=True)
subtraction_4 = Subtraction(A="5", B="1")
orient_4 = Orient(Geometry=ground_banquet_floor_crv, Source=PlaneXY(0, 0, 0), Target=list_item_5)  # -> Geometry, Transform
series_4 = Series(Start="1", Step=1, Count=subtraction_4)
ground_banquet_crv_at_lvl = RemoteSender(orient_4.Geometry)

floor_lvl_s_7 = RemoteReceiver(floor_lvl_s)
list_item_6 = ListItem(List=floor_lvl_s_7, Index="1", Wrap=True)
subtraction_5 = Subtraction(A="5", B="1")
series_5 = Series(Start="1", Step=1, Count=expr("x+1", subtraction_5))
orient_5 = Orient(Geometry=ground_banquet_floor_crv, Source=PlaneXY(0, 0, 0), Target=list_item_6)  # -> Geometry, Transform
ground_banquet_crv_at_lvl_2 = RemoteSender(orient_5.Geometry)
list_length_2 = ListLength(List=series_5)

subtraction_6 = Subtraction(A="19", B="14")
series_6 = Series(Start=expr("x+1", "14"), Step=1, Count=expr("x-1", subtraction_6))

xy_plane_7 = XYPlane(Origin=construct_point_7)

floor_planes_at_lvl = RemoteSender(xy_plane_7)

subtraction_7 = Subtraction(A=list_item, B=list_item_2)
swimming_floor_crv_at_lvl_2 = RemoteReceiver(swimming_floor_crv_at_lvl)
unit_z = UnitZ(Factor=subtraction_7)
extrude = Extrude(Base=swimming_floor_crv_at_lvl_2, Direction=unit_z)
cap_holes = CapHoles(Brep=extrude)

subtraction_8 = Subtraction(A=list_item_2, B=list_item_3)
add_floor_crv_at_lvl_2 = RemoteReceiver(add_floor_crv_at_lvl)
unit_z_2 = UnitZ(Factor=subtraction_8)
extrude_2 = Extrude(Base=add_floor_crv_at_lvl_2, Direction=unit_z_2)
cap_holes_2 = CapHoles(Brep=extrude_2)

subtraction_9 = Subtraction(A=list_item_3, B=list_item_4)
typical_floor_crv_at_lvl_2 = RemoteReceiver(typical_floor_crv_at_lvl)
unit_z_3 = UnitZ(Factor=subtraction_9)
extrude_3 = Extrude(Base=typical_floor_crv_at_lvl_2, Direction=unit_z_3)
cap_holes_3 = CapHoles(Brep=extrude_3)

subtraction_10 = Subtraction(A=list_item_4, B=list_item_5)
ground_banquet_crv_at_lvl_3 = RemoteReceiver([ground_banquet_crv_at_lvl, ground_banquet_crv_at_lvl_2])
unit_z_4 = UnitZ(Factor=subtraction_10)
extrude_4 = Extrude(Base=ground_banquet_crv_at_lvl_3, Direction=unit_z_4)
cap_holes_4 = CapHoles(Brep=extrude_4)

subtraction_11 = Subtraction(A=list_item, B=list_item_3)
add_floor_crv_at_lvl_3 = RemoteReceiver(add_floor_crv_at_lvl)
unit_z_5 = UnitZ(Factor=subtraction_11)
extrude_5 = Extrude(Base=add_floor_crv_at_lvl_3, Direction=unit_z_5)
cap_holes_5 = CapHoles(Brep=extrude_5)

subtraction_12 = Subtraction(A=list_item_4, B=list_item_6)
ground_banquet_crv_at_lvl_4 = RemoteReceiver([ground_banquet_crv_at_lvl_2, ground_banquet_crv_at_lvl])
unit_z_6 = UnitZ(Factor=subtraction_12)
extrude_6 = Extrude(Base=ground_banquet_crv_at_lvl_4, Direction=unit_z_6)
cap_holes_6 = CapHoles(Brep=extrude_6)

floor_planes_at_lvl_2 = RemoteReceiver(floor_planes_at_lvl)
brep = Brep(cap_holes_5)
list_item_7 = ListItem(List=floor_planes_at_lvl_2, Index=series_6, Wrap=True)
brep_plane = BrepPlane(Brep=brep, Plane=list_item_7)  # -> Curves, Points
surface = Surface(flatten(brep_plane.Curves))

floor_planes_at_lvl_3 = RemoteReceiver(floor_planes_at_lvl)
list_item_8 = ListItem(List=floor_planes_at_lvl_3, Index=series_3, Wrap=True)
brep_2 = Brep(cap_holes_3)
brep_plane_2 = BrepPlane(Brep=brep_2, Plane=list_item_8)  # -> Curves, Points
surface_2 = Surface(brep_plane_2.Curves)

floor_planes_at_lvl_4 = RemoteReceiver(floor_planes_at_lvl)
list_item_9 = ListItem(List=floor_planes_at_lvl_4, Index=series_4, Wrap=True)
brep_3 = Brep(cap_holes_4)
brep_plane_3 = BrepPlane(Brep=brep_3, Plane=list_item_9)  # -> Curves, Points
surface_3 = Surface(brep_plane_3.Curves)

floor_planes_at_lvl_5 = RemoteReceiver(floor_planes_at_lvl)
list_item_10 = ListItem(List=floor_planes_at_lvl_5, Index=series_5, Wrap=True)
brep_4 = Brep(cap_holes_6)
brep_plane_4 = BrepPlane(Brep=brep_4, Plane=list_item_10)  # -> Curves, Points
surface_4 = Surface(flatten(brep_plane_4.Curves))

floor_planes_at_lvl_6 = RemoteReceiver(floor_planes_at_lvl)
list_item_11 = ListItem(List=floor_planes_at_lvl_6, Index=series, Wrap=True)
brep_5 = Brep(cap_holes)
brep_plane_5 = BrepPlane(Brep=brep_5, Plane=list_item_11)  # -> Curves, Points
surface_5 = Surface(brep_plane_5.Curves)

floor_planes_at_lvl_7 = RemoteReceiver(floor_planes_at_lvl)
list_item_12 = ListItem(List=floor_planes_at_lvl_7, Index=series_2, Wrap=True)
brep_6 = Brep(cap_holes_2)
brep_plane_6 = BrepPlane(Brep=brep_6, Plane=list_item_12)  # -> Curves, Points
surface_6 = Surface(brep_plane_6.Curves)

merge_61 = Merge(Data1=flatten(surface_5), Data2=flatten(surface_6), Data3=flatten(surface_2), Data4=flatten(surface_3))
area = Area(Geometry=merge_61)  # -> Area, Centroid
deconstruct = Deconstruct(Point=area.Centroid)  # -> XComponent, YComponent, ZComponent
sort_list = SortList(Keys=deconstruct.ZComponent, ValuesValuesA=merge_61)  # -> Keys, ValuesValuesA
floor_thickness_3 = RemoteReceiver(floor_thickness_2)
cull_index = CullIndex(List=sort_list.ValuesValuesA, Indices="1", Wrap=True)
unit_z_7 = UnitZ(Factor=floor_thickness_3)
extrude_7 = Extrude(Base=cull_index, Direction=unit_z_7)
floor_colour_2 = RemoteReceiver(floor_colour)
custom_preview = CustomPreview(Geometry=extrude_7, Material=floor_colour_2)

cull_index_2 = CullIndex(List=flatten(surface_2), Indices=0, Wrap=True)
merge_62 = Merge(Data1=flatten(surface), Data2=flatten(cull_index_2), Data3=flatten(surface_4))
curve = Curve(merge_62)
area_2 = Area(Geometry=curve)  # -> Area, Centroid
deconstruct_2 = Deconstruct(Point=area_2.Centroid)  # -> XComponent, YComponent, ZComponent
sort_list_2 = SortList(Keys=deconstruct_2.ZComponent, ValuesValuesA=curve)  # -> Keys, ValuesValuesA
area_3 = Area(Geometry=sort_list_2.ValuesValuesA)  # -> Area, Centroid
curve_2 = Curve(sort_list_2.ValuesValuesA)
explode = Explode(Curve=curve_2, Recursive=True)  # -> simplify(Segments), Vertices
area_4 = Area(Geometry=curve_2)  # -> Area, simplify(graft(Centroid))
curve_middle = CurveMiddle(Curve=explode.Segments)
rotate_plane = RotatePlane(Plane=area_4.Centroid, Angle=degrees(Slider(5, range=0..10)))
to_polar = ToPolar(Point=curve_middle, System=rotate_plane)  # -> Phi, Theta, Radius
sort_list_3 = SortList(Keys=to_polar.Phi, ValuesValuesA=explode.Segments)  # -> Keys, ValuesValuesA
cull_index_3 = CullIndex(List=sort_list_3.ValuesValuesA, Indices=panel_39, Wrap=True)
join_curves = JoinCurves(Curves=cull_index_3, Preserve=False)
list_item_13 = ListItem(List=join_curves, Index=0, Wrap=True)  # -> Item, Item1

facade_offset_2 = RemoteReceiver(facade_offset)
extend_curve = ExtendCurve(Curve=list_item_13.Item1, Type=0, Start=facade_offset_2, End=facade_offset_2)
rebuild_curve = RebuildCurve(Curve=extend_curve, Degree=3, Count=100, Tangents=False)

facade_offset_3 = RemoteReceiver(facade_offset)
extend_curve_2 = ExtendCurve(Curve=list_item_13.Item, Type=0, Start=facade_offset_3, End=facade_offset_3)
rebuild_curve_2 = RebuildCurve(Curve=extend_curve_2, Degree=3, Count=100, Tangents=False)

number_slider_157 = Slider(5, range=0..10)
addition_5 = Addition(A=number_slider_157, B=1)
balcony_side_additional_cross_setional_c_17 = Curve(<curve referenced from the Rhino model>)  # "Balcony_Side_Additional_Cross-Setional_Crv"
select_upper_lower_right_cross_section = Integer("0")
select_upper_lower_left_cross_section = Integer("1")
right_side_straight_bands_24 = Integer(right_side_straight_bands_2)
left_side_straight_bands_28 = Integer(left_side_straight_bands_2)

number_slider_158 = Slider(3, range=0..10)
addition_6 = Addition(A=number_slider_158, B=1)
select_upper_lower_right_cross_section_2 = Integer("1")
select_upper_lower_left_cross_section_2 = Integer("0")
right_side_straight_bands_25 = Integer(number_slider_8)
left_side_straight_bands_29 = Integer(left_side_straight_bands_4)

number_slider_159 = Slider(5, range=0..10)
addition_7 = Addition(A=number_slider_159, B=1)
balcony_side_additional_cross_setional_c_18 = Curve(<curve referenced from the Rhino model>)  # "Balcony_Side_Additional_Cross-Setional_Crv"
select_upper_lower_right_cross_section_3 = Integer("0")
select_upper_lower_left_cross_section_3 = Integer("1")
right_side_straight_bands_26 = Integer(right_side_straight_bands_5)
left_side_straight_bands_30 = Integer(left_side_straight_bands_5)

number_slider_160 = Slider(1, range=0..10)
addition_8 = Addition(A=number_slider_160, B=1)
select_upper_lower_right_cross_section_4 = Integer("0")
select_upper_lower_left_cross_section_4 = Integer("1")
right_side_straight_bands_27 = Integer(number_slider_8)
left_side_straight_bands_31 = Integer(left_side_straight_bands_3)

number_slider_161 = Slider(4, range=0..10)
addition_9 = Addition(A=number_slider_161, B=1)
select_upper_lower_right_cross_section_5 = Integer("1")
select_upper_lower_left_cross_section_5 = Integer("0")
right_side_straight_bands_28 = Integer(right_side_straight_bands_7)
left_side_straight_bands_32 = Integer(left_side_straight_bands_8)

number_slider_162 = Slider(3, range=0..10)
addition_10 = Addition(A=number_slider_162, B=1)
select_upper_lower_right_cross_section_6 = Integer("0")
select_upper_lower_left_cross_section_6 = Integer("1")
right_side_straight_bands_29 = Integer(right_side_straight_bands_6)
left_side_straight_bands_33 = Integer(left_side_straight_bands_6)

number_slider_163 = Slider(5, range=0..10)
addition_11 = Addition(A=number_slider_163, B=1)
balcony_side_additional_cross_setional_c_19 = Curve(<curve referenced from the Rhino model>)  # "Balcony_Side_Additional_Cross-Setional_Crv"
select_upper_lower_right_cross_section_7 = Integer("0")
select_upper_lower_left_cross_section_7 = Integer("1")
right_side_straight_bands_30 = Integer(right_side_straight_bands_9)
left_side_straight_bands_34 = Integer(left_side_straight_bands_9)

number_slider_164 = Slider(1, range=0..10)
addition_12 = Addition(A=number_slider_164, B=1)
select_upper_lower_right_cross_section_8 = Integer("0")
select_upper_lower_left_cross_section_8 = Integer("1")
right_side_straight_bands_31 = Integer(right_side_straight_bands_10)
left_side_straight_bands_35 = Integer(left_side_straight_bands_10)

number_slider_165 = Slider(2, range=0..10)
addition_13 = Addition(A=number_slider_165, B=1)
select_upper_lower_right_cross_section_9 = Integer("1")
select_upper_lower_left_cross_section_9 = Integer("0")
right_side_straight_bands_32 = Integer(right_side_straight_bands_15)
left_side_straight_bands_36 = Integer(left_side_straight_bands_15)

number_slider_166 = Slider(4, range=0..10)
addition_14 = Addition(A=number_slider_166, B=1)
balcony_side_additional_cross_setional_c_20 = Curve(<curve referenced from the Rhino model>)  # "Balcony_Side_Additional_Cross-Setional_Crv"
select_upper_lower_right_cross_section_10 = Integer("1")
select_upper_lower_left_cross_section_10 = Integer("0")
right_side_straight_bands_33 = Integer(right_side_straight_bands_8)
left_side_straight_bands_37 = Integer(left_side_straight_bands_7)

number_slider_167 = Slider(0, range=0..10)
right_side_straight_bands_34 = RemoteReceiver(right_side_straight_bands)
left_side_straight_bands_38 = RemoteReceiver(left_side_straight_bands)
addition_15 = Addition(A=number_slider_167, B=1)
select_upper_lower_right_cross_section_11 = Integer("0")
select_upper_lower_left_cross_section_11 = Integer("1")
right_side_straight_bands_35 = Integer(right_side_straight_bands_34)
left_side_straight_bands_39 = Integer(left_side_straight_bands_38)

number_slider_168 = Slider(0, range=0..10)
addition_16 = Addition(A=number_slider_168, B=1)
balcony_side_additional_cross_setional_c_21 = Curve(<curve referenced from the Rhino model>)  # "Balcony_Side_Additional_Cross-Setional_Crv"
select_upper_lower_right_cross_section_12 = Integer("1")
select_upper_lower_left_cross_section_12 = Integer("0")
right_side_straight_bands_36 = Integer(right_side_straight_bands_20)
left_side_straight_bands_40 = Integer(left_side_straight_bands_21)

number_slider_169 = Slider(1, range=0..10)
addition_17 = Addition(A=number_slider_169, B=1)
select_upper_lower_right_cross_section_13 = Integer("0")
select_upper_lower_left_cross_section_13 = Integer("1")
right_side_straight_bands_37 = Integer(number_slider_3)
left_side_straight_bands_41 = Integer(left_side_straight_bands_19)

number_slider_170 = Slider(0, range=0..10)
addition_18 = Addition(A=number_slider_170, B=1)
right_side_straight_bands_38 = RemoteReceiver(right_side_straight_bands)
left_side_straight_bands_42 = RemoteReceiver(left_side_straight_bands)
balcony_side_additional_cross_setional_c_22 = Curve(<curve referenced from the Rhino model>)  # "Balcony_Side_Additional_Cross-Setional_Crv"
select_upper_lower_right_cross_section_14 = Integer("1")
select_upper_lower_left_cross_section_14 = Integer("0")
right_side_straight_bands_39 = Integer(right_side_straight_bands_38)
left_side_straight_bands_43 = Integer(left_side_straight_bands_42)

number_slider_171 = Slider(5, range=0..10)  # disabled
addition_19 = Addition(A=number_slider_171, B=1)  # disabled
panel_41 = Panel("1")  # disabled
panel_42 = Panel("0")  # disabled
balcony_side_additional_cross_setional_c_23 = Curve(<curve referenced from the Rhino model>)  # "Balcony_Side_Additional_Cross-Setional_Crv"; disabled
select_upper_lower_right_cross_section_15 = Integer(panel_42)  # disabled
select_upper_lower_left_cross_section_15 = Integer(panel_41)  # disabled
right_side_straight_bands_40 = Integer(right_side_straight_bands_11)  # disabled
left_side_straight_bands_44 = Integer(left_side_straight_bands_11)  # disabled

number_slider_172 = Slider(0, range=0..10)
addition_20 = Addition(A=number_slider_172, B=1)
balcony_side_additional_cross_setional_c_24 = Curve(<curve referenced from the Rhino model>)  # "Balcony_Side_Additional_Cross-Setional_Crv"
select_upper_lower_right_cross_section_16 = Integer("1")
select_upper_lower_left_cross_section_16 = Integer("0")
right_side_straight_bands_41 = Integer(number_slider_3)
left_side_straight_bands_45 = Integer(left_side_straight_bands_23)

number_slider_173 = Slider(3, range=0..10)  # disabled
addition_21 = Addition(A=number_slider_173, B=1)  # disabled
panel_43 = Panel("0")  # disabled
panel_44 = Panel("1")  # disabled
select_upper_lower_right_cross_section_17 = Integer(panel_44)  # disabled
select_upper_lower_left_cross_section_17 = Integer(panel_43)  # disabled
right_side_straight_bands_42 = Integer(number_slider_10)  # disabled
left_side_straight_bands_46 = Integer(left_side_straight_bands_13)  # disabled

number_slider_174 = Slider(5, range=0..10)  # disabled
addition_22 = Addition(A=number_slider_174, B=1)  # disabled
panel_45 = Panel("1")  # disabled
panel_46 = Panel("0")  # disabled
balcony_side_additional_cross_setional_c_25 = Curve(<curve referenced from the Rhino model>)  # "Balcony_Side_Additional_Cross-Setional_Crv"; disabled
select_upper_lower_right_cross_section_18 = Integer(panel_46)  # disabled
select_upper_lower_left_cross_section_18 = Integer(panel_45)  # disabled
right_side_straight_bands_43 = Integer(right_side_straight_bands_14)  # disabled
left_side_straight_bands_47 = Integer(left_side_straight_bands_14)  # disabled

number_slider_175 = Slider(1, range=0..10)  # disabled
addition_23 = Addition(A=number_slider_175, B=1)  # disabled
panel_47 = Panel("1")  # disabled
panel_48 = Panel("0")  # disabled
select_upper_lower_right_cross_section_19 = Integer(panel_48)  # disabled
select_upper_lower_left_cross_section_19 = Integer(panel_47)  # disabled
right_side_straight_bands_44 = Integer(number_slider_10)  # disabled
left_side_straight_bands_48 = Integer(left_side_straight_bands_12)  # disabled

number_slider_176 = Slider(4, range=0..10)  # disabled
addition_24 = Addition(A=number_slider_176, B=1)  # disabled
panel_49 = Panel("0")  # disabled
panel_50 = Panel("1")  # disabled
select_upper_lower_right_cross_section_20 = Integer(panel_50)  # disabled
select_upper_lower_left_cross_section_20 = Integer(panel_49)  # disabled
right_side_straight_bands_45 = Integer(right_side_straight_bands_17)  # disabled
left_side_straight_bands_49 = Integer(left_side_straight_bands_18)  # disabled

number_slider_177 = Slider(3, range=0..10)  # disabled
addition_25 = Addition(A=number_slider_177, B=1)  # disabled
panel_51 = Panel("1")  # disabled
panel_52 = Panel("0")  # disabled
select_upper_lower_right_cross_section_21 = Integer(panel_52)  # disabled
select_upper_lower_left_cross_section_21 = Integer(panel_51)  # disabled
right_side_straight_bands_46 = Integer(right_side_straight_bands_16)  # disabled
left_side_straight_bands_50 = Integer(left_side_straight_bands_16)  # disabled

number_slider_178 = Slider(5, range=0..10)  # disabled
addition_26 = Addition(A=number_slider_178, B=1)  # disabled
panel_53 = Panel("1")  # disabled
panel_54 = Panel("0")  # disabled
balcony_side_additional_cross_setional_c_26 = Curve(<curve referenced from the Rhino model>)  # "Balcony_Side_Additional_Cross-Setional_Crv"; disabled
select_upper_lower_right_cross_section_22 = Integer(panel_54)  # disabled
select_upper_lower_left_cross_section_22 = Integer(panel_53)  # disabled
right_side_straight_bands_47 = Integer(right_side_straight_bands_19)  # disabled
left_side_straight_bands_51 = Integer(left_side_straight_bands_20)  # disabled

number_slider_179 = Slider(1, range=0..10)  # disabled
addition_27 = Addition(A=number_slider_179, B=1)  # disabled
panel_55 = Panel("1")  # disabled
panel_56 = Panel("0")  # disabled
select_upper_lower_right_cross_section_23 = Integer(panel_56)  # disabled
select_upper_lower_left_cross_section_23 = Integer(panel_55)  # disabled
right_side_straight_bands_48 = Integer(right_side_straight_bands_21)  # disabled
left_side_straight_bands_52 = Integer(left_side_straight_bands_22)  # disabled

number_slider_180 = Slider(2, range=0..10)  # disabled
addition_28 = Addition(A=number_slider_180, B=1)  # disabled
panel_57 = Panel("0")  # disabled
panel_58 = Panel("1")  # disabled
select_upper_lower_right_cross_section_24 = Integer(panel_58)  # disabled
select_upper_lower_left_cross_section_24 = Integer(panel_57)  # disabled
right_side_straight_bands_49 = Integer(right_side_straight_bands_22)  # disabled
left_side_straight_bands_53 = Integer(left_side_straight_bands_24)  # disabled

number_slider_181 = Slider(4, range=0..10)  # disabled
addition_29 = Addition(A=number_slider_181, B=1)  # disabled
panel_59 = Panel("0")  # disabled
panel_60 = Panel("1")  # disabled
balcony_side_additional_cross_setional_c_27 = Curve(<curve referenced from the Rhino model>)  # "Balcony_Side_Additional_Cross-Setional_Crv"; disabled
select_upper_lower_right_cross_section_25 = Integer(panel_60)  # disabled
select_upper_lower_left_cross_section_25 = Integer(panel_59)  # disabled
right_side_straight_bands_50 = Integer(right_side_straight_bands_18)  # disabled
left_side_straight_bands_54 = Integer(left_side_straight_bands_17)  # disabled

number_slider_182 = Slider(0, range=0..10)  # disabled
right_side_straight_bands_51 = RemoteReceiver(right_side_straight_bands)  # disabled
left_side_straight_bands_55 = RemoteReceiver(left_side_straight_bands)  # disabled
addition_30 = Addition(A=number_slider_182, B=1)  # disabled
panel_61 = Panel("1")  # disabled
panel_62 = Panel("0")  # disabled
select_upper_lower_right_cross_section_26 = Integer(panel_62)  # disabled
select_upper_lower_left_cross_section_26 = Integer(panel_61)  # disabled
right_side_straight_bands_52 = Integer(right_side_straight_bands_51)  # disabled
left_side_straight_bands_56 = Integer(left_side_straight_bands_55)  # disabled

number_slider_183 = Slider(0, range=0..10)  # disabled
addition_31 = Addition(A=number_slider_183, B=1)  # disabled
panel_63 = Panel("0")  # disabled
panel_64 = Panel("1")  # disabled
balcony_side_additional_cross_setional_c_28 = Curve(<curve referenced from the Rhino model>)  # "Balcony_Side_Additional_Cross-Setional_Crv"; disabled
select_upper_lower_right_cross_section_27 = Integer(panel_64)  # disabled
select_upper_lower_left_cross_section_27 = Integer(panel_63)  # disabled
right_side_straight_bands_53 = Integer(right_side_straight_bands_23)  # disabled
left_side_straight_bands_57 = Integer(left_side_straight_bands_26)  # disabled

number_slider_184 = Slider(1, range=0..10)  # disabled
addition_32 = Addition(A=number_slider_184, B=1)  # disabled
panel_65 = Panel("1")  # disabled
panel_66 = Panel("0")  # disabled
select_upper_lower_right_cross_section_28 = Integer(panel_66)  # disabled
select_upper_lower_left_cross_section_28 = Integer(panel_65)  # disabled
right_side_straight_bands_54 = Integer(number_slider_6)  # disabled
left_side_straight_bands_58 = Integer(left_side_straight_bands_25)  # disabled

number_slider_185 = Slider(0, range=0..10)  # disabled
addition_33 = Addition(A=number_slider_185, B=1)  # disabled
right_side_straight_bands_55 = RemoteReceiver(right_side_straight_bands)  # disabled
left_side_straight_bands_59 = RemoteReceiver(left_side_straight_bands)  # disabled
panel_67 = Panel("0")  # disabled
panel_68 = Panel("1")  # disabled
balcony_side_additional_cross_setional_c_29 = Curve(<curve referenced from the Rhino model>)  # "Balcony_Side_Additional_Cross-Setional_Crv"; disabled
select_upper_lower_right_cross_section_29 = Integer(panel_68)  # disabled
select_upper_lower_left_cross_section_29 = Integer(panel_67)  # disabled
right_side_straight_bands_56 = Integer(right_side_straight_bands_55)  # disabled
left_side_straight_bands_60 = Integer(left_side_straight_bands_59)  # disabled

number_slider_186 = Slider(0, range=0..10)  # disabled
addition_34 = Addition(A=number_slider_186, B=1)  # disabled
panel_69 = Panel("0")  # disabled
panel_70 = Panel("1")  # disabled
balcony_side_additional_cross_setional_c_30 = Curve(<curve referenced from the Rhino model>)  # "Balcony_Side_Additional_Cross-Setional_Crv"; disabled
select_upper_lower_right_cross_section_30 = Integer(panel_70)  # disabled
select_upper_lower_left_cross_section_30 = Integer(panel_69)  # disabled
right_side_straight_bands_57 = Integer(number_slider_6)  # disabled
left_side_straight_bands_61 = Integer(left_side_straight_bands_27)  # disabled

reduce_straight_length = Number(remap_numbers_14.Mapped)
scissor_lower_crv_curvature_32 = Integer(scissor_lower_crv_curvature_15)
cross_section_fillet_1_31 = Number(cross_section_fillet_1_14)
cross_section_fillet_2_31 = Number(cross_section_fillet_2_14)
cross_section_curvature_31 = Integer(cross_section_curvature_14)
scissor_upper_crv_curvature_1_31 = Number(scissor_upper_crv_curvature_1_14)
scissor_upper_crv_curvature_2_31 = Number(scissor_upper_crv_curvature_2_14)
scissor_upper_crv_curvature_32 = Integer(scissor_upper_crv_curvature_15)
scissor_lower_crv_curvature_1_31 = Number(scissor_lower_crv_curvature_1_14)
scissor_lower_crv_curvature_2_31 = Number(scissor_lower_crv_curvature_2_14)
left_side_straight_bands_62 = Integer(left_side_straight_bands_43)
right_side_straight_bands_58 = Integer(right_side_straight_bands_39)
left_side_cross_section_crv = Curve(merge_30)
right_side_cross_section_crv = Curve(merge_29)
select_upper_lower_left_cross_section_31 = Integer(select_upper_lower_left_cross_section_14)
select_upper_lower_right_cross_section_31 = Integer(select_upper_lower_right_cross_section_14)
balcony_side_additional_cross_setional_c_31 = Curve(balcony_side_additional_cross_setional_c_22)  # "Balcony_Side_Additional_Cross-Setional_Crv"
curve_3 = Curve(balcony_side_additional_cross_setional_c_31)
series_7 = Series(Start=0, Step=1, Count=left_side_straight_bands_62)
series_8 = Series(Start="-1", Step="-1", Count=right_side_straight_bands_58)
curve_4 = Curve(left_side_cross_section_crv)
curve_5 = Curve(right_side_cross_section_crv)
range = Range(Domain=Domain(0, 1), Steps=expr("x-1", "14"))
unit_z_8 = UnitZ(Factor=1)
unit_z_9 = UnitZ(Factor=1)
graph_mapper = GraphMapper(
    range,
    x0=0,
    x1=1,
    y0=0,
    y1=1,
    container_name="Bezier",
    cpx=[0, 0.6894743443, 0.8917148113, 1],
    cpy=[0, 0, 0.5817658901, 1])
number = Number(cross_section_fillet_1_31)
number_2 = Number(cross_section_fillet_2_31)
integer = Integer(cross_section_curvature_31)

reduce_straight_length_2 = Number(remap_numbers_2.Mapped)
cross_section_fillet_1_32 = Number(cross_section_fillet_1_2)
cross_section_fillet_2_32 = Number(cross_section_fillet_2_2)
cross_section_curvature_32 = Integer(cross_section_curvature_2)
scissor_upper_crv_curvature_1_32 = Number(scissor_upper_crv_curvature_1_2)
scissor_upper_crv_curvature_2_32 = Number(scissor_upper_crv_curvature_2_2)
scissor_upper_crv_curvature_33 = Integer(scissor_upper_crv_curvature_3)
scissor_lower_crv_curvature_33 = Integer(scissor_lower_crv_curvature_3)
right_side_straight_bands_59 = Integer(right_side_straight_bands_25)
left_side_cross_section_crv_2 = Curve(merge_4)
right_side_cross_section_crv_2 = Curve(merge_3)
select_upper_lower_left_cross_section_32 = Integer(select_upper_lower_left_cross_section_2)
select_upper_lower_right_cross_section_32 = Integer(select_upper_lower_right_cross_section_2)
balcony_side_additional_cross_setional_c_32 = Curve(balcony_side_additional_cross_setional_c)  # "Balcony_Side_Additional_Cross-Setional_Crv"
scissor_lower_crv_curvature_1_32 = Number(scissor_lower_crv_curvature_1_2)
scissor_lower_crv_curvature_2_32 = Number(scissor_lower_crv_curvature_2_2)
left_side_straight_bands_63 = Integer(left_side_straight_bands_29)
series_9 = Series(Start=0, Step=1, Count=left_side_straight_bands_63)
series_10 = Series(Start="-1", Step="-1", Count=right_side_straight_bands_59)
curve_6 = Curve(balcony_side_additional_cross_setional_c_32)
curve_7 = Curve(left_side_cross_section_crv_2)
curve_8 = Curve(right_side_cross_section_crv_2)
range_2 = Range(Domain=Domain(0, 1), Steps=expr("x-1", "14"))
unit_z_10 = UnitZ(Factor=1)
unit_z_11 = UnitZ(Factor=1)
graph_mapper_2 = GraphMapper(
    range_2,
    x0=0,
    x1=1,
    y0=0,
    y1=1,
    container_name="Bezier",
    cpx=[0, 0.4736965001, 0.7455983758, 1],
    cpy=[0, 0, 0.9224411249, 1])
number_3 = Number(cross_section_fillet_1_32)
number_4 = Number(cross_section_fillet_2_32)
integer_2 = Integer(cross_section_curvature_32)

curve_9 = Curve(curve_6)

reduce_straight_length_3 = Number(remap_numbers_4.Mapped)
cross_section_fillet_1_33 = Number(cross_section_fillet_1_4)
cross_section_fillet_2_33 = Number(cross_section_fillet_2_4)
cross_section_curvature_33 = Integer(cross_section_curvature_4)
scissor_upper_crv_curvature_1_33 = Number(scissor_upper_crv_curvature_1_4)
scissor_upper_crv_curvature_2_33 = Number(scissor_upper_crv_curvature_2_4)
scissor_upper_crv_curvature_34 = Integer(scissor_upper_crv_curvature_5)
scissor_lower_crv_curvature_34 = Integer(scissor_lower_crv_curvature_5)
right_side_straight_bands_60 = Integer(right_side_straight_bands_27)
right_side_cross_section_crv_3 = Curve(merge_8)
select_upper_lower_left_cross_section_33 = Integer(select_upper_lower_left_cross_section_4)
select_upper_lower_right_cross_section_33 = Integer(select_upper_lower_right_cross_section_4)
scissor_lower_crv_curvature_1_33 = Number(scissor_lower_crv_curvature_1_4)
scissor_lower_crv_curvature_2_33 = Number(scissor_lower_crv_curvature_2_4)
left_side_straight_bands_64 = Integer(left_side_straight_bands_31)
left_side_cross_section_crv_3 = Curve(typical_left_lower_crv_4)
balcony_side_additional_cross_setional_c_33 = Curve(balcony_side_additional_cross_setional_c_2)  # "Balcony_Side_Additional_Cross-Setional_Crv"
curve_10 = Curve(balcony_side_additional_cross_setional_c_33)
series_11 = Series(Start=0, Step=1, Count=left_side_straight_bands_64)
series_12 = Series(Start="-1", Step="-1", Count=right_side_straight_bands_60)
curve_11 = Curve(left_side_cross_section_crv_3)
curve_12 = Curve(right_side_cross_section_crv_3)
range_3 = Range(Domain=Domain(0, 1), Steps=expr("x-1", "14"))
unit_z_12 = UnitZ(Factor=1)
unit_z_13 = UnitZ(Factor=1)
graph_mapper_3 = GraphMapper(
    range_3,
    x0=0,
    x1=1,
    y0=0,
    y1=1,
    container_name="Bezier",
    cpx=[0, 0.4736965001, 0.7455983758, 1],
    cpy=[0, 0, 0.9224411249, 1])
number_5 = Number(cross_section_fillet_1_33)
number_6 = Number(cross_section_fillet_2_33)
integer_3 = Integer(cross_section_curvature_33)

curve_13 = Curve(curve_10)

reduce_straight_length_4 = Number(remap_numbers_29.Mapped)  # disabled
scissor_lower_crv_curvature_35 = Integer(scissor_lower_crv_curvature_30)  # disabled
cross_section_fillet_1_34 = Number(cross_section_fillet_1_29)  # disabled
cross_section_fillet_2_34 = Number(cross_section_fillet_2_29)  # disabled
cross_section_curvature_34 = Integer(cross_section_curvature_29)  # disabled
scissor_upper_crv_curvature_1_34 = Number(scissor_upper_crv_curvature_1_29)  # disabled
scissor_upper_crv_curvature_2_34 = Number(scissor_upper_crv_curvature_2_29)  # disabled
scissor_upper_crv_curvature_35 = Integer(scissor_upper_crv_curvature_30)  # disabled
scissor_lower_crv_curvature_1_34 = Number(scissor_lower_crv_curvature_1_29)  # disabled
scissor_lower_crv_curvature_2_34 = Number(scissor_lower_crv_curvature_2_29)  # disabled
left_side_straight_bands_65 = Integer(left_side_straight_bands_60)  # disabled
right_side_straight_bands_61 = Integer(right_side_straight_bands_56)  # disabled
left_side_cross_section_crv_4 = Curve(merge_58)  # disabled
right_side_cross_section_crv_4 = Curve(merge_57)  # disabled
select_upper_lower_left_cross_section_34 = Integer(select_upper_lower_left_cross_section_29)  # disabled
select_upper_lower_right_cross_section_34 = Integer(select_upper_lower_right_cross_section_29)  # disabled
balcony_side_additional_cross_setional_c_34 = Curve(balcony_side_additional_cross_setional_c_29)  # "Balcony_Side_Additional_Cross-Setional_Crv"; disabled
panel_71 = Panel("-1")  # disabled
curve_14 = Curve(balcony_side_additional_cross_setional_c_34)  # disabled
series_13 = Series(Start=0, Step=1, Count=left_side_straight_bands_65)  # disabled
series_14 = Series(Start=panel_71, Step=panel_71, Count=right_side_straight_bands_61)  # disabled
curve_15 = Curve(left_side_cross_section_crv_4)  # disabled
curve_16 = Curve(right_side_cross_section_crv_4)  # disabled
panel_72 = Panel("14")  # disabled
range_4 = Range(Domain=Domain(0, 1), Steps=expr("x-1", panel_72))  # disabled
unit_z_14 = UnitZ(Factor=1)  # disabled
panel_73 = Panel("1500")  # disabled
unit_z_15 = UnitZ(Factor=1)  # disabled
graph_mapper_4 = GraphMapper(
    range_4,
    x0=0,
    x1=1,
    y0=0,
    y1=1,
    container_name="Bezier",
    cpx=[0, 0.6894743443, 0.8917148113, 1],
    cpy=[0, 0, 0.5817658901, 1])  # disabled
panel_74 = Panel("0")  # disabled
panel_75 = Panel("-1")  # disabled
panel_76 = Panel("0")  # disabled
number_7 = Number(cross_section_fillet_1_34)  # disabled
number_8 = Number(cross_section_fillet_2_34)  # disabled
integer_4 = Integer(cross_section_curvature_34)  # disabled

reduce_straight_length_5 = Number(remap_numbers_17.Mapped)  # disabled
cross_section_fillet_1_35 = Number(cross_section_fillet_1_17)  # disabled
cross_section_fillet_2_35 = Number(cross_section_fillet_2_17)  # disabled
cross_section_curvature_35 = Integer(cross_section_curvature_17)  # disabled
scissor_upper_crv_curvature_1_35 = Number(scissor_upper_crv_curvature_1_17)  # disabled
scissor_upper_crv_curvature_2_35 = Number(scissor_upper_crv_curvature_2_17)  # disabled
scissor_upper_crv_curvature_36 = Integer(scissor_upper_crv_curvature_18)  # disabled
scissor_lower_crv_curvature_36 = Integer(scissor_lower_crv_curvature_18)  # disabled
right_side_straight_bands_62 = Integer(right_side_straight_bands_42)  # disabled
left_side_cross_section_crv_5 = Curve(merge_34)  # disabled
right_side_cross_section_crv_5 = Curve(merge_32)  # disabled
select_upper_lower_left_cross_section_35 = Integer(select_upper_lower_left_cross_section_17)  # disabled
select_upper_lower_right_cross_section_35 = Integer(select_upper_lower_right_cross_section_17)  # disabled
balcony_side_additional_cross_setional_c_35 = Curve(balcony_side_additional_cross_setional_c_9)  # "Balcony_Side_Additional_Cross-Setional_Crv"; disabled
scissor_lower_crv_curvature_1_35 = Number(scissor_lower_crv_curvature_1_17)  # disabled
scissor_lower_crv_curvature_2_35 = Number(scissor_lower_crv_curvature_2_17)  # disabled
left_side_straight_bands_66 = Integer(left_side_straight_bands_46)  # disabled
panel_77 = Panel("-1")  # disabled
series_15 = Series(Start=0, Step=1, Count=left_side_straight_bands_66)  # disabled
series_16 = Series(Start=panel_77, Step=panel_77, Count=right_side_straight_bands_62)  # disabled
curve_17 = Curve(balcony_side_additional_cross_setional_c_35)  # disabled
curve_18 = Curve(left_side_cross_section_crv_5)  # disabled
curve_19 = Curve(right_side_cross_section_crv_5)  # disabled
panel_78 = Panel("14")  # disabled
range_5 = Range(Domain=Domain(0, 1), Steps=expr("x-1", panel_78))  # disabled
panel_79 = Panel("6")  # disabled
panel_80 = Panel("6")  # disabled
unit_z_16 = UnitZ(Factor=1)  # disabled
panel_81 = Panel("1500")  # disabled
unit_z_17 = UnitZ(Factor=1)  # disabled
graph_mapper_5 = GraphMapper(
    range_5,
    x0=0,
    x1=1,
    y0=0,
    y1=1,
    container_name="Bezier",
    cpx=[0, 0.4736965001, 0.7455983758, 1],
    cpy=[0, 0, 0.9224411249, 1])  # disabled
panel_82 = Panel("0")  # disabled
panel_83 = Panel("-1")  # disabled
panel_84 = Panel("0")  # disabled
number_9 = Number(cross_section_fillet_1_35)  # disabled
number_10 = Number(cross_section_fillet_2_35)  # disabled
integer_5 = Integer(cross_section_curvature_35)  # disabled

curve_20 = Curve(curve_17)  # disabled

reduce_straight_length_6 = Number(remap_numbers_19.Mapped)  # disabled
cross_section_fillet_1_36 = Number(cross_section_fillet_1_19)  # disabled
cross_section_fillet_2_36 = Number(cross_section_fillet_2_19)  # disabled
cross_section_curvature_36 = Integer(cross_section_curvature_19)  # disabled
scissor_upper_crv_curvature_1_36 = Number(scissor_upper_crv_curvature_1_19)  # disabled
scissor_upper_crv_curvature_2_36 = Number(scissor_upper_crv_curvature_2_19)  # disabled
scissor_upper_crv_curvature_37 = Integer(scissor_upper_crv_curvature_20)  # disabled
scissor_lower_crv_curvature_37 = Integer(scissor_lower_crv_curvature_20)  # disabled
right_side_straight_bands_63 = Integer(right_side_straight_bands_44)  # disabled
right_side_cross_section_crv_6 = Curve(merge_38)  # disabled
select_upper_lower_left_cross_section_36 = Integer(select_upper_lower_left_cross_section_19)  # disabled
select_upper_lower_right_cross_section_36 = Integer(select_upper_lower_right_cross_section_19)  # disabled
scissor_lower_crv_curvature_1_36 = Number(scissor_lower_crv_curvature_1_19)  # disabled
scissor_lower_crv_curvature_2_36 = Number(scissor_lower_crv_curvature_2_19)  # disabled
left_side_straight_bands_67 = Integer(left_side_straight_bands_48)  # disabled
left_side_cross_section_crv_6 = Curve(typical_left_lower_crv_19)  # disabled
balcony_side_additional_cross_setional_c_36 = Curve(balcony_side_additional_cross_setional_c_10)  # "Balcony_Side_Additional_Cross-Setional_Crv"; disabled
panel_85 = Panel("-1")  # disabled
curve_21 = Curve(balcony_side_additional_cross_setional_c_36)  # disabled
series_17 = Series(Start=0, Step=1, Count=left_side_straight_bands_67)  # disabled
series_18 = Series(Start=panel_85, Step=panel_85, Count=right_side_straight_bands_63)  # disabled
curve_22 = Curve(left_side_cross_section_crv_6)  # disabled
curve_23 = Curve(right_side_cross_section_crv_6)  # disabled
panel_86 = Panel("14")  # disabled
range_6 = Range(Domain=Domain(0, 1), Steps=expr("x-1", panel_86))  # disabled
panel_87 = Panel("7")  # disabled
unit_z_18 = UnitZ(Factor=1)  # disabled
panel_88 = Panel("1500")  # disabled
unit_z_19 = UnitZ(Factor=1)  # disabled
graph_mapper_6 = GraphMapper(
    range_6,
    x0=0,
    x1=1,
    y0=0,
    y1=1,
    container_name="Bezier",
    cpx=[0, 0.4736965001, 0.7455983758, 1],
    cpy=[0, 0, 0.9224411249, 1])  # disabled
panel_89 = Panel("0")  # disabled
panel_90 = Panel("-1")  # disabled
panel_91 = Panel("0")  # disabled
number_11 = Number(cross_section_fillet_1_36)  # disabled
number_12 = Number(cross_section_fillet_2_36)  # disabled
integer_6 = Integer(cross_section_curvature_36)  # disabled

curve_24 = Curve(curve_21)  # disabled

curve_25 = Curve(curve_3)

curve_26 = Curve(curve_14)  # disabled

explode_2 = Explode(Curve=curve_25, Recursive=True)  # -> Segments, Vertices
list_item_14 = ListItem(List=explode_2.Vertices, Index=0, Wrap=True)  # -> Item1, Item
merge_63 = Merge(Data1=list_item_14.Item, Data2=list_item_14.Item1)

explode_3 = Explode(Curve=curve_9, Recursive=True)  # -> Segments, Vertices
list_item_15 = ListItem(List=explode_3.Vertices, Index=0, Wrap=True)  # -> Item1, Item
merge_64 = Merge(Data1=list_item_15.Item, Data2=list_item_15.Item1)

explode_4 = Explode(Curve=curve_13, Recursive=True)  # -> Segments, Vertices
list_item_16 = ListItem(List=explode_4.Vertices, Index=0, Wrap=True)  # -> Item1, Item
merge_65 = Merge(Data1=list_item_16.Item, Data2=list_item_16.Item1)

explode_5 = Explode(Curve=curve_26, Recursive=True)  # -> Segments, Vertices; disabled
list_item_17 = ListItem(List=explode_5.Vertices, Index=0, Wrap=True)  # -> Item1, Item; disabled
merge_66 = Merge(Data1=list_item_17.Item, Data2=list_item_17.Item1)  # disabled

explode_6 = Explode(Curve=curve_20, Recursive=True)  # -> Segments, Vertices; disabled
list_item_18 = ListItem(List=explode_6.Vertices, Index=0, Wrap=True)  # -> Item1, Item; disabled
merge_67 = Merge(Data1=list_item_18.Item, Data2=list_item_18.Item1)  # disabled

explode_7 = Explode(Curve=curve_24, Recursive=True)  # -> Segments, Vertices; disabled
list_item_19 = ListItem(List=explode_7.Vertices, Index=0, Wrap=True)  # -> Item1, Item; disabled
merge_68 = Merge(Data1=list_item_19.Item, Data2=list_item_19.Item1)  # disabled

number_13 = Number(scissor_upper_crv_curvature_1_31)
number_14 = Number(scissor_upper_crv_curvature_2_31)
integer_7 = Integer(scissor_upper_crv_curvature_32)

number_15 = Number(scissor_lower_crv_curvature_1_31)
integer_8 = Integer(scissor_lower_crv_curvature_32)
number_16 = Number(scissor_lower_crv_curvature_2_31)

number_17 = Number(scissor_upper_crv_curvature_1_32)
number_18 = Number(scissor_upper_crv_curvature_2_32)
integer_9 = Integer(scissor_upper_crv_curvature_33)

number_19 = Number(scissor_lower_crv_curvature_1_32)
integer_10 = Integer(scissor_lower_crv_curvature_33)
number_20 = Number(scissor_lower_crv_curvature_2_32)

number_21 = Number(scissor_upper_crv_curvature_1_33)
number_22 = Number(scissor_upper_crv_curvature_2_33)
integer_11 = Integer(scissor_upper_crv_curvature_34)

number_23 = Number(scissor_lower_crv_curvature_1_33)
integer_12 = Integer(scissor_lower_crv_curvature_34)
number_24 = Number(scissor_lower_crv_curvature_2_33)

number_25 = Number(scissor_upper_crv_curvature_1_34)  # disabled
number_26 = Number(scissor_upper_crv_curvature_2_34)  # disabled
integer_13 = Integer(scissor_upper_crv_curvature_35)  # disabled

number_27 = Number(scissor_lower_crv_curvature_1_34)  # disabled
integer_14 = Integer(scissor_lower_crv_curvature_35)  # disabled
number_28 = Number(scissor_lower_crv_curvature_2_34)  # disabled

number_29 = Number(scissor_upper_crv_curvature_1_35)  # disabled
number_30 = Number(scissor_upper_crv_curvature_2_35)  # disabled
integer_15 = Integer(scissor_upper_crv_curvature_36)  # disabled

number_31 = Number(scissor_lower_crv_curvature_1_35)  # disabled
integer_16 = Integer(scissor_lower_crv_curvature_36)  # disabled
number_32 = Number(scissor_lower_crv_curvature_2_35)  # disabled

number_33 = Number(scissor_upper_crv_curvature_1_36)  # disabled
number_34 = Number(scissor_upper_crv_curvature_2_36)  # disabled
integer_17 = Integer(scissor_upper_crv_curvature_37)  # disabled

number_35 = Number(scissor_lower_crv_curvature_1_36)  # disabled
integer_18 = Integer(scissor_lower_crv_curvature_37)  # disabled
number_36 = Number(scissor_lower_crv_curvature_2_36)  # disabled

curve_27 = Curve(rebuild_curve_2)
list_item_20 = ListItem(List=flatten(curve_27), Index=0, Wrap=True)
flip_curve = FlipCurve(Curve=curve_27, Guide=list_item_20)  # -> Curve, Flag
facade_offset_4 = RemoteReceiver(facade_offset)
xy_plane_8 = XYPlane(Origin=area_3.Centroid)  # -> simplify(graft(Plane))
offset_curve = OffsetCurve(Curve=flip_curve.Curve, Distance=expr("-x", facade_offset_4), Plane=xy_plane_8, Corners=1)  # -> simplify(Curve)
curve_28 = Curve(offset_curve)

rear_elevation_glass_division_pareametrs_2 = RemoteReceiver(rear_elevation_glass_division_pareametrs)
curve_29 = Curve(curve_28)
flip_curve_2 = FlipCurve(Curve=curve_29)  # -> Curve, Flag
end_points = EndPoints(Curve=flip_curve_2.Curve)  # -> Start, End
evaluate_length = EvaluateLength(Curve=flip_curve_2.Curve, Length=rear_elevation_glass_division_pareametrs_2, Normalized=False)  # -> Point, Tangent, Parameter
clean_tree = CleanTree(RemoveNulls=True, RemoveInvalid=True, RemoveEmpty=False, Tree=evaluate_length.Point)
merge_69 = Merge(Data1=end_points.Start, Data2=clean_tree, Data3=end_points.End)
point_list_2 = PointList(Points=merge_69)
polyline = PolyLine(Vertices=merge_69, Closed=False)

rear_facade_crv = RemoteSender(polyline)

rear_facade_crv_2 = RemoteReceiver(rear_facade_crv)
list_item_21 = ListItem(List=flatten(rear_facade_crv_2), Index=0, Wrap=True)
rebuild_curve_3 = RebuildCurve(Curve=list_item_21, Degree=3, Count="50", Tangents=False)
unit_z_20 = UnitZ(Factor="62000")
extrude_8 = Extrude(Base=rebuild_curve_3, Direction=unit_z_20)
rear_ele_ref_srf = RemoteSender(extrude_8)

rear_ele_ref_srf_2 = RemoteReceiver(rear_ele_ref_srf)  # disabled

curve_30 = Curve(rebuild_curve)
list_item_22 = ListItem(List=flatten(curve_30), Index=0, Wrap=True)
flip_curve_3 = FlipCurve(Curve=curve_30, Guide=list_item_22)  # -> Curve, Flag
xy_plane_9 = XYPlane(Origin=area_3.Centroid)  # -> simplify(graft(Plane))
facade_offset_5 = RemoteReceiver(facade_offset)
subtraction_13 = Subtraction(A=list_length, B=1)
offset_curve_2 = OffsetCurve(Curve=flip_curve_3.Curve, Distance=expr("-x", facade_offset_5), Plane=xy_plane_9, Corners=1)  # -> simplify(Curve)
integer_19 = Integer(list_length_2)
integer_20 = Integer(subtraction_13)
merge_70 = Merge(Data1=integer_19, Data2=integer_20)  # -> flatten(Result)
curve_31 = Curve(offset_curve_2)
partition_list = PartitionList(List=flatten(curve_31), Size=merge_70)
explode_tree = ExplodeTree(Data=partition_list)  # -> Branch0, Branch1, Branch2

curve_32 = Curve(simplify(graft(explode_tree.Branch0)))
g_f_glass_division_parameters_2 = RemoteReceiver(g_f_glass_division_parameters)
flip_curve_4 = FlipCurve(Curve=curve_32)  # -> Curve, Flag
end_points_2 = EndPoints(Curve=flip_curve_4.Curve)  # -> Start, End
evaluate_length_2 = EvaluateLength(Curve=flip_curve_4.Curve, Length=g_f_glass_division_parameters_2, Normalized=False)  # -> Point, Tangent, Parameter
clean_tree_2 = CleanTree(RemoveNulls=True, RemoveInvalid=True, RemoveEmpty=False, Tree=evaluate_length_2.Point)
merge_71 = Merge(Data1=end_points_2.Start, Data2=clean_tree_2, Data3=end_points_2.End)
point_list_3 = PointList(Points=merge_71)
polyline_2 = PolyLine(Vertices=merge_71, Closed=False)

curve_33 = Curve(simplify(graft(explode_tree.Branch1)))
typical_floor_glass_division_parameters_2 = RemoteReceiver(typical_floor_glass_division_parameters)
flip_curve_5 = FlipCurve(Curve=curve_33)  # -> Curve, Flag
end_points_3 = EndPoints(Curve=flip_curve_5.Curve)  # -> Start, End
evaluate_length_3 = EvaluateLength(Curve=flip_curve_5.Curve, Length=typical_floor_glass_division_parameters_2, Normalized=False)  # -> Point, Tangent, Parameter
clean_tree_3 = CleanTree(RemoveNulls=True, RemoveInvalid=True, RemoveEmpty=False, Tree=evaluate_length_3.Point)
merge_72 = Merge(Data1=end_points_3.Start, Data2=clean_tree_3, Data3=end_points_3.End)
point_list_4 = PointList(Points=merge_72)
polyline_3 = PolyLine(Vertices=merge_72, Closed=False)

curve_34 = Curve(simplify(graft(explode_tree.Branch2)))
add_floor_glass_division_pareametrs_2 = RemoteReceiver(add_floor_glass_division_pareametrs)
flip_curve_6 = FlipCurve(Curve=curve_34)  # -> Curve, Flag
end_points_4 = EndPoints(Curve=flip_curve_6.Curve)  # -> Start, End
evaluate_length_4 = EvaluateLength(Curve=flip_curve_6.Curve, Length=add_floor_glass_division_pareametrs_2, Normalized=False)  # -> Point, Tangent, Parameter
clean_tree_4 = CleanTree(RemoveNulls=True, RemoveInvalid=True, RemoveEmpty=False, Tree=evaluate_length_4.Point)
merge_73 = Merge(Data1=end_points_4.Start, Data2=clean_tree_4, Data3=end_points_4.End)
point_list_5 = PointList(Points=merge_73)
polyline_4 = PolyLine(Vertices=merge_73, Closed=False)

ground_floor_glass_crvs = RemoteSender(polyline_2)
typical_floor_glass_crvs = RemoteSender(polyline_3)
add_floor_glass_crvs = RemoteSender(polyline_4)
merge_74 = Merge(Data1=polyline_2, Data2=polyline_3, Data3=polyline_4)  # -> flatten(Result)

add_floor_glass_crvs_2 = RemoteReceiver(add_floor_glass_crvs)
add_floor_glass_crvs_3 = RemoteReceiver(add_floor_glass_crvs)
add_floor_glass_crvs_4 = RemoteReceiver(add_floor_glass_crvs)  # disabled
add_floor_glass_crvs_5 = RemoteReceiver(add_floor_glass_crvs)  # disabled
curve_35 = Curve(flatten(merge_74))
curve_middle_2 = CurveMiddle(Curve=curve_35)
deconstruct_3 = Deconstruct(Point=curve_middle_2)  # -> XComponent, YComponent, ZComponent
sort_list_4 = SortList(Keys=deconstruct_3.ZComponent, ValuesValuesA=curve_35)  # -> Keys, ValuesValuesA

front_facade_crv = RemoteSender(sort_list_4.ValuesValuesA)

ground_floor_glass_crvs_2 = RemoteReceiver(ground_floor_glass_crvs)
typical_floor_glass_crvs_2 = RemoteReceiver(typical_floor_glass_crvs)
add_floor_glass_crvs_6 = RemoteReceiver(add_floor_glass_crvs)
boolean_toggle = BooleanToggle(False)

curve_36 = Curve(ground_floor_glass_crvs_2)
explode_8 = Explode(Curve=curve_36, Recursive=True)  # -> Segments, Vertices
interpolate = Interpolate(Vertices=explode_8.Vertices, Degree=3, Periodic=False, KnotStyle=1)  # -> flatten(Curve), Length, Domain
curve_middle_3 = CurveMiddle(Curve=interpolate.Curve)
deconstruct_4 = Deconstruct(Point=curve_middle_3)  # -> XComponent, YComponent, ZComponent
sort_list_5 = SortList(Keys=deconstruct_4.ZComponent, ValuesValuesA=interpolate.Curve)  # -> Keys, ValuesValuesA
loft = Loft(
    Curves=sort_list_5.ValuesValuesA,
    Options={Adjust=False, Closed=False, LoftEnds=0, LoftSimp=0, LoftType=2, Rebuild=10, Refit=0.01})

curve_37 = Curve(typical_floor_glass_crvs_2)
explode_9 = Explode(Curve=curve_37, Recursive=True)  # -> Segments, Vertices
interpolate_2 = Interpolate(Vertices=explode_9.Vertices, Degree=3, Periodic=False, KnotStyle=1)  # -> flatten(Curve), Length, Domain
curve_middle_4 = CurveMiddle(Curve=interpolate_2.Curve)
deconstruct_5 = Deconstruct(Point=curve_middle_4)  # -> XComponent, YComponent, ZComponent
sort_list_6 = SortList(Keys=deconstruct_5.ZComponent, ValuesValuesA=interpolate_2.Curve)  # -> Keys, ValuesValuesA
typical_floor_facade_crvs = RemoteSender(sort_list_6.ValuesValuesA)
loft_2 = Loft(
    Curves=sort_list_6.ValuesValuesA,
    Options={Adjust=False, Closed=False, LoftEnds=0, LoftSimp=0, LoftType=2, Rebuild=10, Refit=0.01})

curve_38 = Curve(add_floor_glass_crvs_6)
explode_10 = Explode(Curve=curve_38, Recursive=True)  # -> Segments, Vertices
interpolate_3 = Interpolate(Vertices=explode_10.Vertices, Degree=3, Periodic=False, KnotStyle=1)  # -> flatten(Curve), Length, Domain
curve_middle_5 = CurveMiddle(Curve=interpolate_3.Curve)
deconstruct_6 = Deconstruct(Point=curve_middle_5)  # -> XComponent, YComponent, ZComponent
sort_list_7 = SortList(Keys=deconstruct_6.ZComponent, ValuesValuesA=interpolate_3.Curve)  # -> Keys, ValuesValuesA
loft_3 = Loft(
    Curves=sort_list_7.ValuesValuesA,
    Options={Adjust=False, Closed=False, LoftEnds=0, LoftSimp=0, LoftType=2, Rebuild=10, Refit=0.01})

srf_extension_up_down_2 = RemoteReceiver(srf_extension_up_down)
srf_extension_left_right_2 = RemoteReceiver(srf_extension_left_right)
extend_surface = ExtendSurface(
    Surface=loft,
    WestEdge=srf_extension_up_down_2,
    SouthEdge=srf_extension_left_right_2,
    EastEdge=srf_extension_up_down_2,
    NorthEdge=srf_extension_left_right_2,
    ExtensionType=boolean_toggle)
ground_floor_reference_srf = RemoteSender(extend_surface)

typical_floor_glass_crvs_3 = RemoteReceiver(typical_floor_glass_crvs)
ground_floor_reference_srf_2 = RemoteReceiver(ground_floor_reference_srf)
curve_39 = Curve(flatten(typical_floor_glass_crvs_3))
list_item_23 = ListItem(List=curve_39, Index=number_slider_169, Wrap=True)
list_item_24 = ListItem(List=curve_39, Index=addition_17, Wrap=True)
surface_7 = Surface(ground_floor_reference_srf_2)

typical_floor_glass_crvs_4 = RemoteReceiver(typical_floor_glass_crvs)
ground_floor_reference_srf_3 = RemoteReceiver(ground_floor_reference_srf)
curve_40 = Curve(flatten(typical_floor_glass_crvs_4))
list_item_25 = ListItem(List=curve_40, Index=number_slider_170, Wrap=True)
list_item_26 = ListItem(List=curve_40, Index=addition_18, Wrap=True)
surface_8 = Surface(ground_floor_reference_srf_3)

typical_floor_glass_crvs_5 = RemoteReceiver(typical_floor_glass_crvs)
ground_floor_reference_srf_4 = RemoteReceiver(ground_floor_reference_srf)
curve_41 = Curve(flatten(typical_floor_glass_crvs_5))
list_item_27 = ListItem(List=curve_41, Index=number_slider_172, Wrap=True)
list_item_28 = ListItem(List=curve_41, Index=addition_20, Wrap=True)
surface_9 = Surface(ground_floor_reference_srf_4)

typical_floor_glass_crvs_6 = RemoteReceiver(typical_floor_glass_crvs)  # disabled
ground_floor_reference_srf_5 = RemoteReceiver(ground_floor_reference_srf)  # disabled
curve_42 = Curve(flatten(typical_floor_glass_crvs_6))  # disabled
list_item_29 = ListItem(List=curve_42, Index=number_slider_184, Wrap=True)  # disabled
list_item_30 = ListItem(List=curve_42, Index=addition_32, Wrap=True)  # disabled
surface_10 = Surface(ground_floor_reference_srf_5)  # disabled

typical_floor_glass_crvs_7 = RemoteReceiver(typical_floor_glass_crvs)  # disabled
ground_floor_reference_srf_6 = RemoteReceiver(ground_floor_reference_srf)  # disabled
curve_43 = Curve(flatten(typical_floor_glass_crvs_7))  # disabled
list_item_31 = ListItem(List=curve_43, Index=number_slider_185, Wrap=True)  # disabled
list_item_32 = ListItem(List=curve_43, Index=addition_33, Wrap=True)  # disabled
surface_11 = Surface(ground_floor_reference_srf_6)  # disabled

typical_floor_glass_crvs_8 = RemoteReceiver(typical_floor_glass_crvs)  # disabled
ground_floor_reference_srf_7 = RemoteReceiver(ground_floor_reference_srf)  # disabled
curve_44 = Curve(flatten(typical_floor_glass_crvs_8))  # disabled
list_item_33 = ListItem(List=curve_44, Index=number_slider_186, Wrap=True)  # disabled
list_item_34 = ListItem(List=curve_44, Index=addition_34, Wrap=True)  # disabled
surface_12 = Surface(ground_floor_reference_srf_7)  # disabled

cluster = Cluster_2(
    reduce_straight_length=remap_numbers_16.Mapped,
    cross_section_fillet_1=cross_section_fillet_1_16,
    cross_section_fillet_2=cross_section_fillet_2_16,
    cross_section_curvature=cross_section_curvature_16,
    scissor_upper_crv_curvature_1=scissor_upper_crv_curvature_1_16,
    scissor_upper_crv_curvature_2=scissor_upper_crv_curvature_2_16,
    scissor_upper_crv_curvature=scissor_upper_crv_curvature_17,
    scissor_lower_crv_curvature_1=scissor_lower_crv_curvature_1_16,
    scissor_lower_crv_curvature_2=scissor_lower_crv_curvature_2_16,
    scissor_lower_crv_curvature=scissor_lower_crv_curvature_17,
    left_side_straight_bands=left_side_straight_bands_45,
    right_side_straight_bands=right_side_straight_bands_41,
    floor_crv=list_item_27,
    next_floor_crv=list_item_28,
    reference_srf=surface_9,
    left_side_cross_section_crv=merge_33,
    right_side_cross_section_crv=merge_31,
    select_upper_lower_left_cross_section=select_upper_lower_left_cross_section_16,
    select_upper_lower_right_cross_section=select_upper_lower_right_cross_section_16,
    balcony_side_additional_cross_setional_c=balcony_side_additional_cross_setional_c_24)  # -> pts_2, crvs_2, straight_srf_2, fillet_srf_2
straight_srf = Surface(cluster.straight_srf_2)
point = Point(cluster.pts_2)
curve_45 = Curve(cluster.crvs_2)
fillet_srf = Surface(cluster.fillet_srf_2)

cluster_2 = Cluster_2(
    reduce_straight_length=remap_numbers_30.Mapped,
    cross_section_fillet_1=cross_section_fillet_1_30,
    cross_section_fillet_2=cross_section_fillet_2_30,
    cross_section_curvature=cross_section_curvature_30,
    scissor_upper_crv_curvature_1=scissor_upper_crv_curvature_1_30,
    scissor_upper_crv_curvature_2=scissor_upper_crv_curvature_2_30,
    scissor_upper_crv_curvature=scissor_upper_crv_curvature_31,
    scissor_lower_crv_curvature_1=scissor_lower_crv_curvature_1_30,
    scissor_lower_crv_curvature_2=scissor_lower_crv_curvature_2_30,
    scissor_lower_crv_curvature=scissor_lower_crv_curvature_31,
    left_side_straight_bands=left_side_straight_bands_61,
    right_side_straight_bands=right_side_straight_bands_57,
    floor_crv=list_item_33,
    next_floor_crv=list_item_34,
    reference_srf=surface_12,
    left_side_cross_section_crv=merge_60,
    right_side_cross_section_crv=merge_59,
    select_upper_lower_left_cross_section=select_upper_lower_left_cross_section_30,
    select_upper_lower_right_cross_section=select_upper_lower_right_cross_section_30,
    balcony_side_additional_cross_setional_c=balcony_side_additional_cross_setional_c_30)  # -> pts_2, crvs_2, straight_srf_2, fillet_srf_2; disabled
straight_srf_2 = Surface(cluster_2.straight_srf_2)  # disabled
point_2 = Point(cluster_2.pts_2)  # disabled
curve_46 = Curve(cluster_2.crvs_2)  # disabled
fillet_srf_2 = Surface(cluster_2.fillet_srf_2)  # disabled

cluster_3 = Cluster_2(
    reduce_straight_length=remap_numbers_13.Mapped,
    cross_section_fillet_1=cross_section_fillet_1_13,
    cross_section_fillet_2=cross_section_fillet_2_13,
    cross_section_curvature=cross_section_curvature_13,
    scissor_upper_crv_curvature_1=scissor_upper_crv_curvature_1_13,
    scissor_upper_crv_curvature_2=scissor_upper_crv_curvature_2_13,
    scissor_upper_crv_curvature=scissor_upper_crv_curvature_14,
    scissor_lower_crv_curvature_1=scissor_lower_crv_curvature_1_13,
    scissor_lower_crv_curvature_2=scissor_lower_crv_curvature_2_13,
    scissor_lower_crv_curvature=scissor_lower_crv_curvature_14,
    left_side_straight_bands=left_side_straight_bands_41,
    right_side_straight_bands=right_side_straight_bands_37,
    floor_crv=list_item_23,
    next_floor_crv=list_item_24,
    reference_srf=surface_7,
    left_side_cross_section_crv=merge_27,
    right_side_cross_section_crv=merge_25,
    select_upper_lower_left_cross_section=select_upper_lower_left_cross_section_13,
    select_upper_lower_right_cross_section=select_upper_lower_right_cross_section_13,
    balcony_side_additional_cross_setional_c=balcony_side_additional_cross_setional_c_8)  # -> pts_2, crvs_2, straight_srf_2, fillet_srf_2
straight_srf_3 = Surface(cluster_3.straight_srf_2)
point_3 = Point(cluster_3.pts_2)
curve_47 = Curve(cluster_3.crvs_2)
fillet_srf_3 = Surface(cluster_3.fillet_srf_2)

cluster_4 = Cluster_2(
    reduce_straight_length=remap_numbers_28.Mapped,
    cross_section_fillet_1=cross_section_fillet_1_28,
    cross_section_fillet_2=cross_section_fillet_2_28,
    cross_section_curvature=cross_section_curvature_28,
    scissor_upper_crv_curvature_1=scissor_upper_crv_curvature_1_28,
    scissor_upper_crv_curvature_2=scissor_upper_crv_curvature_2_28,
    scissor_upper_crv_curvature=scissor_upper_crv_curvature_29,
    scissor_lower_crv_curvature_1=scissor_lower_crv_curvature_1_28,
    scissor_lower_crv_curvature_2=scissor_lower_crv_curvature_2_28,
    scissor_lower_crv_curvature=scissor_lower_crv_curvature_29,
    left_side_straight_bands=left_side_straight_bands_58,
    right_side_straight_bands=right_side_straight_bands_54,
    floor_crv=list_item_29,
    next_floor_crv=list_item_30,
    reference_srf=surface_10,
    left_side_cross_section_crv=merge_56,
    right_side_cross_section_crv=merge_54,
    select_upper_lower_left_cross_section=select_upper_lower_left_cross_section_28,
    select_upper_lower_right_cross_section=select_upper_lower_right_cross_section_28,
    balcony_side_additional_cross_setional_c=balcony_side_additional_cross_setional_c_16)  # -> pts_2, crvs_2, straight_srf_2, fillet_srf_2; disabled
straight_srf_4 = Surface(cluster_4.straight_srf_2)  # disabled
point_4 = Point(cluster_4.pts_2)  # disabled
curve_48 = Curve(cluster_4.crvs_2)  # disabled
fillet_srf_4 = Surface(cluster_4.fillet_srf_2)  # disabled

srf_extension_up_down_3 = RemoteReceiver(srf_extension_up_down)
srf_extension_left_right_3 = RemoteReceiver(srf_extension_left_right)
extend_surface_2 = ExtendSurface(
    Surface=loft_2,
    WestEdge=srf_extension_up_down_3,
    SouthEdge=srf_extension_left_right_3,
    EastEdge=srf_extension_up_down_3,
    NorthEdge=srf_extension_left_right_3,
    ExtensionType=boolean_toggle)
typical_floor_reference_srf = RemoteSender(extend_surface_2)

typical_floor_glass_crvs_9 = RemoteReceiver(typical_floor_glass_crvs)
typical_floor_reference_srf_2 = RemoteReceiver(typical_floor_reference_srf)
curve_49 = Curve(flatten(typical_floor_glass_crvs_9))
list_item_35 = ListItem(List=curve_49, Index=number_slider_157, Wrap=True)
list_item_36 = ListItem(List=curve_49, Index=addition_5, Wrap=True)
surface_13 = Surface(typical_floor_reference_srf_2)

typical_floor_glass_crvs_10 = RemoteReceiver(typical_floor_glass_crvs)
typical_floor_reference_srf_3 = RemoteReceiver(typical_floor_reference_srf)
curve_50 = Curve(flatten(typical_floor_glass_crvs_10))
list_item_37 = ListItem(List=curve_50, Index=number_slider_159, Wrap=True)
list_item_38 = ListItem(List=curve_50, Index=addition_7, Wrap=True)
surface_14 = Surface(typical_floor_reference_srf_3)

typical_floor_glass_crvs_11 = RemoteReceiver(typical_floor_glass_crvs)
typical_floor_reference_srf_4 = RemoteReceiver(typical_floor_reference_srf)
curve_51 = Curve(flatten(typical_floor_glass_crvs_11))
list_item_39 = ListItem(List=curve_51, Index=number_slider_161, Wrap=True)
list_item_40 = ListItem(List=curve_51, Index=addition_9, Wrap=True)
surface_15 = Surface(typical_floor_reference_srf_4)

typical_floor_glass_crvs_12 = RemoteReceiver(typical_floor_glass_crvs)
typical_floor_reference_srf_5 = RemoteReceiver(typical_floor_reference_srf)
curve_52 = Curve(flatten(typical_floor_glass_crvs_12))
list_item_41 = ListItem(List=curve_52, Index=number_slider_162, Wrap=True)
list_item_42 = ListItem(List=curve_52, Index=addition_10, Wrap=True)
surface_16 = Surface(typical_floor_reference_srf_5)

typical_floor_glass_crvs_13 = RemoteReceiver(typical_floor_glass_crvs)
typical_floor_reference_srf_6 = RemoteReceiver(typical_floor_reference_srf)
curve_53 = Curve(flatten(typical_floor_glass_crvs_13))
list_item_43 = ListItem(List=curve_53, Index=number_slider_163, Wrap=True)
list_item_44 = ListItem(List=curve_53, Index=addition_11, Wrap=True)
surface_17 = Surface(typical_floor_reference_srf_6)

typical_floor_glass_crvs_14 = RemoteReceiver(typical_floor_glass_crvs)
typical_floor_reference_srf_7 = RemoteReceiver(typical_floor_reference_srf)
curve_54 = Curve(flatten(typical_floor_glass_crvs_14))
list_item_45 = ListItem(List=curve_54, Index=number_slider_164, Wrap=True)
list_item_46 = ListItem(List=curve_54, Index=addition_12, Wrap=True)
surface_18 = Surface(typical_floor_reference_srf_7)

typical_floor_glass_crvs_15 = RemoteReceiver(typical_floor_glass_crvs)
typical_floor_reference_srf_8 = RemoteReceiver(typical_floor_reference_srf)
curve_55 = Curve(flatten(typical_floor_glass_crvs_15))
list_item_47 = ListItem(List=curve_55, Index=number_slider_165, Wrap=True)
list_item_48 = ListItem(List=curve_55, Index=addition_13, Wrap=True)
surface_19 = Surface(typical_floor_reference_srf_8)

typical_floor_glass_crvs_16 = RemoteReceiver(typical_floor_glass_crvs)
typical_floor_reference_srf_9 = RemoteReceiver(typical_floor_reference_srf)
curve_56 = Curve(flatten(typical_floor_glass_crvs_16))
list_item_49 = ListItem(List=curve_56, Index=number_slider_166, Wrap=True)
list_item_50 = ListItem(List=curve_56, Index=addition_14, Wrap=True)
surface_20 = Surface(typical_floor_reference_srf_9)

typical_floor_glass_crvs_17 = RemoteReceiver(typical_floor_glass_crvs)
typical_floor_reference_srf_10 = RemoteReceiver(typical_floor_reference_srf)
curve_57 = Curve(flatten(typical_floor_glass_crvs_17))
list_item_51 = ListItem(List=curve_57, Index=number_slider_167, Wrap=True)
list_item_52 = ListItem(List=curve_57, Index=addition_15, Wrap=True)
surface_21 = Surface(typical_floor_reference_srf_10)

typical_floor_glass_crvs_18 = RemoteReceiver(typical_floor_glass_crvs)
typical_floor_reference_srf_11 = RemoteReceiver(typical_floor_reference_srf)
curve_58 = Curve(flatten(typical_floor_glass_crvs_18))
list_item_53 = ListItem(List=curve_58, Index=number_slider_168, Wrap=True)
list_item_54 = ListItem(List=curve_58, Index=addition_16, Wrap=True)
surface_22 = Surface(typical_floor_reference_srf_11)

typical_floor_glass_crvs_19 = RemoteReceiver(typical_floor_glass_crvs)  # disabled
typical_floor_reference_srf_12 = RemoteReceiver(typical_floor_reference_srf)  # disabled
curve_59 = Curve(flatten(typical_floor_glass_crvs_19))  # disabled
list_item_55 = ListItem(List=curve_59, Index=number_slider_171, Wrap=True)  # disabled
list_item_56 = ListItem(List=curve_59, Index=addition_19, Wrap=True)  # disabled
surface_23 = Surface(typical_floor_reference_srf_12)  # disabled

typical_floor_glass_crvs_20 = RemoteReceiver(typical_floor_glass_crvs)  # disabled
typical_floor_reference_srf_13 = RemoteReceiver(typical_floor_reference_srf)  # disabled
curve_60 = Curve(flatten(typical_floor_glass_crvs_20))  # disabled
list_item_57 = ListItem(List=curve_60, Index=number_slider_174, Wrap=True)  # disabled
list_item_58 = ListItem(List=curve_60, Index=addition_22, Wrap=True)  # disabled
surface_24 = Surface(typical_floor_reference_srf_13)  # disabled

typical_floor_glass_crvs_21 = RemoteReceiver(typical_floor_glass_crvs)  # disabled
typical_floor_reference_srf_14 = RemoteReceiver(typical_floor_reference_srf)  # disabled
curve_61 = Curve(flatten(typical_floor_glass_crvs_21))  # disabled
list_item_59 = ListItem(List=curve_61, Index=number_slider_176, Wrap=True)  # disabled
list_item_60 = ListItem(List=curve_61, Index=addition_24, Wrap=True)  # disabled
surface_25 = Surface(typical_floor_reference_srf_14)  # disabled

typical_floor_glass_crvs_22 = RemoteReceiver(typical_floor_glass_crvs)  # disabled
typical_floor_reference_srf_15 = RemoteReceiver(typical_floor_reference_srf)  # disabled
curve_62 = Curve(flatten(typical_floor_glass_crvs_22))  # disabled
list_item_61 = ListItem(List=curve_62, Index=number_slider_177, Wrap=True)  # disabled
list_item_62 = ListItem(List=curve_62, Index=addition_25, Wrap=True)  # disabled
surface_26 = Surface(typical_floor_reference_srf_15)  # disabled

typical_floor_glass_crvs_23 = RemoteReceiver(typical_floor_glass_crvs)  # disabled
typical_floor_reference_srf_16 = RemoteReceiver(typical_floor_reference_srf)  # disabled
curve_63 = Curve(flatten(typical_floor_glass_crvs_23))  # disabled
list_item_63 = ListItem(List=curve_63, Index=number_slider_178, Wrap=True)  # disabled
list_item_64 = ListItem(List=curve_63, Index=addition_26, Wrap=True)  # disabled
surface_27 = Surface(typical_floor_reference_srf_16)  # disabled

typical_floor_glass_crvs_24 = RemoteReceiver(typical_floor_glass_crvs)  # disabled
typical_floor_reference_srf_17 = RemoteReceiver(typical_floor_reference_srf)  # disabled
curve_64 = Curve(flatten(typical_floor_glass_crvs_24))  # disabled
list_item_65 = ListItem(List=curve_64, Index=number_slider_179, Wrap=True)  # disabled
list_item_66 = ListItem(List=curve_64, Index=addition_27, Wrap=True)  # disabled
surface_28 = Surface(typical_floor_reference_srf_17)  # disabled

typical_floor_glass_crvs_25 = RemoteReceiver(typical_floor_glass_crvs)  # disabled
typical_floor_reference_srf_18 = RemoteReceiver(typical_floor_reference_srf)  # disabled
curve_65 = Curve(flatten(typical_floor_glass_crvs_25))  # disabled
list_item_67 = ListItem(List=curve_65, Index=number_slider_180, Wrap=True)  # disabled
list_item_68 = ListItem(List=curve_65, Index=addition_28, Wrap=True)  # disabled
surface_29 = Surface(typical_floor_reference_srf_18)  # disabled

typical_floor_glass_crvs_26 = RemoteReceiver(typical_floor_glass_crvs)  # disabled
typical_floor_reference_srf_19 = RemoteReceiver(typical_floor_reference_srf)  # disabled
curve_66 = Curve(flatten(typical_floor_glass_crvs_26))  # disabled
list_item_69 = ListItem(List=curve_66, Index=number_slider_181, Wrap=True)  # disabled
list_item_70 = ListItem(List=curve_66, Index=addition_29, Wrap=True)  # disabled
surface_30 = Surface(typical_floor_reference_srf_19)  # disabled

typical_floor_glass_crvs_27 = RemoteReceiver(typical_floor_glass_crvs)  # disabled
typical_floor_reference_srf_20 = RemoteReceiver(typical_floor_reference_srf)  # disabled
curve_67 = Curve(flatten(typical_floor_glass_crvs_27))  # disabled
list_item_71 = ListItem(List=curve_67, Index=number_slider_182, Wrap=True)  # disabled
list_item_72 = ListItem(List=curve_67, Index=addition_30, Wrap=True)  # disabled
surface_31 = Surface(typical_floor_reference_srf_20)  # disabled

typical_floor_glass_crvs_28 = RemoteReceiver(typical_floor_glass_crvs)  # disabled
typical_floor_reference_srf_21 = RemoteReceiver(typical_floor_reference_srf)  # disabled
curve_68 = Curve(flatten(typical_floor_glass_crvs_28))  # disabled
list_item_73 = ListItem(List=curve_68, Index=number_slider_183, Wrap=True)  # disabled
list_item_74 = ListItem(List=curve_68, Index=addition_31, Wrap=True)  # disabled
surface_32 = Surface(typical_floor_reference_srf_21)  # disabled

cluster_5 = Cluster(
    reduce_straight_length=remap_numbers.Mapped,
    cross_section_fillet_1=cross_section_fillet_1,
    cross_section_fillet_2=cross_section_fillet_2,
    cross_section_curvature=cross_section_curvature,
    scissor_upper_crv_curvature_1=scissor_upper_crv_curvature_1,
    scissor_upper_crv_curvature_2=scissor_upper_crv_curvature_2,
    scissor_upper_crv_curvature=scissor_upper_crv_curvature,
    scissor_lower_crv_curvature_1=scissor_lower_crv_curvature_1,
    scissor_lower_crv_curvature_2=scissor_lower_crv_curvature_2,
    scissor_lower_crv_curvature=scissor_lower_crv_curvature,
    left_side_straight_bands=left_side_straight_bands_28,
    right_side_straight_bands=right_side_straight_bands_24,
    floor_crv=list_item_35,
    next_floor_crv=list_item_36,
    reference_srf=surface_13,
    left_side_cross_section_crv=typical_left_lower_crv,
    right_side_cross_section_crv=typical_right_lower_crv,
    select_upper_lower_left_cross_section=select_upper_lower_left_cross_section,
    select_upper_lower_right_cross_section=select_upper_lower_right_cross_section,
    balcony_side_additional_cross_setional_c=balcony_side_additional_cross_setional_c_17)  # -> pts_2, crvs_2, straight_srf_2, fillet_srf_2
straight_srf_5 = Surface(cluster_5.straight_srf_2)
point_5 = Point(cluster_5.pts_2)
curve_69 = Curve(cluster_5.crvs_2)
fillet_srf_5 = Surface(cluster_5.fillet_srf_2)

cluster_6 = Cluster(
    reduce_straight_length=remap_numbers_15.Mapped,
    cross_section_fillet_1=cross_section_fillet_1_15,
    cross_section_fillet_2=cross_section_fillet_2_15,
    cross_section_curvature=cross_section_curvature_15,
    scissor_upper_crv_curvature_1=scissor_upper_crv_curvature_1_15,
    scissor_upper_crv_curvature_2=scissor_upper_crv_curvature_2_15,
    scissor_upper_crv_curvature=scissor_upper_crv_curvature_16,
    scissor_lower_crv_curvature_1=scissor_lower_crv_curvature_1_15,
    scissor_lower_crv_curvature_2=scissor_lower_crv_curvature_2_15,
    scissor_lower_crv_curvature=scissor_lower_crv_curvature_16,
    left_side_straight_bands=left_side_straight_bands_44,
    right_side_straight_bands=right_side_straight_bands_40,
    floor_crv=list_item_55,
    next_floor_crv=list_item_56,
    reference_srf=surface_23,
    left_side_cross_section_crv=typical_left_lower_crv_15,
    right_side_cross_section_crv=typical_right_lower_crv_15,
    select_upper_lower_left_cross_section=select_upper_lower_left_cross_section_15,
    select_upper_lower_right_cross_section=select_upper_lower_right_cross_section_15,
    balcony_side_additional_cross_setional_c=balcony_side_additional_cross_setional_c_23)  # -> pts_2, crvs_2, straight_srf_2, fillet_srf_2; disabled
straight_srf_6 = Surface(cluster_6.straight_srf_2)  # disabled
point_6 = Point(cluster_6.pts_2)  # disabled
curve_70 = Curve(cluster_6.crvs_2)  # disabled
fillet_srf_6 = Surface(cluster_6.fillet_srf_2)  # disabled

cluster_7 = Cluster(
    reduce_straight_length=remap_numbers_3.Mapped,
    cross_section_fillet_1=cross_section_fillet_1_3,
    cross_section_fillet_2=cross_section_fillet_2_3,
    cross_section_curvature=cross_section_curvature_3,
    scissor_upper_crv_curvature_1=scissor_upper_crv_curvature_1_3,
    scissor_upper_crv_curvature_2=scissor_upper_crv_curvature_2_3,
    scissor_upper_crv_curvature=scissor_upper_crv_curvature_4,
    scissor_lower_crv_curvature_1=scissor_lower_crv_curvature_1_3,
    scissor_lower_crv_curvature_2=scissor_lower_crv_curvature_2_3,
    scissor_lower_crv_curvature=scissor_lower_crv_curvature_4,
    left_side_straight_bands=left_side_straight_bands_30,
    right_side_straight_bands=right_side_straight_bands_26,
    floor_crv=list_item_37,
    next_floor_crv=list_item_38,
    reference_srf=surface_14,
    left_side_cross_section_crv=typical_left_lower_crv_3,
    right_side_cross_section_crv=merge_6,
    select_upper_lower_left_cross_section=select_upper_lower_left_cross_section_3,
    select_upper_lower_right_cross_section=select_upper_lower_right_cross_section_3,
    balcony_side_additional_cross_setional_c=balcony_side_additional_cross_setional_c_18)  # -> pts_2, crvs_2, straight_srf_2, fillet_srf_2
straight_srf_7 = Surface(cluster_7.straight_srf_2)
point_7 = Point(cluster_7.pts_2)
curve_71 = Curve(cluster_7.crvs_2)
fillet_srf_7 = Surface(cluster_7.fillet_srf_2)

cluster_8 = Cluster(
    reduce_straight_length=remap_numbers_18.Mapped,
    cross_section_fillet_1=cross_section_fillet_1_18,
    cross_section_fillet_2=cross_section_fillet_2_18,
    cross_section_curvature=cross_section_curvature_18,
    scissor_upper_crv_curvature_1=scissor_upper_crv_curvature_1_18,
    scissor_upper_crv_curvature_2=scissor_upper_crv_curvature_2_18,
    scissor_upper_crv_curvature=scissor_upper_crv_curvature_19,
    scissor_lower_crv_curvature_1=scissor_lower_crv_curvature_1_18,
    scissor_lower_crv_curvature_2=scissor_lower_crv_curvature_2_18,
    scissor_lower_crv_curvature=scissor_lower_crv_curvature_19,
    left_side_straight_bands=left_side_straight_bands_47,
    right_side_straight_bands=right_side_straight_bands_43,
    floor_crv=list_item_57,
    next_floor_crv=list_item_58,
    reference_srf=surface_24,
    left_side_cross_section_crv=typical_left_lower_crv_18,
    right_side_cross_section_crv=merge_36,
    select_upper_lower_left_cross_section=select_upper_lower_left_cross_section_18,
    select_upper_lower_right_cross_section=select_upper_lower_right_cross_section_18,
    balcony_side_additional_cross_setional_c=balcony_side_additional_cross_setional_c_25)  # -> pts_2, crvs_2, straight_srf_2, fillet_srf_2; disabled
straight_srf_8 = Surface(cluster_8.straight_srf_2)  # disabled
point_8 = Point(cluster_8.pts_2)  # disabled
curve_72 = Curve(cluster_8.crvs_2)  # disabled
fillet_srf_8 = Surface(cluster_8.fillet_srf_2)  # disabled

cluster_9 = Cluster(
    reduce_straight_length=remap_numbers_5.Mapped,
    cross_section_fillet_1=cross_section_fillet_1_5,
    cross_section_fillet_2=cross_section_fillet_2_5,
    cross_section_curvature=cross_section_curvature_5,
    scissor_upper_crv_curvature_1=scissor_upper_crv_curvature_1_5,
    scissor_upper_crv_curvature_2=scissor_upper_crv_curvature_2_5,
    scissor_upper_crv_curvature=scissor_upper_crv_curvature_6,
    scissor_lower_crv_curvature_1=scissor_lower_crv_curvature_1_5,
    scissor_lower_crv_curvature_2=scissor_lower_crv_curvature_2_5,
    scissor_lower_crv_curvature=scissor_lower_crv_curvature_6,
    left_side_straight_bands=left_side_straight_bands_32,
    right_side_straight_bands=right_side_straight_bands_28,
    floor_crv=list_item_39,
    next_floor_crv=list_item_40,
    reference_srf=surface_15,
    left_side_cross_section_crv=merge_10,
    right_side_cross_section_crv=merge_9,
    select_upper_lower_left_cross_section=select_upper_lower_left_cross_section_5,
    select_upper_lower_right_cross_section=select_upper_lower_right_cross_section_5,
    balcony_side_additional_cross_setional_c=balcony_side_additional_cross_setional_c_3)  # -> pts_2, crvs_2, straight_srf_2, fillet_srf_2
straight_srf_9 = Surface(cluster_9.straight_srf_2)
point_9 = Point(cluster_9.pts_2)
curve_73 = Curve(cluster_9.crvs_2)
fillet_srf_9 = Surface(cluster_9.fillet_srf_2)

cluster_10 = Cluster(
    reduce_straight_length=remap_numbers_20.Mapped,
    cross_section_fillet_1=cross_section_fillet_1_20,
    cross_section_fillet_2=cross_section_fillet_2_20,
    cross_section_curvature=cross_section_curvature_20,
    scissor_upper_crv_curvature_1=scissor_upper_crv_curvature_1_20,
    scissor_upper_crv_curvature_2=scissor_upper_crv_curvature_2_20,
    scissor_upper_crv_curvature=scissor_upper_crv_curvature_21,
    scissor_lower_crv_curvature_1=scissor_lower_crv_curvature_1_20,
    scissor_lower_crv_curvature_2=scissor_lower_crv_curvature_2_20,
    scissor_lower_crv_curvature=scissor_lower_crv_curvature_21,
    left_side_straight_bands=left_side_straight_bands_49,
    right_side_straight_bands=right_side_straight_bands_45,
    floor_crv=list_item_59,
    next_floor_crv=list_item_60,
    reference_srf=surface_25,
    left_side_cross_section_crv=merge_40,
    right_side_cross_section_crv=merge_39,
    select_upper_lower_left_cross_section=select_upper_lower_left_cross_section_20,
    select_upper_lower_right_cross_section=select_upper_lower_right_cross_section_20,
    balcony_side_additional_cross_setional_c=balcony_side_additional_cross_setional_c_11)  # -> pts_2, crvs_2, straight_srf_2, fillet_srf_2; disabled
straight_srf_10 = Surface(cluster_10.straight_srf_2)  # disabled
point_10 = Point(cluster_10.pts_2)  # disabled
curve_74 = Curve(cluster_10.crvs_2)  # disabled
fillet_srf_10 = Surface(cluster_10.fillet_srf_2)  # disabled

cluster_11 = Cluster(
    reduce_straight_length=remap_numbers_6.Mapped,
    cross_section_fillet_1=cross_section_fillet_1_6,
    cross_section_fillet_2=cross_section_fillet_2_6,
    cross_section_curvature=cross_section_curvature_6,
    scissor_upper_crv_curvature_1=scissor_upper_crv_curvature_1_6,
    scissor_upper_crv_curvature_2=scissor_upper_crv_curvature_2_6,
    scissor_upper_crv_curvature=scissor_upper_crv_curvature_7,
    scissor_lower_crv_curvature_1=scissor_lower_crv_curvature_1_6,
    scissor_lower_crv_curvature_2=scissor_lower_crv_curvature_2_6,
    scissor_lower_crv_curvature=scissor_lower_crv_curvature_7,
    left_side_straight_bands=left_side_straight_bands_33,
    right_side_straight_bands=right_side_straight_bands_29,
    floor_crv=list_item_41,
    next_floor_crv=list_item_42,
    reference_srf=surface_16,
    left_side_cross_section_crv=merge_13,
    right_side_cross_section_crv=merge_11,
    select_upper_lower_left_cross_section=select_upper_lower_left_cross_section_6,
    select_upper_lower_right_cross_section=select_upper_lower_right_cross_section_6,
    balcony_side_additional_cross_setional_c=balcony_side_additional_cross_setional_c_4)  # -> pts_2, crvs_2, straight_srf_2, fillet_srf_2
straight_srf_11 = Surface(cluster_11.straight_srf_2)
point_11 = Point(cluster_11.pts_2)
curve_75 = Curve(cluster_11.crvs_2)
fillet_srf_11 = Surface(cluster_11.fillet_srf_2)

cluster_12 = Cluster(
    reduce_straight_length=remap_numbers_7.Mapped,
    cross_section_fillet_1=cross_section_fillet_1_7,
    cross_section_fillet_2=cross_section_fillet_2_7,
    cross_section_curvature=cross_section_curvature_7,
    scissor_upper_crv_curvature_1=scissor_upper_crv_curvature_1_7,
    scissor_upper_crv_curvature_2=scissor_upper_crv_curvature_2_7,
    scissor_upper_crv_curvature=scissor_upper_crv_curvature_8,
    scissor_lower_crv_curvature_1=scissor_lower_crv_curvature_1_7,
    scissor_lower_crv_curvature_2=scissor_lower_crv_curvature_2_7,
    scissor_lower_crv_curvature=scissor_lower_crv_curvature_8,
    left_side_straight_bands=left_side_straight_bands_34,
    right_side_straight_bands=right_side_straight_bands_30,
    floor_crv=list_item_43,
    next_floor_crv=list_item_44,
    reference_srf=surface_17,
    left_side_cross_section_crv=merge_14,
    right_side_cross_section_crv=merge_12,
    select_upper_lower_left_cross_section=select_upper_lower_left_cross_section_7,
    select_upper_lower_right_cross_section=select_upper_lower_right_cross_section_7,
    balcony_side_additional_cross_setional_c=balcony_side_additional_cross_setional_c_19)  # -> pts_2, crvs_2, straight_srf_2, fillet_srf_2
straight_srf_12 = Surface(cluster_12.straight_srf_2)
point_12 = Point(cluster_12.pts_2)
curve_76 = Curve(cluster_12.crvs_2)
fillet_srf_12 = Surface(cluster_12.fillet_srf_2)

cluster_13 = Cluster(
    reduce_straight_length=remap_numbers_9.Mapped,
    cross_section_fillet_1=cross_section_fillet_1_9,
    cross_section_fillet_2=cross_section_fillet_2_9,
    cross_section_curvature=cross_section_curvature_9,
    scissor_upper_crv_curvature_1=scissor_upper_crv_curvature_1_9,
    scissor_upper_crv_curvature_2=scissor_upper_crv_curvature_2_9,
    scissor_upper_crv_curvature=scissor_upper_crv_curvature_10,
    scissor_lower_crv_curvature_1=scissor_lower_crv_curvature_1_9,
    scissor_lower_crv_curvature_2=scissor_lower_crv_curvature_2_9,
    scissor_lower_crv_curvature=scissor_lower_crv_curvature_10,
    left_side_straight_bands=left_side_straight_bands_36,
    right_side_straight_bands=right_side_straight_bands_32,
    floor_crv=list_item_47,
    next_floor_crv=list_item_48,
    reference_srf=surface_19,
    left_side_cross_section_crv=merge_19,
    right_side_cross_section_crv=merge_16,
    select_upper_lower_left_cross_section=select_upper_lower_left_cross_section_9,
    select_upper_lower_right_cross_section=select_upper_lower_right_cross_section_9,
    balcony_side_additional_cross_setional_c=balcony_side_additional_cross_setional_c_6)  # -> pts_2, crvs_2, straight_srf_2, fillet_srf_2
straight_srf_13 = Surface(cluster_13.straight_srf_2)
point_13 = Point(cluster_13.pts_2)
curve_77 = Curve(cluster_13.crvs_2)
fillet_srf_13 = Surface(cluster_13.fillet_srf_2)

cluster_14 = Cluster(
    reduce_straight_length=remap_numbers_10.Mapped,
    cross_section_fillet_1=cross_section_fillet_1_10,
    cross_section_fillet_2=cross_section_fillet_2_10,
    cross_section_curvature=cross_section_curvature_10,
    scissor_upper_crv_curvature_1=scissor_upper_crv_curvature_1_10,
    scissor_upper_crv_curvature_2=scissor_upper_crv_curvature_2_10,
    scissor_upper_crv_curvature=scissor_upper_crv_curvature_11,
    scissor_lower_crv_curvature_1=scissor_lower_crv_curvature_1_10,
    scissor_lower_crv_curvature_2=scissor_lower_crv_curvature_2_10,
    scissor_lower_crv_curvature=scissor_lower_crv_curvature_11,
    left_side_straight_bands=left_side_straight_bands_37,
    right_side_straight_bands=right_side_straight_bands_33,
    floor_crv=list_item_49,
    next_floor_crv=list_item_50,
    reference_srf=surface_20,
    left_side_cross_section_crv=merge_20,
    right_side_cross_section_crv=merge_17,
    select_upper_lower_left_cross_section=select_upper_lower_left_cross_section_10,
    select_upper_lower_right_cross_section=select_upper_lower_right_cross_section_10,
    balcony_side_additional_cross_setional_c=balcony_side_additional_cross_setional_c_20)  # -> pts_2, crvs_2, straight_srf_2, fillet_srf_2
straight_srf_14 = Surface(cluster_14.straight_srf_2)
point_14 = Point(cluster_14.pts_2)
curve_78 = Curve(cluster_14.crvs_2)
fillet_srf_14 = Surface(cluster_14.fillet_srf_2)

cluster_15 = Cluster(
    reduce_straight_length=remap_numbers_11.Mapped,
    cross_section_fillet_1=cross_section_fillet_1_11,
    cross_section_fillet_2=cross_section_fillet_2_11,
    cross_section_curvature=cross_section_curvature_11,
    scissor_upper_crv_curvature_1=scissor_upper_crv_curvature_1_11,
    scissor_upper_crv_curvature_2=scissor_upper_crv_curvature_2_11,
    scissor_upper_crv_curvature=scissor_upper_crv_curvature_12,
    scissor_lower_crv_curvature_1=scissor_lower_crv_curvature_1_11,
    scissor_lower_crv_curvature_2=scissor_lower_crv_curvature_2_11,
    scissor_lower_crv_curvature=scissor_lower_crv_curvature_12,
    left_side_straight_bands=left_side_straight_bands_39,
    right_side_straight_bands=right_side_straight_bands_35,
    floor_crv=list_item_51,
    next_floor_crv=list_item_52,
    reference_srf=surface_21,
    left_side_cross_section_crv=merge_23,
    right_side_cross_section_crv=merge_21,
    select_upper_lower_left_cross_section=select_upper_lower_left_cross_section_11,
    select_upper_lower_right_cross_section=select_upper_lower_right_cross_section_11,
    balcony_side_additional_cross_setional_c=balcony_side_additional_cross_setional_c_7)  # -> pts_2, crvs_2, straight_srf_2, fillet_srf_2
straight_srf_15 = Surface(cluster_15.straight_srf_2)
point_15 = Point(cluster_15.pts_2)
curve_79 = Curve(cluster_15.crvs_2)
fillet_srf_15 = Surface(cluster_15.fillet_srf_2)

cluster_16 = Cluster(
    reduce_straight_length=remap_numbers_21.Mapped,
    cross_section_fillet_1=cross_section_fillet_1_21,
    cross_section_fillet_2=cross_section_fillet_2_21,
    cross_section_curvature=cross_section_curvature_21,
    scissor_upper_crv_curvature_1=scissor_upper_crv_curvature_1_21,
    scissor_upper_crv_curvature_2=scissor_upper_crv_curvature_2_21,
    scissor_upper_crv_curvature=scissor_upper_crv_curvature_22,
    scissor_lower_crv_curvature_1=scissor_lower_crv_curvature_1_21,
    scissor_lower_crv_curvature_2=scissor_lower_crv_curvature_2_21,
    scissor_lower_crv_curvature=scissor_lower_crv_curvature_22,
    left_side_straight_bands=left_side_straight_bands_50,
    right_side_straight_bands=right_side_straight_bands_46,
    floor_crv=list_item_61,
    next_floor_crv=list_item_62,
    reference_srf=surface_26,
    left_side_cross_section_crv=merge_43,
    right_side_cross_section_crv=merge_41,
    select_upper_lower_left_cross_section=select_upper_lower_left_cross_section_21,
    select_upper_lower_right_cross_section=select_upper_lower_right_cross_section_21,
    balcony_side_additional_cross_setional_c=balcony_side_additional_cross_setional_c_12)  # -> pts_2, crvs_2, straight_srf_2, fillet_srf_2; disabled
straight_srf_16 = Surface(cluster_16.straight_srf_2)  # disabled
point_16 = Point(cluster_16.pts_2)  # disabled
curve_80 = Curve(cluster_16.crvs_2)  # disabled
fillet_srf_16 = Surface(cluster_16.fillet_srf_2)  # disabled

cluster_17 = Cluster(
    reduce_straight_length=remap_numbers_22.Mapped,
    cross_section_fillet_1=cross_section_fillet_1_22,
    cross_section_fillet_2=cross_section_fillet_2_22,
    cross_section_curvature=cross_section_curvature_22,
    scissor_upper_crv_curvature_1=scissor_upper_crv_curvature_1_22,
    scissor_upper_crv_curvature_2=scissor_upper_crv_curvature_2_22,
    scissor_upper_crv_curvature=scissor_upper_crv_curvature_23,
    scissor_lower_crv_curvature_1=scissor_lower_crv_curvature_1_22,
    scissor_lower_crv_curvature_2=scissor_lower_crv_curvature_2_22,
    scissor_lower_crv_curvature=scissor_lower_crv_curvature_23,
    left_side_straight_bands=left_side_straight_bands_51,
    right_side_straight_bands=right_side_straight_bands_47,
    floor_crv=list_item_63,
    next_floor_crv=list_item_64,
    reference_srf=surface_27,
    left_side_cross_section_crv=merge_44,
    right_side_cross_section_crv=merge_42,
    select_upper_lower_left_cross_section=select_upper_lower_left_cross_section_22,
    select_upper_lower_right_cross_section=select_upper_lower_right_cross_section_22,
    balcony_side_additional_cross_setional_c=balcony_side_additional_cross_setional_c_26)  # -> pts_2, crvs_2, straight_srf_2, fillet_srf_2; disabled
straight_srf_17 = Surface(cluster_17.straight_srf_2)  # disabled
point_17 = Point(cluster_17.pts_2)  # disabled
curve_81 = Curve(cluster_17.crvs_2)  # disabled
fillet_srf_17 = Surface(cluster_17.fillet_srf_2)  # disabled

cluster_18 = Cluster(
    reduce_straight_length=remap_numbers_24.Mapped,
    cross_section_fillet_1=cross_section_fillet_1_24,
    cross_section_fillet_2=cross_section_fillet_2_24,
    cross_section_curvature=cross_section_curvature_24,
    scissor_upper_crv_curvature_1=scissor_upper_crv_curvature_1_24,
    scissor_upper_crv_curvature_2=scissor_upper_crv_curvature_2_24,
    scissor_upper_crv_curvature=scissor_upper_crv_curvature_25,
    scissor_lower_crv_curvature_1=scissor_lower_crv_curvature_1_24,
    scissor_lower_crv_curvature_2=scissor_lower_crv_curvature_2_24,
    scissor_lower_crv_curvature=scissor_lower_crv_curvature_25,
    left_side_straight_bands=left_side_straight_bands_53,
    right_side_straight_bands=right_side_straight_bands_49,
    floor_crv=list_item_67,
    next_floor_crv=list_item_68,
    reference_srf=surface_29,
    left_side_cross_section_crv=merge_49,
    right_side_cross_section_crv=merge_46,
    select_upper_lower_left_cross_section=select_upper_lower_left_cross_section_24,
    select_upper_lower_right_cross_section=select_upper_lower_right_cross_section_24,
    balcony_side_additional_cross_setional_c=balcony_side_additional_cross_setional_c_14)  # -> pts_2, crvs_2, straight_srf_2, fillet_srf_2; disabled
straight_srf_18 = Surface(cluster_18.straight_srf_2)  # disabled
point_18 = Point(cluster_18.pts_2)  # disabled
curve_82 = Curve(cluster_18.crvs_2)  # disabled
fillet_srf_18 = Surface(cluster_18.fillet_srf_2)  # disabled

cluster_19 = Cluster(
    reduce_straight_length=remap_numbers_25.Mapped,
    cross_section_fillet_1=cross_section_fillet_1_25,
    cross_section_fillet_2=cross_section_fillet_2_25,
    cross_section_curvature=cross_section_curvature_25,
    scissor_upper_crv_curvature_1=scissor_upper_crv_curvature_1_25,
    scissor_upper_crv_curvature_2=scissor_upper_crv_curvature_2_25,
    scissor_upper_crv_curvature=scissor_upper_crv_curvature_26,
    scissor_lower_crv_curvature_1=scissor_lower_crv_curvature_1_25,
    scissor_lower_crv_curvature_2=scissor_lower_crv_curvature_2_25,
    scissor_lower_crv_curvature=scissor_lower_crv_curvature_26,
    left_side_straight_bands=left_side_straight_bands_54,
    right_side_straight_bands=right_side_straight_bands_50,
    floor_crv=list_item_69,
    next_floor_crv=list_item_70,
    reference_srf=surface_30,
    left_side_cross_section_crv=merge_50,
    right_side_cross_section_crv=merge_47,
    select_upper_lower_left_cross_section=select_upper_lower_left_cross_section_25,
    select_upper_lower_right_cross_section=select_upper_lower_right_cross_section_25,
    balcony_side_additional_cross_setional_c=balcony_side_additional_cross_setional_c_27)  # -> pts_2, crvs_2, straight_srf_2, fillet_srf_2; disabled
straight_srf_19 = Surface(cluster_19.straight_srf_2)  # disabled
point_19 = Point(cluster_19.pts_2)  # disabled
curve_83 = Curve(cluster_19.crvs_2)  # disabled
fillet_srf_19 = Surface(cluster_19.fillet_srf_2)  # disabled

cluster_20 = Cluster(
    reduce_straight_length=remap_numbers_26.Mapped,
    cross_section_fillet_1=cross_section_fillet_1_26,
    cross_section_fillet_2=cross_section_fillet_2_26,
    cross_section_curvature=cross_section_curvature_26,
    scissor_upper_crv_curvature_1=scissor_upper_crv_curvature_1_26,
    scissor_upper_crv_curvature_2=scissor_upper_crv_curvature_2_26,
    scissor_upper_crv_curvature=scissor_upper_crv_curvature_27,
    scissor_lower_crv_curvature_1=scissor_lower_crv_curvature_1_26,
    scissor_lower_crv_curvature_2=scissor_lower_crv_curvature_2_26,
    scissor_lower_crv_curvature=scissor_lower_crv_curvature_27,
    left_side_straight_bands=left_side_straight_bands_56,
    right_side_straight_bands=right_side_straight_bands_52,
    floor_crv=list_item_71,
    next_floor_crv=list_item_72,
    reference_srf=surface_31,
    left_side_cross_section_crv=merge_53,
    right_side_cross_section_crv=merge_51,
    select_upper_lower_left_cross_section=select_upper_lower_left_cross_section_26,
    select_upper_lower_right_cross_section=select_upper_lower_right_cross_section_26,
    balcony_side_additional_cross_setional_c=balcony_side_additional_cross_setional_c_15)  # -> pts_2, crvs_2, straight_srf_2, fillet_srf_2; disabled
straight_srf_20 = Surface(cluster_20.straight_srf_2)  # disabled
point_20 = Point(cluster_20.pts_2)  # disabled
curve_84 = Curve(cluster_20.crvs_2)  # disabled
fillet_srf_20 = Surface(cluster_20.fillet_srf_2)  # disabled

cluster_21 = Cluster(
    reduce_straight_length=remap_numbers_12.Mapped,
    cross_section_fillet_1=cross_section_fillet_1_12,
    cross_section_fillet_2=cross_section_fillet_2_12,
    cross_section_curvature=cross_section_curvature_12,
    scissor_upper_crv_curvature_1=scissor_upper_crv_curvature_1_12,
    scissor_upper_crv_curvature_2=scissor_upper_crv_curvature_2_12,
    scissor_upper_crv_curvature=scissor_upper_crv_curvature_13,
    scissor_lower_crv_curvature_1=scissor_lower_crv_curvature_1_12,
    scissor_lower_crv_curvature_2=scissor_lower_crv_curvature_2_12,
    scissor_lower_crv_curvature=scissor_lower_crv_curvature_13,
    left_side_straight_bands=left_side_straight_bands_40,
    right_side_straight_bands=right_side_straight_bands_36,
    floor_crv=list_item_53,
    next_floor_crv=list_item_54,
    reference_srf=surface_22,
    left_side_cross_section_crv=merge_26,
    right_side_cross_section_crv=merge_22,
    select_upper_lower_left_cross_section=select_upper_lower_left_cross_section_12,
    select_upper_lower_right_cross_section=select_upper_lower_right_cross_section_12,
    balcony_side_additional_cross_setional_c=balcony_side_additional_cross_setional_c_21)  # -> pts_2, crvs_2, straight_srf_2, fillet_srf_2
straight_srf_21 = Surface(cluster_21.straight_srf_2)
point_21 = Point(cluster_21.pts_2)
curve_85 = Curve(cluster_21.crvs_2)
fillet_srf_21 = Surface(cluster_21.fillet_srf_2)

cluster_22 = Cluster(
    reduce_straight_length=remap_numbers_8.Mapped,
    cross_section_fillet_1=cross_section_fillet_1_8,
    cross_section_fillet_2=cross_section_fillet_2_8,
    cross_section_curvature=cross_section_curvature_8,
    scissor_upper_crv_curvature_1=scissor_upper_crv_curvature_1_8,
    scissor_upper_crv_curvature_2=scissor_upper_crv_curvature_2_8,
    scissor_upper_crv_curvature=scissor_upper_crv_curvature_9,
    scissor_lower_crv_curvature_1=scissor_lower_crv_curvature_1_8,
    scissor_lower_crv_curvature_2=scissor_lower_crv_curvature_2_8,
    scissor_lower_crv_curvature=scissor_lower_crv_curvature_9,
    left_side_straight_bands=left_side_straight_bands_35,
    right_side_straight_bands=right_side_straight_bands_31,
    floor_crv=list_item_45,
    next_floor_crv=list_item_46,
    reference_srf=surface_18,
    left_side_cross_section_crv=merge_18,
    right_side_cross_section_crv=merge_15,
    select_upper_lower_left_cross_section=select_upper_lower_left_cross_section_8,
    select_upper_lower_right_cross_section=select_upper_lower_right_cross_section_8,
    balcony_side_additional_cross_setional_c=balcony_side_additional_cross_setional_c_5)  # -> pts_2, crvs_2, straight_srf_2, fillet_srf_2
straight_srf_22 = Surface(cluster_22.straight_srf_2)
point_22 = Point(cluster_22.pts_2)
curve_86 = Curve(cluster_22.crvs_2)
fillet_srf_22 = Surface(cluster_22.fillet_srf_2)

cluster_23 = Cluster(
    reduce_straight_length=remap_numbers_27.Mapped,
    cross_section_fillet_1=cross_section_fillet_1_27,
    cross_section_fillet_2=cross_section_fillet_2_27,
    cross_section_curvature=cross_section_curvature_27,
    scissor_upper_crv_curvature_1=scissor_upper_crv_curvature_1_27,
    scissor_upper_crv_curvature_2=scissor_upper_crv_curvature_2_27,
    scissor_upper_crv_curvature=scissor_upper_crv_curvature_28,
    scissor_lower_crv_curvature_1=scissor_lower_crv_curvature_1_27,
    scissor_lower_crv_curvature_2=scissor_lower_crv_curvature_2_27,
    scissor_lower_crv_curvature=scissor_lower_crv_curvature_28,
    left_side_straight_bands=left_side_straight_bands_57,
    right_side_straight_bands=right_side_straight_bands_53,
    floor_crv=list_item_73,
    next_floor_crv=list_item_74,
    reference_srf=surface_32,
    left_side_cross_section_crv=merge_55,
    right_side_cross_section_crv=merge_52,
    select_upper_lower_left_cross_section=select_upper_lower_left_cross_section_27,
    select_upper_lower_right_cross_section=select_upper_lower_right_cross_section_27,
    balcony_side_additional_cross_setional_c=balcony_side_additional_cross_setional_c_28)  # -> pts_2, crvs_2, straight_srf_2, fillet_srf_2; disabled
straight_srf_23 = Surface(cluster_23.straight_srf_2)  # disabled
point_23 = Point(cluster_23.pts_2)  # disabled
curve_87 = Curve(cluster_23.crvs_2)  # disabled
fillet_srf_23 = Surface(cluster_23.fillet_srf_2)  # disabled

cluster_24 = Cluster(
    reduce_straight_length=remap_numbers_23.Mapped,
    cross_section_fillet_1=cross_section_fillet_1_23,
    cross_section_fillet_2=cross_section_fillet_2_23,
    cross_section_curvature=cross_section_curvature_23,
    scissor_upper_crv_curvature_1=scissor_upper_crv_curvature_1_23,
    scissor_upper_crv_curvature_2=scissor_upper_crv_curvature_2_23,
    scissor_upper_crv_curvature=scissor_upper_crv_curvature_24,
    scissor_lower_crv_curvature_1=scissor_lower_crv_curvature_1_23,
    scissor_lower_crv_curvature_2=scissor_lower_crv_curvature_2_23,
    scissor_lower_crv_curvature=scissor_lower_crv_curvature_24,
    left_side_straight_bands=left_side_straight_bands_52,
    right_side_straight_bands=right_side_straight_bands_48,
    floor_crv=list_item_65,
    next_floor_crv=list_item_66,
    reference_srf=surface_28,
    left_side_cross_section_crv=merge_48,
    right_side_cross_section_crv=merge_45,
    select_upper_lower_left_cross_section=select_upper_lower_left_cross_section_23,
    select_upper_lower_right_cross_section=select_upper_lower_right_cross_section_23,
    balcony_side_additional_cross_setional_c=balcony_side_additional_cross_setional_c_13)  # -> pts_2, crvs_2, straight_srf_2, fillet_srf_2; disabled
straight_srf_24 = Surface(cluster_24.straight_srf_2)  # disabled
point_24 = Point(cluster_24.pts_2)  # disabled
curve_88 = Curve(cluster_24.crvs_2)  # disabled
fillet_srf_24 = Surface(cluster_24.fillet_srf_2)  # disabled

srf_extension_up_down_4 = RemoteReceiver(srf_extension_up_down)
srf_extension_left_right_4 = RemoteReceiver(srf_extension_left_right)
extend_surface_3 = ExtendSurface(
    Surface=loft_3,
    WestEdge=srf_extension_up_down_4,
    SouthEdge=srf_extension_left_right_4,
    EastEdge=srf_extension_up_down_4,
    NorthEdge=srf_extension_left_right_4,
    ExtensionType=boolean_toggle)
add_floor_reference_srf = RemoteSender(extend_surface_3)

typical_floor_glass_crvs_29 = RemoteReceiver(typical_floor_glass_crvs)
add_floor_reference_srf_2 = RemoteReceiver(add_floor_reference_srf)
curve_89 = Curve(flatten(add_floor_glass_crvs_2))
list_item_75 = ListItem(List=curve_89, Index=number_slider_158, Wrap=True)
list_item_76 = ListItem(List=curve_89, Index=addition_6, Wrap=True)
surface_33 = Surface(add_floor_reference_srf_2)

typical_floor_glass_crvs_30 = RemoteReceiver(typical_floor_glass_crvs)  # disabled
add_floor_reference_srf_3 = RemoteReceiver(add_floor_reference_srf)  # disabled
curve_90 = Curve(flatten(add_floor_glass_crvs_4))  # disabled
list_item_77 = ListItem(List=curve_90, Index=number_slider_173, Wrap=True)  # disabled
list_item_78 = ListItem(List=curve_90, Index=addition_21, Wrap=True)  # disabled
surface_34 = Surface(add_floor_reference_srf_3)  # disabled

add_floor_reference_srf_4 = RemoteReceiver(add_floor_reference_srf)
curve_91 = Curve(flatten(add_floor_glass_crvs_3))
list_item_79 = ListItem(List=curve_91, Index=number_slider_160, Wrap=True)
list_item_80 = ListItem(List=curve_91, Index=addition_8, Wrap=True)
surface_35 = Surface(add_floor_reference_srf_4)

add_floor_reference_srf_5 = RemoteReceiver(add_floor_reference_srf)  # disabled
curve_92 = Curve(flatten(add_floor_glass_crvs_5))  # disabled
list_item_81 = ListItem(List=curve_92, Index=number_slider_175, Wrap=True)  # disabled
list_item_82 = ListItem(List=curve_92, Index=addition_23, Wrap=True)  # disabled
surface_36 = Surface(add_floor_reference_srf_5)  # disabled

floor_crv = Curve(list_item_25)
next_floor_crv = Curve(list_item_26)
reference_srf = Surface(surface_8)
explode_11 = Explode(Curve=floor_crv, Recursive=True)  # -> Segments, Vertices
explode_12 = Explode(Curve=next_floor_crv, Recursive=True)  # -> Segments, Vertices
interpolate_4 = Interpolate(Vertices=explode_11.Vertices, Degree=3, Periodic=False, KnotStyle=1)  # -> Curve, Length, Domain
interpolate_5 = Interpolate(Vertices=explode_12.Vertices, Degree=3, Periodic=False, KnotStyle=1)  # -> Curve, Length, Domain
curve_closest_point = CurveClosestPoint(Point=explode_11.Vertices, Curve=interpolate_4.Curve)  # -> Point, Parameter, Distance
curve_closest_point_2 = CurveClosestPoint(Point=explode_12.Vertices, Curve=interpolate_5.Curve)  # -> Point, Parameter, Distance
perp_frame = PerpFrame(Curve=interpolate_4.Curve, Parameter=curve_closest_point.Parameter)
perp_frame_2 = PerpFrame(Curve=interpolate_5.Curve, Parameter=curve_closest_point_2.Parameter)
list_item_83 = ListItem(List=perp_frame, Index=series_7, Wrap=True)
list_item_84 = ListItem(List=perp_frame_2, Index=series_8, Wrap=True)
list_item_85 = ListItem(List=list_item_83, Index=0, Wrap=True)
list_item_86 = ListItem(List=list_item_84, Index=0, Wrap=True)
source_plane = Plane(list_item_85)
target_plane = Plane(list_item_83)
source_plane_2 = Plane(list_item_86)
target_plane_2 = Plane(list_item_84)
orient_6 = Orient(Geometry=curve_4, Source=source_plane, Target=graft(target_plane))  # -> simplify(Geometry), Transform
orient_7 = Orient(Geometry=curve_5, Source=source_plane_2, Target=graft(target_plane_2))  # -> simplify(Geometry), Transform
curve_93 = Curve(orient_7.Geometry)
list_item_87 = ListItem(List=curve_93, Index=select_upper_lower_right_cross_section_31, Wrap=True)  # -> flatten(Item)
tree_statistics = TreeStatistics(Tree=orient_6.Geometry)  # -> Paths, Length, Count
tree_statistics_2 = TreeStatistics(Tree=orient_7.Geometry)  # -> Paths, Length, Count
reverse_list = ReverseList(List=list_item_87)
list_item_88 = ListItem(List=tree_statistics.Paths, Index=0, Wrap=True)
list_item_89 = ListItem(List=tree_statistics.Paths, Index=-1, Wrap=True)
list_item_90 = ListItem(List=tree_statistics_2.Paths, Index=-1, Wrap=True)
list_item_91 = ListItem(List=tree_statistics_2.Paths, Index=0, Wrap=True)
tree_branch = TreeBranch(Tree=orient_6.Geometry, Path=list_item_88, MaintainPaths=True)
tree_branch_2 = TreeBranch(Tree=orient_6.Geometry, Path=list_item_89, MaintainPaths=True)
tree_branch_3 = TreeBranch(Tree=orient_7.Geometry, Path=list_item_90, MaintainPaths=True)
tree_branch_4 = TreeBranch(Tree=orient_7.Geometry, Path=list_item_91, MaintainPaths=True)
list_item_92 = ListItem(List=orient_6.Geometry, Index=select_upper_lower_left_cross_section_31, Wrap=True)
list_item_93 = ListItem(List=tree_branch, Index=select_upper_lower_left_cross_section_31, Wrap=True)
list_item_94 = ListItem(List=tree_branch_2, Index=select_upper_lower_left_cross_section_31, Wrap=True)
list_item_95 = ListItem(List=tree_branch_3, Index=select_upper_lower_right_cross_section_31, Wrap=True)
merge_75 = Merge(Data1=flatten(reverse_list), Data2=flatten(curve_25))  # -> graft(Result)
explode_13 = Explode(Curve=list_item_93, Recursive=True)  # -> Segments, Vertices
explode_14 = Explode(Curve=list_item_94, Recursive=True)  # -> Segments, Vertices
explode_15 = Explode(Curve=list_item_95, Recursive=True)  # -> Segments, Vertices
curve_94 = Curve(list_item_94)
curve_95 = Curve(list_item_95)
curve_96 = Curve(merge_75)
list_item_96 = ListItem(List=explode_13.Vertices, Index=0, Wrap=True)  # -> Item1, Item
list_item_97 = ListItem(List=explode_14.Vertices, Index=0, Wrap=True)  # -> Item1, Item
list_item_98 = ListItem(List=explode_15.Vertices, Index=0, Wrap=True)  # -> Item1, Item
merge_76 = Merge(Data1=list_item_96.Item, Data2=list_item_96.Item1)
merge_77 = Merge(Data1=list_item_97.Item, Data2=list_item_97.Item1)
merge_78 = Merge(Data1=list_item_98.Item, Data2=list_item_98.Item1)
line = Line(StartPoint=merge_76, EndPoint=merge_77)
line_2 = Line(StartPoint=merge_78, EndPoint=merge_63)
surface_37 = Surface(reference_srf)
curve_97 = Curve(flatten(list_item_92))
curve_98 = Curve(flatten(curve_96))

list_item_99 = ListItem(List=tree_branch_4, Index=select_upper_lower_right_cross_section_31, Wrap=True)

extend_curve_3 = ExtendCurve(Curve=line, Type=0, Start="1800", End="0")
extend_curve_4 = ExtendCurve(Curve=line_2, Type=0, Start="0", End="1800")
end_points_5 = EndPoints(Curve=extend_curve_3)  # -> Start, End
end_points_6 = EndPoints(Curve=extend_curve_4)  # -> Start, End
line_3 = Line(StartPoint=end_points_5.Start, EndPoint=end_points_5.End)
line_4 = Line(StartPoint=end_points_6.Start, EndPoint=end_points_6.End)

next_floor_crv_2 = Curve(list_item_76)
reference_srf_2 = Surface(surface_33)
floor_crv_2 = Curve(list_item_75)
explode_16 = Explode(Curve=floor_crv_2, Recursive=True)  # -> Segments, Vertices
explode_17 = Explode(Curve=next_floor_crv_2, Recursive=True)  # -> Segments, Vertices
interpolate_6 = Interpolate(Vertices=explode_16.Vertices, Degree=3, Periodic=False, KnotStyle=1)  # -> Curve, Length, Domain
interpolate_7 = Interpolate(Vertices=explode_17.Vertices, Degree=3, Periodic=False, KnotStyle=1)  # -> Curve, Length, Domain
curve_closest_point_3 = CurveClosestPoint(Point=explode_16.Vertices, Curve=interpolate_6.Curve)  # -> Point, Parameter, Distance
curve_closest_point_4 = CurveClosestPoint(Point=explode_17.Vertices, Curve=interpolate_7.Curve)  # -> Point, Parameter, Distance
perp_frame_3 = PerpFrame(Curve=interpolate_6.Curve, Parameter=curve_closest_point_3.Parameter)
perp_frame_4 = PerpFrame(Curve=interpolate_7.Curve, Parameter=curve_closest_point_4.Parameter)
list_item_100 = ListItem(List=perp_frame_3, Index=series_9, Wrap=True)
list_item_101 = ListItem(List=perp_frame_4, Index=series_10, Wrap=True)
list_item_102 = ListItem(List=list_item_100, Index=0, Wrap=True)
list_item_103 = ListItem(List=list_item_101, Index=0, Wrap=True)
source_plane_3 = Plane(list_item_102)
target_plane_3 = Plane(list_item_101)
target_plane_4 = Plane(list_item_100)
source_plane_4 = Plane(list_item_103)
orient_8 = Orient(Geometry=curve_7, Source=source_plane_3, Target=graft(target_plane_4))  # -> simplify(Geometry), Transform
orient_9 = Orient(Geometry=curve_8, Source=source_plane_4, Target=graft(target_plane_3))  # -> simplify(Geometry), Transform
tree_statistics_3 = TreeStatistics(Tree=orient_8.Geometry)  # -> Paths, Length, Count
tree_statistics_4 = TreeStatistics(Tree=orient_9.Geometry)  # -> Paths, Length, Count
list_item_104 = ListItem(List=tree_statistics_3.Paths, Index=0, Wrap=True)
list_item_105 = ListItem(List=tree_statistics_3.Paths, Index=-1, Wrap=True)
list_item_106 = ListItem(List=tree_statistics_4.Paths, Index=-1, Wrap=True)
list_item_107 = ListItem(List=tree_statistics_4.Paths, Index=0, Wrap=True)
tree_branch_5 = TreeBranch(Tree=orient_8.Geometry, Path=list_item_104, MaintainPaths=True)
tree_branch_6 = TreeBranch(Tree=orient_8.Geometry, Path=list_item_105, MaintainPaths=True)
tree_branch_7 = TreeBranch(Tree=orient_9.Geometry, Path=list_item_106, MaintainPaths=True)
tree_branch_8 = TreeBranch(Tree=orient_9.Geometry, Path=list_item_107, MaintainPaths=True)
list_item_108 = ListItem(List=orient_8.Geometry, Index=select_upper_lower_left_cross_section_32, Wrap=True)
list_item_109 = ListItem(List=tree_branch_5, Index=select_upper_lower_left_cross_section_32, Wrap=True)
list_item_110 = ListItem(List=tree_branch_6, Index=select_upper_lower_left_cross_section_32, Wrap=True)
list_item_111 = ListItem(List=tree_branch_7, Index=select_upper_lower_right_cross_section_32, Wrap=True)
list_item_112 = ListItem(List=tree_branch_8, Index=select_upper_lower_right_cross_section_32, Wrap=True)
explode_18 = Explode(Curve=list_item_109, Recursive=True)  # -> Segments, Vertices
explode_19 = Explode(Curve=list_item_110, Recursive=True)  # -> Segments, Vertices
explode_20 = Explode(Curve=list_item_111, Recursive=True)  # -> Segments, Vertices
curve_99 = Curve(list_item_110)
curve_100 = Curve(list_item_111)
list_item_113 = ListItem(List=explode_18.Vertices, Index=0, Wrap=True)  # -> Item1, Item
list_item_114 = ListItem(List=explode_19.Vertices, Index=0, Wrap=True)  # -> Item1, Item
list_item_115 = ListItem(List=explode_20.Vertices, Index=0, Wrap=True)  # -> Item1, Item
merge_79 = Merge(Data1=list_item_113.Item, Data2=list_item_113.Item1)
merge_80 = Merge(Data1=list_item_114.Item, Data2=list_item_114.Item1)
merge_81 = Merge(Data1=list_item_115.Item, Data2=list_item_115.Item1)
line_5 = Line(StartPoint=merge_79, EndPoint=merge_80)
line_6 = Line(StartPoint=merge_81, EndPoint=merge_64)
list_item_116 = ListItem(List=line_5, Index=0, Wrap=True)  # -> Item, Item1
list_item_117 = ListItem(List=line_6, Index=0, Wrap=True)  # -> Item, Item1
surface_38 = Surface(reference_srf_2)
curve_101 = Curve(flatten(list_item_108))

curve_102 = Curve(orient_9.Geometry)
list_item_118 = ListItem(List=curve_102, Index=select_upper_lower_right_cross_section_32, Wrap=True)  # -> flatten(Item)
reverse_list_2 = ReverseList(List=list_item_118)
merge_82 = Merge(Data1=flatten(reverse_list_2), Data2=flatten(curve_9))  # -> graft(Result)
curve_103 = Curve(merge_82)

blend_curve = BlendCurve(CurveA=list_item_116.Item1, CurveB=list_item_117.Item1, BulgeA=number_19, BulgeB=number_20, Continuity=integer_10)
curve_104 = Curve(blend_curve)

blend_curve_2 = BlendCurve(CurveA=list_item_116.Item, CurveB=list_item_117.Item, BulgeA=number_17, BulgeB=number_18, Continuity=integer_9)
curve_105 = Curve(blend_curve_2)

next_floor_crv_3 = Curve(list_item_80)
reference_srf_3 = Surface(surface_35)
floor_crv_3 = Curve(list_item_79)
explode_21 = Explode(Curve=floor_crv_3, Recursive=True)  # -> Segments, Vertices
explode_22 = Explode(Curve=next_floor_crv_3, Recursive=True)  # -> Segments, Vertices
interpolate_8 = Interpolate(Vertices=explode_21.Vertices, Degree=3, Periodic=False, KnotStyle=1)  # -> Curve, Length, Domain
interpolate_9 = Interpolate(Vertices=explode_22.Vertices, Degree=3, Periodic=False, KnotStyle=1)  # -> Curve, Length, Domain
curve_closest_point_5 = CurveClosestPoint(Point=explode_21.Vertices, Curve=interpolate_8.Curve)  # -> Point, Parameter, Distance
curve_closest_point_6 = CurveClosestPoint(Point=explode_22.Vertices, Curve=interpolate_9.Curve)  # -> Point, Parameter, Distance
perp_frame_5 = PerpFrame(Curve=interpolate_8.Curve, Parameter=curve_closest_point_5.Parameter)
perp_frame_6 = PerpFrame(Curve=interpolate_9.Curve, Parameter=curve_closest_point_6.Parameter)
list_item_119 = ListItem(List=perp_frame_5, Index=series_11, Wrap=True)
list_item_120 = ListItem(List=perp_frame_6, Index=series_12, Wrap=True)
list_item_121 = ListItem(List=list_item_119, Index=0, Wrap=True)
list_item_122 = ListItem(List=list_item_120, Index=0, Wrap=True)
source_plane_5 = Plane(list_item_121)
target_plane_5 = Plane(list_item_119)
source_plane_6 = Plane(list_item_122)
target_plane_6 = Plane(list_item_120)
orient_10 = Orient(Geometry=curve_11, Source=source_plane_5, Target=graft(target_plane_5))  # -> simplify(Geometry), Transform
orient_11 = Orient(Geometry=curve_12, Source=source_plane_6, Target=graft(target_plane_6))  # -> simplify(Geometry), Transform
tree_statistics_5 = TreeStatistics(Tree=orient_10.Geometry)  # -> Paths, Length, Count
tree_statistics_6 = TreeStatistics(Tree=orient_11.Geometry)  # -> Paths, Length, Count
list_item_123 = ListItem(List=tree_statistics_5.Paths, Index=0, Wrap=True)
list_item_124 = ListItem(List=tree_statistics_5.Paths, Index=-1, Wrap=True)
list_item_125 = ListItem(List=tree_statistics_6.Paths, Index=-1, Wrap=True)
list_item_126 = ListItem(List=tree_statistics_6.Paths, Index=0, Wrap=True)
tree_branch_9 = TreeBranch(Tree=orient_10.Geometry, Path=list_item_123, MaintainPaths=True)
tree_branch_10 = TreeBranch(Tree=orient_10.Geometry, Path=list_item_124, MaintainPaths=True)
tree_branch_11 = TreeBranch(Tree=orient_11.Geometry, Path=list_item_125, MaintainPaths=True)
tree_branch_12 = TreeBranch(Tree=orient_11.Geometry, Path=list_item_126, MaintainPaths=True)
list_item_127 = ListItem(List=tree_branch_12, Index=select_upper_lower_right_cross_section_33, Wrap=True)
list_item_128 = ListItem(List=orient_10.Geometry, Index=select_upper_lower_left_cross_section_33, Wrap=True)
list_item_129 = ListItem(List=tree_branch_9, Index=select_upper_lower_left_cross_section_33, Wrap=True)
list_item_130 = ListItem(List=tree_branch_10, Index=select_upper_lower_left_cross_section_33, Wrap=True)
list_item_131 = ListItem(List=tree_branch_11, Index=select_upper_lower_right_cross_section_33, Wrap=True)
explode_23 = Explode(Curve=list_item_129, Recursive=True)  # -> Segments, Vertices
explode_24 = Explode(Curve=list_item_130, Recursive=True)  # -> Segments, Vertices
explode_25 = Explode(Curve=list_item_131, Recursive=True)  # -> Segments, Vertices
curve_106 = Curve(list_item_130)
curve_107 = Curve(list_item_131)
list_item_132 = ListItem(List=explode_23.Vertices, Index=0, Wrap=True)  # -> Item1, Item
list_item_133 = ListItem(List=explode_24.Vertices, Index=0, Wrap=True)  # -> Item1, Item
list_item_134 = ListItem(List=explode_25.Vertices, Index=0, Wrap=True)  # -> Item1, Item
merge_83 = Merge(Data1=list_item_132.Item, Data2=list_item_132.Item1)
merge_84 = Merge(Data1=list_item_133.Item, Data2=list_item_133.Item1)
merge_85 = Merge(Data1=list_item_134.Item, Data2=list_item_134.Item1)
line_7 = Line(StartPoint=merge_83, EndPoint=merge_84)
line_8 = Line(StartPoint=merge_85, EndPoint=merge_65)
list_item_135 = ListItem(List=line_7, Index=0, Wrap=True)  # -> Item, Item1
list_item_136 = ListItem(List=line_8, Index=0, Wrap=True)  # -> Item, Item1
surface_39 = Surface(reference_srf_3)
curve_108 = Curve(flatten(list_item_128))

curve_109 = Curve(orient_11.Geometry)
list_item_137 = ListItem(List=curve_109, Index=select_upper_lower_right_cross_section_33, Wrap=True)  # -> flatten(Item)
reverse_list_3 = ReverseList(List=list_item_137)
merge_86 = Merge(Data1=flatten(reverse_list_3), Data2=flatten(curve_13))  # -> graft(Result)
curve_110 = Curve(merge_86)

blend_curve_3 = BlendCurve(CurveA=list_item_135.Item1, CurveB=list_item_136.Item1, BulgeA=number_23, BulgeB=number_24, Continuity=integer_12)
curve_111 = Curve(blend_curve_3)

blend_curve_4 = BlendCurve(CurveA=list_item_135.Item, CurveB=list_item_136.Item, BulgeA=number_21, BulgeB=number_22, Continuity=integer_11)
curve_112 = Curve(blend_curve_4)

floor_crv_4 = Curve(list_item_31)  # disabled
next_floor_crv_4 = Curve(list_item_32)  # disabled
reference_srf_4 = Surface(surface_11)  # disabled
explode_26 = Explode(Curve=floor_crv_4, Recursive=True)  # -> Segments, Vertices; disabled
explode_27 = Explode(Curve=next_floor_crv_4, Recursive=True)  # -> Segments, Vertices; disabled
interpolate_10 = Interpolate(Vertices=explode_26.Vertices, Degree=3, Periodic=False, KnotStyle=1)  # -> Curve, Length, Domain; disabled
interpolate_11 = Interpolate(Vertices=explode_27.Vertices, Degree=3, Periodic=False, KnotStyle=1)  # -> Curve, Length, Domain; disabled
curve_closest_point_7 = CurveClosestPoint(Point=explode_26.Vertices, Curve=interpolate_10.Curve)  # -> Point, Parameter, Distance; disabled
curve_closest_point_8 = CurveClosestPoint(Point=explode_27.Vertices, Curve=interpolate_11.Curve)  # -> Point, Parameter, Distance; disabled
perp_frame_7 = PerpFrame(Curve=interpolate_10.Curve, Parameter=curve_closest_point_7.Parameter)  # disabled
perp_frame_8 = PerpFrame(Curve=interpolate_11.Curve, Parameter=curve_closest_point_8.Parameter)  # disabled
list_item_138 = ListItem(List=perp_frame_7, Index=series_13, Wrap=True)  # disabled
list_item_139 = ListItem(List=perp_frame_8, Index=series_14, Wrap=True)  # disabled
list_item_140 = ListItem(List=list_item_138, Index=0, Wrap=True)  # disabled
list_item_141 = ListItem(List=list_item_139, Index=0, Wrap=True)  # disabled
source_plane_7 = Plane(list_item_140)  # disabled
target_plane_7 = Plane(list_item_138)  # disabled
source_plane_8 = Plane(list_item_141)  # disabled
target_plane_8 = Plane(list_item_139)  # disabled
orient_12 = Orient(Geometry=curve_15, Source=source_plane_7, Target=graft(target_plane_7))  # -> simplify(Geometry), Transform; disabled
orient_13 = Orient(Geometry=curve_16, Source=source_plane_8, Target=graft(target_plane_8))  # -> simplify(Geometry), Transform; disabled
curve_113 = Curve(orient_13.Geometry)  # disabled
list_item_142 = ListItem(List=curve_113, Index=select_upper_lower_right_cross_section_34, Wrap=True)  # -> flatten(Item); disabled
tree_statistics_7 = TreeStatistics(Tree=orient_12.Geometry)  # -> Paths, Length, Count; disabled
tree_statistics_8 = TreeStatistics(Tree=orient_13.Geometry)  # -> Paths, Length, Count; disabled
reverse_list_4 = ReverseList(List=list_item_142)  # disabled
list_item_143 = ListItem(List=tree_statistics_7.Paths, Index=0, Wrap=True)  # disabled
list_item_144 = ListItem(List=tree_statistics_7.Paths, Index=-1, Wrap=True)  # disabled
list_item_145 = ListItem(List=tree_statistics_8.Paths, Index=-1, Wrap=True)  # disabled
list_item_146 = ListItem(List=tree_statistics_8.Paths, Index=0, Wrap=True)  # disabled
tree_branch_13 = TreeBranch(Tree=orient_12.Geometry, Path=list_item_143, MaintainPaths=True)  # disabled
tree_branch_14 = TreeBranch(Tree=orient_12.Geometry, Path=list_item_144, MaintainPaths=True)  # disabled
tree_branch_15 = TreeBranch(Tree=orient_13.Geometry, Path=list_item_145, MaintainPaths=True)  # disabled
tree_branch_16 = TreeBranch(Tree=orient_13.Geometry, Path=list_item_146, MaintainPaths=True)  # disabled
list_item_147 = ListItem(List=orient_12.Geometry, Index=select_upper_lower_left_cross_section_34, Wrap=True)  # disabled
list_item_148 = ListItem(List=tree_branch_13, Index=select_upper_lower_left_cross_section_34, Wrap=True)  # disabled
list_item_149 = ListItem(List=tree_branch_14, Index=select_upper_lower_left_cross_section_34, Wrap=True)  # disabled
list_item_150 = ListItem(List=tree_branch_15, Index=select_upper_lower_right_cross_section_34, Wrap=True)  # disabled
merge_87 = Merge(Data1=flatten(reverse_list_4), Data2=flatten(curve_26))  # -> graft(Result); disabled
explode_28 = Explode(Curve=list_item_148, Recursive=True)  # -> Segments, Vertices; disabled
explode_29 = Explode(Curve=list_item_149, Recursive=True)  # -> Segments, Vertices; disabled
explode_30 = Explode(Curve=list_item_150, Recursive=True)  # -> Segments, Vertices; disabled
curve_114 = Curve(list_item_149)  # disabled
curve_115 = Curve(list_item_150)  # disabled
curve_116 = Curve(merge_87)  # disabled
list_item_151 = ListItem(List=explode_28.Vertices, Index=0, Wrap=True)  # -> Item1, Item; disabled
list_item_152 = ListItem(List=explode_29.Vertices, Index=0, Wrap=True)  # -> Item1, Item; disabled
list_item_153 = ListItem(List=explode_30.Vertices, Index=0, Wrap=True)  # -> Item1, Item; disabled
merge_88 = Merge(Data1=list_item_151.Item, Data2=list_item_151.Item1)  # disabled
merge_89 = Merge(Data1=list_item_152.Item, Data2=list_item_152.Item1)  # disabled
merge_90 = Merge(Data1=list_item_153.Item, Data2=list_item_153.Item1)  # disabled
line_9 = Line(StartPoint=merge_88, EndPoint=merge_89)  # disabled
line_10 = Line(StartPoint=merge_90, EndPoint=merge_66)  # disabled
surface_40 = Surface(reference_srf_4)  # disabled
curve_117 = Curve(flatten(list_item_147))  # disabled
curve_118 = Curve(flatten(curve_116))  # disabled

list_item_154 = ListItem(List=tree_branch_16, Index=select_upper_lower_right_cross_section_34, Wrap=True)  # disabled

extend_curve_5 = ExtendCurve(Curve=line_9, Type=0, Start=panel_35, End=panel_34)  # disabled
extend_curve_6 = ExtendCurve(Curve=line_10, Type=0, Start=panel_34, End=panel_35)  # disabled
end_points_7 = EndPoints(Curve=extend_curve_5)  # -> Start, End; disabled
end_points_8 = EndPoints(Curve=extend_curve_6)  # -> Start, End; disabled
line_11 = Line(StartPoint=end_points_7.Start, EndPoint=end_points_7.End)  # disabled
line_12 = Line(StartPoint=end_points_8.Start, EndPoint=end_points_8.End)  # disabled

next_floor_crv_5 = Curve(list_item_78)  # disabled
reference_srf_5 = Surface(surface_34)  # disabled
floor_crv_5 = Curve(list_item_77)  # disabled
explode_31 = Explode(Curve=floor_crv_5, Recursive=True)  # -> Segments, Vertices; disabled
explode_32 = Explode(Curve=next_floor_crv_5, Recursive=True)  # -> Segments, Vertices; disabled
interpolate_12 = Interpolate(Vertices=explode_31.Vertices, Degree=3, Periodic=False, KnotStyle=1)  # -> Curve, Length, Domain; disabled
interpolate_13 = Interpolate(Vertices=explode_32.Vertices, Degree=3, Periodic=False, KnotStyle=1)  # -> Curve, Length, Domain; disabled
curve_closest_point_9 = CurveClosestPoint(Point=explode_31.Vertices, Curve=interpolate_12.Curve)  # -> Point, Parameter, Distance; disabled
curve_closest_point_10 = CurveClosestPoint(Point=explode_32.Vertices, Curve=interpolate_13.Curve)  # -> Point, Parameter, Distance; disabled
perp_frame_9 = PerpFrame(Curve=interpolate_12.Curve, Parameter=curve_closest_point_9.Parameter)  # disabled
perp_frame_10 = PerpFrame(Curve=interpolate_13.Curve, Parameter=curve_closest_point_10.Parameter)  # disabled
list_item_155 = ListItem(List=perp_frame_9, Index=series_15, Wrap=True)  # disabled
list_item_156 = ListItem(List=perp_frame_10, Index=series_16, Wrap=True)  # disabled
list_item_157 = ListItem(List=list_item_155, Index=0, Wrap=True)  # disabled
list_item_158 = ListItem(List=list_item_156, Index=0, Wrap=True)  # disabled
source_plane_9 = Plane(list_item_157)  # disabled
target_plane_9 = Plane(list_item_156)  # disabled
target_plane_10 = Plane(list_item_155)  # disabled
source_plane_10 = Plane(list_item_158)  # disabled
orient_14 = Orient(Geometry=curve_18, Source=source_plane_9, Target=graft(target_plane_10))  # -> simplify(Geometry), Transform; disabled
orient_15 = Orient(Geometry=curve_19, Source=source_plane_10, Target=graft(target_plane_9))  # -> simplify(Geometry), Transform; disabled
tree_statistics_9 = TreeStatistics(Tree=orient_14.Geometry)  # -> Paths, Length, Count; disabled
tree_statistics_10 = TreeStatistics(Tree=orient_15.Geometry)  # -> Paths, Length, Count; disabled
list_item_159 = ListItem(List=tree_statistics_9.Paths, Index=0, Wrap=True)  # disabled
list_item_160 = ListItem(List=tree_statistics_9.Paths, Index=-1, Wrap=True)  # disabled
list_item_161 = ListItem(List=tree_statistics_10.Paths, Index=-1, Wrap=True)  # disabled
list_item_162 = ListItem(List=tree_statistics_10.Paths, Index=0, Wrap=True)  # disabled
tree_branch_17 = TreeBranch(Tree=orient_14.Geometry, Path=list_item_159, MaintainPaths=True)  # disabled
tree_branch_18 = TreeBranch(Tree=orient_14.Geometry, Path=list_item_160, MaintainPaths=True)  # disabled
tree_branch_19 = TreeBranch(Tree=orient_15.Geometry, Path=list_item_161, MaintainPaths=True)  # disabled
tree_branch_20 = TreeBranch(Tree=orient_15.Geometry, Path=list_item_162, MaintainPaths=True)  # disabled
list_item_163 = ListItem(List=orient_14.Geometry, Index=select_upper_lower_left_cross_section_35, Wrap=True)  # disabled
list_item_164 = ListItem(List=tree_branch_17, Index=select_upper_lower_left_cross_section_35, Wrap=True)  # disabled
list_item_165 = ListItem(List=tree_branch_18, Index=select_upper_lower_left_cross_section_35, Wrap=True)  # disabled
list_item_166 = ListItem(List=tree_branch_19, Index=select_upper_lower_right_cross_section_35, Wrap=True)  # disabled
list_item_167 = ListItem(List=tree_branch_20, Index=select_upper_lower_right_cross_section_35, Wrap=True)  # disabled
explode_33 = Explode(Curve=list_item_164, Recursive=True)  # -> Segments, Vertices; disabled
explode_34 = Explode(Curve=list_item_165, Recursive=True)  # -> Segments, Vertices; disabled
explode_35 = Explode(Curve=list_item_166, Recursive=True)  # -> Segments, Vertices; disabled
curve_119 = Curve(list_item_165)  # disabled
curve_120 = Curve(list_item_166)  # disabled
list_item_168 = ListItem(List=explode_33.Vertices, Index=0, Wrap=True)  # -> Item1, Item; disabled
list_item_169 = ListItem(List=explode_34.Vertices, Index=0, Wrap=True)  # -> Item1, Item; disabled
list_item_170 = ListItem(List=explode_35.Vertices, Index=0, Wrap=True)  # -> Item1, Item; disabled
merge_91 = Merge(Data1=list_item_168.Item, Data2=list_item_168.Item1)  # disabled
merge_92 = Merge(Data1=list_item_169.Item, Data2=list_item_169.Item1)  # disabled
merge_93 = Merge(Data1=list_item_170.Item, Data2=list_item_170.Item1)  # disabled
line_13 = Line(StartPoint=merge_91, EndPoint=merge_92)  # disabled
line_14 = Line(StartPoint=merge_93, EndPoint=merge_67)  # disabled
list_item_171 = ListItem(List=line_13, Index=0, Wrap=True)  # -> Item, Item1; disabled
list_item_172 = ListItem(List=line_14, Index=0, Wrap=True)  # -> Item, Item1; disabled
surface_41 = Surface(reference_srf_5)  # disabled
curve_121 = Curve(flatten(list_item_163))  # disabled

curve_122 = Curve(orient_15.Geometry)  # disabled
list_item_173 = ListItem(List=curve_122, Index=select_upper_lower_right_cross_section_35, Wrap=True)  # -> flatten(Item); disabled
reverse_list_5 = ReverseList(List=list_item_173)  # disabled
merge_94 = Merge(Data1=flatten(reverse_list_5), Data2=flatten(curve_20))  # -> graft(Result); disabled
curve_123 = Curve(merge_94)  # disabled

blend_curve_5 = BlendCurve(CurveA=list_item_171.Item1, CurveB=list_item_172.Item1, BulgeA=number_31, BulgeB=number_32, Continuity=integer_16)  # disabled
curve_124 = Curve(blend_curve_5)  # disabled

blend_curve_6 = BlendCurve(CurveA=list_item_171.Item, CurveB=list_item_172.Item, BulgeA=number_29, BulgeB=number_30, Continuity=integer_15)  # disabled
curve_125 = Curve(blend_curve_6)  # disabled

next_floor_crv_6 = Curve(list_item_82)  # disabled
reference_srf_6 = Surface(surface_36)  # disabled
floor_crv_6 = Curve(list_item_81)  # disabled
explode_36 = Explode(Curve=floor_crv_6, Recursive=True)  # -> Segments, Vertices; disabled
explode_37 = Explode(Curve=next_floor_crv_6, Recursive=True)  # -> Segments, Vertices; disabled
interpolate_14 = Interpolate(Vertices=explode_36.Vertices, Degree=3, Periodic=False, KnotStyle=1)  # -> Curve, Length, Domain; disabled
interpolate_15 = Interpolate(Vertices=explode_37.Vertices, Degree=3, Periodic=False, KnotStyle=1)  # -> Curve, Length, Domain; disabled
curve_closest_point_11 = CurveClosestPoint(Point=explode_36.Vertices, Curve=interpolate_14.Curve)  # -> Point, Parameter, Distance; disabled
curve_closest_point_12 = CurveClosestPoint(Point=explode_37.Vertices, Curve=interpolate_15.Curve)  # -> Point, Parameter, Distance; disabled
perp_frame_11 = PerpFrame(Curve=interpolate_14.Curve, Parameter=curve_closest_point_11.Parameter)  # disabled
perp_frame_12 = PerpFrame(Curve=interpolate_15.Curve, Parameter=curve_closest_point_12.Parameter)  # disabled
list_item_174 = ListItem(List=perp_frame_11, Index=series_17, Wrap=True)  # disabled
list_item_175 = ListItem(List=perp_frame_12, Index=series_18, Wrap=True)  # disabled
list_item_176 = ListItem(List=list_item_174, Index=0, Wrap=True)  # disabled
list_item_177 = ListItem(List=list_item_175, Index=0, Wrap=True)  # disabled
source_plane_11 = Plane(list_item_176)  # disabled
target_plane_11 = Plane(list_item_174)  # disabled
source_plane_12 = Plane(list_item_177)  # disabled
target_plane_12 = Plane(list_item_175)  # disabled
orient_16 = Orient(Geometry=curve_22, Source=source_plane_11, Target=graft(target_plane_11))  # -> simplify(Geometry), Transform; disabled
orient_17 = Orient(Geometry=curve_23, Source=source_plane_12, Target=graft(target_plane_12))  # -> simplify(Geometry), Transform; disabled
tree_statistics_11 = TreeStatistics(Tree=orient_16.Geometry)  # -> Paths, Length, Count; disabled
tree_statistics_12 = TreeStatistics(Tree=orient_17.Geometry)  # -> Paths, Length, Count; disabled
list_item_178 = ListItem(List=tree_statistics_11.Paths, Index=0, Wrap=True)  # disabled
list_item_179 = ListItem(List=tree_statistics_11.Paths, Index=-1, Wrap=True)  # disabled
list_item_180 = ListItem(List=tree_statistics_12.Paths, Index=-1, Wrap=True)  # disabled
list_item_181 = ListItem(List=tree_statistics_12.Paths, Index=0, Wrap=True)  # disabled
tree_branch_21 = TreeBranch(Tree=orient_16.Geometry, Path=list_item_178, MaintainPaths=True)  # disabled
tree_branch_22 = TreeBranch(Tree=orient_16.Geometry, Path=list_item_179, MaintainPaths=True)  # disabled
tree_branch_23 = TreeBranch(Tree=orient_17.Geometry, Path=list_item_180, MaintainPaths=True)  # disabled
tree_branch_24 = TreeBranch(Tree=orient_17.Geometry, Path=list_item_181, MaintainPaths=True)  # disabled
list_item_182 = ListItem(List=tree_branch_24, Index=select_upper_lower_right_cross_section_36, Wrap=True)  # disabled
list_item_183 = ListItem(List=orient_16.Geometry, Index=select_upper_lower_left_cross_section_36, Wrap=True)  # disabled
list_item_184 = ListItem(List=tree_branch_21, Index=select_upper_lower_left_cross_section_36, Wrap=True)  # disabled
list_item_185 = ListItem(List=tree_branch_22, Index=select_upper_lower_left_cross_section_36, Wrap=True)  # disabled
list_item_186 = ListItem(List=tree_branch_23, Index=select_upper_lower_right_cross_section_36, Wrap=True)  # disabled
explode_38 = Explode(Curve=list_item_184, Recursive=True)  # -> Segments, Vertices; disabled
explode_39 = Explode(Curve=list_item_185, Recursive=True)  # -> Segments, Vertices; disabled
explode_40 = Explode(Curve=list_item_186, Recursive=True)  # -> Segments, Vertices; disabled
curve_126 = Curve(list_item_185)  # disabled
curve_127 = Curve(list_item_186)  # disabled
list_item_187 = ListItem(List=explode_38.Vertices, Index=0, Wrap=True)  # -> Item1, Item; disabled
list_item_188 = ListItem(List=explode_39.Vertices, Index=0, Wrap=True)  # -> Item1, Item; disabled
list_item_189 = ListItem(List=explode_40.Vertices, Index=0, Wrap=True)  # -> Item1, Item; disabled
merge_95 = Merge(Data1=list_item_187.Item, Data2=list_item_187.Item1)  # disabled
merge_96 = Merge(Data1=list_item_188.Item, Data2=list_item_188.Item1)  # disabled
merge_97 = Merge(Data1=list_item_189.Item, Data2=list_item_189.Item1)  # disabled
line_15 = Line(StartPoint=merge_95, EndPoint=merge_96)  # disabled
line_16 = Line(StartPoint=merge_97, EndPoint=merge_68)  # disabled
list_item_190 = ListItem(List=line_15, Index=0, Wrap=True)  # -> Item, Item1; disabled
list_item_191 = ListItem(List=line_16, Index=0, Wrap=True)  # -> Item, Item1; disabled
surface_42 = Surface(reference_srf_6)  # disabled
curve_128 = Curve(flatten(list_item_183))  # disabled

curve_129 = Curve(orient_17.Geometry)  # disabled
list_item_192 = ListItem(List=curve_129, Index=select_upper_lower_right_cross_section_36, Wrap=True)  # -> flatten(Item); disabled
reverse_list_6 = ReverseList(List=list_item_192)  # disabled
merge_98 = Merge(Data1=flatten(reverse_list_6), Data2=flatten(curve_24))  # -> graft(Result); disabled
curve_130 = Curve(merge_98)  # disabled

blend_curve_7 = BlendCurve(CurveA=list_item_190.Item1, CurveB=list_item_191.Item1, BulgeA=number_35, BulgeB=number_36, Continuity=integer_18)  # disabled
curve_131 = Curve(blend_curve_7)  # disabled

blend_curve_8 = BlendCurve(CurveA=list_item_190.Item, CurveB=list_item_191.Item, BulgeA=number_33, BulgeB=number_34, Continuity=integer_17)  # disabled
curve_132 = Curve(blend_curve_8)  # disabled

list_item_193 = ListItem(List=line_3, Index=0, Wrap=True)  # -> Item, Item1
list_item_194 = ListItem(List=line_4, Index=0, Wrap=True)  # -> Item, Item1

blend_curve_9 = BlendCurve(CurveA=list_item_193.Item1, CurveB=list_item_194.Item1, BulgeA=number_15, BulgeB=number_16, Continuity=integer_8)
curve_133 = Curve(blend_curve_9)

blend_curve_10 = BlendCurve(CurveA=list_item_193.Item, CurveB=list_item_194.Item, BulgeA=number_13, BulgeB=number_14, Continuity=integer_7)
curve_134 = Curve(blend_curve_10)

list_item_195 = ListItem(List=line_11, Index=0, Wrap=True)  # -> Item, Item1; disabled
list_item_196 = ListItem(List=line_12, Index=0, Wrap=True)  # -> Item, Item1; disabled

blend_curve_11 = BlendCurve(CurveA=list_item_195.Item1, CurveB=list_item_196.Item1, BulgeA=number_27, BulgeB=number_28, Continuity=integer_14)  # disabled
curve_135 = Curve(blend_curve_11)  # disabled

blend_curve_12 = BlendCurve(CurveA=list_item_195.Item, CurveB=list_item_196.Item, BulgeA=number_25, BulgeB=number_26, Continuity=integer_13)  # disabled
curve_136 = Curve(blend_curve_12)  # disabled

divide_curve = DivideCurve(Curve=curve_134, Count="14", Kinks=False)  # -> Points, Tangents, Parameters
divide_curve_2 = DivideCurve(Curve=curve_133, Count="14", Kinks=False)  # -> Points, Tangents, Parameters
surface_closest_point = SurfaceClosestPoint(Point=divide_curve.Points, Surface=surface_37)  # -> Point, UVPoint, Distance
surface_closest_point_2 = SurfaceClosestPoint(Point=divide_curve_2.Points, Surface=surface_37)  # -> Point, UVPoint, Distance
line_17 = Line(StartPoint=surface_closest_point.Point, EndPoint=surface_closest_point_2.Point)
interpolate_16 = Interpolate(Vertices=surface_closest_point.Point, Degree=3, Periodic=False, KnotStyle=1)  # -> Curve, Length, Domain
interpolate_17 = Interpolate(Vertices=surface_closest_point_2.Point, Degree=3, Periodic=False, KnotStyle=1)  # -> Curve, Length, Domain
curve_closest_point_13 = CurveClosestPoint(Point=divide_curve_2.Points, Curve=interpolate_17.Curve)  # -> Point, Parameter, Distance
perp_frame_13 = PerpFrame(Curve=interpolate_17.Curve, Parameter=curve_closest_point_13.Parameter)
align_plane = AlignPlane(Plane=perp_frame_13, Direction=unit_z_8)  # -> Plane, Angle
deconstruct_plane = DeconstructPlane(Plane=align_plane.Plane)  # -> Origin, XAxis, YAxis, ZAxis
line_sdl = LineSDL(Start=deconstruct_plane.Origin, Direction=unit_z_9, Length="1500")
line_sdl_2 = LineSDL(Start=deconstruct_plane.Origin, Direction=deconstruct_plane.YAxis, Length="1500")
line_sdl_3 = LineSDL(Start=deconstruct_plane.Origin, Direction=deconstruct_plane.XAxis, Length="1500")
rotate_3d = Rotate3D(Geometry=align_plane.Plane, Angle=degrees(90), Center=deconstruct_plane.Origin, Axis=line_sdl_3)  # -> Geometry, Transform
angle = Angle(VectorA=line_sdl, VectorB=line_sdl_3, Plane=rotate_3d.Geometry)  # -> Angle, Reflex
degrees = Degrees(Radians=angle.Reflex)
rotate = Rotate(Geometry=align_plane.Plane, Angle=degrees(degrees), Plane=rotate_3d.Geometry)  # -> Geometry, Transform
plane = Plane(rotate.Geometry)
curve_plane = CurvePlane(Curve=interpolate_16.Curve, Plane=plane)  # -> flatten(Points), ParamsC, ParamsP
list_item_197 = ListItem(List=plane, Index=0, Wrap=True)  # -> Item1, Item
line_18 = Line(StartPoint=curve_plane.Points, EndPoint=plane)
length = Length(Curve=line_18)

curve_137 = Curve(curve_94)
plane_2 = Plane(list_item_197.Item)

curve_138 = Curve(curve_95)
plane_3 = Plane(list_item_197.Item1)

orient_18 = Orient(Geometry=curve_138, Source=plane_3, Target=xy_plane)  # -> Geometry, Transform
orient_19 = Orient(Geometry=curve_137, Source=plane_2, Target=xy_plane)  # -> Geometry, Transform
tween_two_curves = TweenTwoCurves(CurveA=orient_19.Geometry, CurveB=orient_18.Geometry, Factor=graph_mapper, Refit=0, PointSample=0)
orient_20 = Orient(Geometry=tween_two_curves, Source=xy_plane, Target=plane)  # -> Geometry, Transform
end_points_9 = EndPoints(Curve=orient_20.Geometry)  # -> Start, End
line_19 = Line(StartPoint=end_points_9.Start, EndPoint=end_points_9.End)
length_2 = Length(Curve=line_19)
division_2 = Division(A=length, B=length_2)
scale_nu = ScaleNU(Geometry=orient_20.Geometry, Plane=plane, ScaleX=division_2, ScaleY=1, ScaleZ=1)  # -> Geometry, Transform
cull_index_4 = CullIndex(List=scale_nu.Geometry, Indices=[0, -1], Wrap=True)
merge_99 = Merge(Data1=flatten(curve_97), Data2=flatten(cull_index_4), Data3=flatten(curve_98))
curve_139 = Curve(merge_99)
explode_41 = Explode(Curve=curve_139, Recursive=True)  # -> Segments, Vertices
curve_140 = Curve(explode_41.Segments)
list_item_198 = ListItem(List=curve_140, Index="0", Wrap=True)
cull_index_5 = CullIndex(List=curve_140, Indices=["0", "-1"], Wrap=True)
list_item_199 = ListItem(List=curve_140, Index="-1", Wrap=True)
length_3 = Length(Curve=list_item_198)
length_4 = Length(Curve=list_item_199)
length_5 = Length(Curve=cull_index_5)
multiplication = Multiplication(A=length_3, B=reduce_straight_length)
multiplication_2 = Multiplication(A=length_4, B=reduce_straight_length)
multiplication_3 = Multiplication(A=length_5, B=reduce_straight_length)
negative_3 = Negative(Value=multiplication)
negative_4 = Negative(Value=multiplication_2)
negative_5 = Negative(Value=multiplication_3)
extend_curve_7 = ExtendCurve(Curve=list_item_198, Type=0, Start="0", End=negative_3)  # -> simplify(Curve)
extend_curve_8 = ExtendCurve(Curve=list_item_199, Type=0, Start=negative_4, End="0")  # -> simplify(Curve)
extend_curve_9 = ExtendCurve(Curve=cull_index_5, Type=0, Start=negative_5, End=negative_5)  # -> simplify(Curve)
merge_100 = Merge(Data1=extend_curve_7, Data2=extend_curve_9, Data3=extend_curve_8)
shift_list = ShiftList(List=merge_100, Shift=1, Wrap=False)
shortest_list = ShortestList(ListListA=merge_100, ListListB=shift_list, TrimMode=2)  # -> ListListA, ListListB
blend_curve_13 = BlendCurve(CurveA=shortest_list.ListListA, CurveB=shortest_list.ListListB, BulgeA=number, BulgeB=number_2, Continuity=integer)  # -> simplify(Blend)
weave = Weave(Pattern=[0, 1], Stream0=merge_100, Stream1=blend_curve_13, NullGaps=False)
curve_141 = Curve(merge_100)
curve_142 = Curve(blend_curve_13)
flip_matrix = FlipMatrix(Data=curve_141)
flip_matrix_2 = FlipMatrix(Data=curve_142)  # -> simplify(Data)
end_points_10 = EndPoints(Curve=flip_matrix)  # -> Start, End
end_points_11 = EndPoints(Curve=flip_matrix_2)  # -> Start, End
interpolate_18 = Interpolate(Vertices=end_points_10.Start, Degree=3, Periodic=False, KnotStyle=1)  # -> Curve, Length, Domain
interpolate_19 = Interpolate(Vertices=end_points_10.End, Degree=3, Periodic=False, KnotStyle=1)  # -> Curve, Length, Domain
interpolate_20 = Interpolate(Vertices=end_points_11.Start, Degree=3, Periodic=False, KnotStyle=1)  # -> Curve, Length, Domain
interpolate_21 = Interpolate(Vertices=end_points_11.End, Degree=3, Periodic=False, KnotStyle=1)  # -> Curve, Length, Domain
sweep2 = Sweep2(Rail1=interpolate_18.Curve, Rail2=interpolate_19.Curve, Sections=flip_matrix, SameHeight=False)
sweep2_2 = Sweep2(Rail1=interpolate_20.Curve, Rail2=interpolate_21.Curve, Sections=flip_matrix_2, SameHeight=False)
merge_101 = Merge(Data1=interpolate_18.Curve, Data2=interpolate_19.Curve, Data3=weave)
merge_102 = Merge(Data1=end_points_10.Start, Data2=end_points_10.End)
straight_srf_25 = Surface(sweep2)
fillet_srf_25 = Surface(sweep2_2)
pts = Point(merge_102)
crvs = Curve(merge_101)

straight_srf_26 = Surface(straight_srf_25)
point_25 = Point(pts)
curve_143 = Curve(crvs)
fillet_srf_26 = Surface(fillet_srf_25)

divide_curve_3 = DivideCurve(Curve=curve_105, Count="14", Kinks=False)  # -> Points, Tangents, Parameters
divide_curve_4 = DivideCurve(Curve=curve_104, Count="14", Kinks=False)  # -> Points, Tangents, Parameters
surface_closest_point_3 = SurfaceClosestPoint(Point=divide_curve_3.Points, Surface=surface_38)  # -> Point, UVPoint, Distance
surface_closest_point_4 = SurfaceClosestPoint(Point=divide_curve_4.Points, Surface=surface_38)  # -> Point, UVPoint, Distance
line_20 = Line(StartPoint=surface_closest_point_3.Point, EndPoint=surface_closest_point_4.Point)
interpolate_22 = Interpolate(Vertices=surface_closest_point_3.Point, Degree=3, Periodic=False, KnotStyle=1)  # -> Curve, Length, Domain
interpolate_23 = Interpolate(Vertices=surface_closest_point_4.Point, Degree=3, Periodic=False, KnotStyle=1)  # -> Curve, Length, Domain
rebuild_curve_4 = RebuildCurve(Curve=interpolate_22.Curve, Degree=3, Count="6", Tangents=False)
rebuild_curve_5 = RebuildCurve(Curve=interpolate_23.Curve, Degree=3, Count="6", Tangents=False)
curve_closest_point_14 = CurveClosestPoint(Point=divide_curve_4.Points, Curve=rebuild_curve_5)  # -> Point, Parameter, Distance
perp_frame_14 = PerpFrame(Curve=rebuild_curve_5, Parameter=curve_closest_point_14.Parameter)
align_plane_2 = AlignPlane(Plane=perp_frame_14, Direction=unit_z_10)  # -> Plane, Angle
deconstruct_plane_2 = DeconstructPlane(Plane=align_plane_2.Plane)  # -> Origin, XAxis, YAxis, ZAxis
line_sdl_4 = LineSDL(Start=deconstruct_plane_2.Origin, Direction=unit_z_11, Length="1500")
line_sdl_5 = LineSDL(Start=deconstruct_plane_2.Origin, Direction=deconstruct_plane_2.YAxis, Length="1500")
line_sdl_6 = LineSDL(Start=deconstruct_plane_2.Origin, Direction=deconstruct_plane_2.XAxis, Length="1500")
rotate_3d_2 = Rotate3D(Geometry=align_plane_2.Plane, Angle=degrees(90), Center=deconstruct_plane_2.Origin, Axis=line_sdl_6)  # -> Geometry, Transform
angle_2 = Angle(VectorA=line_sdl_4, VectorB=line_sdl_6, Plane=rotate_3d_2.Geometry)  # -> Angle, Reflex
degrees_2 = Degrees(Radians=angle_2.Reflex)
rotate_2 = Rotate(Geometry=align_plane_2.Plane, Angle=degrees(degrees_2), Plane=rotate_3d_2.Geometry)  # -> Geometry, Transform
plane_4 = Plane(rotate_2.Geometry)
curve_plane_2 = CurvePlane(Curve=rebuild_curve_4, Plane=plane_4)  # -> flatten(Points), ParamsC, ParamsP
list_item_200 = ListItem(List=plane_4, Index=0, Wrap=True)  # -> Item1, Item
line_21 = Line(StartPoint=curve_plane_2.Points, EndPoint=plane_4)
length_6 = Length(Curve=line_21)
curve_144 = Curve(flatten(curve_103))

curve_145 = Curve(curve_99)
plane_5 = Plane(list_item_200.Item)

curve_146 = Curve(curve_100)
plane_6 = Plane(list_item_200.Item1)

orient_21 = Orient(Geometry=curve_146, Source=plane_6, Target=xy_plane_2)  # -> Geometry, Transform
orient_22 = Orient(Geometry=curve_145, Source=plane_5, Target=xy_plane_2)  # -> Geometry, Transform
tween_two_curves_2 = TweenTwoCurves(CurveA=orient_22.Geometry, CurveB=orient_21.Geometry, Factor=graph_mapper_2, Refit=0, PointSample=0)
orient_23 = Orient(Geometry=tween_two_curves_2, Source=xy_plane_2, Target=plane_4)  # -> Geometry, Transform
end_points_12 = EndPoints(Curve=orient_23.Geometry)  # -> Start, End
line_22 = Line(StartPoint=end_points_12.Start, EndPoint=end_points_12.End)
length_7 = Length(Curve=line_22)
division_3 = Division(A=length_6, B=length_7)
scale_nu_2 = ScaleNU(Geometry=orient_23.Geometry, Plane=plane_4, ScaleX=division_3, ScaleY=1, ScaleZ=1)  # -> Geometry, Transform
cull_index_6 = CullIndex(List=scale_nu_2.Geometry, Indices=[0, -1], Wrap=True)
merge_103 = Merge(Data1=flatten(curve_101), Data2=flatten(cull_index_6), Data3=flatten(curve_144))
curve_147 = Curve(merge_103)
explode_42 = Explode(Curve=curve_147, Recursive=True)  # -> Segments, Vertices
curve_148 = Curve(explode_42.Segments)
list_item_201 = ListItem(List=curve_148, Index="0", Wrap=True)
cull_index_7 = CullIndex(List=curve_148, Indices=["0", "-1"], Wrap=True)
list_item_202 = ListItem(List=curve_148, Index="-1", Wrap=True)
length_8 = Length(Curve=list_item_201)
length_9 = Length(Curve=list_item_202)
length_10 = Length(Curve=cull_index_7)
multiplication_4 = Multiplication(A=length_8, B=reduce_straight_length_2)
multiplication_5 = Multiplication(A=length_9, B=reduce_straight_length_2)
multiplication_6 = Multiplication(A=length_10, B=reduce_straight_length_2)
negative_6 = Negative(Value=multiplication_4)
negative_7 = Negative(Value=multiplication_5)
negative_8 = Negative(Value=multiplication_6)
extend_curve_10 = ExtendCurve(Curve=list_item_201, Type=0, Start="0", End=negative_6)  # -> simplify(Curve)
extend_curve_11 = ExtendCurve(Curve=list_item_202, Type=0, Start=negative_7, End="0")  # -> simplify(Curve)
extend_curve_12 = ExtendCurve(Curve=cull_index_7, Type=0, Start=negative_8, End=negative_8)  # -> simplify(Curve)
merge_104 = Merge(Data1=extend_curve_10, Data2=extend_curve_12, Data3=extend_curve_11)
shift_list_2 = ShiftList(List=merge_104, Shift=1, Wrap=False)
shortest_list_2 = ShortestList(ListListA=merge_104, ListListB=shift_list_2, TrimMode=2)  # -> ListListA, ListListB
blend_curve_14 = BlendCurve(
    CurveA=shortest_list_2.ListListA,
    CurveB=shortest_list_2.ListListB,
    BulgeA=number_3,
    BulgeB=number_4,
    Continuity=integer_2)  # -> simplify(Blend)
weave_2 = Weave(Pattern=[0, 1], Stream0=merge_104, Stream1=blend_curve_14, NullGaps=False)
curve_149 = Curve(merge_104)
curve_150 = Curve(blend_curve_14)
flip_matrix_3 = FlipMatrix(Data=curve_149)
flip_matrix_4 = FlipMatrix(Data=curve_150)  # -> simplify(Data)
end_points_13 = EndPoints(Curve=flip_matrix_3)  # -> Start, End
end_points_14 = EndPoints(Curve=flip_matrix_4)  # -> Start, End
interpolate_24 = Interpolate(Vertices=end_points_13.Start, Degree=3, Periodic=False, KnotStyle=1)  # -> Curve, Length, Domain
interpolate_25 = Interpolate(Vertices=end_points_13.End, Degree=3, Periodic=False, KnotStyle=1)  # -> Curve, Length, Domain
interpolate_26 = Interpolate(Vertices=end_points_14.Start, Degree=3, Periodic=False, KnotStyle=1)  # -> Curve, Length, Domain
interpolate_27 = Interpolate(Vertices=end_points_14.End, Degree=3, Periodic=False, KnotStyle=1)  # -> Curve, Length, Domain
sweep2_3 = Sweep2(Rail1=interpolate_24.Curve, Rail2=interpolate_25.Curve, Sections=flip_matrix_3, SameHeight=False)
sweep2_4 = Sweep2(Rail1=interpolate_26.Curve, Rail2=interpolate_27.Curve, Sections=flip_matrix_4, SameHeight=False)
merge_105 = Merge(Data1=interpolate_24.Curve, Data2=interpolate_25.Curve, Data3=weave_2)
merge_106 = Merge(Data1=end_points_13.Start, Data2=end_points_13.End)
straight_srf_27 = Surface(sweep2_3)
fillet_srf_27 = Surface(sweep2_4)
pts_2 = Point(merge_106)
crvs_2 = Curve(merge_105)

straight_srf_28 = Surface(straight_srf_27)
point_26 = Point(pts_2)
curve_151 = Curve(crvs_2)
fillet_srf_28 = Surface(fillet_srf_27)

divide_curve_5 = DivideCurve(Curve=curve_112, Count="14", Kinks=False)  # -> Points, Tangents, Parameters
divide_curve_6 = DivideCurve(Curve=curve_111, Count="14", Kinks=False)  # -> Points, Tangents, Parameters
surface_closest_point_5 = SurfaceClosestPoint(Point=divide_curve_5.Points, Surface=surface_39)  # -> Point, UVPoint, Distance
surface_closest_point_6 = SurfaceClosestPoint(Point=divide_curve_6.Points, Surface=surface_39)  # -> Point, UVPoint, Distance
line_23 = Line(StartPoint=surface_closest_point_5.Point, EndPoint=surface_closest_point_6.Point)
interpolate_28 = Interpolate(Vertices=surface_closest_point_5.Point, Degree=3, Periodic=False, KnotStyle=1)  # -> Curve, Length, Domain
interpolate_29 = Interpolate(Vertices=surface_closest_point_6.Point, Degree=3, Periodic=False, KnotStyle=1)  # -> Curve, Length, Domain
rebuild_curve_6 = RebuildCurve(Curve=interpolate_28.Curve, Degree=3, Count="7", Tangents=False)
rebuild_curve_7 = RebuildCurve(Curve=interpolate_29.Curve, Degree=3, Count="7", Tangents=False)
curve_closest_point_15 = CurveClosestPoint(Point=divide_curve_6.Points, Curve=rebuild_curve_7)  # -> Point, Parameter, Distance
perp_frame_15 = PerpFrame(Curve=rebuild_curve_7, Parameter=curve_closest_point_15.Parameter)
align_plane_3 = AlignPlane(Plane=perp_frame_15, Direction=unit_z_12)  # -> Plane, Angle
deconstruct_plane_3 = DeconstructPlane(Plane=align_plane_3.Plane)  # -> Origin, XAxis, YAxis, ZAxis
line_sdl_7 = LineSDL(Start=deconstruct_plane_3.Origin, Direction=unit_z_13, Length="1500")
line_sdl_8 = LineSDL(Start=deconstruct_plane_3.Origin, Direction=deconstruct_plane_3.YAxis, Length="1500")
line_sdl_9 = LineSDL(Start=deconstruct_plane_3.Origin, Direction=deconstruct_plane_3.XAxis, Length="1500")
rotate_3d_3 = Rotate3D(Geometry=align_plane_3.Plane, Angle=degrees(90), Center=deconstruct_plane_3.Origin, Axis=line_sdl_9)  # -> Geometry, Transform
angle_3 = Angle(VectorA=line_sdl_7, VectorB=line_sdl_9, Plane=rotate_3d_3.Geometry)  # -> Angle, Reflex
degrees_3 = Degrees(Radians=angle_3.Reflex)
rotate_3 = Rotate(Geometry=align_plane_3.Plane, Angle=degrees(degrees_3), Plane=rotate_3d_3.Geometry)  # -> Geometry, Transform
plane_7 = Plane(rotate_3.Geometry)
curve_plane_3 = CurvePlane(Curve=rebuild_curve_6, Plane=plane_7)  # -> flatten(Points), ParamsC, ParamsP
list_item_203 = ListItem(List=plane_7, Index=0, Wrap=True)  # -> Item1, Item
line_24 = Line(StartPoint=curve_plane_3.Points, EndPoint=plane_7)
length_11 = Length(Curve=line_24)
curve_152 = Curve(flatten(curve_110))

curve_153 = Curve(curve_106)
plane_8 = Plane(list_item_203.Item)

curve_154 = Curve(curve_107)
plane_9 = Plane(list_item_203.Item1)

orient_24 = Orient(Geometry=curve_154, Source=plane_9, Target=xy_plane_3)  # -> Geometry, Transform
orient_25 = Orient(Geometry=curve_153, Source=plane_8, Target=xy_plane_3)  # -> Geometry, Transform
tween_two_curves_3 = TweenTwoCurves(CurveA=orient_25.Geometry, CurveB=orient_24.Geometry, Factor=graph_mapper_3, Refit=0, PointSample=0)
orient_26 = Orient(Geometry=tween_two_curves_3, Source=xy_plane_3, Target=plane_7)  # -> Geometry, Transform
end_points_15 = EndPoints(Curve=orient_26.Geometry)  # -> Start, End
line_25 = Line(StartPoint=end_points_15.Start, EndPoint=end_points_15.End)
length_12 = Length(Curve=line_25)
division_4 = Division(A=length_11, B=length_12)
scale_nu_3 = ScaleNU(Geometry=orient_26.Geometry, Plane=plane_7, ScaleX=division_4, ScaleY=1, ScaleZ=1)  # -> Geometry, Transform
cull_index_8 = CullIndex(List=scale_nu_3.Geometry, Indices=[0, -1], Wrap=True)
merge_107 = Merge(Data1=flatten(curve_108), Data2=flatten(cull_index_8), Data3=flatten(curve_152))
curve_155 = Curve(merge_107)
explode_43 = Explode(Curve=curve_155, Recursive=True)  # -> Segments, Vertices
curve_156 = Curve(explode_43.Segments)
list_item_204 = ListItem(List=curve_156, Index="0", Wrap=True)
cull_index_9 = CullIndex(List=curve_156, Indices=["0", "-1"], Wrap=True)
list_item_205 = ListItem(List=curve_156, Index="-1", Wrap=True)
length_13 = Length(Curve=list_item_204)
length_14 = Length(Curve=list_item_205)
length_15 = Length(Curve=cull_index_9)
multiplication_7 = Multiplication(A=length_13, B=reduce_straight_length_3)
multiplication_8 = Multiplication(A=length_14, B=reduce_straight_length_3)
multiplication_9 = Multiplication(A=length_15, B=reduce_straight_length_3)
negative_9 = Negative(Value=multiplication_7)
negative_10 = Negative(Value=multiplication_8)
negative_11 = Negative(Value=multiplication_9)
extend_curve_13 = ExtendCurve(Curve=list_item_204, Type=0, Start="0", End=negative_9)  # -> simplify(Curve)
extend_curve_14 = ExtendCurve(Curve=list_item_205, Type=0, Start=negative_10, End="0")  # -> simplify(Curve)
extend_curve_15 = ExtendCurve(Curve=cull_index_9, Type=0, Start=negative_11, End=negative_11)  # -> simplify(Curve)
merge_108 = Merge(Data1=extend_curve_13, Data2=extend_curve_15, Data3=extend_curve_14)
shift_list_3 = ShiftList(List=merge_108, Shift=1, Wrap=False)
shortest_list_3 = ShortestList(ListListA=merge_108, ListListB=shift_list_3, TrimMode=2)  # -> ListListA, ListListB
blend_curve_15 = BlendCurve(
    CurveA=shortest_list_3.ListListA,
    CurveB=shortest_list_3.ListListB,
    BulgeA=number_5,
    BulgeB=number_6,
    Continuity=integer_3)  # -> simplify(Blend)
weave_3 = Weave(Pattern=[0, 1], Stream0=merge_108, Stream1=blend_curve_15, NullGaps=False)
curve_157 = Curve(merge_108)
curve_158 = Curve(blend_curve_15)
flip_matrix_5 = FlipMatrix(Data=curve_157)
flip_matrix_6 = FlipMatrix(Data=curve_158)  # -> simplify(Data)
end_points_16 = EndPoints(Curve=flip_matrix_5)  # -> Start, End
end_points_17 = EndPoints(Curve=flip_matrix_6)  # -> Start, End
interpolate_30 = Interpolate(Vertices=end_points_16.Start, Degree=3, Periodic=False, KnotStyle=1)  # -> Curve, Length, Domain
interpolate_31 = Interpolate(Vertices=end_points_16.End, Degree=3, Periodic=False, KnotStyle=1)  # -> Curve, Length, Domain
interpolate_32 = Interpolate(Vertices=end_points_17.Start, Degree=3, Periodic=False, KnotStyle=1)  # -> Curve, Length, Domain
interpolate_33 = Interpolate(Vertices=end_points_17.End, Degree=3, Periodic=False, KnotStyle=1)  # -> Curve, Length, Domain
sweep2_5 = Sweep2(Rail1=interpolate_30.Curve, Rail2=interpolate_31.Curve, Sections=flip_matrix_5, SameHeight=False)
sweep2_6 = Sweep2(Rail1=interpolate_32.Curve, Rail2=interpolate_33.Curve, Sections=flip_matrix_6, SameHeight=False)
merge_109 = Merge(Data1=interpolate_30.Curve, Data2=interpolate_31.Curve, Data3=weave_3)
merge_110 = Merge(Data1=end_points_16.Start, Data2=end_points_16.End)
straight_srf_29 = Surface(sweep2_5)
fillet_srf_29 = Surface(sweep2_6)
pts_3 = Point(merge_110)
crvs_3 = Curve(merge_109)

straight_srf_30 = Surface(straight_srf_29)
point_27 = Point(pts_3)
curve_159 = Curve(crvs_3)
fillet_srf_30 = Surface(fillet_srf_29)

surface_43 = Surface([fillet_srf_21, fillet_srf_22, fillet_srf_13, fillet_srf_11, fillet_srf_14, fillet_srf_12, fillet_srf_9, fillet_srf_7, fillet_srf_5, fillet_srf_28, fillet_srf_30, fillet_srf_26, fillet_srf_15, fillet_srf, fillet_srf_3])
colour_swatch = ColourSwatch(SwatchColor=RGB(255, 0, 191))
custom_preview_2 = CustomPreview(Geometry=surface_43, Material=colour_swatch)  # disabled

curve_160 = Curve([curve_85, curve_86, curve_77, curve_75, curve_78, curve_76, curve_73, curve_71, curve_69, curve_151, curve_159, curve_143, curve_79, curve_45, curve_47])
colour_swatch_2 = ColourSwatch(SwatchColor=RGB(31, 31, 31))
custom_preview_lineweights = CustomPreviewLineweights(Geometry=curve_160, Shader=colour_swatch, Thickness=Slider(2.4, range=0..10), Absolute=False)  # disabled

surface_44 = Surface([straight_srf_21, straight_srf_22, straight_srf_13, straight_srf_11, straight_srf_14, straight_srf_12, straight_srf_9, straight_srf_7, straight_srf_5, straight_srf_28, straight_srf_30, straight_srf_26, straight_srf_15, straight_srf, straight_srf_3])
custom_preview_3 = CustomPreview(Geometry=surface_44, Material=ColourSwatch(SwatchColor=RGB(212, 212, 212)))  # disabled

point_28 = Point([point_21, point_22, point_13, point_11, point_14, point_12, point_9, point_7, point_5, point_26, point_27, point_25, point_15, point, point_3])
dot_display = DotDisplay(Point=point_28, Colour=ColourSwatch(SwatchColor=RGB(105, 105, 105)), Size=Slider(34, range=0..100))  # disabled

divide_curve_7 = DivideCurve(Curve=curve_136, Count=panel_72, Kinks=False)  # -> Points, Tangents, Parameters; disabled
divide_curve_8 = DivideCurve(Curve=curve_135, Count=panel_72, Kinks=False)  # -> Points, Tangents, Parameters; disabled
surface_closest_point_7 = SurfaceClosestPoint(Point=divide_curve_7.Points, Surface=surface_40)  # -> Point, UVPoint, Distance; disabled
surface_closest_point_8 = SurfaceClosestPoint(Point=divide_curve_8.Points, Surface=surface_40)  # -> Point, UVPoint, Distance; disabled
line_26 = Line(StartPoint=surface_closest_point_7.Point, EndPoint=surface_closest_point_8.Point)  # disabled
interpolate_34 = Interpolate(Vertices=surface_closest_point_7.Point, Degree=3, Periodic=False, KnotStyle=1)  # -> Curve, Length, Domain; disabled
interpolate_35 = Interpolate(Vertices=surface_closest_point_8.Point, Degree=3, Periodic=False, KnotStyle=1)  # -> Curve, Length, Domain; disabled
curve_closest_point_16 = CurveClosestPoint(Point=divide_curve_8.Points, Curve=interpolate_35.Curve)  # -> Point, Parameter, Distance; disabled
perp_frame_16 = PerpFrame(Curve=interpolate_35.Curve, Parameter=curve_closest_point_16.Parameter)  # disabled
align_plane_4 = AlignPlane(Plane=perp_frame_16, Direction=unit_z_14)  # -> Plane, Angle; disabled
deconstruct_plane_4 = DeconstructPlane(Plane=align_plane_4.Plane)  # -> Origin, XAxis, YAxis, ZAxis; disabled
line_sdl_10 = LineSDL(Start=deconstruct_plane_4.Origin, Direction=unit_z_15, Length=panel_73)  # disabled
line_sdl_11 = LineSDL(Start=deconstruct_plane_4.Origin, Direction=deconstruct_plane_4.YAxis, Length=panel_73)  # disabled
line_sdl_12 = LineSDL(Start=deconstruct_plane_4.Origin, Direction=deconstruct_plane_4.XAxis, Length=panel_73)  # disabled
rotate_3d_4 = Rotate3D(Geometry=align_plane_4.Plane, Angle=degrees(90), Center=deconstruct_plane_4.Origin, Axis=line_sdl_12)  # -> Geometry, Transform; disabled
angle_4 = Angle(VectorA=line_sdl_10, VectorB=line_sdl_12, Plane=rotate_3d_4.Geometry)  # -> Angle, Reflex; disabled
degrees_4 = Degrees(Radians=angle_4.Reflex)  # disabled
rotate_4 = Rotate(Geometry=align_plane_4.Plane, Angle=degrees(degrees_4), Plane=rotate_3d_4.Geometry)  # -> Geometry, Transform; disabled
plane_10 = Plane(rotate_4.Geometry)  # disabled
curve_plane_4 = CurvePlane(Curve=interpolate_34.Curve, Plane=plane_10)  # -> flatten(Points), ParamsC, ParamsP; disabled
list_item_206 = ListItem(List=plane_10, Index=0, Wrap=True)  # -> Item1, Item; disabled
line_27 = Line(StartPoint=curve_plane_4.Points, EndPoint=plane_10)  # disabled
length_16 = Length(Curve=line_27)  # disabled

curve_161 = Curve(curve_114)  # disabled
plane_11 = Plane(list_item_206.Item)  # disabled

curve_162 = Curve(curve_115)  # disabled
plane_12 = Plane(list_item_206.Item1)  # disabled

orient_27 = Orient(Geometry=curve_162, Source=plane_12, Target=xy_plane_4)  # -> Geometry, Transform; disabled
orient_28 = Orient(Geometry=curve_161, Source=plane_11, Target=xy_plane_4)  # -> Geometry, Transform; disabled
tween_two_curves_4 = TweenTwoCurves(CurveA=orient_28.Geometry, CurveB=orient_27.Geometry, Factor=graph_mapper_4, Refit=0, PointSample=0)  # disabled
orient_29 = Orient(Geometry=tween_two_curves_4, Source=xy_plane_4, Target=plane_10)  # -> Geometry, Transform; disabled
end_points_18 = EndPoints(Curve=orient_29.Geometry)  # -> Start, End; disabled
line_28 = Line(StartPoint=end_points_18.Start, EndPoint=end_points_18.End)  # disabled
length_17 = Length(Curve=line_28)  # disabled
division_5 = Division(A=length_16, B=length_17)  # disabled
scale_nu_4 = ScaleNU(Geometry=orient_29.Geometry, Plane=plane_10, ScaleX=division_5, ScaleY=1, ScaleZ=1)  # -> Geometry, Transform; disabled
cull_index_10 = CullIndex(List=scale_nu_4.Geometry, Indices=[0, -1], Wrap=True)  # disabled
merge_111 = Merge(Data1=flatten(curve_117), Data2=flatten(cull_index_10), Data3=flatten(curve_118))  # disabled
curve_163 = Curve(merge_111)  # disabled
explode_44 = Explode(Curve=curve_163, Recursive=True)  # -> Segments, Vertices; disabled
curve_164 = Curve(explode_44.Segments)  # disabled
list_item_207 = ListItem(List=curve_164, Index=panel_74, Wrap=True)  # disabled
cull_index_11 = CullIndex(List=curve_164, Indices=[panel_74, panel_75], Wrap=True)  # disabled
list_item_208 = ListItem(List=curve_164, Index=panel_75, Wrap=True)  # disabled
length_18 = Length(Curve=list_item_207)  # disabled
length_19 = Length(Curve=list_item_208)  # disabled
length_20 = Length(Curve=cull_index_11)  # disabled
multiplication_10 = Multiplication(A=length_18, B=reduce_straight_length_4)  # disabled
multiplication_11 = Multiplication(A=length_19, B=reduce_straight_length_4)  # disabled
multiplication_12 = Multiplication(A=length_20, B=reduce_straight_length_4)  # disabled
negative_12 = Negative(Value=multiplication_10)  # disabled
negative_13 = Negative(Value=multiplication_11)  # disabled
negative_14 = Negative(Value=multiplication_12)  # disabled
extend_curve_16 = ExtendCurve(Curve=list_item_207, Type=0, Start=panel_76, End=negative_12)  # -> simplify(Curve); disabled
extend_curve_17 = ExtendCurve(Curve=list_item_208, Type=0, Start=negative_13, End=panel_76)  # -> simplify(Curve); disabled
extend_curve_18 = ExtendCurve(Curve=cull_index_11, Type=0, Start=negative_14, End=negative_14)  # -> simplify(Curve); disabled
merge_112 = Merge(Data1=extend_curve_16, Data2=extend_curve_18, Data3=extend_curve_17)  # disabled
shift_list_4 = ShiftList(List=merge_112, Shift=1, Wrap=False)  # disabled
shortest_list_4 = ShortestList(ListListA=merge_112, ListListB=shift_list_4, TrimMode=2)  # -> ListListA, ListListB; disabled
blend_curve_16 = BlendCurve(
    CurveA=shortest_list_4.ListListA,
    CurveB=shortest_list_4.ListListB,
    BulgeA=number_7,
    BulgeB=number_8,
    Continuity=integer_4)  # -> simplify(Blend); disabled
weave_4 = Weave(Pattern=[0, 1], Stream0=merge_112, Stream1=blend_curve_16, NullGaps=False)  # disabled
curve_165 = Curve(merge_112)  # disabled
curve_166 = Curve(blend_curve_16)  # disabled
flip_matrix_7 = FlipMatrix(Data=curve_165)  # disabled
flip_matrix_8 = FlipMatrix(Data=curve_166)  # -> simplify(Data); disabled
end_points_19 = EndPoints(Curve=flip_matrix_7)  # -> Start, End; disabled
end_points_20 = EndPoints(Curve=flip_matrix_8)  # -> Start, End; disabled
interpolate_36 = Interpolate(Vertices=end_points_19.Start, Degree=3, Periodic=False, KnotStyle=1)  # -> Curve, Length, Domain; disabled
interpolate_37 = Interpolate(Vertices=end_points_19.End, Degree=3, Periodic=False, KnotStyle=1)  # -> Curve, Length, Domain; disabled
interpolate_38 = Interpolate(Vertices=end_points_20.Start, Degree=3, Periodic=False, KnotStyle=1)  # -> Curve, Length, Domain; disabled
interpolate_39 = Interpolate(Vertices=end_points_20.End, Degree=3, Periodic=False, KnotStyle=1)  # -> Curve, Length, Domain; disabled
sweep2_7 = Sweep2(Rail1=interpolate_36.Curve, Rail2=interpolate_37.Curve, Sections=flip_matrix_7, SameHeight=False)  # disabled
sweep2_8 = Sweep2(Rail1=interpolate_38.Curve, Rail2=interpolate_39.Curve, Sections=flip_matrix_8, SameHeight=False)  # disabled
merge_113 = Merge(Data1=interpolate_36.Curve, Data2=interpolate_37.Curve, Data3=weave_4)  # disabled
merge_114 = Merge(Data1=end_points_19.Start, Data2=end_points_19.End)  # disabled
straight_srf_31 = Surface(sweep2_7)  # disabled
fillet_srf_31 = Surface(sweep2_8)  # disabled
pts_4 = Point(merge_114)  # disabled
crvs_4 = Curve(merge_113)  # disabled

straight_srf_32 = Surface(straight_srf_31)  # disabled
point_29 = Point(pts_4)  # disabled
curve_167 = Curve(crvs_4)  # disabled
fillet_srf_32 = Surface(fillet_srf_31)  # disabled

divide_curve_9 = DivideCurve(Curve=curve_125, Count=panel_78, Kinks=False)  # -> Points, Tangents, Parameters; disabled
divide_curve_10 = DivideCurve(Curve=curve_124, Count=panel_78, Kinks=False)  # -> Points, Tangents, Parameters; disabled
surface_closest_point_9 = SurfaceClosestPoint(Point=divide_curve_9.Points, Surface=surface_41)  # -> Point, UVPoint, Distance; disabled
surface_closest_point_10 = SurfaceClosestPoint(Point=divide_curve_10.Points, Surface=surface_41)  # -> Point, UVPoint, Distance; disabled
line_29 = Line(StartPoint=surface_closest_point_9.Point, EndPoint=surface_closest_point_10.Point)  # disabled
interpolate_40 = Interpolate(Vertices=surface_closest_point_9.Point, Degree=3, Periodic=False, KnotStyle=1)  # -> Curve, Length, Domain; disabled
interpolate_41 = Interpolate(Vertices=surface_closest_point_10.Point, Degree=3, Periodic=False, KnotStyle=1)  # -> Curve, Length, Domain; disabled
rebuild_curve_8 = RebuildCurve(Curve=interpolate_40.Curve, Degree=3, Count=panel_79, Tangents=False)  # disabled
rebuild_curve_9 = RebuildCurve(Curve=interpolate_41.Curve, Degree=3, Count=panel_80, Tangents=False)  # disabled
curve_closest_point_17 = CurveClosestPoint(Point=divide_curve_10.Points, Curve=rebuild_curve_9)  # -> Point, Parameter, Distance; disabled
perp_frame_17 = PerpFrame(Curve=rebuild_curve_9, Parameter=curve_closest_point_17.Parameter)  # disabled
align_plane_5 = AlignPlane(Plane=perp_frame_17, Direction=unit_z_16)  # -> Plane, Angle; disabled
deconstruct_plane_5 = DeconstructPlane(Plane=align_plane_5.Plane)  # -> Origin, XAxis, YAxis, ZAxis; disabled
line_sdl_13 = LineSDL(Start=deconstruct_plane_5.Origin, Direction=unit_z_17, Length=panel_81)  # disabled
line_sdl_14 = LineSDL(Start=deconstruct_plane_5.Origin, Direction=deconstruct_plane_5.YAxis, Length=panel_81)  # disabled
line_sdl_15 = LineSDL(Start=deconstruct_plane_5.Origin, Direction=deconstruct_plane_5.XAxis, Length=panel_81)  # disabled
rotate_3d_5 = Rotate3D(Geometry=align_plane_5.Plane, Angle=degrees(90), Center=deconstruct_plane_5.Origin, Axis=line_sdl_15)  # -> Geometry, Transform; disabled
angle_5 = Angle(VectorA=line_sdl_13, VectorB=line_sdl_15, Plane=rotate_3d_5.Geometry)  # -> Angle, Reflex; disabled
degrees_5 = Degrees(Radians=angle_5.Reflex)  # disabled
rotate_5 = Rotate(Geometry=align_plane_5.Plane, Angle=degrees(degrees_5), Plane=rotate_3d_5.Geometry)  # -> Geometry, Transform; disabled
plane_13 = Plane(rotate_5.Geometry)  # disabled
curve_plane_5 = CurvePlane(Curve=rebuild_curve_8, Plane=plane_13)  # -> flatten(Points), ParamsC, ParamsP; disabled
list_item_209 = ListItem(List=plane_13, Index=0, Wrap=True)  # -> Item1, Item; disabled
line_30 = Line(StartPoint=curve_plane_5.Points, EndPoint=plane_13)  # disabled
length_21 = Length(Curve=line_30)  # disabled
curve_168 = Curve(flatten(curve_123))  # disabled

curve_169 = Curve(curve_119)  # disabled
plane_14 = Plane(list_item_209.Item)  # disabled

curve_170 = Curve(curve_120)  # disabled
plane_15 = Plane(list_item_209.Item1)  # disabled

orient_30 = Orient(Geometry=curve_170, Source=plane_15, Target=xy_plane_5)  # -> Geometry, Transform; disabled
orient_31 = Orient(Geometry=curve_169, Source=plane_14, Target=xy_plane_5)  # -> Geometry, Transform; disabled
tween_two_curves_5 = TweenTwoCurves(CurveA=orient_31.Geometry, CurveB=orient_30.Geometry, Factor=graph_mapper_5, Refit=0, PointSample=0)  # disabled
orient_32 = Orient(Geometry=tween_two_curves_5, Source=xy_plane_5, Target=plane_13)  # -> Geometry, Transform; disabled
end_points_21 = EndPoints(Curve=orient_32.Geometry)  # -> Start, End; disabled
line_31 = Line(StartPoint=end_points_21.Start, EndPoint=end_points_21.End)  # disabled
length_22 = Length(Curve=line_31)  # disabled
division_6 = Division(A=length_21, B=length_22)  # disabled
scale_nu_5 = ScaleNU(Geometry=orient_32.Geometry, Plane=plane_13, ScaleX=division_6, ScaleY=1, ScaleZ=1)  # -> Geometry, Transform; disabled
cull_index_12 = CullIndex(List=scale_nu_5.Geometry, Indices=[0, -1], Wrap=True)  # disabled
merge_115 = Merge(Data1=flatten(curve_121), Data2=flatten(cull_index_12), Data3=flatten(curve_168))  # disabled
curve_171 = Curve(merge_115)  # disabled
explode_45 = Explode(Curve=curve_171, Recursive=True)  # -> Segments, Vertices; disabled
curve_172 = Curve(explode_45.Segments)  # disabled
list_item_210 = ListItem(List=curve_172, Index=panel_82, Wrap=True)  # disabled
cull_index_13 = CullIndex(List=curve_172, Indices=[panel_82, panel_83], Wrap=True)  # disabled
list_item_211 = ListItem(List=curve_172, Index=panel_83, Wrap=True)  # disabled
length_23 = Length(Curve=list_item_210)  # disabled
length_24 = Length(Curve=list_item_211)  # disabled
length_25 = Length(Curve=cull_index_13)  # disabled
multiplication_13 = Multiplication(A=length_23, B=reduce_straight_length_5)  # disabled
multiplication_14 = Multiplication(A=length_24, B=reduce_straight_length_5)  # disabled
multiplication_15 = Multiplication(A=length_25, B=reduce_straight_length_5)  # disabled
negative_15 = Negative(Value=multiplication_13)  # disabled
negative_16 = Negative(Value=multiplication_14)  # disabled
negative_17 = Negative(Value=multiplication_15)  # disabled
extend_curve_19 = ExtendCurve(Curve=list_item_210, Type=0, Start=panel_84, End=negative_15)  # -> simplify(Curve); disabled
extend_curve_20 = ExtendCurve(Curve=list_item_211, Type=0, Start=negative_16, End=panel_84)  # -> simplify(Curve); disabled
extend_curve_21 = ExtendCurve(Curve=cull_index_13, Type=0, Start=negative_17, End=negative_17)  # -> simplify(Curve); disabled
merge_116 = Merge(Data1=extend_curve_19, Data2=extend_curve_21, Data3=extend_curve_20)  # disabled
shift_list_5 = ShiftList(List=merge_116, Shift=1, Wrap=False)  # disabled
shortest_list_5 = ShortestList(ListListA=merge_116, ListListB=shift_list_5, TrimMode=2)  # -> ListListA, ListListB; disabled
blend_curve_17 = BlendCurve(
    CurveA=shortest_list_5.ListListA,
    CurveB=shortest_list_5.ListListB,
    BulgeA=number_9,
    BulgeB=number_10,
    Continuity=integer_5)  # -> simplify(Blend); disabled
weave_5 = Weave(Pattern=[0, 1], Stream0=merge_116, Stream1=blend_curve_17, NullGaps=False)  # disabled
curve_173 = Curve(merge_116)  # disabled
curve_174 = Curve(blend_curve_17)  # disabled
flip_matrix_9 = FlipMatrix(Data=curve_173)  # disabled
flip_matrix_10 = FlipMatrix(Data=curve_174)  # -> simplify(Data); disabled
end_points_22 = EndPoints(Curve=flip_matrix_9)  # -> Start, End; disabled
end_points_23 = EndPoints(Curve=flip_matrix_10)  # -> Start, End; disabled
interpolate_42 = Interpolate(Vertices=end_points_22.Start, Degree=3, Periodic=False, KnotStyle=1)  # -> Curve, Length, Domain; disabled
interpolate_43 = Interpolate(Vertices=end_points_22.End, Degree=3, Periodic=False, KnotStyle=1)  # -> Curve, Length, Domain; disabled
interpolate_44 = Interpolate(Vertices=end_points_23.Start, Degree=3, Periodic=False, KnotStyle=1)  # -> Curve, Length, Domain; disabled
interpolate_45 = Interpolate(Vertices=end_points_23.End, Degree=3, Periodic=False, KnotStyle=1)  # -> Curve, Length, Domain; disabled
sweep2_9 = Sweep2(Rail1=interpolate_42.Curve, Rail2=interpolate_43.Curve, Sections=flip_matrix_9, SameHeight=False)  # disabled
sweep2_10 = Sweep2(Rail1=interpolate_44.Curve, Rail2=interpolate_45.Curve, Sections=flip_matrix_10, SameHeight=False)  # disabled
merge_117 = Merge(Data1=interpolate_42.Curve, Data2=interpolate_43.Curve, Data3=weave_5)  # disabled
merge_118 = Merge(Data1=end_points_22.Start, Data2=end_points_22.End)  # disabled
straight_srf_33 = Surface(sweep2_9)  # disabled
fillet_srf_33 = Surface(sweep2_10)  # disabled
pts_5 = Point(merge_118)  # disabled
crvs_5 = Curve(merge_117)  # disabled

straight_srf_34 = Surface(straight_srf_33)  # disabled
point_30 = Point(pts_5)  # disabled
curve_175 = Curve(crvs_5)  # disabled
fillet_srf_34 = Surface(fillet_srf_33)  # disabled

divide_curve_11 = DivideCurve(Curve=curve_132, Count=panel_86, Kinks=False)  # -> Points, Tangents, Parameters; disabled
divide_curve_12 = DivideCurve(Curve=curve_131, Count=panel_86, Kinks=False)  # -> Points, Tangents, Parameters; disabled
surface_closest_point_11 = SurfaceClosestPoint(Point=divide_curve_11.Points, Surface=surface_42)  # -> Point, UVPoint, Distance; disabled
surface_closest_point_12 = SurfaceClosestPoint(Point=divide_curve_12.Points, Surface=surface_42)  # -> Point, UVPoint, Distance; disabled
line_32 = Line(StartPoint=surface_closest_point_11.Point, EndPoint=surface_closest_point_12.Point)  # disabled
interpolate_46 = Interpolate(Vertices=surface_closest_point_11.Point, Degree=3, Periodic=False, KnotStyle=1)  # -> Curve, Length, Domain; disabled
interpolate_47 = Interpolate(Vertices=surface_closest_point_12.Point, Degree=3, Periodic=False, KnotStyle=1)  # -> Curve, Length, Domain; disabled
rebuild_curve_10 = RebuildCurve(Curve=interpolate_46.Curve, Degree=3, Count=panel_87, Tangents=False)  # disabled
rebuild_curve_11 = RebuildCurve(Curve=interpolate_47.Curve, Degree=3, Count=panel_87, Tangents=False)  # disabled
curve_closest_point_18 = CurveClosestPoint(Point=divide_curve_12.Points, Curve=rebuild_curve_11)  # -> Point, Parameter, Distance; disabled
perp_frame_18 = PerpFrame(Curve=rebuild_curve_11, Parameter=curve_closest_point_18.Parameter)  # disabled
align_plane_6 = AlignPlane(Plane=perp_frame_18, Direction=unit_z_18)  # -> Plane, Angle; disabled
deconstruct_plane_6 = DeconstructPlane(Plane=align_plane_6.Plane)  # -> Origin, XAxis, YAxis, ZAxis; disabled
line_sdl_16 = LineSDL(Start=deconstruct_plane_6.Origin, Direction=unit_z_19, Length=panel_88)  # disabled
line_sdl_17 = LineSDL(Start=deconstruct_plane_6.Origin, Direction=deconstruct_plane_6.YAxis, Length=panel_88)  # disabled
line_sdl_18 = LineSDL(Start=deconstruct_plane_6.Origin, Direction=deconstruct_plane_6.XAxis, Length=panel_88)  # disabled
rotate_3d_6 = Rotate3D(Geometry=align_plane_6.Plane, Angle=degrees(90), Center=deconstruct_plane_6.Origin, Axis=line_sdl_18)  # -> Geometry, Transform; disabled
angle_6 = Angle(VectorA=line_sdl_16, VectorB=line_sdl_18, Plane=rotate_3d_6.Geometry)  # -> Angle, Reflex; disabled
degrees_6 = Degrees(Radians=angle_6.Reflex)  # disabled
rotate_6 = Rotate(Geometry=align_plane_6.Plane, Angle=degrees(degrees_6), Plane=rotate_3d_6.Geometry)  # -> Geometry, Transform; disabled
plane_16 = Plane(rotate_6.Geometry)  # disabled
curve_plane_6 = CurvePlane(Curve=rebuild_curve_10, Plane=plane_16)  # -> flatten(Points), ParamsC, ParamsP; disabled
list_item_212 = ListItem(List=plane_16, Index=0, Wrap=True)  # -> Item1, Item; disabled
line_33 = Line(StartPoint=curve_plane_6.Points, EndPoint=plane_16)  # disabled
length_26 = Length(Curve=line_33)  # disabled
curve_176 = Curve(flatten(curve_130))  # disabled

curve_177 = Curve(curve_126)  # disabled
plane_17 = Plane(list_item_212.Item)  # disabled

curve_178 = Curve(curve_127)  # disabled
plane_18 = Plane(list_item_212.Item1)  # disabled

orient_33 = Orient(Geometry=curve_178, Source=plane_18, Target=xy_plane_6)  # -> Geometry, Transform; disabled
orient_34 = Orient(Geometry=curve_177, Source=plane_17, Target=xy_plane_6)  # -> Geometry, Transform; disabled
tween_two_curves_6 = TweenTwoCurves(CurveA=orient_34.Geometry, CurveB=orient_33.Geometry, Factor=graph_mapper_6, Refit=0, PointSample=0)  # disabled
orient_35 = Orient(Geometry=tween_two_curves_6, Source=xy_plane_6, Target=plane_16)  # -> Geometry, Transform; disabled
end_points_24 = EndPoints(Curve=orient_35.Geometry)  # -> Start, End; disabled
line_34 = Line(StartPoint=end_points_24.Start, EndPoint=end_points_24.End)  # disabled
length_27 = Length(Curve=line_34)  # disabled
division_7 = Division(A=length_26, B=length_27)  # disabled
scale_nu_6 = ScaleNU(Geometry=orient_35.Geometry, Plane=plane_16, ScaleX=division_7, ScaleY=1, ScaleZ=1)  # -> Geometry, Transform; disabled
cull_index_14 = CullIndex(List=scale_nu_6.Geometry, Indices=[0, -1], Wrap=True)  # disabled
merge_119 = Merge(Data1=flatten(curve_128), Data2=flatten(cull_index_14), Data3=flatten(curve_176))  # disabled
curve_179 = Curve(merge_119)  # disabled
explode_46 = Explode(Curve=curve_179, Recursive=True)  # -> Segments, Vertices; disabled
curve_180 = Curve(explode_46.Segments)  # disabled
list_item_213 = ListItem(List=curve_180, Index=panel_89, Wrap=True)  # disabled
cull_index_15 = CullIndex(List=curve_180, Indices=[panel_89, panel_90], Wrap=True)  # disabled
list_item_214 = ListItem(List=curve_180, Index=panel_90, Wrap=True)  # disabled
length_28 = Length(Curve=list_item_213)  # disabled
length_29 = Length(Curve=list_item_214)  # disabled
length_30 = Length(Curve=cull_index_15)  # disabled
multiplication_16 = Multiplication(A=length_28, B=reduce_straight_length_6)  # disabled
multiplication_17 = Multiplication(A=length_29, B=reduce_straight_length_6)  # disabled
multiplication_18 = Multiplication(A=length_30, B=reduce_straight_length_6)  # disabled
negative_18 = Negative(Value=multiplication_16)  # disabled
negative_19 = Negative(Value=multiplication_17)  # disabled
negative_20 = Negative(Value=multiplication_18)  # disabled
extend_curve_22 = ExtendCurve(Curve=list_item_213, Type=0, Start=panel_91, End=negative_18)  # -> simplify(Curve); disabled
extend_curve_23 = ExtendCurve(Curve=list_item_214, Type=0, Start=negative_19, End=panel_91)  # -> simplify(Curve); disabled
extend_curve_24 = ExtendCurve(Curve=cull_index_15, Type=0, Start=negative_20, End=negative_20)  # -> simplify(Curve); disabled
merge_120 = Merge(Data1=extend_curve_22, Data2=extend_curve_24, Data3=extend_curve_23)  # disabled
shift_list_6 = ShiftList(List=merge_120, Shift=1, Wrap=False)  # disabled
shortest_list_6 = ShortestList(ListListA=merge_120, ListListB=shift_list_6, TrimMode=2)  # -> ListListA, ListListB; disabled
blend_curve_18 = BlendCurve(
    CurveA=shortest_list_6.ListListA,
    CurveB=shortest_list_6.ListListB,
    BulgeA=number_11,
    BulgeB=number_12,
    Continuity=integer_6)  # -> simplify(Blend); disabled
weave_6 = Weave(Pattern=[0, 1], Stream0=merge_120, Stream1=blend_curve_18, NullGaps=False)  # disabled
curve_181 = Curve(merge_120)  # disabled
curve_182 = Curve(blend_curve_18)  # disabled
flip_matrix_11 = FlipMatrix(Data=curve_181)  # disabled
flip_matrix_12 = FlipMatrix(Data=curve_182)  # -> simplify(Data); disabled
end_points_25 = EndPoints(Curve=flip_matrix_11)  # -> Start, End; disabled
end_points_26 = EndPoints(Curve=flip_matrix_12)  # -> Start, End; disabled
interpolate_48 = Interpolate(Vertices=end_points_25.Start, Degree=3, Periodic=False, KnotStyle=1)  # -> Curve, Length, Domain; disabled
interpolate_49 = Interpolate(Vertices=end_points_25.End, Degree=3, Periodic=False, KnotStyle=1)  # -> Curve, Length, Domain; disabled
interpolate_50 = Interpolate(Vertices=end_points_26.Start, Degree=3, Periodic=False, KnotStyle=1)  # -> Curve, Length, Domain; disabled
interpolate_51 = Interpolate(Vertices=end_points_26.End, Degree=3, Periodic=False, KnotStyle=1)  # -> Curve, Length, Domain; disabled
sweep2_11 = Sweep2(Rail1=interpolate_48.Curve, Rail2=interpolate_49.Curve, Sections=flip_matrix_11, SameHeight=False)  # disabled
sweep2_12 = Sweep2(Rail1=interpolate_50.Curve, Rail2=interpolate_51.Curve, Sections=flip_matrix_12, SameHeight=False)  # disabled
merge_121 = Merge(Data1=interpolate_48.Curve, Data2=interpolate_49.Curve, Data3=weave_6)  # disabled
merge_122 = Merge(Data1=end_points_25.Start, Data2=end_points_25.End)  # disabled
straight_srf_35 = Surface(sweep2_11)  # disabled
fillet_srf_35 = Surface(sweep2_12)  # disabled
pts_6 = Point(merge_122)  # disabled
crvs_6 = Curve(merge_121)  # disabled

straight_srf_36 = Surface(straight_srf_35)  # disabled
point_31 = Point(pts_6)  # disabled
curve_183 = Curve(crvs_6)  # disabled
fillet_srf_36 = Surface(fillet_srf_35)  # disabled

rear_facade_crv_3 = RemoteReceiver(rear_facade_crv)
curve_184 = Curve(flatten(rear_facade_crv_3))
curve_middle_6 = CurveMiddle(Curve=curve_184)
deconstruct_7 = Deconstruct(Point=curve_middle_6)  # -> XComponent, YComponent, ZComponent
sort_list_8 = SortList(Keys=deconstruct_7.ZComponent, ValuesValuesA=curve_184)  # -> Keys, ValuesValuesA
cull_index_16 = CullIndex(List=sort_list_8.ValuesValuesA, Indices=0, Wrap=True)
shift_list_7 = ShiftList(List=sort_list_8.Keys, Shift=1, Wrap=False)
shortest_list_7 = ShortestList(ListListA=shift_list_7, ListListB=sort_list_8.Keys, TrimMode=2)  # -> ListListA, ListListB
subtraction_14 = Subtraction(A=shortest_list_7.ListListA, B=shortest_list_7.ListListB)
negative_21 = Negative(Value=subtraction_14)
unit_z_21 = UnitZ(Factor=negative_21)
move = Move(Geometry=cull_index_16, Motion=unit_z_21)  # -> Geometry, Transform
merge_123 = Merge(Data1=graft(cull_index_16), Data2=graft(move.Geometry))
mullion_width_2 = RemoteReceiver(mullion_width)
mullion_depth_2 = RemoteReceiver(mullion_depth)
glass_thickness_2 = RemoteReceiver(glass_thickness)
mullion_colour_2 = RemoteReceiver(mullion_colour)
glass_colour_2 = RemoteReceiver(glass_colour)

mesh_loft = MeshLoft(Polylines=merge_123, Cap=False)
mesh = Mesh([<mesh referenced from the Rhino model> x17])

weaverbird_s_picture_frame = WeaverbirdsPictureFrame(MeshPolylines=mesh, Distance=expr("x/2", mullion_width_2), InsetType=1)
weaverbird_s_mesh_window = WeaverbirdsMeshWindow(MeshPolylines=mesh, Distance=expr("x/2", mullion_width_2), InsetType=1)
offset_mesh = OffsetMesh(Mesh=weaverbird_s_mesh_window, Distance=mullion_depth_2, BothSides=0, CreateSolid=False)
offset_mesh_2 = OffsetMesh(Mesh=offset_mesh, Distance=expr("-x", glass_thickness_2), BothSides=0, CreateSolid=True)
offset_mesh_3 = OffsetMesh(Mesh=weaverbird_s_picture_frame, Distance=mullion_depth_2, BothSides=0, CreateSolid=True)
offset_mesh_4 = OffsetMesh(Mesh=weaverbird_s_mesh_window, Distance=glass_thickness_2, BothSides=0, CreateSolid=True)
merge_124 = Merge(Data1=flatten(offset_mesh_4), Data2=flatten(offset_mesh_2))
custom_preview_4 = CustomPreview(
    Geometry=offset_mesh_3,
    Material={diffuse=RGB(0, 0, 0), emission=RGB(0, 0, 0), shine=1, specular=RGB(70, 70, 70), transparency=0})
custom_preview_5 = CustomPreview(Geometry=merge_124, Material=glass_colour_2)  # disabled

# ----
# Visualise Glass Widths, in terms of unique components
mesh_2 = Mesh(mesh)
mesh_explode = MeshExplode(Mesh=simplify(mesh_2), Interpolate=False)
mesh_3 = Mesh(graft(mesh_explode))
mesh_area = MeshArea(Mesh=mesh_explode)  # -> Area, Centroid
mesh_edges = MeshEdges(Mesh=mesh_3)  # -> simplify(NakedEdges), InteriorEdges, NonManifoldEdges
point_list_6 = PointList(Points=mesh_area.Centroid)
join_curves_2 = JoinCurves(Curves=mesh_edges.NakedEdges, Preserve=False)
discontinuity = Discontinuity(Curve=join_curves_2, Level=1)  # -> Points, Parameters
panel_92 = Panel(join_curves_2)
list_item_215 = ListItem(List=discontinuity.Points, Index=0, Wrap=True)  # -> Item, Item1, Item2, Item3
_4point_surface = _4PointSurface(CornerA=list_item_215.Item, CornerB=list_item_215.Item1, CornerC=list_item_215.Item2, CornerD=list_item_215.Item3)  # -> flatten(Surface)
dimensions = Dimensions(Surface=_4point_surface)  # -> UDimension, VDimension
round = Round(Number=dimensions.UDimension)  # -> Nearest, Floor, Ceiling
create_set = CreateSet(List=round.Nearest)  # -> Set, Map
sort_list_9 = SortList(Keys=create_set.Set)  # -> Keys, ValuesValuesA
equality = Equality(FirstNumber=graft(sort_list_9.Keys), SecondNumber=round.Nearest)  # -> Equality, Inequality
dispatch = Dispatch(List=_4point_surface, DispatchPattern=equality.Equality)  # -> simplify(ListA), ListB
tree_statistics_13 = TreeStatistics(Tree=dispatch.ListA)  # -> Paths, Length, Count
negative_22 = Negative(Value=Slider(1000, range=0..1000))
number_slider_187 = Slider(800, range=0..10000)
series_19 = Series(Start=0, Step=1, Count=tree_statistics_13.Count)
construct_point_8 = ConstructPoint(XCoordinate=negative_22, YCoordinate=0, ZCoordinate=0)
bounds = Bounds(Numbers=series_19)
negative_23 = Negative(Value=Slider(1000, range=0..1000))
xz_plane = XZPlane(Origin=construct_point_8)
deconstruct_domain = DeconstructDomain(Domain=bounds)  # -> Start, End
unit_z_22 = UnitZ(Factor=number_slider_187)
rectangle = Rectangle(Plane=xz_plane, XSize=negative_23, YSize=number_slider_187, Radius=0)  # -> Rectangle, Length
gradient = Gradient(
    LowerLimit=deconstruct_domain.Start,
    UpperLimit=deconstruct_domain.End,
    Parameter=series_19,
    stops=[0: RGB(48, 18, 59), 0.0294: RGB(56, 40, 112), 0.0588: RGB(63, 62, 156), 0.0882: RGB(68, 82, 193), 0.118: RGB(70, 102, 221), 0.147: RGB(71, 122, 241)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])
linear_array = LinearArray(Geometry=rectangle.Rectangle, Direction=unit_z_22, Count=tree_statistics_13.Count)  # -> Geometry, Transform
match_tree = MatchTree(Tree=graft(gradient), Guide=dispatch.ListA)
discontinuity_2 = Discontinuity(Curve=linear_array.Geometry, Level=1)  # -> Points, Parameters
surface_45 = Surface(linear_array.Geometry)
unit_x = UnitX(Factor=expr("-x", Slider(689, range=0..1000)))
list_item_216 = ListItem(List=discontinuity_2.Points, Index=0, Wrap=True)
move_2 = Move(Geometry=list_item_216, Motion=unit_x)  # -> Geometry, Transform
graft_tree = GraftTree(Tree=sort_list_9.Keys, IncludeEmptyLists=True, IncludeNullItems=True)  # -> simplify(Tree)
plane_origin = PlaneOrigin(Base=xz_plane, Origin=move_2.Geometry)
text_entity = TextEntity(Plane=plane_origin, Text=graft_tree)  # -> TextEntity, Plane, Text, Style
custom_preview_6 = CustomPreview(Geometry=surface_45, Material=gradient)
custom_preview_7 = CustomPreview(Geometry=dispatch.ListA, Material=match_tree)

brep_wireframe = BrepWireframe(Brep=dispatch.ListA, Density=-1)
custom_preview_lineweights_2 = CustomPreviewLineweights(
    Geometry=brep_wireframe,
    Shader=ColourSwatch(SwatchColor=RGB(0, 0, 0)),
    Thickness=Slider(2.1, range=0..10),
    Absolute=False)

front_facade_crv_2 = RemoteReceiver(front_facade_crv)
curve_185 = Curve(flatten(front_facade_crv_2))
curve_middle_7 = CurveMiddle(Curve=curve_185)
deconstruct_8 = Deconstruct(Point=curve_middle_7)  # -> XComponent, YComponent, ZComponent
sort_list_10 = SortList(Keys=deconstruct_8.ZComponent, ValuesValuesA=curve_185)  # -> Keys, ValuesValuesA
cull_index_17 = CullIndex(List=sort_list_10.ValuesValuesA, Indices=0, Wrap=True)
shift_list_8 = ShiftList(List=sort_list_10.Keys, Shift=1, Wrap=False)
shortest_list_8 = ShortestList(ListListA=shift_list_8, ListListB=sort_list_10.Keys, TrimMode=2)  # -> ListListA, ListListB
subtraction_15 = Subtraction(A=shortest_list_8.ListListA, B=shortest_list_8.ListListB)
negative_24 = Negative(Value=subtraction_15)
unit_z_23 = UnitZ(Factor=negative_24)
move_3 = Move(Geometry=cull_index_17, Motion=unit_z_23)  # -> Geometry, Transform
merge_125 = Merge(Data1=graft(cull_index_17), Data2=graft(move_3.Geometry))
mullion_width_3 = RemoteReceiver(mullion_width)
mullion_depth_3 = RemoteReceiver(mullion_depth)
glass_thickness_3 = RemoteReceiver(glass_thickness)
mullion_colour_3 = RemoteReceiver(mullion_colour)
glass_colour_3 = RemoteReceiver(glass_colour)

mesh_loft_2 = MeshLoft(Polylines=merge_125, Cap=False)
mesh_4 = Mesh([<mesh referenced from the Rhino model> x18])

mesh_explode_2 = MeshExplode(Mesh=mesh_4, Interpolate=False)
face_boundaries = FaceBoundaries(Mesh=mesh_explode_2)
face_normals = FaceNormals(Mesh=mesh_explode_2)  # -> Centers, Normals
explode_47 = Explode(Curve=face_boundaries, Recursive=True)  # -> Segments, Vertices
reverse = Reverse(Vector=face_normals.Normals)
list_item_217 = ListItem(List=explode_47.Segments, Index=3, Wrap=True)  # -> simplify(Item)
curve_middle_8 = CurveMiddle(Curve=list_item_217)
line_sdl_19 = LineSDL(Start=curve_middle_8, Direction=reverse, Length="7000")
trim_tree = TrimTree(Tree=line_sdl_19, Depth=1)
explode_tree_2 = ExplodeTree(Data=trim_tree)
unit_z_24 = UnitZ(Factor="-3000")
move_4 = Move(Geometry=explode_tree_2, Motion=unit_z_24)  # -> Geometry, Transform
unit_z_25 = UnitZ(Factor="53000")
extend_curve_25 = ExtendCurve(Curve=move_4.Geometry, Type=0, Start="800", End="800")
extrude_9 = Extrude(Base=extend_curve_25, Direction=unit_z_25)
surface_46 = Surface(extrude_9)

cluster_25 = Cluster_3(cutting_planes=surface_46, straight_srf=straight_srf_26, fillet_srf=fillet_srf_26)  # -> cleat_2, intersection_crv_2, bracket_2, ms_pipe_2
cluster_26 = Cluster_3(cutting_planes=surface_46, straight_srf=straight_srf_32, fillet_srf=fillet_srf_32)  # -> cleat_2, intersection_crv_2, bracket_2, ms_pipe_2; disabled
cluster_27 = Cluster_3(cutting_planes=surface_46, straight_srf=straight_srf_5, fillet_srf=fillet_srf_5)  # -> cleat_2, intersection_crv_2, bracket_2, ms_pipe_2
cluster_28 = Cluster_3(cutting_planes=surface_46, straight_srf=straight_srf_7, fillet_srf=fillet_srf_7)  # -> cleat_2, intersection_crv_2, bracket_2, ms_pipe_2
cluster_29 = Cluster_3(cutting_planes=surface_46, straight_srf=straight_srf_22, fillet_srf=fillet_srf_22)  # -> cleat_2, intersection_crv_2, bracket_2, ms_pipe_2
cluster_30 = Cluster_3(cutting_planes=surface_46, straight_srf=straight_srf_9, fillet_srf=fillet_srf_9)  # -> cleat_2, intersection_crv_2, bracket_2, ms_pipe_2
cluster_31 = Cluster_3(cutting_planes=surface_46, straight_srf=straight_srf_6, fillet_srf=fillet_srf_6)  # -> cleat_2, intersection_crv_2, bracket_2, ms_pipe_2; disabled
surface_47 = Surface(cluster_25.cleat_2)
curve_186 = Curve(cluster_25.intersection_crv_2)
mesh_5 = Mesh(cluster_25.bracket_2)
mesh_6 = Mesh(cluster_25.ms_pipe_2)
cluster_32 = Cluster_3(cutting_planes=surface_46, straight_srf=straight_srf_11, fillet_srf=fillet_srf_11)  # -> cleat_2, intersection_crv_2, bracket_2, ms_pipe_2
cluster_33 = Cluster_3(cutting_planes=surface_46, straight_srf=straight_srf_14, fillet_srf=fillet_srf_14)  # -> cleat_2, intersection_crv_2, bracket_2, ms_pipe_2
cluster_34 = Cluster_3(cutting_planes=surface_46, straight_srf=straight_srf_21, fillet_srf=fillet_srf_21)  # -> cleat_2, intersection_crv_2, bracket_2, ms_pipe_2
cluster_35 = Cluster_3(cutting_planes=surface_46, straight_srf=straight_srf_8, fillet_srf=fillet_srf_8)  # -> cleat_2, intersection_crv_2, bracket_2, ms_pipe_2; disabled
cluster_36 = Cluster_3(cutting_planes=surface_46, straight_srf=straight_srf_12, fillet_srf=fillet_srf_12)  # -> cleat_2, intersection_crv_2, bracket_2, ms_pipe_2
cluster_37 = Cluster_3(cutting_planes=surface_46, straight_srf=straight_srf_15, fillet_srf=fillet_srf_15)  # -> cleat_2, intersection_crv_2, bracket_2, ms_pipe_2
cluster_38 = Cluster_3(cutting_planes=surface_46, straight_srf=straight_srf_3, fillet_srf=fillet_srf_3)  # -> cleat_2, intersection_crv_2, bracket_2, ms_pipe_2
cluster_39 = Cluster_3(cutting_planes=surface_46, straight_srf=straight_srf_24, fillet_srf=fillet_srf_24)  # -> cleat_2, intersection_crv_2, bracket_2, ms_pipe_2; disabled
cluster_40 = Cluster_3(cutting_planes=surface_46, straight_srf=straight_srf_10, fillet_srf=fillet_srf_10)  # -> cleat_2, intersection_crv_2, bracket_2, ms_pipe_2; disabled
surface_48 = Surface(cluster_26.cleat_2)  # disabled
curve_187 = Curve(cluster_26.intersection_crv_2)  # disabled
mesh_7 = Mesh(cluster_26.bracket_2)  # disabled
mesh_8 = Mesh(cluster_26.ms_pipe_2)  # disabled
cluster_41 = Cluster_3(cutting_planes=surface_46, straight_srf=straight_srf_13, fillet_srf=fillet_srf_13)  # -> cleat_2, intersection_crv_2, bracket_2, ms_pipe_2
cluster_42 = Cluster_3(cutting_planes=surface_46, straight_srf=straight_srf_16, fillet_srf=fillet_srf_16)  # -> cleat_2, intersection_crv_2, bracket_2, ms_pipe_2; disabled
cluster_43 = Cluster_3(cutting_planes=surface_46, straight_srf=straight_srf_19, fillet_srf=fillet_srf_19)  # -> cleat_2, intersection_crv_2, bracket_2, ms_pipe_2; disabled
cluster_44 = Cluster_3(cutting_planes=surface_46, straight_srf=straight_srf_23, fillet_srf=fillet_srf_23)  # -> cleat_2, intersection_crv_2, bracket_2, ms_pipe_2; disabled
cluster_45 = Cluster_3(cutting_planes=surface_46, straight_srf=straight_srf_17, fillet_srf=fillet_srf_17)  # -> cleat_2, intersection_crv_2, bracket_2, ms_pipe_2; disabled
cluster_46 = Cluster_3(cutting_planes=surface_46, straight_srf=straight_srf, fillet_srf=fillet_srf)  # -> cleat_2, intersection_crv_2, bracket_2, ms_pipe_2
cluster_47 = Cluster_3(cutting_planes=surface_46, straight_srf=straight_srf_20, fillet_srf=fillet_srf_20)  # -> cleat_2, intersection_crv_2, bracket_2, ms_pipe_2; disabled
cluster_48 = Cluster_3(cutting_planes=surface_46, straight_srf=straight_srf_4, fillet_srf=fillet_srf_4)  # -> cleat_2, intersection_crv_2, bracket_2, ms_pipe_2; disabled
cluster_49 = Cluster_3(cutting_planes=surface_46, straight_srf=straight_srf_18, fillet_srf=fillet_srf_18)  # -> cleat_2, intersection_crv_2, bracket_2, ms_pipe_2; disabled
mesh_9 = Mesh(cluster_27.bracket_2)
surface_49 = Surface(cluster_27.cleat_2)
curve_188 = Curve(cluster_27.intersection_crv_2)
mesh_10 = Mesh(cluster_27.ms_pipe_2)
cluster_50 = Cluster_3(cutting_planes=surface_46, straight_srf=straight_srf_2, fillet_srf=fillet_srf_2)  # -> cleat_2, intersection_crv_2, bracket_2, ms_pipe_2; disabled
surface_50 = Surface(cluster_28.cleat_2)
curve_189 = Curve(cluster_28.intersection_crv_2)
mesh_11 = Mesh(cluster_28.bracket_2)
mesh_12 = Mesh(cluster_28.ms_pipe_2)
mesh_13 = Mesh(cluster_29.bracket_2)
surface_51 = Surface(cluster_29.cleat_2)
curve_190 = Curve(cluster_29.intersection_crv_2)
mesh_14 = Mesh(cluster_29.ms_pipe_2)
mesh_15 = Mesh(cluster_31.bracket_2)  # disabled
surface_52 = Surface(cluster_31.cleat_2)  # disabled
curve_191 = Curve(cluster_31.intersection_crv_2)  # disabled
mesh_16 = Mesh(cluster_31.ms_pipe_2)  # disabled
mesh_17 = Mesh(cluster_30.ms_pipe_2)
surface_53 = Surface(cluster_30.cleat_2)
curve_192 = Curve(cluster_30.intersection_crv_2)
mesh_18 = Mesh(cluster_30.bracket_2)
mesh_19 = Mesh(cluster_33.ms_pipe_2)
curve_193 = Curve(cluster_33.intersection_crv_2)
mesh_20 = Mesh(cluster_33.bracket_2)
surface_54 = Surface(cluster_32.cleat_2)
curve_194 = Curve(cluster_32.intersection_crv_2)
mesh_21 = Mesh(cluster_32.bracket_2)
mesh_22 = Mesh(cluster_32.ms_pipe_2)
surface_55 = Surface(cluster_33.cleat_2)
mesh_23 = Mesh(cluster_34.bracket_2)
surface_56 = Surface(cluster_35.cleat_2)  # disabled
curve_195 = Curve(cluster_35.intersection_crv_2)  # disabled
mesh_24 = Mesh(cluster_35.bracket_2)  # disabled
mesh_25 = Mesh(cluster_35.ms_pipe_2)  # disabled
curve_196 = Curve(cluster_34.intersection_crv_2)
mesh_26 = Mesh(cluster_34.ms_pipe_2)
surface_57 = Surface(cluster_34.cleat_2)
surface_58 = Surface(cluster_36.cleat_2)
mesh_27 = Mesh(cluster_36.bracket_2)
curve_197 = Curve(cluster_36.intersection_crv_2)
mesh_28 = Mesh(cluster_36.ms_pipe_2)
surface_59 = Surface(cluster_37.cleat_2)
mesh_29 = Mesh(cluster_37.ms_pipe_2)
curve_198 = Curve(cluster_37.intersection_crv_2)
mesh_30 = Mesh(cluster_37.bracket_2)
mesh_31 = Mesh(cluster_39.bracket_2)  # disabled
surface_60 = Surface(cluster_39.cleat_2)  # disabled
curve_199 = Curve(cluster_39.intersection_crv_2)  # disabled
mesh_32 = Mesh(cluster_39.ms_pipe_2)  # disabled
surface_61 = Surface(cluster_38.cleat_2)
curve_200 = Curve(cluster_38.intersection_crv_2)
mesh_33 = Mesh(cluster_38.bracket_2)
mesh_34 = Mesh(cluster_38.ms_pipe_2)
mesh_35 = Mesh(cluster_41.bracket_2)
mesh_36 = Mesh(cluster_40.ms_pipe_2)  # disabled
surface_62 = Surface(cluster_41.cleat_2)
curve_201 = Curve(cluster_41.intersection_crv_2)
mesh_37 = Mesh(cluster_41.ms_pipe_2)
surface_63 = Surface(cluster_40.cleat_2)  # disabled
curve_202 = Curve(cluster_40.intersection_crv_2)  # disabled
mesh_38 = Mesh(cluster_40.bracket_2)  # disabled
mesh_39 = Mesh(cluster_43.ms_pipe_2)  # disabled
curve_203 = Curve(cluster_43.intersection_crv_2)  # disabled
mesh_40 = Mesh(cluster_43.bracket_2)  # disabled
surface_64 = Surface(cluster_42.cleat_2)  # disabled
curve_204 = Curve(cluster_42.intersection_crv_2)  # disabled
mesh_41 = Mesh(cluster_42.bracket_2)  # disabled
mesh_42 = Mesh(cluster_42.ms_pipe_2)  # disabled
surface_65 = Surface(cluster_43.cleat_2)  # disabled
mesh_43 = Mesh(cluster_44.bracket_2)  # disabled
curve_205 = Curve(cluster_44.intersection_crv_2)  # disabled
mesh_44 = Mesh(cluster_44.ms_pipe_2)  # disabled
surface_66 = Surface(cluster_44.cleat_2)  # disabled
surface_67 = Surface(cluster_45.cleat_2)  # disabled
mesh_45 = Mesh(cluster_45.bracket_2)  # disabled
curve_206 = Curve(cluster_45.intersection_crv_2)  # disabled
mesh_46 = Mesh(cluster_45.ms_pipe_2)  # disabled
surface_68 = Surface(cluster_47.cleat_2)  # disabled
mesh_47 = Mesh(cluster_47.ms_pipe_2)  # disabled
curve_207 = Curve(cluster_47.intersection_crv_2)  # disabled
mesh_48 = Mesh(cluster_47.bracket_2)  # disabled
surface_69 = Surface(cluster_46.cleat_2)
mesh_49 = Mesh(cluster_46.bracket_2)
curve_208 = Curve(cluster_46.intersection_crv_2)
mesh_50 = Mesh(cluster_46.ms_pipe_2)
surface_70 = Surface(cluster_48.cleat_2)  # disabled
curve_209 = Curve(cluster_48.intersection_crv_2)  # disabled
mesh_51 = Mesh(cluster_48.bracket_2)  # disabled
mesh_52 = Mesh(cluster_48.ms_pipe_2)  # disabled
mesh_53 = Mesh(cluster_49.bracket_2)  # disabled
surface_71 = Surface(cluster_49.cleat_2)  # disabled
curve_210 = Curve(cluster_49.intersection_crv_2)  # disabled
mesh_54 = Mesh(cluster_49.ms_pipe_2)  # disabled
surface_72 = Surface(cluster_50.cleat_2)  # disabled
mesh_55 = Mesh(cluster_50.bracket_2)  # disabled
curve_211 = Curve(cluster_50.intersection_crv_2)  # disabled
mesh_56 = Mesh(cluster_50.ms_pipe_2)  # disabled

mesh_explode_3 = MeshExplode(Mesh=mesh_4, Interpolate=False)
face_boundaries_2 = FaceBoundaries(Mesh=mesh_explode_3)
face_normals_2 = FaceNormals(Mesh=mesh_explode_3)  # -> Centers, Normals
explode_48 = Explode(Curve=face_boundaries_2, Recursive=True)  # -> Segments, Vertices
reverse_2 = Reverse(Vector=face_normals_2.Normals)
list_item_218 = ListItem(List=explode_48.Segments, Index=3, Wrap=True)  # -> simplify(Item)
curve_middle_9 = CurveMiddle(Curve=list_item_218)
line_sdl_20 = LineSDL(Start=curve_middle_9, Direction=reverse_2, Length="7000")
trim_tree_2 = TrimTree(Tree=line_sdl_20, Depth=1)
tree_statistics_14 = TreeStatistics(Tree=trim_tree_2)  # -> Paths, Length, Count
list_item_219 = ListItem(List=tree_statistics_14.Paths, Index="11", Wrap=True)
unit_z_26 = UnitZ(Factor="-3000")
tree_branch_25 = TreeBranch(Tree=trim_tree_2, Path=list_item_219, MaintainPaths=True)
move_5 = Move(Geometry=tree_branch_25, Motion=unit_z_26)  # -> Geometry, Transform
unit_z_27 = UnitZ(Factor="16000")
extend_curve_26 = ExtendCurve(Curve=move_5.Geometry, Type=0, Start="800", End="800")
extrude_10 = Extrude(Base=extend_curve_26, Direction=unit_z_27)
surface_73 = Surface(extrude_10)

cluster_51 = Cluster_3(cutting_planes=surface_73, straight_srf=straight_srf_28, fillet_srf=fillet_srf_28)  # -> cleat_2, intersection_crv_2, bracket_2, ms_pipe_2
cluster_52 = Cluster_3(cutting_planes=surface_73, straight_srf=straight_srf_30, fillet_srf=fillet_srf_30)  # -> cleat_2, intersection_crv_2, bracket_2, ms_pipe_2
cluster_53 = Cluster_3(cutting_planes=surface_73, straight_srf=straight_srf_34, fillet_srf=fillet_srf_34)  # -> cleat_2, intersection_crv_2, bracket_2, ms_pipe_2; disabled
cluster_54 = Cluster_3(cutting_planes=surface_73, straight_srf=straight_srf_36, fillet_srf=fillet_srf_36)  # -> cleat_2, intersection_crv_2, bracket_2, ms_pipe_2; disabled
surface_74 = Surface(cluster_51.cleat_2)
curve_212 = Curve(cluster_51.intersection_crv_2)
mesh_57 = Mesh(cluster_51.bracket_2)
mesh_58 = Mesh(cluster_51.ms_pipe_2)
surface_75 = Surface(cluster_52.cleat_2)
curve_213 = Curve(cluster_52.intersection_crv_2)
mesh_59 = Mesh(cluster_52.bracket_2)
mesh_60 = Mesh(cluster_52.ms_pipe_2)
surface_76 = Surface(cluster_53.cleat_2)  # disabled
curve_214 = Curve(cluster_53.intersection_crv_2)  # disabled
mesh_61 = Mesh(cluster_53.bracket_2)  # disabled
mesh_62 = Mesh(cluster_53.ms_pipe_2)  # disabled
surface_77 = Surface(cluster_54.cleat_2)  # disabled
curve_215 = Curve(cluster_54.intersection_crv_2)  # disabled
mesh_63 = Mesh(cluster_54.bracket_2)  # disabled
mesh_64 = Mesh(cluster_54.ms_pipe_2)  # disabled

weaverbird_s_picture_frame_2 = WeaverbirdsPictureFrame(MeshPolylines=mesh_4, Distance=expr("x/2", mullion_width_3), InsetType=1)
weaverbird_s_mesh_window_2 = WeaverbirdsMeshWindow(MeshPolylines=mesh_4, Distance=expr("x/2", mullion_width_3), InsetType=1)
offset_mesh_5 = OffsetMesh(Mesh=weaverbird_s_mesh_window_2, Distance=mullion_depth_3, BothSides=0, CreateSolid=False)
offset_mesh_6 = OffsetMesh(Mesh=offset_mesh_5, Distance=expr("-x", glass_thickness_3), BothSides=0, CreateSolid=True)
offset_mesh_7 = OffsetMesh(Mesh=weaverbird_s_picture_frame_2, Distance=mullion_depth_3, BothSides=0, CreateSolid=True)
offset_mesh_8 = OffsetMesh(Mesh=weaverbird_s_mesh_window_2, Distance=glass_thickness_3, BothSides=0, CreateSolid=True)
merge_126 = Merge(Data1=flatten(offset_mesh_8), Data2=flatten(offset_mesh_6))
custom_preview_8 = CustomPreview(
    Geometry=offset_mesh_7,
    Material={diffuse=RGB(0, 0, 0), emission=RGB(0, 0, 0), shine=1, specular=RGB(70, 70, 70), transparency=0})
custom_preview_9 = CustomPreview(Geometry=merge_126, Material=glass_colour_3)  # disabled

surface_78 = Surface([surface_47, surface_59, surface_69, surface_61, surface_57, surface_51, surface_62, surface_54, surface_55, surface_58, surface_53, surface_50, surface_49, surface_74, surface_75])
offset_surface = OffsetSurface(Surface=surface_78, Distance="15", BothSides=expr("-x", "15"), CreateSolid=True)
custom_preview_10 = CustomPreview(Geometry=offset_surface, Material=ColourSwatch(SwatchColor=RGB(0, 0, 255)))  # disabled

mesh_65 = Mesh([mesh_5, mesh_6, mesh_30, mesh_29, mesh_49, mesh_50, mesh_33, mesh_34, mesh_23, mesh_26, mesh_13, mesh_14, mesh_35, mesh_37, mesh_21, mesh_22, mesh_20, mesh_19, mesh_27, mesh_28, mesh_18, mesh_17, mesh_11, mesh_12, mesh_9, mesh_10, mesh_57, mesh_58, mesh_59, mesh_60])
custom_preview_11 = CustomPreview(Geometry=mesh_65, Material=ColourSwatch(SwatchColor=RGB(38, 38, 38)))  # disabled

curve_216 = Curve([curve_186, curve_198, curve_208, curve_200, curve_196, curve_190, curve_201, curve_194, curve_193, curve_197, curve_192, curve_189, curve_188, curve_212, curve_213])
custom_preview_lineweights_3 = CustomPreviewLineweights(
    Geometry=curve_216,
    Shader=ColourSwatch(SwatchColor=RGB(255, 0, 191)),
    Thickness=Slider(2.5, range=0..10),
    Absolute=False)  # disabled

custom_preview_12 = CustomPreview(
    Geometry=merge_126,
    Material={diffuse=RGB(0, 0, 0), emission=RGB(0, 0, 0), shine=1, specular=RGB(220, 167, 74), transparency=0.01})

mesh_66 = Mesh(mesh)
mesh_67 = Mesh(mesh_4)

# ----
# Visualise Glass Heights, in terms of unique components
mesh_68 = Mesh(mesh_4)
mesh_explode_4 = MeshExplode(Mesh=simplify(mesh_68), Interpolate=False)
mesh_69 = Mesh(graft(mesh_explode_4))
mesh_area_2 = MeshArea(Mesh=mesh_explode_4)  # -> Area, Centroid
mesh_edges_2 = MeshEdges(Mesh=mesh_69)  # -> simplify(NakedEdges), InteriorEdges, NonManifoldEdges
point_list_7 = PointList(Points=mesh_area_2.Centroid)
join_curves_3 = JoinCurves(Curves=mesh_edges_2.NakedEdges, Preserve=False)
discontinuity_3 = Discontinuity(Curve=join_curves_3, Level=1)  # -> Points, Parameters
panel_93 = Panel(join_curves_3)
list_item_220 = ListItem(List=discontinuity_3.Points, Index=0, Wrap=True)  # -> Item, Item1, Item2, Item3
_4point_surface_2 = _4PointSurface(CornerA=list_item_220.Item, CornerB=list_item_220.Item1, CornerC=list_item_220.Item2, CornerD=list_item_220.Item3)  # -> flatten(Surface)
dimensions_2 = Dimensions(Surface=_4point_surface_2)  # -> UDimension, VDimension
round_2 = Round(Number=dimensions_2.UDimension)  # -> Nearest, Floor, Ceiling
create_set_2 = CreateSet(List=round_2.Nearest)  # -> Set, Map
sort_list_11 = SortList(Keys=create_set_2.Set)  # -> Keys, ValuesValuesA
equality_2 = Equality(FirstNumber=graft(sort_list_11.Keys), SecondNumber=round_2.Nearest)  # -> Equality, Inequality
dispatch_2 = Dispatch(List=_4point_surface_2, DispatchPattern=equality_2.Equality)  # -> simplify(ListA), ListB
tree_statistics_15 = TreeStatistics(Tree=dispatch_2.ListA)  # -> Paths, Length, Count
negative_25 = Negative(Value=Slider(1000, range=0..1000))
negative_26 = Negative(Value="19860")
number_slider_188 = Slider(800, range=0..10000)
series_20 = Series(Start=0, Step=1, Count=tree_statistics_15.Count)
construct_point_9 = ConstructPoint(XCoordinate=negative_25, YCoordinate=negative_26, ZCoordinate=0)
bounds_2 = Bounds(Numbers=series_20)
negative_27 = Negative(Value=Slider(1000, range=0..1000))
xz_plane_2 = XZPlane(Origin=construct_point_9)
deconstruct_domain_2 = DeconstructDomain(Domain=bounds_2)  # -> Start, End
unit_z_28 = UnitZ(Factor=number_slider_188)
rectangle_2 = Rectangle(Plane=xz_plane_2, XSize=negative_27, YSize=number_slider_188, Radius=0)  # -> Rectangle, Length
gradient_2 = Gradient(
    LowerLimit=deconstruct_domain_2.Start,
    UpperLimit=deconstruct_domain_2.End,
    Parameter=series_20,
    stops=[0: RGB(48, 18, 59), 0.0294: RGB(56, 40, 112), 0.0588: RGB(63, 62, 156), 0.0882: RGB(68, 82, 193), 0.118: RGB(70, 102, 221), 0.147: RGB(71, 122, 241)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])
linear_array_2 = LinearArray(Geometry=rectangle_2.Rectangle, Direction=unit_z_28, Count=tree_statistics_15.Count)  # -> Geometry, Transform
match_tree_2 = MatchTree(Tree=graft(gradient_2), Guide=dispatch_2.ListA)
discontinuity_4 = Discontinuity(Curve=linear_array_2.Geometry, Level=1)  # -> Points, Parameters
surface_79 = Surface(linear_array_2.Geometry)
unit_x_2 = UnitX(Factor=expr("-x", Slider(689, range=0..1000)))
list_item_221 = ListItem(List=discontinuity_4.Points, Index=0, Wrap=True)
move_6 = Move(Geometry=list_item_221, Motion=unit_x_2)  # -> Geometry, Transform
graft_tree_2 = GraftTree(Tree=sort_list_11.Keys, IncludeEmptyLists=True, IncludeNullItems=True)  # -> simplify(Tree)
plane_origin_2 = PlaneOrigin(Base=xz_plane_2, Origin=move_6.Geometry)
text_entity_2 = TextEntity(Plane=plane_origin_2, Text=graft_tree_2)  # -> TextEntity, Plane, Text, Style
custom_preview_13 = CustomPreview(Geometry=surface_79, Material=gradient_2)
custom_preview_14 = CustomPreview(Geometry=dispatch_2.ListA, Material=match_tree_2)

brep_wireframe_2 = BrepWireframe(Brep=dispatch_2.ListA, Density=-1)
custom_preview_lineweights_4 = CustomPreviewLineweights(
    Geometry=brep_wireframe_2,
    Shader=ColourSwatch(SwatchColor=RGB(0, 0, 0)),
    Thickness=Slider(2.1, range=0..10),
    Absolute=False)

mesh_naked_edges = MeshNakedEdges(Mesh=mesh_66)  # -> Naked, ResultBoolean
mesh_naked_edges_2 = MeshNakedEdges(Mesh=mesh_67)  # -> Naked, ResultBoolean
discontinuity_5 = Discontinuity(Curve=mesh_naked_edges.Naked, Level=1)  # -> Points, Parameters
discontinuity_6 = Discontinuity(Curve=mesh_naked_edges_2.Naked, Level=1)  # -> Points, Parameters
polyline_5 = PolyLine(Vertices=discontinuity_5.Points, Closed=True)
polyline_6 = PolyLine(Vertices=discontinuity_6.Points, Closed=True)
explode_49 = Explode(Curve=polyline_5, Recursive=True)  # -> Segments, Vertices
explode_50 = Explode(Curve=polyline_6, Recursive=True)  # -> Segments, Vertices
curve_middle_10 = CurveMiddle(Curve=explode_49.Segments)
curve_middle_11 = CurveMiddle(Curve=explode_50.Segments)
deconstruct_9 = Deconstruct(Point=curve_middle_11)  # -> XComponent, YComponent, ZComponent
deconstruct_10 = Deconstruct(Point=curve_middle_10)  # -> XComponent, YComponent, ZComponent
sort_list_12 = SortList(Keys=deconstruct_9.XComponent, ValuesA=explode_50.Segments)  # -> Keys, ValuesA
sort_list_13 = SortList(Keys=deconstruct_10.XComponent, ValuesValuesA=explode_49.Segments)  # -> Keys, ValuesValuesA
list_item_222 = ListItem(List=sort_list_13.ValuesValuesA, Index=0, Wrap=True)  # -> Item1, Item
list_item_223 = ListItem(List=sort_list_12.ValuesA, Index=0, Wrap=True)  # -> Item1, Item
flatten_tree = FlattenTree(Tree=list_item_222.Item1, Path="{0}")
flatten_tree_2 = FlattenTree(Tree=list_item_223.Item1, Path="{0}")
curve_middle_12 = CurveMiddle(Curve=flatten_tree)
curve_middle_13 = CurveMiddle(Curve=flatten_tree_2)
deconstruct_11 = Deconstruct(Point=curve_middle_12)  # -> XComponent, YComponent, ZComponent
deconstruct_12 = Deconstruct(Point=curve_middle_13)  # -> XComponent, YComponent, ZComponent
sort_list_14 = SortList(Keys=deconstruct_11.ZComponent, ValuesValuesA=flatten_tree)  # -> Keys, ValuesValuesA
sort_list_15 = SortList(Keys=deconstruct_12.ZComponent, ValuesA=flatten_tree_2)  # -> Keys, ValuesA
panel_94 = Panel("""13
16
17
19""")
cull_index_18 = CullIndex(List=sort_list_14.ValuesValuesA, Indices="-1", Wrap=True)
cull_index_19 = CullIndex(List=sort_list_15.ValuesA, Indices=panel_94, Wrap=True)
merge_127 = Merge(Data1=graft(cull_index_18), Data2=graft(cull_index_19))  # -> simplify(Result)
list_item_224 = ListItem(List=cull_index_19, Index=0, Wrap=True)
flip_curve_7 = FlipCurve(Curve=merge_127, Guide=list_item_224)  # -> Curve, Flag
extend_curve_27 = ExtendCurve(Curve=flip_curve_7.Curve, Type=0, Start=expr("-x", "0"), End=expr("-x", floor_thickness))
list_item_225 = ListItem(List=extend_curve_27, Index=0, Wrap=True)  # -> Item, Item1
end_points_27 = EndPoints(Curve=list_item_225.Item)  # -> Start, End
end_points_28 = EndPoints(Curve=list_item_225.Item1)  # -> Start, End
mullion_depth_4 = RemoteReceiver(mullion_depth)
line_35 = Line(StartPoint=end_points_27.Start, EndPoint=end_points_28.Start)
line_36 = Line(StartPoint=end_points_27.End, EndPoint=end_points_28.End)
negative_28 = Negative(Value=mullion_depth_4)
extend_curve_28 = ExtendCurve(Curve=line_35, Type=0, Start=negative_28, End=negative_28)
extend_curve_29 = ExtendCurve(Curve=line_36, Type=0, Start=negative_28, End=negative_28)
merge_128 = Merge(Data1=extend_curve_28, Data2=extend_curve_29)
loft_4 = Loft(Curves=merge_128, Options={Adjust=False, Closed=False, LoftEnds=0, LoftSimp=0, LoftType=0, Rebuild=10, Refit=0.01})
dimensions_3 = Dimensions(Surface=loft_4)  # -> UDimension, VDimension
division_8 = Division(A=dimensions_3.VDimension, B=Slider(900, range=0..1000))
round_3 = Round(Number=division_8)  # -> Nearest, Floor, Ceiling
panel_95 = Panel(dimensions_3.VDimension)
quad_panels = QuadPanels(Surface=loft_4, UDivisions="1", VDivisions=round_3.Floor)
simple_mesh = SimpleMesh(Brep=quad_panels)
mullion_width_4 = RemoteReceiver(mullion_width)
mullion_depth_5 = RemoteReceiver(mullion_depth)
glass_thickness_4 = RemoteReceiver(glass_thickness)
mullion_colour_4 = RemoteReceiver(mullion_colour)
glass_colour_4 = RemoteReceiver(glass_colour)

mesh_join = MeshJoin(Meshes=simple_mesh)
mesh_70 = Mesh([<mesh referenced from the Rhino model> x16])

weaverbird_s_picture_frame_3 = WeaverbirdsPictureFrame(MeshPolylines=mesh_70, Distance=expr("x/2", mullion_width_4), InsetType=1)
weaverbird_s_mesh_window_3 = WeaverbirdsMeshWindow(MeshPolylines=mesh_70, Distance=expr("x/2", mullion_width_4), InsetType=1)
offset_mesh_9 = OffsetMesh(Mesh=weaverbird_s_mesh_window_3, Distance=mullion_depth_5, BothSides=0, CreateSolid=False)
offset_mesh_10 = OffsetMesh(Mesh=weaverbird_s_picture_frame_3, Distance=mullion_depth_5, BothSides=0, CreateSolid=True)
offset_mesh_11 = OffsetMesh(Mesh=weaverbird_s_mesh_window_3, Distance=glass_thickness_4, BothSides=0, CreateSolid=True)
offset_mesh_12 = OffsetMesh(Mesh=offset_mesh_9, Distance=expr("-x", glass_thickness_4), BothSides=0, CreateSolid=True)
merge_129 = Merge(Data1=flatten(offset_mesh_11), Data2=flatten(offset_mesh_12))
custom_preview_15 = CustomPreview(
    Geometry=merge_129,
    Material={diffuse=RGB(250, 250, 250), emission=RGB(0, 0, 0), shine=0, specular=RGB(255, 255, 255), transparency=0})
custom_preview_16 = CustomPreview(
    Geometry=offset_mesh_10,
    Material={diffuse=RGB(0, 0, 0), emission=RGB(0, 0, 0), shine=1, specular=RGB(70, 70, 70), transparency=0})

path = FilePath("C:\Users\NAITIK\Downloads\output-onlinepngtools.png")  # disabled
gl_mesh = GLMeshShader(
    M=[weaverbird_s_mesh_window, weaverbird_s_mesh_window_2, weaverbird_s_mesh_window_3],
    U_texture=path,
    DepthTestingEnabled=True,
    DepthWritingEnabled=True,
    DrawMode=4,
    FragmentShader="""#version 330

uniform vec3 _lightDirection[4];
uniform mat3 _worldToCameraNormal;
uniform sampler2D u_texture;

in  vec3 normal;
in vec2 texcoord;
in vec3 v_normal;
out vec4 fragment_color;

void main() {
  
  vec2 uv = v_normal.xy * 0.5 + 0.5;
  uv.y = 1.0 - uv.y;
  fragment_color = texture2D(u_texture, uv);
}""",
    GLShader=(0, 2, 0),
    PreviewSortOrder=5,
    VertexShader="""#version 330

layout(location = 0) in vec3 _meshVertex;
layout(location = 1) in vec3 _meshNormal;
layout(location = 2) in vec2 _meshTextureCoordinate;

uniform mat4 _worldToClip;
uniform mat3 _worldToCameraNormal;
out vec3 normal;
out vec3 v_normal;
out vec2 texcoord;

void main() {
  normal = _meshNormal;
  gl_Position = _worldToClip * vec4(_meshVertex , 1.0);
  v_normal = _worldToCameraNormal * normal;
  texcoord = _meshTextureCoordinate;
}""",
    glLineWidth=3,
    glPointSize=8)  # -> Color, Depth; disabled

mesh_flip = MeshFlip(Mesh=merge_129)

flatten_tree_3 = FlattenTree(Tree=list_item_222.Item, Path="{0}")
flatten_tree_4 = FlattenTree(Tree=list_item_223.Item, Path="{0}")
curve_middle_14 = CurveMiddle(Curve=flatten_tree_3)
curve_middle_15 = CurveMiddle(Curve=flatten_tree_4)
deconstruct_13 = Deconstruct(Point=curve_middle_14)  # -> XComponent, YComponent, ZComponent
deconstruct_14 = Deconstruct(Point=curve_middle_15)  # -> XComponent, YComponent, ZComponent
sort_list_16 = SortList(Keys=deconstruct_13.ZComponent, ValuesValuesA=flatten_tree_3)  # -> Keys, flatten(ValuesValuesA)
sort_list_17 = SortList(Keys=deconstruct_14.ZComponent, ValuesValuesA=flatten_tree_4)  # -> Keys, ValuesValuesA
panel_96 = Panel("""13
15
16""")
cull_index_20 = CullIndex(List=sort_list_17.ValuesValuesA, Indices=panel_96, Wrap=True)  # -> flatten(List)
merge_130 = Merge(Data1=graft(sort_list_16.ValuesValuesA), Data2=graft(cull_index_20))  # -> simplify(Result)
list_item_226 = ListItem(List=cull_index_20, Index=0, Wrap=True)
flip_curve_8 = FlipCurve(Curve=merge_130, Guide=list_item_226)  # -> Curve, Flag
list_item_227 = ListItem(List=flip_curve_8.Curve, Index=0, Wrap=True)  # -> Item, Item1
end_points_29 = EndPoints(Curve=list_item_227.Item)  # -> Start, End
end_points_30 = EndPoints(Curve=list_item_227.Item1)  # -> Start, End
mullion_depth_6 = RemoteReceiver(mullion_depth)
line_37 = Line(StartPoint=end_points_29.Start, EndPoint=end_points_30.Start)
line_38 = Line(StartPoint=end_points_29.End, EndPoint=end_points_30.End)
negative_29 = Negative(Value=mullion_depth_6)
extend_curve_30 = ExtendCurve(Curve=line_37, Type=0, Start=negative_29, End=negative_29)
extend_curve_31 = ExtendCurve(Curve=line_38, Type=0, Start=negative_29, End=negative_29)
merge_131 = Merge(Data1=extend_curve_30, Data2=extend_curve_31)
loft_5 = Loft(Curves=merge_131, Options={Adjust=False, Closed=False, LoftEnds=0, LoftSimp=0, LoftType=0, Rebuild=10, Refit=0.01})
dimensions_4 = Dimensions(Surface=loft_5)  # -> UDimension, VDimension
division_9 = Division(A=dimensions_4.VDimension, B=Slider(480, range=0..1000))
round_4 = Round(Number=division_9)  # -> Nearest, Floor, Ceiling
panel_97 = Panel(dimensions_4.VDimension)
quad_panels_2 = QuadPanels(Surface=loft_5, UDivisions="1", VDivisions=round_4.Floor)
simple_mesh_2 = SimpleMesh(Brep=quad_panels_2)
silicone_width_in_honeycomg_sheet_2 = RemoteReceiver(silicone_width_in_honeycomg_sheet)

curve_middle_16 = CurveMiddle(Curve=sort_list_16.ValuesValuesA)
point_list_8 = PointList(Points=curve_middle_16, Size=Slider(1000, range=0..1000))

mesh_join_2 = MeshJoin(Meshes=simple_mesh_2)
mesh_71 = Mesh([<mesh referenced from the Rhino model> x17])

weaverbird_s_picture_frame_4 = WeaverbirdsPictureFrame(MeshPolylines=mesh_71, Distance=expr("x/2", silicone_width_in_honeycomg_sheet_2), InsetType=1)
weaverbird_s_mesh_window_4 = WeaverbirdsMeshWindow(MeshPolylines=mesh_71, Distance=expr("x/2", silicone_width_in_honeycomg_sheet_2), InsetType=1)
offset_mesh_13 = OffsetMesh(Mesh=weaverbird_s_picture_frame_4, Distance=honeycomb_sheet_depth_2, BothSides=0, CreateSolid=True)
offset_mesh_14 = OffsetMesh(Mesh=weaverbird_s_mesh_window_4, Distance=honeycomb_sheet_depth_2, BothSides=0, CreateSolid=True)
custom_preview_17 = CustomPreview(Geometry=offset_mesh_13, Material=silicone_colour_2)
custom_preview_18 = CustomPreview(Geometry=offset_mesh_14, Material=honeycomb_sheet_colour_2)

# ==== cluster Cluster
balcony_side_additional_cross_setional_c = ClusterInput()  # "Balcony_Side_Additional_Cross-Setional_Crv"
right_side_straight_bands = ClusterInput()
next_floor_crv = ClusterInput()
reference_srf = ClusterInput()
right_side_cross_section_crv = ClusterInput()
select_upper_lower_left_cross_section = ClusterInput()
select_upper_lower_right_cross_section = ClusterInput()
left_side_straight_bands = ClusterInput()
floor_crv = ClusterInput()
left_side_cross_section_crv = ClusterInput()
reduce_straight_length = ClusterInput()
cross_section_fillet_1 = ClusterInput()
cross_section_fillet_2 = ClusterInput()
scissor_upper_crv_curvature_1 = ClusterInput()
scissor_upper_crv_curvature_2 = ClusterInput()
scissor_lower_crv_curvature = ClusterInput()
cross_section_curvature = ClusterInput()
scissor_upper_crv_curvature = ClusterInput()
scissor_lower_crv_curvature_1 = ClusterInput()
scissor_lower_crv_curvature_2 = ClusterInput()
balcony_side_additional_cross_setional_c_2 = Curve(balcony_side_additional_cross_setional_c)  # "Balcony_Side_Additional_Cross-Setional_Crv"
reduce_straight_length_2 = Number(reduce_straight_length)
cross_section_fillet_1_2 = Number(cross_section_fillet_1)
cross_section_fillet_2_2 = Number(cross_section_fillet_2)
scissor_upper_crv_curvature_1_2 = Number(scissor_upper_crv_curvature_1)
scissor_upper_crv_curvature_2_2 = Number(scissor_upper_crv_curvature_2)
scissor_lower_crv_curvature_3 = Integer(scissor_lower_crv_curvature)
right_side_straight_bands_2 = Integer(right_side_straight_bands)
next_floor_crv_2 = Curve(next_floor_crv)
reference_srf_2 = Surface(reference_srf)
right_side_cross_section_crv_2 = Curve(right_side_cross_section_crv)
select_upper_lower_left_cross_section_2 = Integer(select_upper_lower_left_cross_section)
select_upper_lower_right_cross_section_2 = Integer(select_upper_lower_right_cross_section)
cross_section_curvature_2 = Integer(cross_section_curvature)
scissor_upper_crv_curvature_3 = Integer(scissor_upper_crv_curvature)
scissor_lower_crv_curvature_1_2 = Number(scissor_lower_crv_curvature_1)
scissor_lower_crv_curvature_2_2 = Number(scissor_lower_crv_curvature_2)
left_side_straight_bands_2 = Integer(left_side_straight_bands)
floor_crv_2 = Curve(floor_crv)
left_side_cross_section_crv_2 = Curve(left_side_cross_section_crv)
explode = Explode(Curve=floor_crv_2, Recursive=True)  # -> Segments, Vertices
explode_2 = Explode(Curve=next_floor_crv_2, Recursive=True)  # -> Segments, Vertices
curve = Curve(balcony_side_additional_cross_setional_c_2)
series = Series(Start=0, Step=1, Count=left_side_straight_bands_2)
series_2 = Series(Start="-1", Step="-1", Count=right_side_straight_bands_2)
interpolate = Interpolate(Vertices=explode.Vertices, Degree=3, Periodic=False, KnotStyle=1)  # -> Curve, Length, Domain
interpolate_2 = Interpolate(Vertices=explode_2.Vertices, Degree=3, Periodic=False, KnotStyle=1)  # -> Curve, Length, Domain
curve_closest_point = CurveClosestPoint(Point=explode.Vertices, Curve=interpolate.Curve)  # -> Point, Parameter, Distance
curve_closest_point_2 = CurveClosestPoint(Point=explode_2.Vertices, Curve=interpolate_2.Curve)  # -> Point, Parameter, Distance
perp_frame = PerpFrame(Curve=interpolate.Curve, Parameter=curve_closest_point.Parameter)
perp_frame_2 = PerpFrame(Curve=interpolate_2.Curve, Parameter=curve_closest_point_2.Parameter)
list_item = ListItem(List=perp_frame, Index=series, Wrap=True)
list_item_2 = ListItem(List=perp_frame_2, Index=series_2, Wrap=True)
list_item_3 = ListItem(List=list_item, Index=0, Wrap=True)
list_item_4 = ListItem(List=list_item_2, Index=0, Wrap=True)
source_plane = Plane(list_item_3)
target_plane = Plane(list_item_2)
target_plane_2 = Plane(list_item)
source_plane_2 = Plane(list_item_4)
curve_2 = Curve(left_side_cross_section_crv_2)
curve_3 = Curve(right_side_cross_section_crv_2)
orient = Orient(Geometry=curve_2, Source=source_plane, Target=graft(target_plane_2))  # -> simplify(Geometry), Transform
orient_2 = Orient(Geometry=curve_3, Source=source_plane_2, Target=graft(target_plane))  # -> simplify(Geometry), Transform
curve_4 = Curve(orient_2.Geometry)
tree_statistics = TreeStatistics(Tree=orient.Geometry)  # -> Paths, Length, Count
tree_statistics_2 = TreeStatistics(Tree=orient_2.Geometry)  # -> Paths, Length, Count
list_item_5 = ListItem(List=curve_4, Index=select_upper_lower_right_cross_section_2, Wrap=True)  # -> flatten(Item)
list_item_6 = ListItem(List=tree_statistics.Paths, Index=0, Wrap=True)
list_item_7 = ListItem(List=tree_statistics.Paths, Index=-1, Wrap=True)
list_item_8 = ListItem(List=tree_statistics_2.Paths, Index=-1, Wrap=True)
list_item_9 = ListItem(List=tree_statistics_2.Paths, Index=0, Wrap=True)
reverse_list = ReverseList(List=list_item_5)
tree_branch = TreeBranch(Tree=orient.Geometry, Path=list_item_6, MaintainPaths=True)
tree_branch_2 = TreeBranch(Tree=orient.Geometry, Path=list_item_7, MaintainPaths=True)
tree_branch_3 = TreeBranch(Tree=orient_2.Geometry, Path=list_item_8, MaintainPaths=True)
tree_branch_4 = TreeBranch(Tree=orient_2.Geometry, Path=list_item_9, MaintainPaths=True)
curve_5 = Curve(curve)
merge = Merge(Data1=flatten(reverse_list), Data2=flatten(curve_5))  # -> graft(Result)
list_item_10 = ListItem(List=orient.Geometry, Index=select_upper_lower_left_cross_section_2, Wrap=True)
list_item_11 = ListItem(List=tree_branch, Index=select_upper_lower_left_cross_section_2, Wrap=True)
list_item_12 = ListItem(List=tree_branch_2, Index=select_upper_lower_left_cross_section_2, Wrap=True)
list_item_13 = ListItem(List=tree_branch_3, Index=select_upper_lower_right_cross_section_2, Wrap=True)
list_item_14 = ListItem(List=tree_branch_4, Index=select_upper_lower_right_cross_section_2, Wrap=True)
explode_3 = Explode(Curve=list_item_11, Recursive=True)  # -> Segments, Vertices
explode_4 = Explode(Curve=list_item_12, Recursive=True)  # -> Segments, Vertices
explode_5 = Explode(Curve=list_item_13, Recursive=True)  # -> Segments, Vertices
explode_6 = Explode(Curve=list_item_14, Recursive=True)  # -> Segments, Vertices
curve_6 = Curve(list_item_12)
curve_7 = Curve(list_item_13)
curve_8 = Curve(merge)
list_item_15 = ListItem(List=explode_3.Vertices, Index=0, Wrap=True)  # -> Item1, Item
list_item_16 = ListItem(List=explode_4.Vertices, Index=0, Wrap=True)  # -> Item1, Item
list_item_17 = ListItem(List=explode_5.Vertices, Index=0, Wrap=True)  # -> Item1, Item
list_item_18 = ListItem(List=explode_6.Vertices, Index=0, Wrap=True)  # -> Item1, Item
merge_2 = Merge(Data1=list_item_15.Item, Data2=list_item_15.Item1)
merge_3 = Merge(Data1=list_item_16.Item, Data2=list_item_16.Item1)
merge_4 = Merge(Data1=list_item_17.Item, Data2=list_item_17.Item1)
merge_5 = Merge(Data1=list_item_18.Item, Data2=list_item_18.Item1)
line = Line(StartPoint=merge_2, EndPoint=merge_3)
line_2 = Line(StartPoint=merge_4, EndPoint=merge_5)
list_item_19 = ListItem(List=line, Index=0, Wrap=True)  # -> Item, Item1
list_item_20 = ListItem(List=line_2, Index=0, Wrap=True)  # -> Item, Item1

number = Number(scissor_upper_crv_curvature_1_2)
number_2 = Number(scissor_upper_crv_curvature_2_2)
integer = Integer(scissor_upper_crv_curvature_3)
blend_curve = BlendCurve(CurveA=list_item_19.Item, CurveB=list_item_20.Item, BulgeA=number, BulgeB=number_2, Continuity=integer)
curve_9 = Curve(blend_curve)

number_3 = Number(scissor_lower_crv_curvature_1_2)
integer_2 = Integer(scissor_lower_crv_curvature_3)
number_4 = Number(scissor_lower_crv_curvature_2_2)
blend_curve_2 = BlendCurve(CurveA=list_item_19.Item1, CurveB=list_item_20.Item1, BulgeA=number_3, BulgeB=number_4, Continuity=integer_2)
curve_10 = Curve(blend_curve_2)

divide_curve = DivideCurve(Curve=curve_9, Count="14", Kinks=False)  # -> Points, Tangents, Parameters
divide_curve_2 = DivideCurve(Curve=curve_10, Count="14", Kinks=False)  # -> Points, Tangents, Parameters
surface = Surface(reference_srf_2)
surface_closest_point = SurfaceClosestPoint(Point=divide_curve.Points, Surface=surface)  # -> Point, UVPoint, Distance
surface_closest_point_2 = SurfaceClosestPoint(Point=divide_curve_2.Points, Surface=surface)  # -> Point, UVPoint, Distance
range = Range(Domain=Domain(0, 1), Steps=expr("x-1", "14"))
line_3 = Line(StartPoint=surface_closest_point.Point, EndPoint=surface_closest_point_2.Point)
interpolate_3 = Interpolate(Vertices=surface_closest_point.Point, Degree=3, Periodic=False, KnotStyle=1)  # -> Curve, Length, Domain
interpolate_4 = Interpolate(Vertices=surface_closest_point_2.Point, Degree=3, Periodic=False, KnotStyle=1)  # -> Curve, Length, Domain
curve_closest_point_3 = CurveClosestPoint(Point=divide_curve_2.Points, Curve=interpolate_4.Curve)  # -> Point, Parameter, Distance
unit_z = UnitZ(Factor=1)
perp_frame_3 = PerpFrame(Curve=interpolate_4.Curve, Parameter=curve_closest_point_3.Parameter)
align_plane = AlignPlane(Plane=perp_frame_3, Direction=unit_z)  # -> Plane, Angle
deconstruct_plane = DeconstructPlane(Plane=align_plane.Plane)  # -> Origin, XAxis, YAxis, ZAxis
unit_z_2 = UnitZ(Factor=1)
line_sdl = LineSDL(Start=deconstruct_plane.Origin, Direction=unit_z_2, Length="1500")
line_sdl_2 = LineSDL(Start=deconstruct_plane.Origin, Direction=deconstruct_plane.YAxis, Length="1500")
line_sdl_3 = LineSDL(Start=deconstruct_plane.Origin, Direction=deconstruct_plane.XAxis, Length="1500")
rotate_3d = Rotate3D(Geometry=align_plane.Plane, Angle=degrees(90), Center=deconstruct_plane.Origin, Axis=line_sdl_3)  # -> Geometry, Transform
angle = Angle(VectorA=line_sdl, VectorB=line_sdl_3, Plane=rotate_3d.Geometry)  # -> Angle, Reflex
degrees = Degrees(Radians=angle.Reflex)
rotate = Rotate(Geometry=align_plane.Plane, Angle=degrees(degrees), Plane=rotate_3d.Geometry)  # -> Geometry, Transform
plane = Plane(rotate.Geometry)

construct_point = ConstructPoint(XCoordinate=0, YCoordinate=0, ZCoordinate=0)
xy_plane = XYPlane(Origin=construct_point)

curve_plane = CurvePlane(Curve=interpolate_3.Curve, Plane=plane)  # -> flatten(Points), ParamsC, ParamsP
list_item_21 = ListItem(List=plane, Index=0, Wrap=True)  # -> Item1, Item

curve_11 = Curve(curve_6)
plane_2 = Plane(list_item_21.Item)

curve_12 = Curve(curve_7)
plane_3 = Plane(list_item_21.Item1)

graph_mapper = GraphMapper(
    range,
    x0=0,
    x1=1,
    y0=0,
    y1=1,
    container_name="Bezier",
    cpx=[0, 0.3606700003, 0.2583149374, 1],
    cpy=[0, 0.08987557888, 1, 1])
orient_3 = Orient(Geometry=curve_12, Source=plane_3, Target=xy_plane)  # -> Geometry, Transform
orient_4 = Orient(Geometry=curve_11, Source=plane_2, Target=xy_plane)  # -> Geometry, Transform
tween_two_curves = TweenTwoCurves(CurveA=orient_4.Geometry, CurveB=orient_3.Geometry, Factor=graph_mapper, Refit=0, PointSample=0)
orient_5 = Orient(Geometry=tween_two_curves, Source=xy_plane, Target=plane)  # -> Geometry, Transform
end_points = EndPoints(Curve=orient_5.Geometry)  # -> Start, End
line_4 = Line(StartPoint=end_points.Start, EndPoint=end_points.End)
line_5 = Line(StartPoint=curve_plane.Points, EndPoint=plane)
length = Length(Curve=line_4)
length_2 = Length(Curve=line_5)
division = Division(A=length_2, B=length)
scale_nu = ScaleNU(Geometry=orient_5.Geometry, Plane=plane, ScaleX=division, ScaleY=1, ScaleZ=1)  # -> Geometry, Transform
curve_13 = Curve(flatten(list_item_10))
curve_14 = Curve(flatten(curve_8))
cull_index = CullIndex(List=scale_nu.Geometry, Indices=[0, -1], Wrap=True)
reverse_list_2 = ReverseList(List=curve_14)
merge_6 = Merge(Data1=flatten(curve_13), Data2=flatten(cull_index), Data3=flatten(curve_14))
curve_15 = Curve(merge_6)
explode_7 = Explode(Curve=curve_15, Recursive=True)  # -> Segments, Vertices
curve_16 = Curve(explode_7.Segments)
list_item_22 = ListItem(List=curve_16, Index="0", Wrap=True)
cull_index_2 = CullIndex(List=curve_16, Indices=["0", "-1"], Wrap=True)
list_item_23 = ListItem(List=curve_16, Index="-1", Wrap=True)
length_3 = Length(Curve=list_item_22)
length_4 = Length(Curve=list_item_23)
length_5 = Length(Curve=cull_index_2)
multiplication = Multiplication(A=length_3, B=reduce_straight_length_2)
multiplication_2 = Multiplication(A=length_4, B=reduce_straight_length_2)
multiplication_3 = Multiplication(A=length_5, B=reduce_straight_length_2)
negative = Negative(Value=multiplication)
negative_2 = Negative(Value=multiplication_2)
negative_3 = Negative(Value=multiplication_3)
extend_curve = ExtendCurve(Curve=list_item_22, Type=0, Start="0", End=negative)  # -> simplify(Curve)
extend_curve_2 = ExtendCurve(Curve=list_item_23, Type=0, Start=negative_2, End="0")  # -> simplify(Curve)
extend_curve_3 = ExtendCurve(Curve=cull_index_2, Type=0, Start=negative_3, End=negative_3)  # -> simplify(Curve)
merge_7 = Merge(Data1=extend_curve, Data2=extend_curve_3, Data3=extend_curve_2)
shift_list = ShiftList(List=merge_7, Shift=1, Wrap=False)
shortest_list = ShortestList(ListListA=merge_7, ListListB=shift_list, TrimMode=2)  # -> ListListA, ListListB
number_5 = Number(cross_section_fillet_1_2)
number_6 = Number(cross_section_fillet_2_2)
integer_3 = Integer(cross_section_curvature_2)
blend_curve_3 = BlendCurve(CurveA=shortest_list.ListListA, CurveB=shortest_list.ListListB, BulgeA=number_5, BulgeB=number_6, Continuity=integer_3)  # -> simplify(Blend)
weave = Weave(Pattern=[0, 1], Stream0=merge_7, Stream1=blend_curve_3, NullGaps=False)
curve_17 = Curve(merge_7)
curve_18 = Curve(blend_curve_3)
flip_matrix = FlipMatrix(Data=curve_17)
flip_matrix_2 = FlipMatrix(Data=curve_18)  # -> simplify(Data)
end_points_2 = EndPoints(Curve=flip_matrix)  # -> Start, End
end_points_3 = EndPoints(Curve=flip_matrix_2)  # -> Start, End
interpolate_5 = Interpolate(Vertices=end_points_2.Start, Degree=3, Periodic=False, KnotStyle=1)  # -> Curve, Length, Domain
interpolate_6 = Interpolate(Vertices=end_points_2.End, Degree=3, Periodic=False, KnotStyle=1)  # -> Curve, Length, Domain
interpolate_7 = Interpolate(Vertices=end_points_3.Start, Degree=3, Periodic=False, KnotStyle=1)  # -> Curve, Length, Domain
interpolate_8 = Interpolate(Vertices=end_points_3.End, Degree=3, Periodic=False, KnotStyle=1)  # -> Curve, Length, Domain
sweep2 = Sweep2(Rail1=interpolate_5.Curve, Rail2=interpolate_6.Curve, Sections=flip_matrix, SameHeight=False)
sweep2_2 = Sweep2(Rail1=interpolate_7.Curve, Rail2=interpolate_8.Curve, Sections=flip_matrix_2, SameHeight=False)
merge_8 = Merge(Data1=interpolate_5.Curve, Data2=interpolate_6.Curve, Data3=weave)
merge_9 = Merge(Data1=end_points_2.Start, Data2=end_points_2.End)
straight_srf = Surface(sweep2)
fillet_srf = Surface(sweep2_2)
pts = Point(merge_9)
crvs = Curve(merge_8)
fillet_srf_2 = ClusterOutput(fillet_srf)
straight_srf_2 = ClusterOutput(straight_srf)
crvs_2 = ClusterOutput(crvs)
pts_2 = ClusterOutput(pts)

# ==== cluster Cluster_2
reduce_straight_length = ClusterInput()
cross_section_fillet_1 = ClusterInput()
cross_section_fillet_2 = ClusterInput()
cross_section_curvature = ClusterInput()
scissor_upper_crv_curvature_1 = ClusterInput()
scissor_upper_crv_curvature_2 = ClusterInput()
scissor_upper_crv_curvature = ClusterInput()
scissor_lower_crv_curvature_1 = ClusterInput()
scissor_lower_crv_curvature_2 = ClusterInput()
scissor_lower_crv_curvature = ClusterInput()
left_side_straight_bands = ClusterInput()
right_side_straight_bands = ClusterInput()
floor_crv = ClusterInput()
next_floor_crv = ClusterInput()
reference_srf = ClusterInput()
left_side_cross_section_crv = ClusterInput()
right_side_cross_section_crv = ClusterInput()
select_upper_lower_left_cross_section = ClusterInput()
select_upper_lower_right_cross_section = ClusterInput()
balcony_side_additional_cross_setional_c = ClusterInput()  # "Balcony_Side_Additional_Cross-Setional_Crv"
reduce_straight_length_2 = Number(reduce_straight_length)
cross_section_fillet_1_2 = Number(cross_section_fillet_1)
cross_section_fillet_2_2 = Number(cross_section_fillet_2)
scissor_upper_crv_curvature_1_2 = Number(scissor_upper_crv_curvature_1)
scissor_upper_crv_curvature_2_2 = Number(scissor_upper_crv_curvature_2)
scissor_lower_crv_curvature_3 = Integer(scissor_lower_crv_curvature)
right_side_straight_bands_2 = Integer(right_side_straight_bands)
next_floor_crv_2 = Curve(next_floor_crv)
reference_srf_2 = Surface(reference_srf)
right_side_cross_section_crv_2 = Curve(right_side_cross_section_crv)
select_upper_lower_left_cross_section_2 = Integer(select_upper_lower_left_cross_section)
select_upper_lower_right_cross_section_2 = Integer(select_upper_lower_right_cross_section)
cross_section_curvature_2 = Integer(cross_section_curvature)
scissor_upper_crv_curvature_3 = Integer(scissor_upper_crv_curvature)
scissor_lower_crv_curvature_1_2 = Number(scissor_lower_crv_curvature_1)
scissor_lower_crv_curvature_2_2 = Number(scissor_lower_crv_curvature_2)
left_side_straight_bands_2 = Integer(left_side_straight_bands)
floor_crv_2 = Curve(floor_crv)
left_side_cross_section_crv_2 = Curve(left_side_cross_section_crv)
balcony_side_additional_cross_setional_c_2 = Curve(balcony_side_additional_cross_setional_c)  # "Balcony_Side_Additional_Cross-Setional_Crv"
explode = Explode(Curve=floor_crv_2, Recursive=True)  # -> Segments, Vertices
explode_2 = Explode(Curve=next_floor_crv_2, Recursive=True)  # -> Segments, Vertices
series = Series(Start=0, Step=1, Count=left_side_straight_bands_2)
series_2 = Series(Start="-1", Step="-1", Count=right_side_straight_bands_2)
interpolate = Interpolate(Vertices=explode.Vertices, Degree=3, Periodic=False, KnotStyle=1)  # -> Curve, Length, Domain
interpolate_2 = Interpolate(Vertices=explode_2.Vertices, Degree=3, Periodic=False, KnotStyle=1)  # -> Curve, Length, Domain
curve = Curve(balcony_side_additional_cross_setional_c_2)
curve_closest_point = CurveClosestPoint(Point=explode.Vertices, Curve=interpolate.Curve)  # -> Point, Parameter, Distance
curve_closest_point_2 = CurveClosestPoint(Point=explode_2.Vertices, Curve=interpolate_2.Curve)  # -> Point, Parameter, Distance
perp_frame = PerpFrame(Curve=interpolate.Curve, Parameter=curve_closest_point.Parameter)
perp_frame_2 = PerpFrame(Curve=interpolate_2.Curve, Parameter=curve_closest_point_2.Parameter)
list_item = ListItem(List=perp_frame, Index=series, Wrap=True)
list_item_2 = ListItem(List=perp_frame_2, Index=series_2, Wrap=True)
list_item_3 = ListItem(List=list_item, Index=0, Wrap=True)
list_item_4 = ListItem(List=list_item_2, Index=0, Wrap=True)
source_plane = Plane(list_item_3)
target_plane = Plane(list_item_2)
target_plane_2 = Plane(list_item)
source_plane_2 = Plane(list_item_4)
curve_2 = Curve(left_side_cross_section_crv_2)
curve_3 = Curve(right_side_cross_section_crv_2)
orient = Orient(Geometry=curve_2, Source=source_plane, Target=graft(target_plane_2))  # -> simplify(Geometry), Transform
orient_2 = Orient(Geometry=curve_3, Source=source_plane_2, Target=graft(target_plane))  # -> simplify(Geometry), Transform
tree_statistics = TreeStatistics(Tree=orient.Geometry)  # -> Paths, Length, Count
tree_statistics_2 = TreeStatistics(Tree=orient_2.Geometry)  # -> Paths, Length, Count
list_item_5 = ListItem(List=tree_statistics.Paths, Index=0, Wrap=True)
list_item_6 = ListItem(List=tree_statistics.Paths, Index=-1, Wrap=True)
list_item_7 = ListItem(List=tree_statistics_2.Paths, Index=-1, Wrap=True)
list_item_8 = ListItem(List=tree_statistics_2.Paths, Index=0, Wrap=True)
curve_4 = Curve(orient_2.Geometry)
tree_branch = TreeBranch(Tree=orient.Geometry, Path=list_item_5, MaintainPaths=True)
tree_branch_2 = TreeBranch(Tree=orient.Geometry, Path=list_item_6, MaintainPaths=True)
tree_branch_3 = TreeBranch(Tree=orient_2.Geometry, Path=list_item_7, MaintainPaths=True)
tree_branch_4 = TreeBranch(Tree=orient_2.Geometry, Path=list_item_8, MaintainPaths=True)
list_item_9 = ListItem(List=curve_4, Index=select_upper_lower_right_cross_section_2, Wrap=True)  # -> flatten(Item)
list_item_10 = ListItem(List=orient.Geometry, Index=select_upper_lower_left_cross_section_2, Wrap=True)
list_item_11 = ListItem(List=tree_branch, Index=select_upper_lower_left_cross_section_2, Wrap=True)
list_item_12 = ListItem(List=tree_branch_2, Index=select_upper_lower_left_cross_section_2, Wrap=True)
list_item_13 = ListItem(List=tree_branch_3, Index=select_upper_lower_right_cross_section_2, Wrap=True)

list_item_14 = ListItem(List=tree_branch_4, Index=select_upper_lower_right_cross_section_2, Wrap=True)
curve_5 = Curve(curve)

reverse_list = ReverseList(List=list_item_9)
explode_3 = Explode(Curve=list_item_11, Recursive=True)  # -> Segments, Vertices
explode_4 = Explode(Curve=list_item_12, Recursive=True)  # -> Segments, Vertices
explode_5 = Explode(Curve=list_item_13, Recursive=True)  # -> Segments, Vertices
explode_6 = Explode(Curve=curve_5, Recursive=True)  # -> Segments, Vertices
merge = Merge(Data1=flatten(reverse_list), Data2=flatten(curve_5))  # -> graft(Result)
curve_6 = Curve(list_item_12)
curve_7 = Curve(list_item_13)
list_item_15 = ListItem(List=explode_3.Vertices, Index=0, Wrap=True)  # -> Item1, Item
list_item_16 = ListItem(List=explode_4.Vertices, Index=0, Wrap=True)  # -> Item1, Item
list_item_17 = ListItem(List=explode_5.Vertices, Index=0, Wrap=True)  # -> Item1, Item
list_item_18 = ListItem(List=explode_6.Vertices, Index=0, Wrap=True)  # -> Item1, Item
curve_8 = Curve(merge)
merge_2 = Merge(Data1=list_item_15.Item, Data2=list_item_15.Item1)
merge_3 = Merge(Data1=list_item_16.Item, Data2=list_item_16.Item1)
merge_4 = Merge(Data1=list_item_17.Item, Data2=list_item_17.Item1)
merge_5 = Merge(Data1=list_item_18.Item, Data2=list_item_18.Item1)
line = Line(StartPoint=merge_2, EndPoint=merge_3)
line_2 = Line(StartPoint=merge_4, EndPoint=merge_5)
list_item_19 = ListItem(List=line, Index=0, Wrap=True)  # -> Item, Item1
list_item_20 = ListItem(List=line_2, Index=0, Wrap=True)  # -> Item, Item1

number = Number(scissor_upper_crv_curvature_1_2)
number_2 = Number(scissor_upper_crv_curvature_2_2)
integer = Integer(scissor_upper_crv_curvature_3)
blend_curve = BlendCurve(CurveA=list_item_19.Item, CurveB=list_item_20.Item, BulgeA=number, BulgeB=number_2, Continuity=integer)
curve_9 = Curve(blend_curve)

number_3 = Number(scissor_lower_crv_curvature_1_2)
integer_2 = Integer(scissor_lower_crv_curvature_3)
number_4 = Number(scissor_lower_crv_curvature_2_2)
blend_curve_2 = BlendCurve(CurveA=list_item_19.Item1, CurveB=list_item_20.Item1, BulgeA=number_3, BulgeB=number_4, Continuity=integer_2)
curve_10 = Curve(blend_curve_2)

divide_curve = DivideCurve(Curve=curve_9, Count="14", Kinks=False)  # -> Points, Tangents, Parameters
divide_curve_2 = DivideCurve(Curve=curve_10, Count="14", Kinks=False)  # -> Points, Tangents, Parameters
surface = Surface(reference_srf_2)
surface_closest_point = SurfaceClosestPoint(Point=divide_curve.Points, Surface=surface)  # -> Point, UVPoint, Distance
surface_closest_point_2 = SurfaceClosestPoint(Point=divide_curve_2.Points, Surface=surface)  # -> Point, UVPoint, Distance
range = Range(Domain=Domain(0, 1), Steps=expr("x-1", "14"))
line_3 = Line(StartPoint=surface_closest_point.Point, EndPoint=surface_closest_point_2.Point)
interpolate_3 = Interpolate(Vertices=surface_closest_point.Point, Degree=3, Periodic=False, KnotStyle=1)  # -> Curve, Length, Domain
interpolate_4 = Interpolate(Vertices=surface_closest_point_2.Point, Degree=3, Periodic=False, KnotStyle=1)  # -> Curve, Length, Domain
curve_closest_point_3 = CurveClosestPoint(Point=divide_curve_2.Points, Curve=interpolate_4.Curve)  # -> Point, Parameter, Distance
unit_z = UnitZ(Factor=1)
perp_frame_3 = PerpFrame(Curve=interpolate_4.Curve, Parameter=curve_closest_point_3.Parameter)
align_plane = AlignPlane(Plane=perp_frame_3, Direction=unit_z)  # -> Plane, Angle
deconstruct_plane = DeconstructPlane(Plane=align_plane.Plane)  # -> Origin, XAxis, YAxis, ZAxis
unit_z_2 = UnitZ(Factor=1)
line_sdl = LineSDL(Start=deconstruct_plane.Origin, Direction=unit_z_2, Length="1500")
line_sdl_2 = LineSDL(Start=deconstruct_plane.Origin, Direction=deconstruct_plane.YAxis, Length="1500")
line_sdl_3 = LineSDL(Start=deconstruct_plane.Origin, Direction=deconstruct_plane.XAxis, Length="1500")
rotate_3d = Rotate3D(Geometry=align_plane.Plane, Angle=degrees(90), Center=deconstruct_plane.Origin, Axis=line_sdl_3)  # -> Geometry, Transform
angle = Angle(VectorA=line_sdl, VectorB=line_sdl_3, Plane=rotate_3d.Geometry)  # -> Angle, Reflex
degrees = Degrees(Radians=angle.Reflex)
rotate = Rotate(Geometry=align_plane.Plane, Angle=degrees(degrees), Plane=rotate_3d.Geometry)  # -> Geometry, Transform
plane = Plane(rotate.Geometry)

construct_point = ConstructPoint(XCoordinate=0, YCoordinate=0, ZCoordinate=0)
xy_plane = XYPlane(Origin=construct_point)

curve_plane = CurvePlane(Curve=interpolate_3.Curve, Plane=plane)  # -> flatten(Points), ParamsC, ParamsP
list_item_21 = ListItem(List=plane, Index=0, Wrap=True)  # -> Item1, Item

curve_11 = Curve(curve_6)
plane_2 = Plane(list_item_21.Item)

curve_12 = Curve(curve_7)
plane_3 = Plane(list_item_21.Item1)

graph_mapper = GraphMapper(
    range,
    x0=0,
    x1=1,
    y0=0,
    y1=1,
    container_name="Bezier",
    cpx=[0, 0.878439188, 0.7914119363, 1],
    cpy=[0, 0, 0.5205467343, 0.8780995011])
orient_3 = Orient(Geometry=curve_12, Source=plane_3, Target=xy_plane)  # -> Geometry, Transform
orient_4 = Orient(Geometry=curve_11, Source=plane_2, Target=xy_plane)  # -> Geometry, Transform
tween_two_curves = TweenTwoCurves(CurveA=orient_4.Geometry, CurveB=orient_3.Geometry, Factor=graph_mapper, Refit=0, PointSample=0)
orient_5 = Orient(Geometry=tween_two_curves, Source=xy_plane, Target=plane)  # -> Geometry, Transform
end_points = EndPoints(Curve=orient_5.Geometry)  # -> Start, End
line_4 = Line(StartPoint=end_points.Start, EndPoint=end_points.End)
line_5 = Line(StartPoint=curve_plane.Points, EndPoint=plane)
length = Length(Curve=line_4)
length_2 = Length(Curve=line_5)
division = Division(A=length_2, B=length)
scale_nu = ScaleNU(Geometry=orient_5.Geometry, Plane=plane, ScaleX=division, ScaleY=1, ScaleZ=1)  # -> Geometry, Transform
curve_13 = Curve(flatten(list_item_10))
cull_index = CullIndex(List=scale_nu.Geometry, Indices=[0, -1], Wrap=True)
reverse_list_2 = ReverseList(List=curve_8)
merge_6 = Merge(Data1=flatten(curve_13), Data2=flatten(cull_index), Data3=flatten(reverse_list_2))
curve_14 = Curve(merge_6)
explode_7 = Explode(Curve=curve_14, Recursive=True)  # -> Segments, Vertices
curve_15 = Curve(explode_7.Segments)
list_item_22 = ListItem(List=curve_15, Index="0", Wrap=True)
cull_index_2 = CullIndex(List=curve_15, Indices=["0", "-1"], Wrap=True)
list_item_23 = ListItem(List=curve_15, Index="-1", Wrap=True)
length_3 = Length(Curve=list_item_22)
length_4 = Length(Curve=list_item_23)
length_5 = Length(Curve=cull_index_2)
multiplication = Multiplication(A=length_3, B=reduce_straight_length_2)
multiplication_2 = Multiplication(A=length_4, B=reduce_straight_length_2)
multiplication_3 = Multiplication(A=length_5, B=reduce_straight_length_2)
negative = Negative(Value=multiplication)
negative_2 = Negative(Value=multiplication_2)
negative_3 = Negative(Value=multiplication_3)
extend_curve = ExtendCurve(Curve=list_item_22, Type=0, Start="0", End=negative)  # -> simplify(Curve)
extend_curve_2 = ExtendCurve(Curve=list_item_23, Type=0, Start=negative_2, End="0")  # -> simplify(Curve)
extend_curve_3 = ExtendCurve(Curve=cull_index_2, Type=0, Start=negative_3, End=negative_3)  # -> simplify(Curve)
merge_7 = Merge(Data1=extend_curve, Data2=extend_curve_3, Data3=extend_curve_2)
shift_list = ShiftList(List=merge_7, Shift=1, Wrap=False)
shortest_list = ShortestList(ListListA=merge_7, ListListB=shift_list, TrimMode=2)  # -> ListListA, ListListB
number_5 = Number(cross_section_fillet_1_2)
number_6 = Number(cross_section_fillet_2_2)
integer_3 = Integer(cross_section_curvature_2)
blend_curve_3 = BlendCurve(CurveA=shortest_list.ListListA, CurveB=shortest_list.ListListB, BulgeA=number_5, BulgeB=number_6, Continuity=integer_3)  # -> simplify(Blend)
weave = Weave(Pattern=[0, 1], Stream0=merge_7, Stream1=blend_curve_3, NullGaps=False)
curve_16 = Curve(merge_7)
curve_17 = Curve(blend_curve_3)
flip_matrix = FlipMatrix(Data=curve_16)
flip_matrix_2 = FlipMatrix(Data=curve_17)  # -> simplify(Data)
end_points_2 = EndPoints(Curve=flip_matrix)  # -> Start, End
end_points_3 = EndPoints(Curve=flip_matrix_2)  # -> Start, End
interpolate_5 = Interpolate(Vertices=end_points_2.Start, Degree=3, Periodic=False, KnotStyle=1)  # -> Curve, Length, Domain
interpolate_6 = Interpolate(Vertices=end_points_2.End, Degree=3, Periodic=False, KnotStyle=1)  # -> Curve, Length, Domain
interpolate_7 = Interpolate(Vertices=end_points_3.Start, Degree=3, Periodic=False, KnotStyle=1)  # -> Curve, Length, Domain
interpolate_8 = Interpolate(Vertices=end_points_3.End, Degree=3, Periodic=False, KnotStyle=1)  # -> Curve, Length, Domain
sweep2 = Sweep2(Rail1=interpolate_5.Curve, Rail2=interpolate_6.Curve, Sections=flip_matrix, SameHeight=False)
sweep2_2 = Sweep2(Rail1=interpolate_7.Curve, Rail2=interpolate_8.Curve, Sections=flip_matrix_2, SameHeight=False)
merge_8 = Merge(Data1=interpolate_5.Curve, Data2=interpolate_6.Curve, Data3=weave)
merge_9 = Merge(Data1=end_points_2.Start, Data2=end_points_2.End)
pts = Point(merge_9)
crvs = Curve(merge_8)
straight_srf = Surface(sweep2)
fillet_srf = Surface(sweep2_2)
fillet_srf_2 = ClusterOutput(fillet_srf)
pts_2 = ClusterOutput(pts)
straight_srf_2 = ClusterOutput(straight_srf)
crvs_2 = ClusterOutput(crvs)

# ==== cluster Cluster_3
cutting_planes = ClusterInput()
straight_srf = ClusterInput()
fillet_srf = ClusterInput()
symmetric_domain = SymmetricDomain(Length="160", Base=0)

cutting_planes_2 = Brep(cutting_planes)
straight_srf_2 = Surface(straight_srf)
fillet_srf_2 = Surface(fillet_srf)
merge = Merge(Data1=straight_srf_2, Data2=fillet_srf_2)  # -> flatten(Result)
brep_join = BrepJoin(Breps=merge)  # -> Breps, Closed
merge_faces = MergeFaces(Brep=brep_join.Breps)  # -> graft(Breps), Before, After
brep_brep = BrepBrep(BrepA=cutting_planes_2, BrepB=merge_faces.Breps)  # -> simplify(Curves), Points
trim_tree = TrimTree(Tree=brep_brep.Curves, Depth=1)
flip_matrix = FlipMatrix(Data=trim_tree)
join_curves_with_tolerance = JoinCurvesWithTolerance(Curves=flip_matrix, Tolerance=Slider(3, range=0..100), Option=0)  # -> simplify(Curve)

discontinuity = Discontinuity(Curve=cutting_planes_2, Level=1)  # -> Points, Parameters
list_item = ListItem(List=discontinuity.Points, Index=0, Wrap=True)  # -> Item, Item1
line = Line(StartPoint=list_item.Item1, EndPoint=list_item.Item)
list_length = ListLength(List=flatten(merge_faces.Breps))
larger_than = LargerThan(FirstNumber=list_length, SecondNumber="1")  # -> LargerThan, OrEqualTo
create_set = CreateSet(List=flatten(larger_than.LargerThan))  # -> Set, Map
panel = Panel(create_set.Set)
stream_filter = StreamFilter(Gate=create_set.Set, Stream0=brep_brep.Curves, Stream1=join_curves_with_tolerance)
curve = Curve(stream_filter)
end_points = EndPoints(Curve=curve)  # -> Start, End
interpolate = Interpolate(Vertices=flatten(end_points.Start), Degree=3, Periodic=False, KnotStyle=1)  # -> Curve, Length, Domain
interpolate_2 = Interpolate(Vertices=flatten(end_points.End), Degree=3, Periodic=False, KnotStyle=1)  # -> Curve, Length, Domain
brep_curve = BrepCurve(Brep=cutting_planes_2, Curve=interpolate.Curve)  # -> Curves, Points
brep_curve_2 = BrepCurve(Brep=cutting_planes_2, Curve=interpolate_2.Curve)  # -> Curves, Points
tween_two_points = TweenTwoPoints(PointA=brep_curve.Points, PointB=brep_curve_2.Points, Factor=0.5)  # -> simplify(Tween)
line_2 = Line(StartPoint=tween_two_points, EndPoint=brep_curve.Points)
construct_plane = ConstructPlane(Origin=tween_two_points, XAxis=line, YAxis=line_2)
plane = Plane(construct_plane)
rectangle = Rectangle(Plane=plane, XSize="80", YSize=symmetric_domain, Radius=0)  # -> Rectangle, Length
surface = Surface(rectangle.Rectangle)
plane_2 = Plane(plane)

intersection_crv = Curve(stream_filter)
cleat = Surface(surface)

rebuild_curve = RebuildCurve(Curve=intersection_crv, Degree=3, Count=11, Tangents=False)
loft = Loft(
    Curves=flatten(rebuild_curve),
    Options={Adjust=False, Closed=False, LoftEnds=0, LoftSimp=0, LoftType=0, Rebuild=10, Refit=0.01})
offset_surface = OffsetSurface(Surface=loft, Distance="85", Retrim=True)
quad_panels = QuadPanels(Surface=loft, UDivisions="49", VDivisions="3")
partition_list = PartitionList(List=quad_panels, Size="3")
flip_matrix_2 = FlipMatrix(Data=partition_list)
explode_tree = ExplodeTree(Data=flip_matrix_2)  # -> Branch0, Branch1, Branch2
brep_edges = BrepEdges(Brep=explode_tree.Branch0)  # -> simplify(Naked), Interior, NonManifold
brep_edges_2 = BrepEdges(Brep=explode_tree.Branch2)  # -> simplify(Naked), Interior, NonManifold
list_item_2 = ListItem(List=brep_edges.Naked, Index=0, Wrap=True)
list_item_3 = ListItem(List=brep_edges_2.Naked, Index=0, Wrap=True)
list_item_4 = ListItem(List=brep_edges.Naked, Index=2, Wrap=True)
list_item_5 = ListItem(List=brep_edges_2.Naked, Index=2, Wrap=True)
join_curves = JoinCurves(Curves=flatten(list_item_2), Preserve=False)
join_curves_2 = JoinCurves(Curves=flatten(list_item_4), Preserve=False)
join_curves_3 = JoinCurves(Curves=flatten(list_item_3), Preserve=False)
join_curves_4 = JoinCurves(Curves=flatten(list_item_5), Preserve=False)
explode = Explode(Curve=join_curves, Recursive=True)  # -> Segments, Vertices
explode_2 = Explode(Curve=join_curves_2, Recursive=True)  # -> Segments, Vertices
explode_3 = Explode(Curve=join_curves_3, Recursive=True)  # -> Segments, Vertices
explode_4 = Explode(Curve=join_curves_4, Recursive=True)  # -> Segments, Vertices
interpolate_3 = Interpolate(Vertices=explode.Vertices, Degree=3, Periodic=False, KnotStyle=1)  # -> Curve, Length, Domain
interpolate_4 = Interpolate(Vertices=explode_2.Vertices, Degree=3, Periodic=False, KnotStyle=1)  # -> Curve, Length, Domain
interpolate_5 = Interpolate(Vertices=explode_3.Vertices, Degree=3, Periodic=False, KnotStyle=1)  # -> Curve, Length, Domain
interpolate_6 = Interpolate(Vertices=explode_4.Vertices, Degree=3, Periodic=False, KnotStyle=1)  # -> Curve, Length, Domain
curve_plane = CurvePlane(Curve=interpolate_3.Curve, Plane=plane)  # -> simplify(Points), ParamsC, ParamsP
curve_plane_2 = CurvePlane(Curve=interpolate_4.Curve, Plane=plane)  # -> simplify(Points), ParamsC, ParamsP
curve_plane_3 = CurvePlane(Curve=interpolate_5.Curve, Plane=plane)  # -> simplify(Points), ParamsC, ParamsP
curve_plane_4 = CurvePlane(Curve=interpolate_6.Curve, Plane=plane)  # -> simplify(Points), ParamsC, ParamsP
merge_2 = Merge(Data1=curve_plane.Points, Data2=curve_plane_2.Points, Data3=curve_plane_3.Points, Data4=curve_plane_4.Points)
polyline = PolyLine(Vertices=merge_2, Closed=False)
extend_curve = ExtendCurve(Curve=polyline, Type=0, Start="-40", End="-40")
close_curve = CloseCurve(Curve=extend_curve, CloseType=0, Bulge=0.5, Tolerance=0)  # -> Closed, ResultBoolean
polygon_center = PolygonCenter(Polyline=close_curve.Closed)  # -> CenterV, CenterE, CenterA
plane_origin = PlaneOrigin(Base=plane_2, Origin=polygon_center.CenterV)
offset_curve = OffsetCurve(Curve=close_curve.Closed, Distance="10", Plane=plane_origin, Corners=1)  # -> simplify(Curve)
offset_curve_2 = OffsetCurve(Curve=offset_curve, Distance=expr("-x", "40"), Corners=1)  # -> simplify(Curve)
discontinuity_2 = Discontinuity(Curve=offset_curve_2, Level=1)  # -> Points, Parameters
flip_matrix_3 = FlipMatrix(Data=discontinuity_2.Points)
polyline_2 = PolyLine(Vertices=flip_matrix_3, Closed=False)
merge_3 = Merge(Data1=offset_curve, Data2=offset_curve_2)
explode_5 = Explode(Curve=polyline_2, Recursive=True)  # -> Segments, Vertices
mesh_loft = MeshLoft(Polylines=merge_3, Cap=False)
extend_curve_2 = ExtendCurve(Curve=explode_5.Segments, Type=0, Start="-5", End="-5")
mesh_pipe = MeshPipe(Polylines=extend_curve_2, NumberOfSides=Slider(4, range=0..10), Radius=Slider(20, range=0..100), Cap=False)
ms_pipe = Mesh(mesh_pipe)
bracket = Mesh(mesh_loft)
ms_pipe_2 = ClusterOutput(ms_pipe)
bracket_2 = ClusterOutput(bracket)
cleat_2 = ClusterOutput(cleat)
intersection_crv_2 = ClusterOutput(intersection_crv)
